# Dynamo graph 3.3. Set and Sheet Creation of call outs for RVT 2019.dyn (Dynamo 2.6.1.8786)
# packages: Rhythm 2021.7.3, Genius Loci 2021.7.30, Clockwork for Dynamo 1.x 1.31.1

categories = Categories("OST_Sheets")
all_elements_of_category = ElementsOfCategory(Category=categories)

# group: The Sheet Layout to follow
code_block = CodeBlock(a=all_elements_of_category) { a[65]; }
code_block_2 = CodeBlock(a=all_elements_of_category) { a[64]; }
code_block_3 = CodeBlock(a=all_elements_of_category) { a[63]; }

# group: Callout 11-14
ʳʰʸᵗʰᵐ_sheet = Rhythm.Revit.Elements.Sheet.GetViewportsAndViews(sheet=code_block)
code_block_4 = CodeBlock(a=ʳʰʸᵗʰᵐ_sheet.views) { a; }
python_script = Python(IN[0]=code_block_4)
# ---------- python_script.python (8 lines) ----------
# Load the Python Standard and DesignScript Libraries
import sys
import clr
clr.AddReference('ProtoGeometry')
from Autodesk.DesignScript.Geometry import *

# The inputs to this node will be stored as a list in the IN variables.
OUT=IN[0][1::]
# ----------------------------------------
ʳʰʸᵗʰᵐ_viewport_boxcenter = Rhythm.Revit.Elements.Viewport.BoxCenter(viewport=ʳʰʸᵗʰᵐ_sheet.viewports)

# group: Callout 6-10
ʳʰʸᵗʰᵐ_sheet_2 = Rhythm.Revit.Elements.Sheet.GetViewportsAndViews(sheet=code_block_2)
code_block_5 = CodeBlock(a=ʳʰʸᵗʰᵐ_sheet_2.views) { a; }
python_script_2 = Python(IN[0]=code_block_5)  # same code as python_script
ʳʰʸᵗʰᵐ_viewport_boxcenter_2 = Rhythm.Revit.Elements.Viewport.BoxCenter(viewport=ʳʰʸᵗʰᵐ_sheet_2.viewports)

# group: Callout 1-5
ʳʰʸᵗʰᵐ_sheet_3 = Rhythm.Revit.Elements.Sheet.GetViewportsAndViews(sheet=code_block_3)
code_block_6 = CodeBlock(a=ʳʰʸᵗʰᵐ_sheet_3.views) { a; }
python_script_3 = Python(IN[0]=code_block_6)  # same code as python_script
ʳʰʸᵗʰᵐ_viewport_boxcenter_3 = Rhythm.Revit.Elements.Viewport.BoxCenter(viewport=ʳʰʸᵗʰᵐ_sheet_3.viewports)

# group: Excel Input
# note: Put Excel Data here
file_path = Filename("..\..\..\..\..\..\Downloads\L55-L60 - list of views for new sheets (1).xlsx")
file_from_path = FileObject(path=file_path)
code_block_7 = CodeBlock { "Sheet2"; true; false; }
importExcel = Data.ImportExcel(file=file_from_path, sheetName=code_block_7.out0, readAsStrings=code_block_7.out1, showExcel=code_block_7.out2)
restOfItems = List.RestOfItems(list=importExcel)
transpose = List.Transpose(lists=restOfItems)

# group: Excel data
sheet_number = CodeBlock(a=transpose) { a[1]; }
sheet_name = CodeBlock(a=transpose) { a[2]; }
B6_Zone = CodeBlock(a=transpose) { a[0]; }

uniqueItems = List.UniqueItems(list=sheet_number)

# group: Sheet Name
uniqueItems_2 = List.UniqueItems(list=sheet_name)
python_script_4 = Python(IN[0]=uniqueItems, IN[1]=uniqueItems_2)
# ---------- python_script_4.python (16 lines) ----------
# Load the Python Standard and DesignScript Libraries
import sys
import clr
clr.AddReference('ProtoGeometry')
from Autodesk.DesignScript.Geometry import *

# The inputs to this node will be stored as a list in the IN variables.
num=IN[0]

name=IN[1]
final=[]
for i in name:
	x=[i]*3
	final.append(x)
	
OUT=final
# ----------------------------------------
flatten = List.Flatten(list=python_script_4)

# group: Title Block
family_types = FamilyTypes("3IM_ARC_CLG_buffle:3IM_ARC_CLG_CLG-40_2300x800mm")

# group: Unfreez at Second Run
create_sheet = Custom[Create Sheet](sheetName=flatten, sheetNumber=uniqueItems, titleBlock=family_types)  # frozen; package Genius Loci; Creates new sheets.

code_block_8 = CodeBlock { "B6_Purpose"; "02- SHEET VIEWS"; }
setParameterByName = Element.SetParameterByName(element=create_sheet.Sheets, parameterName=code_block_8.out0, value=code_block_8.out1)
python_script_5 = Python(IN[0]=setParameterByName)
# ---------- python_script_5.python (15 lines) ----------
# Load the Python Standard and DesignScript Libraries
import sys
import clr
clr.AddReference('ProtoGeometry')
from Autodesk.DesignScript.Geometry import *

# The inputs to this node will be stored as a list in the IN variables.
sheets=IN[0]
l=len(sheets)
final=[]
for i in range(0,l-1,3):
	x=sheets[i:i+3]
	final.append(x)
	
OUT=final
# ----------------------------------------
code_block_9 = CodeBlock { "B6_Zone"; }
uniqueItems_3 = List.UniqueItems(list=B6_Zone)
python_script_6 = Python(IN[0]=uniqueItems, IN[1]=uniqueItems_3)  # same code as python_script_4
flatten_2 = List.Flatten(list=python_script_6)
setParameterByName_2 = Element.SetParameterByName(element=setParameterByName, parameterName=code_block_9, value=flatten_2)
python_script_7 = Python(IN[0]=setParameterByName_2)  # same code as python_script_5
passthrough = Custom[Passthrough](passThrough=python_script_5, waitFor=python_script_7)  # package Clockwork for Dynamo 1.x; Forces a sequential order of execution. The node wired into the output of the Passthrough node will be executed *after* the node wired into the waitFor input (e.g. important for some Revit operations). The value of the passThrough input will be passed on to the node wired into the output port of the Passthrough node.

# group: Filtering Views as per excel Names
view_on_sheets = CodeBlock(a=transpose) { a[3]; }
categories_2 = Categories("OST_Views")
all_elements_of_category_2 = ElementsOfCategory(Category=categories_2)
name = Element.Name(element=all_elements_of_category_2)
python_script_8 = Python(IN[0]=view_on_sheets, IN[1]=all_elements_of_category_2, IN[2]=name)
# ---------- python_script_8.python (18 lines) ----------
# Load the Python Standard and DesignScript Libraries
import sys
import clr
clr.AddReference('ProtoGeometry')
from Autodesk.DesignScript.Geometry import *

# The inputs to this node will be stored as a list in the IN variables.
viewex=IN[0]
elements=IN[1]
names=IN[2]
final=[]
for i in viewex:
	if i in names:
		ind=names.index(i)
		elem=elements[ind]
		final.append(elem)
		
OUT=final
# ----------------------------------------

python_script_9 = Python(IN[0]=python_script_8)
# ---------- python_script_9.python (15 lines) ----------
# Load the Python Standard and DesignScript Libraries
import sys
import clr
clr.AddReference('ProtoGeometry')
from Autodesk.DesignScript.Geometry import *

# The inputs to this node will be stored as a list in the IN variables.
sheets=IN[0]
l=len(sheets)
final=[]
for i in range(0,l-1,14):
	x=sheets[i:i+14]
	final.append(x)
	
OUT=final
# ----------------------------------------

# group: Viewport Location
python_script_10 = Python(IN[0]=ʳʰʸᵗʰᵐ_viewport_boxcenter_3)  # same code as python_script
python_script_11 = Python(IN[0]=ʳʰʸᵗʰᵐ_viewport_boxcenter_2)  # same code as python_script
python_script_12 = Python(IN[0]=ʳʰʸᵗʰᵐ_viewport_boxcenter)  # same code as python_script

list_create = List.Create(item0=python_script_10, item1=python_script_11, item2=python_script_12)

# group: Creating viewport
viewport = Python(IN[0]=passthrough, IN[1]=python_script_9, IN[2]=list_create)
# ---------- viewport.python (89 lines) ----------
import clr
clr.AddReference('ProtoGeometry')
from Autodesk.DesignScript.Geometry import *
# Import ToDSType(bool) extension method



###################################################
clr.AddReference("RevitNodes")
import Revit
clr.ImportExtensions(Revit.Elements)
# Import geometry conversion extension methods
clr.ImportExtensions(Revit.GeometryConversion)
# Import DocumentManager and TransactionManager
clr.AddReference("RevitServices")
import RevitServices
from RevitServices.Persistence import DocumentManager
from RevitServices.Transactions import TransactionManager
from System.Collections.Generic import *
# Import RevitAPI
clr.AddReference("RevitAPI")
import Autodesk
from Autodesk.Revit.DB import *

doc = DocumentManager.Instance.CurrentDBDocument
uiapp = DocumentManager.Instance.CurrentUIApplication
app = uiapp.Application
uidoc=DocumentManager.Instance.CurrentUIApplication.ActiveUIDocument


#######################################################

points=IN[2]
sheets = []
for i in IN[0]:
	sub=[]
	for j in i:
		sub.append(UnwrapElement(i))
	sheets.append(UnwrapElement(i))	
views=[]	
for i in IN[1]:
	views.append(UnwrapElement(i))
	
	

TransactionManager.Instance.EnsureInTransaction(doc)

final = []
for ind, sht in enumerate(sheets):
	view_ind=views[ind]
	
	v1=view_ind[0]
	v2=view_ind[1]
	v3=view_ind[2]
	v4=view_ind[3]
	v5=view_ind[4]
	v6=view_ind[5]
	v7=view_ind[6]
	v8=view_ind[7]
	v9=view_ind[8]
	v10=view_ind[9]
	v11=view_ind[10]
	v12=view_ind[11]
	v13=view_ind[12]
	v14=view_ind[13]
	v_1=[v1,v2,v3,v4,v5]
	v_2=[v6, v7, v8, v9, v10]
	v_3=[v11,v12,v13,v14]
	
	view=[v_1,v_2,v_3]
	
	
	sub_s=[]
	for ind1, j in enumerate(sht):
		pts=points[ind1]
		view_st=view[ind1]
		sub=[]
		for ind2 in range(len(pts)):
			v=view_st[ind2]
			p=pts[ind2]
			viewport = Viewport.Create(doc, j.Id, v.Id, p.ToXyz())
			sub.append(viewport)
		sub_s.append(sub)
	final.append(sub_s)	

TransactionManager.Instance.TransactionTaskDone()

# Assign your output to the OUT variable.
OUT = final
# ----------------------------------------
