# Dynamo graph V1- Creating Sheets and Views as per excel and placing as per base layout.dyn (Dynamo 2.6.1.8786)
# packages: Rhythm 2021.7.3, Genius Loci 2021.7.30, Clockwork for Dynamo 1.x 1.31.1

# group: Sheet data from excel
file_path = Filename(".\SheetNames - 1.xlsx")
file_from_path = FileObject(path=file_path)
code_block = CodeBlock { "Foglio1"; true; false; }
importExcel = Data.ImportExcel(file=file_from_path, sheetName=code_block.out0, readAsStrings=code_block.out1, showExcel=code_block.out2)
restOfItems = List.RestOfItems(list=importExcel)
transpose = List.Transpose(lists=restOfItems)

# group: Sheet Name
code_block_2 = CodeBlock(a=transpose) { a[0]; }

# group: Sheet Number
code_block_3 = CodeBlock(a=transpose) { a[1]; }

# group: Title block
titleblock_types = TagTypes("3IM_STARTING VIEW:3IM_STARTING VIEW")

# group: Sheets
create_sheet = Custom[Create Sheet](sheetName=code_block_2, sheetNumber=code_block_3, titleBlock=titleblock_types)  # package Genius Loci; Creates new sheets.

# group: Sheet as per exce format
passthrough = Custom[Passthrough](passThrough=code_block_2, waitFor=create_sheet.Sheets)  # package Clockwork for Dynamo 1.x; Forces a sequential order of execution. The node wired into the output of the Passthrough node will be executed *after* the node wired into the waitFor input (e.g. important for some Revit operations). The value of the passThrough input will be passed on to the node wired into the output port of the Passthrough node.
sheet_byname = Custom[Sheet ByName](NameOrNumber=passthrough)  # package Genius Loci; Collects sheets by name or number in the active or given document.

# group: View by name
code_block_4 = CodeBlock(a=transpose) { a[2]; }
view_byname = Custom[View ByName](ViewName=code_block_4)  # package Genius Loci; Collect views by given name in the active or given document. Based on a Christian Gartland's script.

# group: The Sheet Layout to follow
categories = Categories("OST_Sheets")
all_elements_of_category = ElementsOfCategory(Category=categories)
code_block_5 = CodeBlock(a=all_elements_of_category) { a[0]; }

# group: Location
ʳʰʸᵗʰᵐ_sheet = Rhythm.Revit.Elements.Sheet.GetViewportsAndViews(sheet=code_block_5)
ʳʰʸᵗʰᵐ_viewport_boxcenter = Rhythm.Revit.Elements.Viewport.BoxCenter(viewport=ʳʰʸᵗʰᵐ_sheet.viewports)

# group: Viewport Location
python_script = Python(IN[0]=ʳʰʸᵗʰᵐ_viewport_boxcenter)
# ---------- python_script.python (8 lines) ----------
# Load the Python Standard and DesignScript Libraries
import sys
import clr
clr.AddReference('ProtoGeometry')
from Autodesk.DesignScript.Geometry import *

# The inputs to this node will be stored as a list in the IN variables.
OUT=IN[0][1::]
# ----------------------------------------

list_create = List.Create(item0=python_script)

# group: Creating viewport
viewport = Python(IN[0]=sheet_byname, IN[1]=view_byname, IN[2]=list_create)
# ---------- viewport.python (56 lines) ----------
import clr
clr.AddReference('ProtoGeometry')
from Autodesk.DesignScript.Geometry import *
# Import ToDSType(bool) extension method



###################################################
clr.AddReference("RevitNodes")
import Revit
clr.ImportExtensions(Revit.Elements)
# Import geometry conversion extension methods
clr.ImportExtensions(Revit.GeometryConversion)
# Import DocumentManager and TransactionManager
clr.AddReference("RevitServices")
import RevitServices
from RevitServices.Persistence import DocumentManager
from RevitServices.Transactions import TransactionManager
from System.Collections.Generic import *
# Import RevitAPI
clr.AddReference("RevitAPI")
import Autodesk
from Autodesk.Revit.DB import *

doc = DocumentManager.Instance.CurrentDBDocument
uiapp = DocumentManager.Instance.CurrentUIApplication
app = uiapp.Application
uidoc=DocumentManager.Instance.CurrentUIApplication.ActiveUIDocument


#######################################################

points=IN[2]
sheets = []
for i in IN[0]:
	sheets.append(UnwrapElement(i))	
views=[]	
for i in IN[1]:
	views.append(UnwrapElement(i))
	
	

TransactionManager.Instance.EnsureInTransaction(doc)

final = []
for ind, sht in enumerate(sheets):
	view_st=views[ind]	
	pts=points[0]
	sub=[]
	viewport = Viewport.Create(doc, sht.Id, view_st.Id, pts.ToXyz())
	final.append(viewport)	

TransactionManager.Instance.TransactionTaskDone()

# Assign your output to the OUT variable.
OUT = final
# ----------------------------------------

# group: Sheet Parameter
code_block_6 = CodeBlock { "B6_Purpose"; "02- SHEET VIEWS"; }
setParameterByName = Element.SetParameterByName(element=create_sheet.Sheets, parameterName=code_block_6.out0, value=code_block_6.out1)  # frozen
code_block_7 = CodeBlock { "B6_Zone"; }
setParameterByName_2 = Element.SetParameterByName(element=setParameterByName, parameterName=code_block_7)  # unwired: value

# group: Test
categories_2 = Categories("OST_Views")
all_elements_of_category_2 = ElementsOfCategory(Category=categories_2)
code_block_8 = CodeBlock(a=all_elements_of_category_2) { a[0..8]; }

# group: Test
byCoordinates = Point.ByCoordinates()
list_create_2 = List.Create(item0=byCoordinates)
