# Dynamo graph Selecting copy monitor.dyn (Dynamo 2.6.1.8786)

file_path = Filename("C:\Users\139\Desktop\ZNM-VOL-MSW-ZZ-M3-BW-00002_Error Report.html.xlsx")
file_from_path = FileObject(path=file_path)
code_block = CodeBlock { "S"; }
code_block_2 = CodeBlock { true; false; }
importExcel = Data.ImportExcel(file=file_from_path, sheetName=code_block, readAsStrings=code_block_2.out0, showExcel=code_block_2.out1)
restOfItems = List.RestOfItems(list=importExcel)
transpose = List.Transpose(lists=restOfItems)
code_block_3 = CodeBlock(a=transpose) { a[1]; }
python_script = Python(IN[0]=code_block_3)
# ---------- python_script.python (16 lines) ----------
# Load the Python Standard and DesignScript Libraries
import sys
import clr
clr.AddReference('ProtoGeometry')
from Autodesk.DesignScript.Geometry import *

# The inputs to this node will be stored as a list in the IN variables.
dataEnteringNode = IN

# Place your code below this line
inp=IN[0][3::]
# Assign your output to the OUT variable.
x = [i.split(": ")[-1] for i in inp]

y= [int(i.split(" ")[-1]) for i in x]
OUT=y
# ----------------------------------------
