# Dynamo graph Final - Room Information with Linked File data Generalisation 2.dyn "Room Information with Linked File data Generalisation 2" (Dynamo 2.6.1.8786)
# packages: Rhythm 2021.4.2, Clockwork for Dynamo 2.x 2.3.0, archi-lab.net 2021.25.2621, LunchBox for Dynamo 2016.11.11, Orchid 206.3.0.7800, spring nodes 110.0.2, bimorphNodes 3.0.3

# group: Getting Room Parameter and Associating with "Type Mark" Parameter of all elements
categories = Categories("OST_Rooms")
all_elements_of_category = ElementsOfCategory(Category=categories)
boundaries = Custom[Room.Boundaries](room=all_elements_of_category)  # package archi-lab.net; This node returns all Room bounding curves and elements that generated them (walls, separation lines etc).
code_block = CodeBlock { "Mark"; }
code_block_2 = CodeBlock { "Comments"; }
code_block_3 = CodeBlock { "Type Mark"; }
ʳʰʸᵗʰᵐ_elements = Rhythm.Revit.Elements.Elements.GetParameterValueByNameTypeOrInstance(element=boundaries.element@L2, parameterName=code_block_3)

flatten = List.Flatten(list=boundaries.element)
python_script = Python(IN[0]=boundaries.element)
# ---------- python_script.python (13 lines) ----------
# Load the Python Standard and DesignScript Libraries
import sys
import clr
clr.AddReference('ProtoGeometry')
from Autodesk.DesignScript.Geometry import *
names=[]
for j in IN[0]:
	sub=[]
	for ind, i in enumerate(j):
		sub.append('Code'+str(ind+1))		
	
	names.append(sub)
OUT = names
# ----------------------------------------
flatten_2 = List.Flatten(list=python_script)
python_script_2 = Python(IN[0]=flatten, IN[1]=flatten_2)  # unwired: IN[2]
# ---------- python_script_2.python (30 lines) ----------
import clr

#Import the Revit API
clr.AddReference('RevitAPI')
import Autodesk
from Autodesk.Revit.DB import *

#Import DocumentManager and TransactionManager
clr.AddReference('RevitServices')
import RevitServices
from RevitServices.Persistence import DocumentManager
from RevitServices.Transactions import TransactionManager

#Reference the active Document and application
doc = DocumentManager.Instance.CurrentDBDocument

elements=[UnwrapElement(i) for i in IN[0]]

TransactionManager.Instance.EnsureInTransaction(doc)
params=[]
elems=[]
for ind, i in enumerate(elements):
	if i!=None and i!=[]:
		elem_param = i.get_Parameter(BuiltInParameter.ALL_MODEL_INSTANCE_COMMENTS)		
		elem_param.Set(IN[1][ind])
		params.append(elem_param.AsString())
		elems.append(i)
TransactionManager.Instance.TransactionTaskDone()

OUT=elems
# ----------------------------------------
code_block_4 = CodeBlock { "Comments"; }
ʳʰʸᵗʰᵐ_elements_2 = Rhythm.Revit.Elements.Elements.GetParameterValueByNameTypeOrInstance(element=python_script_2, parameterName=code_block_4)

# group (continued): Getting Room Parameter and Associating with "Type Mark" Parameter of all elements
setParameterByName = Element.SetParameterByName(element=boundaries.element, parameterName=code_block, value=ʳʰʸᵗʰᵐ_elements_2)
getParameterValueByName = Element.GetParameterValueByName(element=setParameterByName, parameterName=code_block)
getParameterValueByName_2 = Element.GetParameterValueByName(element=setParameterByName, parameterName=code_block_2)
list_create = List.Create(item0=getParameterValueByName, item1=getParameterValueByName_2)

# group: Getting Wall data from Wall Sweeps
categories_2 = Categories("OST_Cornices")
all_elements_of_category_2 = ElementsOfCategory(Category=categories_2)
python_script_3 = Python(IN[0]=all_elements_of_category_2)
# ---------- python_script_3.python (53 lines) ----------
import clr #This is .NET's Common Language Runtime. It's an execution environment
#that is able to execute code from several different languages.
import sys #sys is a fundamental Python library - here, we're using it to load in
#the standard IronPython libraries
sys.path.append('C:\Program Files (x86)\IronPython 2.7\Lib') #Imports the
#standard IronPython libraries, which cover everything from servers and
#encryption through to regular expressions.
import System #The System namespace at the root of .NET
from System import Array #.NET class for handling array information
from System.Collections.Generic import * #Lets you handle generics. Revit's API
#sometimes wants hard-typed 'generic' lists, called ILists. If you don't need
#these you can delete this line.
clr.AddReference('ProtoGeometry')  #A Dynamo library for its proxy geometry
#classes. You'll only need this if you're interacting with geometry.
from Autodesk.DesignScript.Geometry import * #Loads everything in Dynamo's
#geometry library
clr.AddReference("RevitNodes") #Dynamo's nodes for Revit
import Revit #Loads in the Revit namespace in RevitNodes
clr.ImportExtensions(Revit.Elements) #More loading of Dynamo's Revit libraries
clr.ImportExtensions(Revit.GeometryConversion) #More loading of Dynamo's
#Revit libraries. You'll only need this if you're interacting with geometry.
clr.AddReference("RevitServices") #Dynamo's classes for handling Revit documents
import RevitServices 
from RevitServices.Persistence import DocumentManager #An internal Dynamo class
#that keeps track of the document that Dynamo is currently attached to
from RevitServices.Transactions import TransactionManager #A Dynamo class for
#opening and closing transactions to change the Revit document's database

clr.AddReference("RevitAPI") #Adding reference to Revit's API DLLs
clr.AddReference("RevitAPIUI") #Adding reference to Revit's API DLLs

import Autodesk #Loads the Autodesk namespace
from Autodesk.Revit.DB import * #Loading Revit's API classes
from Autodesk.Revit.UI import * #Loading Revit's API UI classes  

doc = DocumentManager.Instance.CurrentDBDocument #Finally, setting up handles to the active Revit document
uiapp = DocumentManager.Instance.CurrentUIApplication #Setting a handle to the active Revit UI document
app = uiapp.Application  #Setting a handle to the currently-open instance of the Revit application
uidoc = uiapp.ActiveUIDocument #Setting a handle to the currently-open instance of the Revit UI application


wall_sweep=[UnwrapElement(i) for i in IN[0]]

TransactionManager.Instance.EnsureInTransaction(doc)

hostId=[]
for i in wall_sweep:
	id_host=i.GetHostIds()
	hostId.append(id_host)
	
TransactionManager.Instance.TransactionTaskDone()

OUT=hostId
# ----------------------------------------
element_by_id = ElementById(Id=python_script_3)
code_block_5 = CodeBlock { "Wall_Sweep"; }
code_block_6 = CodeBlock { "Type Mark"; }
ʳʰʸᵗʰᵐ_elements_3 = Rhythm.Revit.Elements.Elements.GetParameterValueByNameTypeOrInstance(element=all_elements_of_category_2, parameterName=code_block_6)
python_script_4 = Python(IN[0]=element_by_id, IN[1]=code_block_5, IN[2]=ʳʰʸᵗʰᵐ_elements_3)
# ---------- python_script_4.python (62 lines) ----------
import clr #This is .NET's Common Language Runtime. It's an execution environment
#that is able to execute code from several different languages.
import sys #sys is a fundamental Python library - here, we're using it to load in
#the standard IronPython libraries
sys.path.append('C:\Program Files (x86)\IronPython 2.7\Lib') #Imports the
#standard IronPython libraries, which cover everything from servers and
#encryption through to regular expressions.
import System #The System namespace at the root of .NET
from System import Array #.NET class for handling array information
from System.Collections.Generic import * #Lets you handle generics. Revit's API
#sometimes wants hard-typed 'generic' lists, called ILists. If you don't need
#these you can delete this line.
clr.AddReference('ProtoGeometry')  #A Dynamo library for its proxy geometry
#classes. You'll only need this if you're interacting with geometry.
from Autodesk.DesignScript.Geometry import * #Loads everything in Dynamo's
#geometry library
clr.AddReference("RevitNodes") #Dynamo's nodes for Revit
import Revit #Loads in the Revit namespace in RevitNodes
clr.ImportExtensions(Revit.Elements) #More loading of Dynamo's Revit libraries
clr.ImportExtensions(Revit.GeometryConversion) #More loading of Dynamo's
#Revit libraries. You'll only need this if you're interacting with geometry.
clr.AddReference("RevitServices") #Dynamo's classes for handling Revit documents
import RevitServices 
from RevitServices.Persistence import DocumentManager #An internal Dynamo class
#that keeps track of the document that Dynamo is currently attached to
from RevitServices.Transactions import TransactionManager #A Dynamo class for
#opening and closing transactions to change the Revit document's database

clr.AddReference("RevitAPI") #Adding reference to Revit's API DLLs
clr.AddReference("RevitAPIUI") #Adding reference to Revit's API DLLs

import Autodesk #Loads the Autodesk namespace
from Autodesk.Revit.DB import * #Loading Revit's API classes
from Autodesk.Revit.UI import * #Loading Revit's API UI classes  

doc = DocumentManager.Instance.CurrentDBDocument #Finally, setting up handles to the active Revit document
uiapp = DocumentManager.Instance.CurrentUIApplication #Setting a handle to the active Revit UI document
app = uiapp.Application  #Setting a handle to the currently-open instance of the Revit application
uidoc = uiapp.ActiveUIDocument #Setting a handle to the currently-open instance of the Revit UI application

elements1=IN[0]
elements=[]
for e in elements1:
	sub=[]
	for i in e:
		sub.append(UnwrapElement(i))
	elements.append(sub)

parameter_name=IN[1]
parameter_value=IN[2]

TransactionManager.Instance.EnsureInTransaction(doc)

for index, items in enumerate(elements):
	para=parameter_value[index]
	for i in items:
		param=i.get_Parameter(BuiltInParameter.ALL_MODEL_INSTANCE_COMMENTS)
		param.Set(para)
		
TransactionManager.Instance.TransactionTaskDone()

OUT= 0
# ----------------------------------------

# group: Execution Queue
passthrough = Custom[Passthrough](passThrough=getParameterValueByName, waitFor=python_script_4)  # package Clockwork for Dynamo 2.x; Forces a sequential order of execution. The node wired into the output of the Passthrough node will be executed *after* the node wired into the waitFor input (e.g. important for some Revit operations). The value of the passThrough input will be passed on to the node wired into the output port of the Passthrough node.

# group: Sorting Elements from all existing elements
python_script_5 = Python(IN[0]=passthrough, IN[1]=list_create)
# ---------- python_script_5.python (121 lines) ----------
import clr #This is .NET's Common Language Runtime. It's an execution environment
#that is able to execute code from several different languages.
import sys #sys is a fundamental Python library - here, we're using it to load in
#the standard IronPython libraries
sys.path.append('C:\Program Files (x86)\IronPython 2.7\Lib') #Imports the
#standard IronPython libraries, which cover everything from servers and
#encryption through to regular expressions.
import System #The System namespace at the root of .NET
from System import Array #.NET class for handling array information
from System.Collections.Generic import * #Lets you handle generics. Revit's API
#sometimes wants hard-typed 'generic' lists, called ILists. If you don't need
#these you can delete this line.
clr.AddReference('ProtoGeometry')  #A Dynamo library for its proxy geometry
#classes. You'll only need this if you're interacting with geometry.
from Autodesk.DesignScript.Geometry import * #Loads everything in Dynamo's
#geometry library
clr.AddReference("RevitNodes") #Dynamo's nodes for Revit
import Revit #Loads in the Revit namespace in RevitNodes
clr.ImportExtensions(Revit.Elements) #More loading of Dynamo's Revit libraries
clr.ImportExtensions(Revit.GeometryConversion) #More loading of Dynamo's
#Revit libraries. You'll only need this if you're interacting with geometry.
clr.AddReference("RevitServices") #Dynamo's classes for handling Revit documents
import RevitServices 
from RevitServices.Persistence import DocumentManager #An internal Dynamo class
#that keeps track of the document that Dynamo is currently attached to
from RevitServices.Transactions import TransactionManager #A Dynamo class for
#opening and closing transactions to change the Revit document's database

clr.AddReference("RevitAPI") #Adding reference to Revit's API DLLs
clr.AddReference("RevitAPIUI") #Adding reference to Revit's API DLLs

import Autodesk #Loads the Autodesk namespace
from Autodesk.Revit.DB import * #Loading Revit's API classes
from Autodesk.Revit.UI import * #Loading Revit's API UI classes  

doc = DocumentManager.Instance.CurrentDBDocument #Finally, setting up handles to the active Revit document
uiapp = DocumentManager.Instance.CurrentUIApplication #Setting a handle to the active Revit UI document
app = uiapp.Application  #Setting a handle to the currently-open instance of the Revit application
uidoc = uiapp.ActiveUIDocument #Setting a handle to the currently-open instance of the Revit UI application

############# Inputs

names=IN[0]
comments=IN[1][1]

############ Separating Elements



coll_walls=FilteredElementCollector(doc).OfCategory(BuiltInCategory.OST_Walls).WhereElementIsNotElementType().ToElements()
wall_names=[]
roof_names=[]
floor_names=[]
ceiling_names=[]
wall_sweeps=[]
for elem in coll_walls:
	DB=elem.GetParameters("Mark")
	for i in DB:
		wall_names.append(i.AsString())
for elem in coll_walls:
	DB=elem.GetParameters("Comments")
	for i in DB:
		wall_sweeps.append(i.AsString())
coll_roofs=FilteredElementCollector(doc).OfCategory(BuiltInCategory.OST_Roofs).WhereElementIsNotElementType().ToElements()
for elem in coll_roofs:
	DB=elem.GetParameters("Mark")
	for i in DB:
		roof_names.append(i.AsString())


coll_floors=FilteredElementCollector(doc).OfCategory(BuiltInCategory.OST_Floors).WhereElementIsNotElementType().ToElements()
for elem in coll_floors:
	DB=elem.GetParameters("Mark")
	for i in DB:
		floor_names.append(i.AsString())


coll_ceilings=FilteredElementCollector(doc).OfCategory(BuiltInCategory.OST_Ceilings).WhereElementIsNotElementType().ToElements()
ceiling_heights=[]
ceiling1=[]
for elem in coll_ceilings:
	DB=elem.GetParameters("Mark")
	DB_H=elem.GetParameters("Height Offset From Level")
	for i in DB:
		ceiling_names.append(i.AsString())
	for i,j in zip(DB, DB_H):
		ceiling1.append([i.AsString(), j.AsValueString()])
roofs1=[]
floors1=[]
ceilings1=[]
walls1=[]
c_height=[]
w_sweep=[]
for index, name in enumerate(names):
	comm=comments[index]
	sub_w=[]
	sub_r=[]
	sub_c=[]
	sub_f=[]
	sub_s=[]
	for sub,c in zip(name,comm):
		if sub in wall_names:
			sub_w.append(sub)
			sub_s.append(c)
		elif sub in roof_names:
			sub_r.append(sub)			
		elif sub in ceiling_names:
			sub_c.append(sub)
		elif sub in floor_names:
			sub_f.append(sub)		
	walls1.append(set(sub_w))
	roofs1.append(set(sub_r))
	ceilings1.append(set(sub_c))
	floors1.append(set(sub_f))
	w_sweep.append(set(sub_s))
for index, item in ceiling1:
	c_height.append(item)
		

	
OUT= floors1,  roofs1, ceilings1, walls1, ceiling1, c_height, w_sweep
# ----------------------------------------
floors = CodeBlock(a=python_script_5) { a[0]; }
roofs = CodeBlock(a=python_script_5) { a[1]; }
ceilings = CodeBlock(a=python_script_5) { a[2]; }
walls = CodeBlock(a=python_script_5) { a[3]; }
removeNulls = Lists.Manage.RemoveNulls(Data=walls@L2)
wall_sweep = CodeBlock(a=python_script_5) { a[6]; }
removeNulls_2 = Lists.Manage.RemoveNulls(Data=wall_sweep@L2)
ceiling_height = CodeBlock(a=python_script_5) { a[5]; }

# group: Joining sub list to form one name
python_script_6 = Python(IN[0]=floors, IN[1]=roofs, IN[2]=ceilings, IN[3]=removeNulls.Cleaned, IN[4]=removeNulls_2.Cleaned)
# ---------- python_script_6.python (94 lines) ----------
import clr #This is .NET's Common Language Runtime. It's an execution environment
#that is able to execute code from several different languages.
import sys #sys is a fundamental Python library - here, we're using it to load in
#the standard IronPython libraries
sys.path.append('C:\Program Files (x86)\IronPython 2.7\Lib') #Imports the
#standard IronPython libraries, which cover everything from servers and
#encryption through to regular expressions.
import System #The System namespace at the root of .NET
from System import Array #.NET class for handling array information
from System.Collections.Generic import * #Lets you handle generics. Revit's API
#sometimes wants hard-typed 'generic' lists, called ILists. If you don't need
#these you can delete this line.
clr.AddReference('ProtoGeometry')  #A Dynamo library for its proxy geometry
#classes. You'll only need this if you're interacting with geometry.
from Autodesk.DesignScript.Geometry import * #Loads everything in Dynamo's
#geometry library
clr.AddReference("RevitNodes") #Dynamo's nodes for Revit
import Revit #Loads in the Revit namespace in RevitNodes
clr.ImportExtensions(Revit.Elements) #More loading of Dynamo's Revit libraries
clr.ImportExtensions(Revit.GeometryConversion) #More loading of Dynamo's
#Revit libraries. You'll only need this if you're interacting with geometry.
clr.AddReference("RevitServices") #Dynamo's classes for handling Revit documents
import RevitServices 
from RevitServices.Persistence import DocumentManager #An internal Dynamo class
#that keeps track of the document that Dynamo is currently attached to
from RevitServices.Transactions import TransactionManager #A Dynamo class for
#opening and closing transactions to change the Revit document's database

clr.AddReference("RevitAPI") #Adding reference to Revit's API DLLs
clr.AddReference("RevitAPIUI") #Adding reference to Revit's API DLLs

import Autodesk #Loads the Autodesk namespace
from Autodesk.Revit.DB import * #Loading Revit's API classes
from Autodesk.Revit.UI import * #Loading Revit's API UI classes  

doc = DocumentManager.Instance.CurrentDBDocument #Finally, setting up handles to the active Revit document
uiapp = DocumentManager.Instance.CurrentUIApplication #Setting a handle to the active Revit UI document
app = uiapp.Application  #Setting a handle to the currently-open instance of the Revit application
uidoc = uiapp.ActiveUIDocument #Setting a handle to the currently-open instance of the Revit UI application


floor=IN[0]
roof=IN[1]
ceiling=IN[2]
wall=IN[3]
wall_sweep=IN[4]

new_floor=[]
new_roof=[]
new_ceiling=[]
new_wall=[]
new_sweep=[]
for name in floor:
	if name=='':
		new_floor.append(" ")
	elif isinstance(name, list):
		new_floor.append(' + '.join(name))
	else:
		new_floor.append(name)
for name in roof:
	if name=='':
		new_roof.append(" ")
	elif isinstance(name, list):
		new_roof.append(' + '.join(name))
	else:
		new_roof.append(name)	
	
for name in ceiling:
	if name=='':
		new_ceiling.append(" ")
	elif isinstance(name, list):
		new_ceiling.append(' + '.join(name))
	else:
		new_ceiling.append(name)

for name in wall:
	if name== "":
		new_wall.append("")
	elif isinstance(name, list):
		new_wall.append(" + ".join(name))				
	else:
		new_wall.append(name)	
		
for name in wall_sweep:
	
	if name== "":
		new_sweep.append("")
	elif isinstance(name, list):
		new_sweep.append(" + ".join(name))				
	else:
		new_sweep.append(name)	
		

OUT= new_floor, new_roof, new_ceiling, new_wall, new_sweep
# ----------------------------------------
roofs_2 = CodeBlock(a=python_script_6) { a[1]; }
walls_2 = CodeBlock(a=python_script_6) { a[3]; }
floors_2 = CodeBlock(a=python_script_6) { a[0]; }
ceilings_2 = CodeBlock(a=python_script_6) { a[2]; }
sweeps = CodeBlock(a=python_script_6) { a[4]; }

# group: Setting Parameter
code_block_7 = CodeBlock { "Wall Finish"; }
nullSetParameter = Custom[Springs.NullSetParameter](element=all_elements_of_category, parameter=code_block_7, value=walls_2)  # package spring nodes; Similar to the built-in function but with the ability to handle null values. Part of the SmartCopyMon workflow.
code_block_8 = CodeBlock { "Floor Finish"; }
nullSetParameter_2 = Custom[Springs.NullSetParameter](element=all_elements_of_category, parameter=code_block_8, value=floors_2)
code_block_9 = CodeBlock { "Ceiling Finish"; }
nullSetParameter_3 = Custom[Springs.NullSetParameter](element=all_elements_of_category, parameter=code_block_9, value=ceilings_2)
code_block_10 = CodeBlock { "Department"; }
nullSetParameter_4 = Custom[Springs.NullSetParameter](element=all_elements_of_category, parameter=code_block_10, value=sweeps)
code_block_11 = CodeBlock { "Ceiling Height"; }
nullSetParameter_5 = Custom[Springs.NullSetParameter](element=all_elements_of_category, parameter=code_block_11, value=ceiling_height)

code_block_12 = CodeBlock { "Ceiling Finish"; }
id = Element.Id(element=all_elements_of_category)
python_script_7 = Python()  # unwired: IN[0]
# ---------- python_script_7.python (48 lines) ----------
import clr #This is .NET's Common Language Runtime. It's an execution environment
#that is able to execute code from several different languages.
import sys #sys is a fundamental Python library - here, we're using it to load in
#the standard IronPython libraries
sys.path.append('C:\Program Files (x86)\IronPython 2.7\Lib') #Imports the
#standard IronPython libraries, which cover everything from servers and
#encryption through to regular expressions.
import System #The System namespace at the root of .NET
from System import Array #.NET class for handling array information
from System.Collections.Generic import * #Lets you handle generics. Revit's API
#sometimes wants hard-typed 'generic' lists, called ILists. If you don't need
#these you can delete this line.
clr.AddReference('ProtoGeometry')  #A Dynamo library for its proxy geometry
#classes. You'll only need this if you're interacting with geometry.
from Autodesk.DesignScript.Geometry import * #Loads everything in Dynamo's
#geometry library
clr.AddReference("RevitNodes") #Dynamo's nodes for Revit
import Revit #Loads in the Revit namespace in RevitNodes
clr.ImportExtensions(Revit.Elements) #More loading of Dynamo's Revit libraries
clr.ImportExtensions(Revit.GeometryConversion) #More loading of Dynamo's
#Revit libraries. You'll only need this if you're interacting with geometry.
clr.AddReference("RevitServices") #Dynamo's classes for handling Revit documents
import RevitServices 
from RevitServices.Persistence import DocumentManager #An internal Dynamo class
#that keeps track of the document that Dynamo is currently attached to
from RevitServices.Transactions import TransactionManager #A Dynamo class for
#opening and closing transactions to change the Revit document's database

clr.AddReference("RevitAPI") #Adding reference to Revit's API DLLs
clr.AddReference("RevitAPIUI") #Adding reference to Revit's API DLLs

import Autodesk #Loads the Autodesk namespace
from Autodesk.Revit.DB import * #Loading Revit's API classes
from Autodesk.Revit.UI import * #Loading Revit's API UI classes  

doc = DocumentManager.Instance.CurrentDBDocument #Finally, setting up handles to the active Revit document
uiapp = DocumentManager.Instance.CurrentUIApplication #Setting a handle to the active Revit UI document
app = uiapp.Application  #Setting a handle to the currently-open instance of the Revit application
uidoc = uiapp.ActiveUIDocument #Setting a handle to the currently-open instance of the Revit UI application
rooms= FilteredElementCollector(doc).OfCategory(BuiltInCategory.OST_Rooms).ToElements()

room_id=[]

for i in rooms:
	nam=i.Id
	
	room_id.append(nam)
OUT= room_id
# ----------------------------------------
string_from_object = FromObject(obj=python_script_7)
toNumber = String.ToNumber(str=string_from_object)
nameById = Orchid.RevitProject.Elements.Element.NameById(id=toNumber)

# group: Ceiling Data with Navis work
file_path = Filename(".\Test1.xlsx")  # frozen
file_from_path = FileObject(path=file_path)
code_block_13 = CodeBlock { "Sheet2"; }
code_block_14 = CodeBlock { true; false; }
importExcel = Data.ImportExcel(file=file_from_path, sheetName=code_block_13, readAsStrings=code_block_14.out0, showExcel=code_block_14.out1)
restOfItems = List.RestOfItems(list=importExcel)
transpose = List.Transpose(lists=restOfItems)
python_script_8 = Python(IN[0]=transpose, IN[1]=nameById)
# ---------- python_script_8.python (119 lines) ----------
import clr #This is .NET's Common Language Runtime. It's an execution environment
#that is able to execute code from several different languages.
import sys #sys is a fundamental Python library - here, we're using it to load in
#the standard IronPython libraries
sys.path.append('C:\Program Files (x86)\IronPython 2.7\Lib') #Imports the
#standard IronPython libraries, which cover everything from servers and
#encryption through to regular expressions.
import System #The System namespace at the root of .NET
from System import Array #.NET class for handling array information
from System.Collections.Generic import * #Lets you handle generics. Revit's API
#sometimes wants hard-typed 'generic' lists, called ILists. If you don't need
#these you can delete this line.
clr.AddReference('ProtoGeometry')  #A Dynamo library for its proxy geometry
#classes. You'll only need this if you're interacting with geometry.
from Autodesk.DesignScript.Geometry import * #Loads everything in Dynamo's
#geometry library
clr.AddReference("RevitNodes") #Dynamo's nodes for Revit
import Revit #Loads in the Revit namespace in RevitNodes
clr.ImportExtensions(Revit.Elements) #More loading of Dynamo's Revit libraries
clr.ImportExtensions(Revit.GeometryConversion) #More loading of Dynamo's
#Revit libraries. You'll only need this if you're interacting with geometry.
clr.AddReference("RevitServices") #Dynamo's classes for handling Revit documents
import RevitServices 
from RevitServices.Persistence import DocumentManager #An internal Dynamo class
#that keeps track of the document that Dynamo is currently attached to
from RevitServices.Transactions import TransactionManager #A Dynamo class for
#opening and closing transactions to change the Revit document's database

clr.AddReference("RevitAPI") #Adding reference to Revit's API DLLs
clr.AddReference("RevitAPIUI") #Adding reference to Revit's API DLLs

import Autodesk #Loads the Autodesk namespace
from Autodesk.Revit.DB import * #Loading Revit's API classes
from Autodesk.Revit.UI import * #Loading Revit's API UI classes  

doc = DocumentManager.Instance.CurrentDBDocument #Finally, setting up handles to the active Revit document
uiapp = DocumentManager.Instance.CurrentUIApplication #Setting a handle to the active Revit UI document
app = uiapp.Application  #Setting a handle to the currently-open instance of the Revit application
uidoc = uiapp.ActiveUIDocument #Setting a handle to the currently-open instance of the Revit UI application


names_c=IN[0][11]
names_r=IN[0][16]
room_name_coll=IN[1]




#################### Getting names of ceilings and rooms


name_list_c=[]
name_list_r=[]
for i in names_c:
	s=i.split(" > ")
	name_list_c.append(s)

name_final_c=[]

for i in name_list_c:
	name_final_c.append(i[6])
		
for i in names_r:
	s=i.split(" > ")
	name_list_r.append(s)

name_final_r=[]

for i in name_list_r:
	name_final_r.append(i[4])




############### Sorting names

zipped=zip(name_final_r, name_final_c)

sorted=sorted(zipped)
tuples=zip(*sorted)

list1,list2=[list(tuple) for tuple in tuples]

unique_name=set(list1)


#################  Duplicates

from collections import defaultdict

def list_duplicates(seq):
	tally=defaultdict(list)
	for i,item in enumerate(seq):
		tally[item].append(i)
	return((key,locs) for key, locs in tally.items() if len(locs)>1)

new_list=[]
for dup in list_duplicates(list1):
	new_list.append(dup)


################ final rooms and names

rooms=[]
ceilings=[]

for item in new_list:
	rooms.append(item[0])
	sub=[]
	for j in item[1]:
		j1=list2[j]
		if j1 not in sub:
			sub.append(j1)
		
	sub1=" + ".join(sub)	
	ceilings.append(sub1)
	
	
OUT=rooms, ceilings, name_final_c #new_list
# ----------------------------------------

# group: Ceiling Names per room
nameById_2 = Orchid.RevitProject.Elements.Element.NameById(id=id)
code_block_15 = CodeBlock(a=python_script_8) { a[0]; }
code_block_16 = CodeBlock(a=python_script_8) { a[1]; }
python_script_9 = Python(IN[0]=nameById_2, IN[1]=code_block_15, IN[2]=code_block_16)
# ---------- python_script_9.python (56 lines) ----------
import clr #This is .NET's Common Language Runtime. It's an execution environment
#that is able to execute code from several different languages.
import sys #sys is a fundamental Python library - here, we're using it to load in
#the standard IronPython libraries
sys.path.append('C:\Program Files (x86)\IronPython 2.7\Lib') #Imports the
#standard IronPython libraries, which cover everything from servers and
#encryption through to regular expressions.
import System #The System namespace at the root of .NET
from System import Array #.NET class for handling array information
from System.Collections.Generic import * #Lets you handle generics. Revit's API
#sometimes wants hard-typed 'generic' lists, called ILists. If you don't need
#these you can delete this line.
clr.AddReference('ProtoGeometry')  #A Dynamo library for its proxy geometry
#classes. You'll only need this if you're interacting with geometry.
from Autodesk.DesignScript.Geometry import * #Loads everything in Dynamo's
#geometry library
clr.AddReference("RevitNodes") #Dynamo's nodes for Revit
import Revit #Loads in the Revit namespace in RevitNodes
clr.ImportExtensions(Revit.Elements) #More loading of Dynamo's Revit libraries
clr.ImportExtensions(Revit.GeometryConversion) #More loading of Dynamo's
#Revit libraries. You'll only need this if you're interacting with geometry.
clr.AddReference("RevitServices") #Dynamo's classes for handling Revit documents
import RevitServices 
from RevitServices.Persistence import DocumentManager #An internal Dynamo class
#that keeps track of the document that Dynamo is currently attached to
from RevitServices.Transactions import TransactionManager #A Dynamo class for
#opening and closing transactions to change the Revit document's database

clr.AddReference("RevitAPI") #Adding reference to Revit's API DLLs
clr.AddReference("RevitAPIUI") #Adding reference to Revit's API DLLs

import Autodesk #Loads the Autodesk namespace
from Autodesk.Revit.DB import * #Loading Revit's API classes
from Autodesk.Revit.UI import * #Loading Revit's API UI classes  

doc = DocumentManager.Instance.CurrentDBDocument #Finally, setting up handles to the active Revit document
uiapp = DocumentManager.Instance.CurrentUIApplication #Setting a handle to the active Revit UI document
app = uiapp.Application  #Setting a handle to the currently-open instance of the Revit application
uidoc = uiapp.ActiveUIDocument #Setting a handle to the currently-open instance of the Revit UI application


room_name=IN[0]
room_c=IN[1]
length=[len(i) for i in room_c]
ceiling=IN[2]

room_ceiling=[]
n=[]
for i in room_name:
	if i in room_c:	
		ind=room_c.index(i)
		room_ceiling.append(ceiling[ind])
	else:
		room_ceiling.append("-")
		
OUT = room_ceiling
# ----------------------------------------

# group: Change ceiling data/ If data are not filled with one node
nullSetParameter_6 = Custom[Springs.NullSetParameter]()  # unwired: element, parameter, value
ʳʰʸᵗʰᵐ_elements_4 = Rhythm.Revit.Elements.Elements.SetParameterByNameTypeOrInstance(element=all_elements_of_category, parameterName=code_block_12, value=python_script_9)

# group: Linked Files
getDocuments = archilab.Revit.Selection.Select.GetDocuments()  # frozen
categories_3 = Categories("OST_Ceilings")
ofCategory = Revit.LinkElement.OfCategory(linkInstance=getDocuments.Link_Instance, Category=categories_3)
element = Revit.LinkElement.Element(linkElement=ofCategory)
solids = Element.Solids(element=element@L1)
python_script_10 = Python(IN[0]=solids)
# ---------- python_script_10.python (19 lines) ----------
# Load the Python Standard and DesignScript Libraries
import sys
import clr
clr.AddReference('ProtoGeometry')
from Autodesk.DesignScript.Geometry import *

# The inputs to this node will be stored as a list in the IN variables.

solids=IN[0]

index=[]
solids_new=[]
for ind, i in enumerate(solids):
	if i==None or i==[]:
		pass
	else:
		index.append(ind)
		solids_new.append(i)
OUT=index, solids_new
# ----------------------------------------
code_block_17 = CodeBlock(a=python_script_10) { a[0]; }
categories_4 = Categories("OST_Rooms")
all_elements_of_category_3 = ElementsOfCategory(Category=categories_4)
solids_2 = Element.Solids(element=all_elements_of_category_3)
python_script_11 = Python(IN[0]=solids_2)  # same code as python_script_10
code_block_18 = CodeBlock(a=python_script_11) { a[0]; }
code_block_19 = CodeBlock(a=python_script_11) { a[1]; }
flatten_3 = List.Flatten(list=code_block_19)
code_block_20 = CodeBlock(a=python_script_10) { a[1]; }
flatten_4 = List.Flatten(list=code_block_20)
python_script_12 = Python(IN[0]=flatten_3, IN[1]=flatten_4)
# ---------- python_script_12.python (25 lines) ----------
# Load the Python Standard and DesignScript Libraries
import sys
import clr
clr.AddReference('ProtoGeometry')
from Autodesk.DesignScript.Geometry import *

# The inputs to this node will be stored as a list in the IN variables.
rooms=IN[0]
ceiling=IN[1]

rooms1=[]
ceilings=[]
for ind, i in enumerate(rooms):
	ceilings_sub=[]
	sub=[]
	if i!='' and i!= None:
		for ind1, j in enumerate(ceiling):
			if j!='' and j!=None:
				boo1=str(j.DoesIntersect(i))
				if boo1=="True":
					ceilings_sub.append(ind1)
					sub.append(ind)	
	ceilings.append(ceilings_sub)
	rooms1.append(set(sub))					
OUT =rooms1, ceilings				
# ----------------------------------------
room_index = CodeBlock(a=python_script_12) { a[0]; }
getItemAtIndex = List.GetItemAtIndex(list=all_elements_of_category_3, index=room_index@L2)
code_block_21 = CodeBlock { "Ceiling Finish"; }
flatten_5 = List.Flatten(list=element)
ceiling_index = CodeBlock(a=python_script_12) { a[1]; }
getItemAtIndex_2 = List.GetItemAtIndex(list=flatten_5, index=ceiling_index@L2)
code_block_22 = CodeBlock { "Type Mark"; }
ʳʰʸᵗʰᵐ_elements_5 = Rhythm.Revit.Elements.Elements.GetParameterValueByNameTypeOrInstance(element=getItemAtIndex_2, parameterName=code_block_22)
python_script_13 = Python(IN[0]=ʳʰʸᵗʰᵐ_elements_5)
# ---------- python_script_13.python (20 lines) ----------
# Load the Python Standard and DesignScript Libraries
import sys
import clr
clr.AddReference('ProtoGeometry')
from Autodesk.DesignScript.Geometry import *

# The inputs to this node will be stored as a list in the IN variables.
names=IN[0]

new=[]

for i in names:
	if i!=[] and isinstance(i,list):
		sub=list(filter(None,i))
		x='+'.join(sub)
		new.append(x)
	elif i!=[] and isinstance(i,str):
		new.append(i)

OUT= new
# ----------------------------------------
ʳʰʸᵗʰᵐ_elements_6 = Rhythm.Revit.Elements.Elements.SetParameterByNameTypeOrInstance(element=getItemAtIndex, parameterName=code_block_21, value=python_script_13)

# group: Rooms in 3D
categories_5 = Categories("OST_Rooms")  # frozen
all_elements_of_category_4 = ElementsOfCategory(Category=categories_5)

# group: Color set
code_block_23 = CodeBlock { 0; 255; }
byARGB = Color.ByARGB(r=code_block_23.out1, g=code_block_23.out0, b=code_block_23.out0)
byARGB_2 = Color.ByARGB(r=code_block_23.out0, g=code_block_23.out1, b=code_block_23.out0)
byARGB_3 = Color.ByARGB(r=code_block_23.out0, g=code_block_23.out0, b=code_block_23.out0)
list_create_2 = List.Create(item0=byARGB, item1=byARGB_2, item2=byARGB_3)
code_block_24 = CodeBlock { 0; 0.5; 1; }
list_create_3 = List.Create(item0=code_block_24.out0, item1=code_block_24.out1, item2=code_block_24.out2)

# group: Counting unique items based on name and associating them with total names
name = Custom[Element.Name+](element=all_elements_of_category_4)  # package Clockwork for Dynamo 2.x; Gets an element's name. Unlike the OOTB node, this node should work for all Revit elements that have names and will also return the localized names of system parameters, parameter groups, display unit types, parameter types, unit symbol types and unit types.
python_script_14 = Python(IN[0]=name)
# ---------- python_script_14.python (42 lines) ----------
import clr #This is .NET's Common Language Runtime. It's an execution environment
#that is able to execute code from several different languages.
import sys #sys is a fundamental Python library - here, we're using it to load in
#the standard IronPython libraries
sys.path.append('C:\Program Files (x86)\IronPython 2.7\Lib') #Imports the
#standard IronPython libraries, which cover everything from servers and
#encryption through to regular expressions.
import System #The System namespace at the root of .NET
from System import Array #.NET class for handling array information
from System.Collections.Generic import * #Lets you handle generics. Revit's API
#sometimes wants hard-typed 'generic' lists, called ILists. If you don't need
#these you can delete this line.
clr.AddReference('ProtoGeometry')  #A Dynamo library for its proxy geometry
#classes. You'll only need this if you're interacting with geometry.
from Autodesk.DesignScript.Geometry import * #Loads everything in Dynamo's
#geometry library
clr.AddReference("RevitNodes") #Dynamo's nodes for Revit
import Revit #Loads in the Revit namespace in RevitNodes
clr.ImportExtensions(Revit.Elements) #More loading of Dynamo's Revit libraries
clr.ImportExtensions(Revit.GeometryConversion) #More loading of Dynamo's
#Revit libraries. You'll only need this if you're interacting with geometry.
clr.AddReference("RevitServices") #Dynamo's classes for handling Revit documents
import RevitServices 
from RevitServices.Persistence import DocumentManager #An internal Dynamo class
#that keeps track of the document that Dynamo is currently attached to
from RevitServices.Transactions import TransactionManager #A Dynamo class for
#opening and closing transactions to change the Revit document's database

clr.AddReference("RevitAPI") #Adding reference to Revit's API DLLs
clr.AddReference("RevitAPIUI") #Adding reference to Revit's API DLLs

import Autodesk #Loads the Autodesk namespace
from Autodesk.Revit.DB import * #Loading Revit's API classes
from Autodesk.Revit.UI import * #Loading Revit's API UI classes  

doc = DocumentManager.Instance.CurrentDBDocument #Finally, setting up handles to the active Revit document
uiapp = DocumentManager.Instance.CurrentUIApplication #Setting a handle to the active Revit UI document
app = uiapp.Application  #Setting a handle to the currently-open instance of the Revit application
uidoc = uiapp.ActiveUIDocument #Setting a handle to the currently-open instance of the Revit UI application

name=set(IN[0])
OUT= name
# ----------------------------------------
python_script_15 = Python(IN[0]=python_script_14)
# ---------- python_script_15.python (47 lines) ----------
import clr #This is .NET's Common Language Runtime. It's an execution environment
#that is able to execute code from several different languages.
import sys #sys is a fundamental Python library - here, we're using it to load in
#the standard IronPython libraries
sys.path.append('C:\Program Files (x86)\IronPython 2.7\Lib') #Imports the
#standard IronPython libraries, which cover everything from servers and
#encryption through to regular expressions.
import System #The System namespace at the root of .NET
from System import Array #.NET class for handling array information
from System.Collections.Generic import * #Lets you handle generics. Revit's API
#sometimes wants hard-typed 'generic' lists, called ILists. If you don't need
#these you can delete this line.
clr.AddReference('ProtoGeometry')  #A Dynamo library for its proxy geometry
#classes. You'll only need this if you're interacting with geometry.
from Autodesk.DesignScript.Geometry import * #Loads everything in Dynamo's
#geometry library
clr.AddReference("RevitNodes") #Dynamo's nodes for Revit
import Revit #Loads in the Revit namespace in RevitNodes
clr.ImportExtensions(Revit.Elements) #More loading of Dynamo's Revit libraries
clr.ImportExtensions(Revit.GeometryConversion) #More loading of Dynamo's
#Revit libraries. You'll only need this if you're interacting with geometry.
clr.AddReference("RevitServices") #Dynamo's classes for handling Revit documents
import RevitServices 
from RevitServices.Persistence import DocumentManager #An internal Dynamo class
#that keeps track of the document that Dynamo is currently attached to
from RevitServices.Transactions import TransactionManager #A Dynamo class for
#opening and closing transactions to change the Revit document's database

clr.AddReference("RevitAPI") #Adding reference to Revit's API DLLs
clr.AddReference("RevitAPIUI") #Adding reference to Revit's API DLLs

import Autodesk #Loads the Autodesk namespace
from Autodesk.Revit.DB import * #Loading Revit's API classes
from Autodesk.Revit.UI import * #Loading Revit's API UI classes  

doc = DocumentManager.Instance.CurrentDBDocument #Finally, setting up handles to the active Revit document
uiapp = DocumentManager.Instance.CurrentUIApplication #Setting a handle to the active Revit UI document
app = uiapp.Application  #Setting a handle to the currently-open instance of the Revit application
uidoc = uiapp.ActiveUIDocument #Setting a handle to the currently-open instance of the Revit UI application


ind=[]

for index, i in enumerate(IN[0]):
	ind.append(index)
	
OUT= ind
# ----------------------------------------
python_script_16 = Python(IN[0]=all_elements_of_category_4, IN[1]=name, IN[2]=python_script_14, IN[3]=python_script_15)
# ---------- python_script_16.python (54 lines) ----------
import clr #This is .NET's Common Language Runtime. It's an execution environment
#that is able to execute code from several different languages.
import sys #sys is a fundamental Python library - here, we're using it to load in
#the standard IronPython libraries
sys.path.append('C:\Program Files (x86)\IronPython 2.7\Lib') #Imports the
#standard IronPython libraries, which cover everything from servers and
#encryption through to regular expressions.
import System #The System namespace at the root of .NET
from System import Array #.NET class for handling array information
from System.Collections.Generic import * #Lets you handle generics. Revit's API
#sometimes wants hard-typed 'generic' lists, called ILists. If you don't need
#these you can delete this line.
clr.AddReference('ProtoGeometry')  #A Dynamo library for its proxy geometry
#classes. You'll only need this if you're interacting with geometry.
from Autodesk.DesignScript.Geometry import * #Loads everything in Dynamo's
#geometry library
clr.AddReference("RevitNodes") #Dynamo's nodes for Revit
import Revit #Loads in the Revit namespace in RevitNodes
clr.ImportExtensions(Revit.Elements) #More loading of Dynamo's Revit libraries
clr.ImportExtensions(Revit.GeometryConversion) #More loading of Dynamo's
#Revit libraries. You'll only need this if you're interacting with geometry.
clr.AddReference("RevitServices") #Dynamo's classes for handling Revit documents
import RevitServices 
from RevitServices.Persistence import DocumentManager #An internal Dynamo class
#that keeps track of the document that Dynamo is currently attached to
from RevitServices.Transactions import TransactionManager #A Dynamo class for
#opening and closing transactions to change the Revit document's database

clr.AddReference("RevitAPI") #Adding reference to Revit's API DLLs
clr.AddReference("RevitAPIUI") #Adding reference to Revit's API DLLs

import Autodesk #Loads the Autodesk namespace
from Autodesk.Revit.DB import * #Loading Revit's API classes
from Autodesk.Revit.UI import * #Loading Revit's API UI classes  

doc = DocumentManager.Instance.CurrentDBDocument #Finally, setting up handles to the active Revit document
uiapp = DocumentManager.Instance.CurrentUIApplication #Setting a handle to the active Revit UI document
app = uiapp.Application  #Setting a handle to the currently-open instance of the Revit application
uidoc = uiapp.ActiveUIDocument #Setting a handle to the currently-open instance of the Revit UI application


elements=[UnwrapElement(i) for i in IN[0]]
element_name=IN[1]
set_name=IN[2]
set_count=IN[3]

element_number=[]
#element_name=[]
for i in element_name:
	if i in set_name:
		ind=set_name.index(i)
		element_number.append(ind)
		
OUT= element_number
# ----------------------------------------
code_block_25 = CodeBlock { 0; 1; }
remapRange = Math.RemapRange(numbers=python_script_16, newMin=code_block_25.out0, newMax=code_block_25.out1)
color_range = ColorRange(colors=list_create_2, indices=list_create_3, value=remapRange)

materials = Material()  # nothing selected

# group: Creating Mass
geometry = Element.Geometry(element=all_elements_of_category_4)
categories_6 = Categories("OST_Mass")
number = Room.Number(room=all_elements_of_category_4)
byGeometry = DirectShape.ByGeometry(geometry=geometry, category=categories_6, material=materials, name=number)

byGeometryColor = Modifiers.GeometryColor.ByGeometryColor(geometry=geometry, color=color_range)
overrideColorInView = Element.OverrideColorInView(element=byGeometry, color=color_range)
code_block_26 = CodeBlock { "Description"; }
ʳʰʸᵗʰᵐ_elements_7 = Rhythm.Revit.Elements.Elements.SetParameterByNameTypeOrInstance(element=overrideColorInView, parameterName=code_block_26, value=name)
code_block_27 = CodeBlock { "WBS 1"; }
id_2 = Element.Id(element=all_elements_of_category_4)
string_from_object_2 = FromObject(obj=id_2)
ʳʰʸᵗʰᵐ_elements_8 = Rhythm.Revit.Elements.Elements.SetParameterByNameTypeOrInstance(element=overrideColorInView, parameterName=code_block_27, value=string_from_object_2)
code_block_28 = CodeBlock { "Ceiling Bottom Height"; }
code_block_29 = CodeBlock { "Bottom Height"; }
ʳʰʸᵗʰᵐ_elements_9 = Rhythm.Revit.Elements.Elements.GetParameterValueByNameTypeOrInstance(element=getItemAtIndex_2, parameterName=code_block_29)
python_script_17 = Python(IN[0]=ʳʰʸᵗʰᵐ_elements_9)
# ---------- python_script_17.python (19 lines) ----------
# Load the Python Standard and DesignScript Libraries
import sys
import clr
clr.AddReference('ProtoGeometry')
from Autodesk.DesignScript.Geometry import *

# The inputs to this node will be stored as a list in the IN variables.
height=IN[0]

bottom=[]

for i in height:
	sub=[]
	if i!=[]:
		x=min(i)
		sub.append(x)
	bottom.append(sub)

OUT= bottom
# ----------------------------------------
ʳʰʸᵗʰᵐ_elements_10 = Rhythm.Revit.Elements.Elements.SetParameterByNameTypeOrInstance(element=getItemAtIndex, parameterName=code_block_28, value=python_script_17)
