# Dynamo graph Creating excel Sheets with multiple classes_Generalised.dyn (Dynamo 2.5.0.7460)
# packages: Genius Loci 2021.5.18, Rhythm 2020.1.22, Clockwork for Dynamo 2.x 2.3.0

# group: Sheet data from excel
file_path = Filename(".\SheetNames - 1.xlsx")
file_from_path = FileObject(path=file_path)
code_block = CodeBlock { "Foglio1"; }
importExcel = Data.ImportExcel(file=file_from_path, sheetName=code_block)
restOfItems = List.RestOfItems(list=importExcel)
transpose = List.Transpose(lists=restOfItems)

# group: Sheet Name
code_block_2 = CodeBlock { 1; }
getItemAtIndex = List.GetItemAtIndex(list=transpose, index=code_block_2)

# group: Sheet Number
code_block_3 = CodeBlock { 0; }
getItemAtIndex_2 = List.GetItemAtIndex(list=transpose, index=code_block_3)

python_script = Python(IN[0]=getItemAtIndex_2)
# ---------- python_script.python (13 lines) ----------
# Load the Python Standard and DesignScript Libraries
import sys
import clr
clr.AddReference('ProtoGeometry')
from Autodesk.DesignScript.Geometry import *

# The inputs to this node will be stored as a list in the IN variables.
dataEnteringNode = IN

# Place your code below this line

# Assign your output to the OUT variable.
OUT=[str(i).split('.')[0] for i in IN[0]]
# ----------------------------------------

# group: Sheet type
family_types = FamilyTypes("ZZ_DUT_TitleBlock_A1_STR:DUT_Title Block A1_New")

create_sheet = Custom[Create Sheet](SheetName=getItemAtIndex, SheetNumber=python_script, TitleBlock=family_types)  # package Genius Loci; Creates new sheets.

# group: Main Purpose Parameter
string = StringInput("B6_Main Purpose")

# group: Main Group
code_block_4 = CodeBlock { 2; }
getItemAtIndex_3 = List.GetItemAtIndex(list=transpose, index=code_block_4)

passthrough = Custom[Passthrough](passThrough=getItemAtIndex_3, waitFor=create_sheet.Sheets)  # package Clockwork for Dynamo 2.x; Forces a sequential order of execution. The node wired into the output of the Passthrough node will be executed *after* the node wired into the waitFor input (e.g. important for some Revit operations). The value of the passThrough input will be passed on to the node wired into the output port of the Passthrough node.
ʳʰʸᵗʰᵐ_elements = Rhythm.Revit.Elements.Elements.SetParameterByNameTypeOrInstance(element=create_sheet.Sheets, parameterName=string, value=passthrough)

# group: Sub Purpose Parameter
string_2 = StringInput("B6_Purpose")

# group: Sub Group
code_block_5 = CodeBlock { 3; }
getItemAtIndex_4 = List.GetItemAtIndex(list=transpose, index=code_block_5)

passthrough_2 = Custom[Passthrough](passThrough=getItemAtIndex_4, waitFor=ʳʰʸᵗʰᵐ_elements)
ʳʰʸᵗʰᵐ_elements_2 = Rhythm.Revit.Elements.Elements.SetParameterByNameTypeOrInstance(element=ʳʰʸᵗʰᵐ_elements, parameterName=string_2, value=passthrough_2)
