# Dynamo graph 2. Settin Parameter from Family to Assembly.dyn "Settin Parameter from Family to Assembly" (Dynamo 2.6.1.8786)
# packages: Rhythm 2021.4.2

categories = Categories("OST_Assemblies")
all_elements_of_category = ElementsOfCategory(Category=categories)
code_block = CodeBlock { "Description"; }
categories_2 = Categories("OST_GenericModel")
all_elements_of_category_2 = ElementsOfCategory(Category=categories_2)
code_block_2 = CodeBlock { "AZA_Descrizione"; }
ʳʰʸᵗʰᵐ_elements = Rhythm.Revit.Elements.Elements.GetParameterValueByNameTypeOrInstance(element=all_elements_of_category_2, parameterName=code_block_2)
ʳʰʸᵗʰᵐ_elements_2 = Rhythm.Revit.Elements.Elements.SetParameterByNameTypeOrInstance(element=all_elements_of_category, parameterName=code_block, value=ʳʰʸᵗʰᵐ_elements)
