# Dynamo graph 5. AZA_Adding new assemblies.dyn (Dynamo 2.6.1.8786)
# packages: SteamNodes 1.2.3, Clockwork for Dynamo 2.x 2.3.0, MEPover 2020.6.2, Rhythm 2021.4.2

# group: 0. creare assemblies from model from GLA, GLF, GES generic models families
categories = Categories("OST_GenericModel")
all_elements_of_category = ElementsOfCategory(Category=categories)
string_from_object = FromObject(obj=all_elements_of_category)
string = StringInput("GES")
contains = String.Contains(str=string_from_object, searchFor=string)
filterByBoolMask = List.FilterByBoolMask(list=all_elements_of_category, mask=contains)
string_from_object_2 = FromObject(obj=all_elements_of_category)
string_2 = StringInput("GLF")
contains_2 = String.Contains(str=string_from_object_2, searchFor=string_2)
filterByBoolMask_2 = List.FilterByBoolMask(list=all_elements_of_category, mask=contains_2)
string_from_object_3 = FromObject(obj=all_elements_of_category)
string_3 = StringInput("GLA")
contains_3 = String.Contains(str=string_from_object_3, searchFor=string_3)
filterByBoolMask_3 = List.FilterByBoolMask(list=all_elements_of_category, mask=contains_3)
list_create = List.Create(item0=filterByBoolMask.in, item1=filterByBoolMask_2.in, item2=filterByBoolMask_3.in)

createAssembly = Custom[Tool.CreateAssembly](List=all_elements_of_category@L1)  # package SteamNodes; Create an Assembly for each element
name = Custom[Element.Name+](element=all_elements_of_category@L1)  # package Clockwork for Dynamo 2.x; Gets an element's name. Unlike the OOTB node, this node should work for all Revit elements that have names and will also return the localized names of system parameters, parameter groups, display unit types, parameter types, unit symbol types and unit types.
python_script = Python(IN[1]=name)  # unwired: IN[0]
# ---------- python_script.python (47 lines) ----------
import clr
clr.AddReference('ProtoGeometry')
from Autodesk.DesignScript.Geometry import *
# Import ToDSType(bool) extension method
clr.AddReference("RevitNodes")
import Revit
clr.ImportExtensions(Revit.Elements)
# Import geometry conversion extension methods
clr.ImportExtensions(Revit.GeometryConversion)
# Import DocumentManager and TransactionManager
clr.AddReference("RevitServices")
import RevitServices
from RevitServices.Persistence import DocumentManager
from RevitServices.Transactions import TransactionManager
from System.Collections.Generic import *
# Import RevitAPI
clr.AddReference("RevitAPI")
import Autodesk
from Autodesk.Revit.DB import *

doc = DocumentManager.Instance.CurrentDBDocument
uiapp = DocumentManager.Instance.CurrentUIApplication
app = uiapp.Application
uidoc=DocumentManager.Instance.CurrentUIApplication.ActiveUIDocument
#TransactionManager.ForceCloseTransaction()
elt = []
for i in IN[0]:
	elt.append(UnwrapElement(i))
NamesList=IN[1]
names=[]
# Start Transaction
TransactionManager.Instance.EnsureInTransaction(doc)

Assemb=[]
non=[]
for index, i in enumerate(elt):
	if i!= None:
		i.AssemblyTypeName = NamesList[index]
		Assemb.append(i)
	
for i in Assemb:
	names.append(i.AssemblyTypeName)
# End Transaction
TransactionManager.Instance.TransactionTaskDone()

OUT= elt
#Assign your output to the OUT variable.
# ----------------------------------------
element_types = ElementTypes("AssemblyInstance")  # frozen
all_elements_of_type = ElementsOfType(element_type=element_types)
code_block = CodeBlock { "Description"; }
flatten = List.Flatten(list=list_create)
code_block_2 = CodeBlock { "AZA_Descrizione"; }
ʳʰʸᵗʰᵐ_elements = Rhythm.Revit.Elements.Elements.GetParameterValueByNameTypeOrInstance(element=flatten, parameterName=code_block_2)  # frozen
setParameterSetValueString = Custom[SetParameterSetValueString](Elements=all_elements_of_type, ParameterName=code_block, Values=ʳʰʸᵗʰᵐ_elements)  # package MEPover; Sets the parameters by strings. Useful for setting numerical values that are affected by Revit's internal unit conversion. Does not work for parameters that are stored as elementId
getParameterValueByName = Element.GetParameterValueByName(element=setParameterSetValueString, parameterName=code_block)
categories_2 = Categories("OST_GenericModel")  # frozen
all_elements_of_category_2 = ElementsOfCategory(Category=categories_2)
code_block_3 = CodeBlock { "AZA_Code"; "bbbbbbbbb"; }
ʳʰʸᵗʰᵐ_elements_2 = Rhythm.Revit.Elements.Elements.GetParameterValueByNameTypeOrInstance(element=all_elements_of_category_2, parameterName=code_block_3.out0)
python_script_2 = Python(IN[0]=all_elements_of_category_2, IN[1]=ʳʰʸᵗʰᵐ_elements_2, IN[2]=code_block_3.out1)
# ---------- python_script_2.python (49 lines) ----------
import clr #This is .NET's Common Language Runtime. It's an execution environment
#that is able to execute code from several different languages.
import sys #sys is a fundamental Python library - here, we're using it to load in
#the standard IronPython libraries
sys.path.append('C:\Program Files (x86)\IronPython 2.7\Lib') #Imports the
#standard IronPython libraries, which cover everything from servers and
#encryption through to regular expressions.
import System #The System namespace at the root of .NET
from System import Array #.NET class for handling array information
from System.Collections.Generic import * #Lets you handle generics. Revit's API
#sometimes wants hard-typed 'generic' lists, called ILists. If you don't need
#these you can delete this line.
clr.AddReference('ProtoGeometry')  #A Dynamo library for its proxy geometry
#classes. You'll only need this if you're interacting with geometry.
from Autodesk.DesignScript.Geometry import * #Loads everything in Dynamo's
#geometry library
clr.AddReference("RevitNodes") #Dynamo's nodes for Revit
import Revit #Loads in the Revit namespace in RevitNodes
clr.ImportExtensions(Revit.Elements) #More loading of Dynamo's Revit libraries
clr.ImportExtensions(Revit.GeometryConversion) #More loading of Dynamo's
#Revit libraries. You'll only need this if you're interacting with geometry.
clr.AddReference("RevitServices") #Dynamo's classes for handling Revit documents
import RevitServices 
from RevitServices.Persistence import DocumentManager #An internal Dynamo class
#that keeps track of the document that Dynamo is currently attached to
from RevitServices.Transactions import TransactionManager #A Dynamo class for
#opening and closing transactions to change the Revit document's database

clr.AddReference("RevitAPI") #Adding reference to Revit's API DLLs
clr.AddReference("RevitAPIUI") #Adding reference to Revit's API DLLs

import Autodesk #Loads the Autodesk namespace
from Autodesk.Revit.DB import * #Loading Revit's API classes
from Autodesk.Revit.UI import * #Loading Revit's API UI classes  

doc = DocumentManager.Instance.CurrentDBDocument #Finally, setting up handles to the active Revit document
uiapp = DocumentManager.Instance.CurrentUIApplication #Setting a handle to the active Revit UI document
app = uiapp.Application  #Setting a handle to the currently-open instance of the Revit application
uidoc = uiapp.ActiveUIDocument #Setting a handle to the currently-open instance of the Revit UI application

elements=[UnwrapElement(i) for i in IN[0]]

param=IN[1]
elements_new=[]
for elem, para in zip(elements, param):
	if para==IN[2]:
		elements_new.append(elem)
		
OUT= elements_new
# ----------------------------------------
createAssembly_2 = Custom[Tool.CreateAssembly](List=python_script_2@L1)
name_2 = Custom[Element.Name+](element=python_script_2@L1)
python_script_3 = Python(IN[0]=createAssembly_2, IN[1]=name_2)  # same code as python_script
