# Dynamo graph 31. Fill Parameters by part data-2.dyn (Dynamo 2.5.1.7586)
# packages: Civil3DToolkit 1.1.17

# group: Current Document Name Description Data
current = Autodesk.AutoCAD.DynamoNodes.Document.Current()
pressurePipeNetworks = PressurePipeNetworks(document=current)
getPipesFittings = Autodesk.Civil.DynamoNodes.PressurePipeNetworks.PressurePipeNetwork.GetPipesFittings(pressurePipeNetwork=pressurePipeNetworks)
code_block = CodeBlock(a=getPipesFittings.Fittings) { a[1]; }
partDescription = Autodesk.Civil.DynamoNodes.PressurePipeNetworks.PressureFitting.PartDescription(pressureFitting=code_block)

# group: Property Set and Property name
code_block_2 = CodeBlock { "bb"; "A2"; }

# group: Excel Data
file_path = Filename(".\Basic1.xlsx")
file_from_path = FileObject(path=file_path)
code_block_3 = CodeBlock { "Basic"; true; false; }
importExcel = Data.ImportExcel(file=file_from_path, sheetName=code_block_3.out0, readAsStrings=code_block_3.out1, showExcel=code_block_3.out2)
restOfItems = List.RestOfItems(list=importExcel)
transpose = List.Transpose(lists=restOfItems)
code_block_4 = CodeBlock(a=transpose) { a[3]; a[1]; a[4]; }

# group: model name
python_script = Python(IN[0]=partDescription, IN[1]=code_block_4.out0, IN[2]=code_block_4.out1, IN[3]=code_block_4.out2)
# ---------- python_script.python (47 lines) ----------
sub_lst=IN[0]
full_name=IN[1]
full_dia=IN[2]
model_name=IN[3]


full=[i+" "+full_dia[index] for index, i in enumerate(full_name)]

bad_char=["-","(", ")", ","]

# removing bad charac

new_name=[]

for j in sub_lst:
	for i in bad_char:
		j=j.replace(i,"")
	new_name.append(j)
	
new_sub=[]

for i in new_name:
	i=i.replace("10MPa", "10 MPa")
	i=i.lower()
	new_sub.append(i.split())
	

new_full=[]

for j in full:
	n=j.lower()
	new_full.append(n)
	
#new_full=set(new_full)

lst2=[]
model=[]

for index, i in enumerate(new_full):
	for j in new_sub:
		if all(x in i for x in j):
			#lst2.append(j)
			model.append(model_name[index])

models=[v for i, v in enumerate(model) if i==0 or v!=model[i-1]]

OUT= models	
# ----------------------------------------

# group: Setting Property Value
updateProperty = Autodesk.AutoCAD.DynamoNodes.Object.UpdateProperty(object=code_block, propertySetName=code_block_2.out0, propertyName=code_block_2.out1, propertyValue=python_script)
