# Dynamo graph 31. Fill Parameters by part data-3.dyn (Dynamo 2.5.1.7586)
# packages: Civil3DToolkit 1.1.17

# group: Excel Data
file_path = Filename("..\..\..\..\..\..\Downloads\Standard (1).csv")
file_from_path = FileObject(path=file_path)
code_block = CodeBlock { "SDF_Gas"; true; false; }
importExcel = Data.ImportExcel(sheetName=code_block.out0, readAsStrings=code_block.out1, showExcel=code_block.out2)  # unwired: file

importCSV = Data.ImportCSV(filePath=file_path)
code_block_2 = CodeBlock(a=importCSV) { [a[0],a[6]]; }

# group (continued): Excel Data
transpose = List.Transpose(lists=code_block_2)

# group: Current Document Name Description Data
current = Autodesk.AutoCAD.DynamoNodes.Document.Current()
pressurePipeNetworks = PressurePipeNetworks(document=current)
getPipesFittings = Autodesk.Civil.DynamoNodes.PressurePipeNetworks.PressurePipeNetwork.GetPipesFittings(pressurePipeNetwork=pressurePipeNetworks)
code_block_3 = CodeBlock(a=getPipesFittings.Fittings) { a; }

flatten = List.Flatten(list=code_block_3)
name = Autodesk.Civil.DynamoNodes.CivilObject.Name(civilObject=flatten)
python_script = Python(IN[0]=code_block_2)
# ---------- python_script.python (20 lines) ----------
x=IN[0][0][2::]
y=IN[0][1][2::]

fin1=[]
fin2=[]

for ind, i in enumerate(x):
	j=y[ind]
	if i!=None:
		n1=i.replace('''"''','')
		fin1.append(n1)
	else:
		fin1.append([])
	if j!=None:
		n2=j.replace('''"''','')
		fin2.append(n2)
	else:
		fin2.append([])

OUT=fin1,fin2
# ----------------------------------------

# group (continued): Excel Data
code_block_4 = CodeBlock(a=python_script) { a[0]; a[1]; }

# group: model name
python_script_2 = Python(IN[0]=name, IN[1]=code_block_4.out0, IN[2]=code_block_4.out1)  # frozen
# ---------- python_script_2.python (47 lines) ----------
sub_lst=IN[0]
full_name=IN[1]
#full_dia=IN[2]
model_name=IN[2]


full=[i+" "+full_dia[index] for index, i in enumerate(full_name)]

bad_char=["-","(", ")", ",", "_"]

# removing bad charac

new_name=[]

for j in sub_lst:
	for i in bad_char:
		j=j.replace(i,"")
	new_name.append(j)
	
new_sub=[]

for i in new_name:
	i=i.replace("10MPa", "10 MPa")
	i=i.lower()
	new_sub.append(i.split())
	

new_full=[]

for j in full:
	n=j.lower()
	new_full.append(n)
	
#new_full=set(new_full)

lst2=[]
model=[]

for index, i in enumerate(new_full):
	for j in new_sub:
		if all(x in i for x in j):
			#lst2.append(j)
			model.append(model_name[index])

#models=[v for i, v in enumerate(model) if i==0 or v!=model[i-1]]

OUT= model
# ----------------------------------------

# group: Property Set and Property name
code_block_5 = CodeBlock { "ModelName"; "Model_Name"; }

python_script_3 = Python(IN[0]=name)
# ---------- python_script_3.python (6 lines) ----------
# Load the Python Standard and DesignScript Libraries
import sys
import clr
x=[i.replace('-','') for i in IN[0]]

OUT=[i.replace(' ','') for i in x]
# ----------------------------------------
python_script_4 = Python(IN[0]=code_block_4.out0)  # same code as python_script_3
python_script_5 = Python(IN[0]=python_script_3, IN[1]=python_script_4, IN[2]=code_block_4.out1)
# ---------- python_script_5.python (14 lines) ----------
prname=IN[0]
excel_name=IN[1]
modelname=IN[2]
final=[]
for ind1,i in enumerate(prname):
	ind=excel_name.index(i)
	model=modelname[ind]
	if model!="???":
		final.append(model)
	else:
		final.append([])

OUT=final
	
# ----------------------------------------

# group: Setting Property Value
updateProperty = Autodesk.AutoCAD.DynamoNodes.Object.UpdateProperty(object=flatten, propertySetName=code_block_5.out0, propertyName=code_block_5.out1, propertyValue=python_script_5)  # frozen

python_script_6 = Python(IN[0]=importCSV)
# ---------- python_script_6.python (1 lines) ----------
OUT=len(IN[0])
# ----------------------------------------

# group: Selection of Pressure Network
code_block_6 = CodeBlock(a=pressurePipeNetworks) { [a[0],a[3],a[5]]; }

partDescription = Autodesk.Civil.DynamoNodes.PressurePipeNetworks.PressureFitting.PartDescription(pressureFitting=flatten)
