# Dynamo graph Final- Spliting Circular elements - Generalised.dyn "Spliting Circular elements - Generalised" (Dynamo 2.5.0.7460)
# packages: Orchid 203.3.0.7815, Rhythm 2020.1.22, spring nodes 204.1.0, MeshToolkit 3.0.0

# note: First run without connecting direct shape. Second run with directshape connected.

# group: Select the generic Model
select_model_element = DSModelElementSelection()  # 1 picked in the model

# group: Converting Mesh to Solids
geometry = Element.Geometry(element=select_model_element)
toToolkitMesh = Custom[Springs.Mesh.ToToolkitMesh](mesh=geometry)  # package spring nodes; Converts a Dynamo mesh to a toolkit mesh. You obviously need to have the appropriate version of the mesh toolkit package downloaded first.
triangles = Autodesk.Dynamo.MeshToolkit.Mesh.Triangles(mesh=toToolkitMesh)
byJoinedSurfaces = Solid.ByJoinedSurfaces(facesOfSolid=triangles)

# group: Splitting Grid 2
select_model_element_2 = DSModelElementSelection()  # 1 picked in the model

# group: Plane Grid 2
curve = Grid.Curve(grid=select_model_element_2)
pointAtParameter = Curve.PointAtParameter(curve=curve)
normalAtParameter = Curve.NormalAtParameter(curve=curve)
byOriginNormal = Plane.ByOriginNormal(origin=pointAtParameter, normal=normalAtParameter)

split = Geometry.Split(geometry=byJoinedSurfaces, other=byOriginNormal)

# group: Split Geometries
code_block = CodeBlock(a=split) { a[0][1]; }
code_block_2 = CodeBlock(a=split) { a[0][0]; }

# group: Splitting Grid 1
select_model_element_3 = DSModelElementSelection()  # 1 picked in the model

# group: Plane for grid1
curve_2 = Grid.Curve(grid=select_model_element_3)
pointAtParameter_2 = Curve.PointAtParameter(curve=curve_2)
normalAtParameter_2 = Curve.NormalAtParameter(curve=curve_2)
byOriginNormal_2 = Plane.ByOriginNormal(origin=pointAtParameter_2, normal=normalAtParameter_2)

# group: Splitting in four pieces
split_2 = Geometry.Split(geometry=code_block, other=byOriginNormal_2)
code_block_3 = CodeBlock(a=split_2) { a[1]; }
code_block_4 = CodeBlock(a=split_2) { a[0]; }
split_3 = Geometry.Split(geometry=code_block_2, other=byOriginNormal_2)
code_block_5 = CodeBlock(a=split_3) { a[1]; }
code_block_6 = CodeBlock(a=split_3) { a[0]; }

# group: All grids except splitting grid
select_model_elements = DSModelElementsSelection()  # 46 picked in the model

# group: Create Planes
curve_3 = Grid.Curve(grid=select_model_elements)
pointAtParameter_3 = Curve.PointAtParameter(curve=curve_3)
normalAtParameter_3 = Curve.NormalAtParameter(curve=curve_3)
byOriginNormal_3 = Plane.ByOriginNormal(origin=pointAtParameter_3, normal=normalAtParameter_3)

# group: This number is the height in z direction, and must cross the element to split
code_block_7 = CodeBlock { 100000; }

# group: Creating Surface on the grid so as to check intersection
length = Curve.Length(curve=curve_3)
byWidthLength = Rectangle.ByWidthLength(plane=byOriginNormal_3, width=code_block_7, length=length)
byPatch = Surface.ByPatch(closedCurve=byWidthLength)

# group: Planes for each piece
python_script = Python(IN[0]=code_block_3, IN[1]=byPatch, IN[2]=byOriginNormal_3)
# ---------- python_script.python (17 lines) ----------
# Load the Python Standard and DesignScript Libraries
import sys
import clr
clr.AddReference('ProtoGeometry')
from Autodesk.DesignScript.Geometry import *

# The inputs to this node will be stored as a list in the IN variables.
solid=IN[0]
surface=IN[1]
planes=IN[2]
planes1=[]
for ind, i in enumerate(surface):
	boo=solid.DoesIntersect(i)
	boo1=str(boo)
	if boo1=="True":
		planes1.append(planes[ind])
OUT=planes1		
# ----------------------------------------
python_script_2 = Python(IN[0]=code_block_4, IN[1]=byPatch, IN[2]=byOriginNormal_3)  # same code as python_script
python_script_3 = Python(IN[0]=code_block_5, IN[1]=byPatch, IN[2]=byOriginNormal_3)  # same code as python_script
python_script_4 = Python(IN[0]=code_block_6, IN[1]=byPatch, IN[2]=byOriginNormal_3)  # same code as python_script

# group: Splitting Geometry
python_script_5 = Python(IN[0]=code_block_3, IN[1]=python_script)
# ---------- python_script_5.python (33 lines) ----------
# Load the Python Standard and DesignScript Libraries
import sys
import clr
clr.AddReference('ProtoGeometry')
from Autodesk.DesignScript.Geometry import *

# The inputs to this node will be stored as a list in the IN variables.

solids=IN[0]
solid=solids
planes=IN[1]
solids=[]

for ind, i in enumerate(planes):
	sol1=Geometry.Split(solid, i)
	if len(sol1)==2 and ind<len(planes)-1:
		boo1=str(sol1[0].DoesIntersect(planes[ind+1]))
		if boo1=="True":
			solid=sol1[0]
			solids.append(sol1[1])
		else:
			solid=sol1[1]
			solids.append(sol1[0])
	else:
		solids.append(solid)
		
solids1=Geometry.Split(solids[-1], planes[-1])
if len(solids1)==2:
	solids[-1]=solids1[0]
	solids.append(solids1[1])


OUT=solids
# ----------------------------------------
python_script_6 = Python(IN[0]=code_block_4, IN[1]=python_script_2)  # same code as python_script_5
python_script_7 = Python(IN[0]=code_block_5, IN[1]=python_script_3)  # same code as python_script_5
python_script_8 = Python(IN[0]=code_block_6, IN[1]=python_script_4)
# ---------- python_script_8.python (34 lines) ----------
# Load the Python Standard and DesignScript Libraries
import sys
import clr
clr.AddReference('ProtoGeometry')
from Autodesk.DesignScript.Geometry import *

# The inputs to this node will be stored as a list in the IN variables.


solids=IN[0]
solid=solids
planes=IN[1]
solids=[]

for ind, i in enumerate(planes):
	sol1=Geometry.Split(solid, i)
	if len(sol1)==2 and ind<len(planes)-1:
		boo1=str(sol1[0].DoesIntersect(planes[ind+1]))
		if boo1=="True":
			solid=sol1[0]
			solids.append(sol1[1])
		else:
			solid=sol1[1]
			solids.append(sol1[0])
	else:
		solids.append(solid)
		
solids1=Geometry.Split(solids[-1], planes[-1])
if len(solids1)==2:
	solids[-1]=solids1[0]
	solids.append(solids1[1])


OUT=solids
# ----------------------------------------

list_create = List.Create(item0=python_script_5, item1=python_script_6, item2=python_script_7, item3=python_script_8)
flatten = List.Flatten(list=list_create)
categories = Categories("OST_GenericModel")
materials = Material("Glass")

# group: Generating names
python_script_9 = Python(IN[0]=flatten)
# ---------- python_script_9.python (52 lines) ----------
import clr #This is .NET's Common Language Runtime. It's an execution environment
#that is able to execute code from several different languages.
import sys #sys is a fundamental Python library - here, we're using it to load in
#the standard IronPython libraries
sys.path.append('C:\Program Files (x86)\IronPython 2.7\Lib') #Imports the
#standard IronPython libraries, which cover everything from servers and
#encryption through to regular expressions.
import System #The System namespace at the root of .NET
from System import Array #.NET class for handling array information
from System.Collections.Generic import * #Lets you handle generics. Revit's API
#sometimes wants hard-typed 'generic' lists, called ILists. If you don't need
#these you can delete this line.
clr.AddReference('ProtoGeometry')  #A Dynamo library for its proxy geometry
#classes. You'll only need this if you're interacting with geometry.
from Autodesk.DesignScript.Geometry import * #Loads everything in Dynamo's
#geometry library
clr.AddReference("RevitNodes") #Dynamo's nodes for Revit
import Revit #Loads in the Revit namespace in RevitNodes
clr.ImportExtensions(Revit.Elements) #More loading of Dynamo's Revit libraries
clr.ImportExtensions(Revit.GeometryConversion) #More loading of Dynamo's
#Revit libraries. You'll only need this if you're interacting with geometry.
clr.AddReference("RevitServices") #Dynamo's classes for handling Revit documents
import RevitServices 
from RevitServices.Persistence import DocumentManager #An internal Dynamo class
#that keeps track of the document that Dynamo is currently attached to
from RevitServices.Transactions import TransactionManager #A Dynamo class for
#opening and closing transactions to change the Revit document's database

clr.AddReference("RevitAPI") #Adding reference to Revit's API DLLs
clr.AddReference("RevitAPIUI") #Adding reference to Revit's API DLLs

import Autodesk #Loads the Autodesk namespace
from Autodesk.Revit.DB import * #Loading Revit's API classes
from Autodesk.Revit.UI import * #Loading Revit's API UI classes  

doc = DocumentManager.Instance.CurrentDBDocument #Finally, setting up handles to the active Revit document
uiapp = DocumentManager.Instance.CurrentUIApplication #Setting a handle to the active Revit UI document
app = uiapp.Application  #Setting a handle to the currently-open instance of the Revit application
uidoc = uiapp.ActiveUIDocument #Setting a handle to the currently-open instance of the Revit UI application

inp=[UnwrapElement(i) for i in IN[0]]


size=len(inp)

name_general="Solid"
new=[]

for i in range(size):
	name=name_general+' '+str(i+1)
	new.append(name)
OUT=new
# ----------------------------------------

byGeometry = DirectShape.ByGeometry(geometry=flatten, category=categories, material=materials, name=python_script_9)
code_block_8 = CodeBlock { "Mark"; }

# group: Volumes
volume = Solid.Volume(solid=python_script_5)
volume_2 = Solid.Volume(solid=python_script_6)
volume_3 = Solid.Volume(solid=python_script_7)
volume_4 = Solid.Volume(solid=python_script_8)

list_create_2 = List.Create(item0=volume, item1=volume_2, item2=volume_3, item3=volume_4)
flatten_2 = List.Flatten(list=list_create_2)
string_from_object = FromObject(obj=flatten_2)

# group: Setting "Mark" parameter with volumes of solids
ʳʰʸᵗʰᵐ_elements = Rhythm.Revit.Elements.Elements.SetParameterByNameTypeOrInstance(element=byGeometry, parameterName=code_block_8, value=string_from_object)

uniqueItems = List.UniqueItems(list=flatten_2)
