# Dynamo graph Final- Spliting elements horizontally.dyn "Spliting elements horizontally (1) (1)" (Dynamo 2.0.4.12684)

# group: Select the generic Model
select_model_element = DSModelElementSelection()  # 1 picked in the model
solids = Element.Solids(element=select_model_element)

flatten = List.Flatten(list=solids)
categories = Categories(index=248)
all_elements_of_category = ElementsOfCategory(Category=categories)
elevation = Level.Elevation(level=all_elements_of_category)
python_script = Python(IN[0]=elevation, IN[1]=all_elements_of_category)
# ---------- python_script.python (20 lines) ----------
# Enable Python support and load DesignScript library
import clr
clr.AddReference('ProtoGeometry')
from Autodesk.DesignScript.Geometry import *

# The inputs to this node will be stored as a list in the IN variables.
dataEnteringNode = IN

level=IN[0]

list1 = level
list2 = IN[1]
 
zipped_lists = zip(list1, list2)
sorted_pairs = sorted(zipped_lists)
 
tuples = zip(*sorted_pairs)
list1, list2 = [ list(tuple) for tuple in  tuples]

OUT= list1, list2
# ----------------------------------------
code_block = CodeBlock(a=python_script) { a[1]; }
plane = Custom[Level.Plane](level=code_block)  # Retrieves the plane of a given level
flatten_2 = List.Flatten(list=plane)

# group: Splitting Elements
python_script_2 = Python(IN[0]=flatten, IN[1]=flatten_2)
# ---------- python_script_2.python (31 lines) ----------
import clr
import sys
clr.AddReference('ProtoGeometry')
from Autodesk.DesignScript.Geometry import *


solids=IN[0]
solid=solids[0]
planes=IN[1]
solids=[]

for ind, i in enumerate(planes):
	sol1=Geometry.Split(solid, i)
	if len(sol1)==2 and ind<len(planes)-1:
		boo1=str(sol1[0].DoesIntersect(planes[ind+1]))
		if boo1=="True":
			solid=sol1[0]
			solids.append(sol1[1])
		else:
			solid=sol1[1]
			solids.append(sol1[0])
	else:
		solids.append(solid)
		
solids1=Geometry.Split(solids[-1], planes[-1])
if len(solids1)==2:
	solids.append(solids1[0])
	solids.append(solids1[1])


OUT=solids
# ----------------------------------------

categories_2 = Categories(index=276)
materials = Material(index=16)

# group: Generating names
python_script_3 = Python(IN[0]=python_script_2)
# ---------- python_script_3.python (52 lines) ----------
import clr #This is .NET's Common Language Runtime. It's an execution environment
#that is able to execute code from several different languages.
import sys #sys is a fundamental Python library - here, we're using it to load in
#the standard IronPython libraries
sys.path.append('C:\Program Files (x86)\IronPython 2.7\Lib') #Imports the
#standard IronPython libraries, which cover everything from servers and
#encryption through to regular expressions.
import System #The System namespace at the root of .NET
from System import Array #.NET class for handling array information
from System.Collections.Generic import * #Lets you handle generics. Revit's API
#sometimes wants hard-typed 'generic' lists, called ILists. If you don't need
#these you can delete this line.
clr.AddReference('ProtoGeometry')  #A Dynamo library for its proxy geometry
#classes. You'll only need this if you're interacting with geometry.
from Autodesk.DesignScript.Geometry import * #Loads everything in Dynamo's
#geometry library
clr.AddReference("RevitNodes") #Dynamo's nodes for Revit
import Revit #Loads in the Revit namespace in RevitNodes
clr.ImportExtensions(Revit.Elements) #More loading of Dynamo's Revit libraries
clr.ImportExtensions(Revit.GeometryConversion) #More loading of Dynamo's
#Revit libraries. You'll only need this if you're interacting with geometry.
clr.AddReference("RevitServices") #Dynamo's classes for handling Revit documents
import RevitServices 
from RevitServices.Persistence import DocumentManager #An internal Dynamo class
#that keeps track of the document that Dynamo is currently attached to
from RevitServices.Transactions import TransactionManager #A Dynamo class for
#opening and closing transactions to change the Revit document's database

clr.AddReference("RevitAPI") #Adding reference to Revit's API DLLs
clr.AddReference("RevitAPIUI") #Adding reference to Revit's API DLLs

import Autodesk #Loads the Autodesk namespace
from Autodesk.Revit.DB import * #Loading Revit's API classes
from Autodesk.Revit.UI import * #Loading Revit's API UI classes  

doc = DocumentManager.Instance.CurrentDBDocument #Finally, setting up handles to the active Revit document
uiapp = DocumentManager.Instance.CurrentUIApplication #Setting a handle to the active Revit UI document
app = uiapp.Application  #Setting a handle to the currently-open instance of the Revit application
uidoc = uiapp.ActiveUIDocument #Setting a handle to the currently-open instance of the Revit UI application

inp=[UnwrapElement(i) for i in IN[0]]


size=len(inp)

name_general="Solid"
new=[]

for i in range(size):
	name=name_general+' '+str(i+1)
	new.append(name)
OUT=new
# ----------------------------------------

# note: First run without connecting direct shape. Second run with directshape connected.
byGeometry = DirectShape.ByGeometry(geometry=python_script_2, category=categories_2, material=materials, name=python_script_3)
code_block_2 = CodeBlock { "Mark"; }

# group: Setting "Mark" parameter with names of solids
ʳʰʸᵗʰᵐ_elements = Rhythm.Revit.Elements.Elements.SetParameterByNameTypeOrInstance(element=byGeometry, parameterName=code_block_2, value=python_script_3)

volume = Solid.Volume(solid=python_script_2)

# group: Organising the volume and solids
python_script_4 = Python(IN[0]=python_script_2, IN[1]=volume)
# ---------- python_script_4.python (49 lines) ----------
import clr #This is .NET's Common Language Runtime. It's an execution environment
#that is able to execute code from several different languages.
import sys #sys is a fundamental Python library - here, we're using it to load in
#the standard IronPython libraries
sys.path.append('C:\Program Files (x86)\IronPython 2.7\Lib') #Imports the
#standard IronPython libraries, which cover everything from servers and
#encryption through to regular expressions.
import System #The System namespace at the root of .NET
from System import Array #.NET class for handling array information
from System.Collections.Generic import * #Lets you handle generics. Revit's API
#sometimes wants hard-typed 'generic' lists, called ILists. If you don't need
#these you can delete this line.
clr.AddReference('ProtoGeometry')  #A Dynamo library for its proxy geometry
#classes. You'll only need this if you're interacting with geometry.
from Autodesk.DesignScript.Geometry import * #Loads everything in Dynamo's
#geometry library
clr.AddReference("RevitNodes") #Dynamo's nodes for Revit
import Revit #Loads in the Revit namespace in RevitNodes
clr.ImportExtensions(Revit.Elements) #More loading of Dynamo's Revit libraries
clr.ImportExtensions(Revit.GeometryConversion) #More loading of Dynamo's
#Revit libraries. You'll only need this if you're interacting with geometry.
clr.AddReference("RevitServices") #Dynamo's classes for handling Revit documents
import RevitServices 
from RevitServices.Persistence import DocumentManager #An internal Dynamo class
#that keeps track of the document that Dynamo is currently attached to
from RevitServices.Transactions import TransactionManager #A Dynamo class for
#opening and closing transactions to change the Revit document's database

clr.AddReference("RevitAPI") #Adding reference to Revit's API DLLs
clr.AddReference("RevitAPIUI") #Adding reference to Revit's API DLLs

import Autodesk #Loads the Autodesk namespace
from Autodesk.Revit.DB import * #Loading Revit's API classes
from Autodesk.Revit.UI import * #Loading Revit's API UI classes  

doc = DocumentManager.Instance.CurrentDBDocument #Finally, setting up handles to the active Revit document
uiapp = DocumentManager.Instance.CurrentUIApplication #Setting a handle to the active Revit UI document
app = uiapp.Application  #Setting a handle to the currently-open instance of the Revit application
uidoc = uiapp.ActiveUIDocument #Setting a handle to the currently-open instance of the Revit UI application

solids=IN[0]
volumes=IN[1]
vol=[]
sol=[]
for index, volume in enumerate(volumes):
	if volume not in vol:
		vol.append(volume)
		sol.append(solids[index])
OUT= sol, vol
# ----------------------------------------

solids_2 = CodeBlock(a=python_script_4) { a[0]; }
volumes = CodeBlock(a=python_script_4) { a[1]; }

# group: Check volumes w.r.t total volumes
python_script_5 = Python(IN[0]=solids, IN[1]=volumes)
# ---------- python_script_5.python (56 lines) ----------
import clr #This is .NET's Common Language Runtime. It's an execution environment
#that is able to execute code from several different languages.
import sys #sys is a fundamental Python library - here, we're using it to load in
#the standard IronPython libraries
sys.path.append('C:\Program Files (x86)\IronPython 2.7\Lib') #Imports the
#standard IronPython libraries, which cover everything from servers and
#encryption through to regular expressions.
import System #The System namespace at the root of .NET
from System import Array #.NET class for handling array information
from System.Collections.Generic import * #Lets you handle generics. Revit's API
#sometimes wants hard-typed 'generic' lists, called ILists. If you don't need
#these you can delete this line.
clr.AddReference('ProtoGeometry')  #A Dynamo library for its proxy geometry
#classes. You'll only need this if you're interacting with geometry.
from Autodesk.DesignScript.Geometry import * #Loads everything in Dynamo's
#geometry library
clr.AddReference("RevitNodes") #Dynamo's nodes for Revit
import Revit #Loads in the Revit namespace in RevitNodes
clr.ImportExtensions(Revit.Elements) #More loading of Dynamo's Revit libraries
clr.ImportExtensions(Revit.GeometryConversion) #More loading of Dynamo's
#Revit libraries. You'll only need this if you're interacting with geometry.
clr.AddReference("RevitServices") #Dynamo's classes for handling Revit documents
import RevitServices 
from RevitServices.Persistence import DocumentManager #An internal Dynamo class
#that keeps track of the document that Dynamo is currently attached to
from RevitServices.Transactions import TransactionManager #A Dynamo class for
#opening and closing transactions to change the Revit document's database

clr.AddReference("RevitAPI") #Adding reference to Revit's API DLLs
clr.AddReference("RevitAPIUI") #Adding reference to Revit's API DLLs

import Autodesk #Loads the Autodesk namespace
from Autodesk.Revit.DB import * #Loading Revit's API classes
from Autodesk.Revit.UI import * #Loading Revit's API UI classes  

doc = DocumentManager.Instance.CurrentDBDocument #Finally, setting up handles to the active Revit document
uiapp = DocumentManager.Instance.CurrentUIApplication #Setting a handle to the active Revit UI document
app = uiapp.Application  #Setting a handle to the currently-open instance of the Revit application
uidoc = uiapp.ActiveUIDocument #Setting a handle to the currently-open instance of the Revit UI application

solid_orig=IN[0]
sol_splits=IN[1]

vol_orig=solid_orig[0].Volume
vol_splits=[]
vol=0
for i in sol_splits:
	vol=vol+i

if vol_orig==vol:
	OUT= vol, vol_orig, "Split Volume correct"
elif vol_orig>vol:
	OUT= vol, vol_orig, "Split elements volume less than original volume. Splits are not complete"
elif vol_orig<vol:
	OUT= vol, vol_orig, "Split volume more than original volume. Duplication of split volumes."
	
# ----------------------------------------

# group: Level input
select_model_elements = DSModelElementsSelection()  # 15 picked in the model

volume_2 = Solid.Volume(solid=solids)
