# Dynamo graph Spliting Circular elements.dyn (Dynamo 2.6.1.8786)
# packages: Orchid 206.3.0.7800, Rhythm 2021.4.2, spring nodes 110.0.2, MeshToolkit 3.0.0

# group: Select the generic Model
select_model_element = DSModelElementSelection()  # 1 picked in the model

# group: Converting Mesh to Solids
geometry = Element.Geometry(element=select_model_element)
toToolkitMesh = Custom[Springs.Mesh.ToToolkitMesh](mesh=geometry)  # package spring nodes; Converts a Dynamo mesh to a toolkit mesh. You obviously need to have the appropriate version of the mesh toolkit package downloaded first.
triangles = Autodesk.Dynamo.MeshToolkit.Mesh.Triangles(mesh=toToolkitMesh)
byJoinedSurfaces = Solid.ByJoinedSurfaces(facesOfSolid=triangles)

# group: Grid input
select_model_elements = DSModelElementsSelection()  # 48 picked in the model

# group: Create Planes
curve = Grid.Curve(grid=select_model_elements)
pointAtParameter = Curve.PointAtParameter(curve=curve)
normalAtParameter = Curve.NormalAtParameter(curve=curve)
byOriginNormal = Plane.ByOriginNormal(origin=pointAtParameter, normal=normalAtParameter)

code_block = CodeBlock(a=byOriginNormal) { a[0]; }
split = Geometry.Split(geometry=byJoinedSurfaces, other=code_block)
code_block_2 = CodeBlock(a=split) { a[0][0]; }

# group: Creating Surface on the grid so as to check intersection
code_block_3 = CodeBlock { 100000; }
length = Curve.Length(curve=curve)
byWidthLength = Rectangle.ByWidthLength(plane=byOriginNormal, width=code_block_3, length=length)
byPatch = Surface.ByPatch(closedCurve=byWidthLength)

doesIntersect = Geometry.DoesIntersect(geometry=code_block_2, other=byPatch, lacing=CrossProduct)
python_script = Python(IN[0]=byOriginNormal, IN[1]=doesIntersect)
# ---------- python_script.python (19 lines) ----------
# Load the Python Standard and DesignScript Libraries
import sys
import clr
clr.AddReference('ProtoGeometry')
from Autodesk.DesignScript.Geometry import *

# The inputs to this node will be stored as a list in the IN variables.
planes=IN[0]
boo=IN[1]
boo=[str(i) for i in boo]
planes_1=[]
planes_2=[]
for index, i in enumerate(boo):
	if i=="True":
		planes_1.append(planes[index])
		
	else:
		planes_2.append(planes[index])	
OUT=planes_1, planes_2
# ----------------------------------------
code_block_4 = CodeBlock(a=python_script) { a[0]; }
python_script_2 = Python(IN[0]=code_block_2, IN[1]=code_block_4)
# ---------- python_script_2.python (51 lines) ----------
# Load the Python Standard and DesignScript Libraries
import sys
import clr
clr.AddReference('ProtoGeometry')
from Autodesk.DesignScript.Geometry import *

# The inputs to this node will be stored as a list in the IN variables.

solid=IN[0]
planes=IN[1]
sol=solid
solids=[]

a=[]
# Test
# sol2=Geometry.Split(sol,planes[1])

for i in planes[1::]:
	
	sol1=Geometry.Split(sol,i)
	if len(sol1)==2:
		solids.append(sol1[1])
		sol=sol1[0]
	else:
		a=sol1[0]
		solids.append(sol)

		
		
plane_total1=planes[::-1]	

sol2=[]
sol_=solid
for p in plane_total1:
	
	srf_new=Geometry.Split(sol_,p)
#	sol2.append(srf_new)
	
	
	if len(srf_new)==2:
		sol2.append(srf_new[0])
		sol_=srf_new[1]
	
	else:
		#a=srf_new[0]
		a=srf_new[0]

solids=solids+[sol2[0]]


OUT= solids
# ----------------------------------------
code_block_5 = CodeBlock(a=split) { a[0][1]; }
code_block_6 = CodeBlock(a=python_script) { a[1]; }
python_script_3 = Python(IN[0]=code_block_5, IN[1]=code_block_6)
# ---------- python_script_3.python (49 lines) ----------
import sys
import clr
clr.AddReference('ProtoGeometry')
from Autodesk.DesignScript.Geometry import *

# The inputs to this node will be stored as a list in the IN variables.

solid=IN[0]
planes=IN[1]
sol=solid
solids=[]

a=[]
# Test
# sol2=Geometry.Split(sol,planes[1])

for i in planes:
	
	sol1=Geometry.Split(sol,i)
	if len(sol1)==2:
		solids.append(sol1[1])
		sol=sol1[0]
	else:
		a=sol1[0]
		solids.append(sol)

		
plane_total1=planes[::-1]	

sol2=[]
sol_=solid
for p in plane_total1:
	
	srf_new=Geometry.Split(sol_,p)
	solids.append(srf_new)
	
	
	if len(srf_new)==2:
		sol2.append(srf_new[0])
		sol_=srf_new[1]
	
	else:
		#a=srf_new[0]
		a=srf_new[0]
sol2=sol2+[solids[0]]



OUT=sol2
# ----------------------------------------
list_create = List.Create(item0=python_script_2, item1=python_script_3)
flatten = List.Flatten(list=list_create)
categories = Categories("OST_GenericModel")
materials = Material("Concrete, Cast In Situ")

# group: Generating names
python_script_4 = Python(IN[0]=flatten)
# ---------- python_script_4.python (52 lines) ----------
import clr #This is .NET's Common Language Runtime. It's an execution environment
#that is able to execute code from several different languages.
import sys #sys is a fundamental Python library - here, we're using it to load in
#the standard IronPython libraries
sys.path.append('C:\Program Files (x86)\IronPython 2.7\Lib') #Imports the
#standard IronPython libraries, which cover everything from servers and
#encryption through to regular expressions.
import System #The System namespace at the root of .NET
from System import Array #.NET class for handling array information
from System.Collections.Generic import * #Lets you handle generics. Revit's API
#sometimes wants hard-typed 'generic' lists, called ILists. If you don't need
#these you can delete this line.
clr.AddReference('ProtoGeometry')  #A Dynamo library for its proxy geometry
#classes. You'll only need this if you're interacting with geometry.
from Autodesk.DesignScript.Geometry import * #Loads everything in Dynamo's
#geometry library
clr.AddReference("RevitNodes") #Dynamo's nodes for Revit
import Revit #Loads in the Revit namespace in RevitNodes
clr.ImportExtensions(Revit.Elements) #More loading of Dynamo's Revit libraries
clr.ImportExtensions(Revit.GeometryConversion) #More loading of Dynamo's
#Revit libraries. You'll only need this if you're interacting with geometry.
clr.AddReference("RevitServices") #Dynamo's classes for handling Revit documents
import RevitServices 
from RevitServices.Persistence import DocumentManager #An internal Dynamo class
#that keeps track of the document that Dynamo is currently attached to
from RevitServices.Transactions import TransactionManager #A Dynamo class for
#opening and closing transactions to change the Revit document's database

clr.AddReference("RevitAPI") #Adding reference to Revit's API DLLs
clr.AddReference("RevitAPIUI") #Adding reference to Revit's API DLLs

import Autodesk #Loads the Autodesk namespace
from Autodesk.Revit.DB import * #Loading Revit's API classes
from Autodesk.Revit.UI import * #Loading Revit's API UI classes  

doc = DocumentManager.Instance.CurrentDBDocument #Finally, setting up handles to the active Revit document
uiapp = DocumentManager.Instance.CurrentUIApplication #Setting a handle to the active Revit UI document
app = uiapp.Application  #Setting a handle to the currently-open instance of the Revit application
uidoc = uiapp.ActiveUIDocument #Setting a handle to the currently-open instance of the Revit UI application

inp=[UnwrapElement(i) for i in IN[0]]


size=len(inp)

name_general="Solid"
new=[]

for i in range(size):
	name=name_general+' '+str(i+1)
	new.append(name)
OUT=new
# ----------------------------------------

# note: First run without connecting direct shape. Second run with directshape connected.
byGeometry = DirectShape.ByGeometry(geometry=flatten, category=categories, material=materials, name=python_script_4)
code_block_7 = CodeBlock { "Mark"; }
volume = Solid.Volume(solid=python_script_2)
volume_2 = Solid.Volume(solid=python_script_3)
list_create_2 = List.Create(item0=volume, item1=volume_2)
flatten_2 = List.Flatten(list=list_create_2)
string_from_object = FromObject(obj=flatten_2)

# group: Setting "Mark" parameter with volumes of solids
ʳʰʸᵗʰᵐ_elements = Rhythm.Revit.Elements.Elements.SetParameterByNameTypeOrInstance(element=byGeometry, parameterName=code_block_7, value=string_from_object)
