# Dynamo graph Spliting elements horizontally.dyn (Dynamo 2.6.1.8786)
# packages: Rhythm 2021.4.2, Orchid 206.3.0.7800, Clockwork for Dynamo 2.x 2.3.0

# group: Select the generic Model
select_model_element = DSModelElementSelection()  # 1 picked in the model
solids = Element.Solids(element=select_model_element)

flatten = List.Flatten(list=solids)
categories = Categories("OST_Levels")
all_elements_of_category = ElementsOfCategory(Category=categories)
plane = Custom[Level.Plane](level=all_elements_of_category)  # package Clockwork for Dynamo 2.x; Retrieves the plane of a given level
flatten_2 = List.Flatten(list=plane)
python_script = Python(IN[0]=flatten, IN[1]=flatten_2)
# ---------- python_script.python (26 lines) ----------
import clr
import sys
clr.AddReference('ProtoGeometry')
from Autodesk.DesignScript.Geometry import *


solids=IN[0]
solid=solids[0]
planes=IN[1]
solids=[]

for ind, i in enumerate(planes):
	sol1=Geometry.Split(solid, i)
	if len(sol1)==2 and ind<len(planes):
		boo1=str(sol1[0].DoesIntersect(planes[ind+1]))
		if boo1=="True":
			solid=sol1[0]
			solids.append(sol1[1])
		else:
			solid=sol1[1]
			solids.append(sol1[0])
	else:
		solids.append(solid)
	
	
OUT=solids
# ----------------------------------------
volume = Solid.Volume(solid=python_script)

# group: Organising the volume and solids
python_script_2 = Python(IN[0]=python_script, IN[1]=volume)  # frozen
# ---------- python_script_2.python (49 lines) ----------
import clr #This is .NET's Common Language Runtime. It's an execution environment
#that is able to execute code from several different languages.
import sys #sys is a fundamental Python library - here, we're using it to load in
#the standard IronPython libraries
sys.path.append('C:\Program Files (x86)\IronPython 2.7\Lib') #Imports the
#standard IronPython libraries, which cover everything from servers and
#encryption through to regular expressions.
import System #The System namespace at the root of .NET
from System import Array #.NET class for handling array information
from System.Collections.Generic import * #Lets you handle generics. Revit's API
#sometimes wants hard-typed 'generic' lists, called ILists. If you don't need
#these you can delete this line.
clr.AddReference('ProtoGeometry')  #A Dynamo library for its proxy geometry
#classes. You'll only need this if you're interacting with geometry.
from Autodesk.DesignScript.Geometry import * #Loads everything in Dynamo's
#geometry library
clr.AddReference("RevitNodes") #Dynamo's nodes for Revit
import Revit #Loads in the Revit namespace in RevitNodes
clr.ImportExtensions(Revit.Elements) #More loading of Dynamo's Revit libraries
clr.ImportExtensions(Revit.GeometryConversion) #More loading of Dynamo's
#Revit libraries. You'll only need this if you're interacting with geometry.
clr.AddReference("RevitServices") #Dynamo's classes for handling Revit documents
import RevitServices 
from RevitServices.Persistence import DocumentManager #An internal Dynamo class
#that keeps track of the document that Dynamo is currently attached to
from RevitServices.Transactions import TransactionManager #A Dynamo class for
#opening and closing transactions to change the Revit document's database

clr.AddReference("RevitAPI") #Adding reference to Revit's API DLLs
clr.AddReference("RevitAPIUI") #Adding reference to Revit's API DLLs

import Autodesk #Loads the Autodesk namespace
from Autodesk.Revit.DB import * #Loading Revit's API classes
from Autodesk.Revit.UI import * #Loading Revit's API UI classes  

doc = DocumentManager.Instance.CurrentDBDocument #Finally, setting up handles to the active Revit document
uiapp = DocumentManager.Instance.CurrentUIApplication #Setting a handle to the active Revit UI document
app = uiapp.Application  #Setting a handle to the currently-open instance of the Revit application
uidoc = uiapp.ActiveUIDocument #Setting a handle to the currently-open instance of the Revit UI application

solids=IN[0]
volumes=IN[1]
vol=[]
sol=[]
for index, volume in enumerate(volumes):
	if volume not in vol:
		vol.append(volume)
		sol.append(solids[index])
OUT= sol, vol
# ----------------------------------------

solids_2 = CodeBlock(a=python_script_2) { a[0]; }
categories_2 = Categories("OST_Mass")
materials = Material("Default Mass Zone")

# group: Generating names
python_script_3 = Python(IN[0]=python_script)
# ---------- python_script_3.python (52 lines) ----------
import clr #This is .NET's Common Language Runtime. It's an execution environment
#that is able to execute code from several different languages.
import sys #sys is a fundamental Python library - here, we're using it to load in
#the standard IronPython libraries
sys.path.append('C:\Program Files (x86)\IronPython 2.7\Lib') #Imports the
#standard IronPython libraries, which cover everything from servers and
#encryption through to regular expressions.
import System #The System namespace at the root of .NET
from System import Array #.NET class for handling array information
from System.Collections.Generic import * #Lets you handle generics. Revit's API
#sometimes wants hard-typed 'generic' lists, called ILists. If you don't need
#these you can delete this line.
clr.AddReference('ProtoGeometry')  #A Dynamo library for its proxy geometry
#classes. You'll only need this if you're interacting with geometry.
from Autodesk.DesignScript.Geometry import * #Loads everything in Dynamo's
#geometry library
clr.AddReference("RevitNodes") #Dynamo's nodes for Revit
import Revit #Loads in the Revit namespace in RevitNodes
clr.ImportExtensions(Revit.Elements) #More loading of Dynamo's Revit libraries
clr.ImportExtensions(Revit.GeometryConversion) #More loading of Dynamo's
#Revit libraries. You'll only need this if you're interacting with geometry.
clr.AddReference("RevitServices") #Dynamo's classes for handling Revit documents
import RevitServices 
from RevitServices.Persistence import DocumentManager #An internal Dynamo class
#that keeps track of the document that Dynamo is currently attached to
from RevitServices.Transactions import TransactionManager #A Dynamo class for
#opening and closing transactions to change the Revit document's database

clr.AddReference("RevitAPI") #Adding reference to Revit's API DLLs
clr.AddReference("RevitAPIUI") #Adding reference to Revit's API DLLs

import Autodesk #Loads the Autodesk namespace
from Autodesk.Revit.DB import * #Loading Revit's API classes
from Autodesk.Revit.UI import * #Loading Revit's API UI classes  

doc = DocumentManager.Instance.CurrentDBDocument #Finally, setting up handles to the active Revit document
uiapp = DocumentManager.Instance.CurrentUIApplication #Setting a handle to the active Revit UI document
app = uiapp.Application  #Setting a handle to the currently-open instance of the Revit application
uidoc = uiapp.ActiveUIDocument #Setting a handle to the currently-open instance of the Revit UI application

inp=[UnwrapElement(i) for i in IN[0]]


size=len(inp)

name_general="Solid"
new=[]

for i in range(size):
	name=name_general+' '+str(i+1)
	new.append(name)
OUT=new
# ----------------------------------------

# note: First run without connecting direct shape. Second run with directshape connected.
byGeometry = DirectShape.ByGeometry(geometry=solids_2, category=categories_2, material=materials, name=python_script_3)
code_block = CodeBlock { "Mark"; }

# group: Setting "Mark" parameter with names of solids
ʳʰʸᵗʰᵐ_elements = Rhythm.Revit.Elements.Elements.SetParameterByNameTypeOrInstance(element=byGeometry, parameterName=code_block, value=python_script_3)

volumes = CodeBlock(a=python_script_2) { a[1]; }

# group: Check volumes w.r.t total volumes
python_script_4 = Python(IN[0]=solids, IN[1]=volumes)
# ---------- python_script_4.python (56 lines) ----------
import clr #This is .NET's Common Language Runtime. It's an execution environment
#that is able to execute code from several different languages.
import sys #sys is a fundamental Python library - here, we're using it to load in
#the standard IronPython libraries
sys.path.append('C:\Program Files (x86)\IronPython 2.7\Lib') #Imports the
#standard IronPython libraries, which cover everything from servers and
#encryption through to regular expressions.
import System #The System namespace at the root of .NET
from System import Array #.NET class for handling array information
from System.Collections.Generic import * #Lets you handle generics. Revit's API
#sometimes wants hard-typed 'generic' lists, called ILists. If you don't need
#these you can delete this line.
clr.AddReference('ProtoGeometry')  #A Dynamo library for its proxy geometry
#classes. You'll only need this if you're interacting with geometry.
from Autodesk.DesignScript.Geometry import * #Loads everything in Dynamo's
#geometry library
clr.AddReference("RevitNodes") #Dynamo's nodes for Revit
import Revit #Loads in the Revit namespace in RevitNodes
clr.ImportExtensions(Revit.Elements) #More loading of Dynamo's Revit libraries
clr.ImportExtensions(Revit.GeometryConversion) #More loading of Dynamo's
#Revit libraries. You'll only need this if you're interacting with geometry.
clr.AddReference("RevitServices") #Dynamo's classes for handling Revit documents
import RevitServices 
from RevitServices.Persistence import DocumentManager #An internal Dynamo class
#that keeps track of the document that Dynamo is currently attached to
from RevitServices.Transactions import TransactionManager #A Dynamo class for
#opening and closing transactions to change the Revit document's database

clr.AddReference("RevitAPI") #Adding reference to Revit's API DLLs
clr.AddReference("RevitAPIUI") #Adding reference to Revit's API DLLs

import Autodesk #Loads the Autodesk namespace
from Autodesk.Revit.DB import * #Loading Revit's API classes
from Autodesk.Revit.UI import * #Loading Revit's API UI classes  

doc = DocumentManager.Instance.CurrentDBDocument #Finally, setting up handles to the active Revit document
uiapp = DocumentManager.Instance.CurrentUIApplication #Setting a handle to the active Revit UI document
app = uiapp.Application  #Setting a handle to the currently-open instance of the Revit application
uidoc = uiapp.ActiveUIDocument #Setting a handle to the currently-open instance of the Revit UI application

solid_orig=IN[0]
sol_splits=IN[1]

vol_orig=solid_orig[0].Volume
vol_splits=[]
vol=0
for i in sol_splits:
	vol=vol+i

if vol_orig==vol:
	OUT= vol, vol_orig, "Split Volume correct"
elif vol_orig>vol:
	OUT= vol, vol_orig, "Split elements volume less than original volume. Splits are not complete"
elif vol_orig<vol:
	OUT= vol, vol_orig, "Split volume more than original volume. Duplication of split volumes."
	
# ----------------------------------------

# group: Level input
select_model_elements = DSModelElementsSelection()  # 15 picked in the model

volume_2 = Solid.Volume(solid=solids)
