# Dynamo graph Splitting Elements.dyn "SPLITS" (Dynamo 2.6.1.8786)
# packages: Clockwork for Dynamo 2.x 2.3.0

select_model_element = DSModelElementSelection()  # 1 picked in the model
solids = Element.Solids(element=select_model_element)
select_model_elements = DSModelElementsSelection()  # 68 picked in the model
code_block = CodeBlock(a=select_model_elements) { a[19..67]; }
curve = Grid.Curve(grid=code_block)
pointAtParameter = Curve.PointAtParameter(curve=curve)
normalAtParameter = Curve.NormalAtParameter(curve=curve)
byOriginNormal = Plane.ByOriginNormal(origin=pointAtParameter, normal=normalAtParameter)
python_script = Python(IN[0]=solids, IN[1]=byOriginNormal)
# ---------- python_script.python (35 lines) ----------
import clr
import sys
clr.AddReference('ProtoGeometry')
from Autodesk.DesignScript.Geometry import *


solid_total=IN[0]
plane_total=IN[1]
srf=Geometry.Split(solid_total[0], plane_total[0])

l=len(plane_total)

plane1=plane_total[1:int(l/2)+1]
plane2=plane_total[int(l/2)+1::]

srf1=srf[0]
srf2=srf[1]	
sol=[]
for p in plane1:
	
	
	srf_new=Geometry.Split(srf1,p)
	v1=srf_new[0].Volume
	v2=srf_new[1].Volume
	
	if v1>v2:
		sol.append(srf_new[1])
		srf1=srf_new[0]
	else:
		sol.append(srf_new[0])
		srf1=srf_new[1]
	


OUT=sol
# ----------------------------------------
volume = Solid.Volume(solid=python_script)
python_script_2 = Python(IN[0]=solids, IN[1]=byOriginNormal)
# ---------- python_script_2.python (34 lines) ----------
import clr
import sys
clr.AddReference('ProtoGeometry')
from Autodesk.DesignScript.Geometry import *


solid_total=IN[0]
plane_total=IN[1]
srf=Geometry.Split(solid_total[0], plane_total[0])

l=len(plane_total)

plane1=plane_total[1:int(l/2)+1]
plane2=plane_total[int(l/2)+1::]

srf1=srf[0]
srf2=srf[1]	
sol=[]
for p in plane1:
	srf_new=Geometry.Split(srf2,p)
	v1=srf_new[0].Volume
	v2=srf_new[1].Volume
	
	if v1>v2:
		sol.append(srf_new[1])
		srf2=srf_new[0]
	else:
		sol.append(srf_new[0])
		srf2=srf_new[1]




OUT=sol
# ----------------------------------------
list_create = List.Create(item0=python_script, item1=python_script_2)
flatten = List.Flatten(list=list_create)
categories = Categories("OST_Mass")
name = Custom[Element.Name+](element=select_model_elements)  # package Clockwork for Dynamo 2.x; Gets an element's name. Unlike the OOTB node, this node should work for all Revit elements that have names and will also return the localized names of system parameters, parameter groups, display unit types, parameter types, unit symbol types and unit types.
code_block_2 = CodeBlock(a=name) { a[19..67]; }
byGeometry = DirectShape.ByGeometry(geometry=flatten, category=categories, name=code_block_2)
volume_2 = Solid.Volume(solid=python_script_2)
