# Dynamo graph 4. Void Cut using centroid of element.dyn "Void Cut using centroid of element" (Dynamo 2.6.1.8786)
# packages: Genius Loci 2021.4.13, Rhythm 2021.4.2, spring nodes 110.0.2, Clockwork for Dynamo 2.x 2.3.0

code_block = CodeBlock { "aa"; }

# group: Select walls
select_model_elements = DSModelElementsSelection()  # 12 picked in the model

geometry = Element.Geometry(element=select_model_elements)
flatten = List.Flatten(list=geometry)

# group: Select Windows
select_model_elements_2 = DSModelElementsSelection()  # 6 picked in the model

geometry_2 = Element.Geometry(element=select_model_elements_2)
centroid = Solid.Centroid(solid=geometry_2)
python_script = Python(IN[0]=centroid)
# ---------- python_script.python (16 lines) ----------
# Load the Python Standard and DesignScript Libraries
import sys
import clr
clr.AddReference('ProtoGeometry')
from Autodesk.DesignScript.Geometry import *

pts=IN[0]

def elem(n):
	return n[1]
	
result=list(map(elem, pts))
# Place your code below this line

# Assign your output to the OUT variable.
OUT = result
# ----------------------------------------
code_block_2 = CodeBlock { "Width"; }
ʳʰʸᵗʰᵐ_elements = Rhythm.Revit.Elements.Elements.GetParameterValueByNameTypeOrInstance(element=select_model_elements_2, parameterName=code_block_2)
code_block_3 = CodeBlock { 5000; }
code_block_4 = CodeBlock { "Height"; }
ʳʰʸᵗʰᵐ_elements_2 = Rhythm.Revit.Elements.Elements.GetParameterValueByNameTypeOrInstance(element=select_model_elements_2, parameterName=code_block_4)
byLengths = Cuboid.ByLengths(origin=python_script, width=ʳʰʸᵗʰᵐ_elements, length=code_block_3, height=ʳʰʸᵗʰᵐ_elements_2)
ZAxis = Vector.ZAxis()
element_getrotation = Custom[Element GetRotation](element=select_model_elements_2)  # package Genius Loci; Calculates the rotation angle between the given element and the X axis. Works for point/ line/ sketch based elements and link instances.
code_block_5 = CodeBlock(a=element_getrotation) { angle=a-180; }
rotate = Geometry.Rotate(geometry=byLengths, origin=python_script, axis=ZAxis, degrees=code_block_5)
element_host = Custom[Element Host](element=select_model_elements_2)  # package Genius Loci; Gets the host of the element. Unlike the OOTB node FamilyInstance.GetHost, it also works for elements hosted by a linked document, wall sweeps, foundations, railings and builing pads. Based on a Clockwork's node
code_block_6 = CodeBlock { "Width"; }
ʳʰʸᵗʰᵐ_elements_3 = Rhythm.Revit.Elements.Elements.GetParameterValueByNameTypeOrInstance(element=element_host, parameterName=code_block_6)
byLengths_2 = Cuboid.ByLengths(origin=python_script, width=ʳʰʸᵗʰᵐ_elements, length=ʳʰʸᵗʰᵐ_elements_3, height=ʳʰʸᵗʰᵐ_elements_2)
rotate_2 = Geometry.Rotate(geometry=byLengths_2, origin=python_script, axis=ZAxis, degrees=code_block_5)
difference = Solid.Difference(solid=rotate, other=rotate_2)
python_script_2 = Python(IN[0]=flatten, IN[1]=difference)
# ---------- python_script_2.python (30 lines) ----------
# Load the Python Standard and DesignScript Libraries
import sys
import clr
clr.AddReference('ProtoGeometry')
from Autodesk.DesignScript.Geometry import *

# The inputs to this node will be stored as a list in the IN variables

walls=IN[0]
voids=IN[1]


voids_1=[]
walls_1=[]


	
for ind1, i in enumerate(voids):
	index1=[]
	for ind, j in enumerate(walls):
		bool1 = j.DoesIntersect(i)	
		bool2 = str(bool1)
		if bool2 == "True" :
			index1.append(ind)
			voids_1.append(ind1)
	walls_1.append(index1)

voids_1=set(voids_1)

OUT = voids_1, walls_1
# ----------------------------------------
code_block_7 = CodeBlock(a=python_script_2) { a[1]; }
getItemAtIndex = List.GetItemAtIndex(list=select_model_elements, index=code_block_7)
file_path = Filename("..\..\..\..\..\..\..\ProgramData\Autodesk\RVT 2021\Family Templates\English\Metric Generic Model.rft")

# group: Family Name
python_script_3 = Python(IN[0]=difference)
# ---------- python_script_3.python (18 lines) ----------
# Load the Python Standard and DesignScript Libraries
import sys
import clr
clr.AddReference('ProtoGeometry')
from Autodesk.DesignScript.Geometry import *

# The inputs to this node will be stored as a list in the IN variables.
sol=IN[0]
l=0
if isinstance(sol, list):
	l=len(sol)
else:
	l=1

names=['solid'+str(i) for i in range(l)]

# Assign your output to the OUT variable.
OUT = names
# ----------------------------------------

categories = Categories("OST_GenericModel")
boolean = BoolSelector(true)
byGeometry = Custom[Springs.FamilyInstance.ByGeometry](geometry=difference, familyTemplatePath=file_path, familyName=python_script_3, category=categories, isVoid=boolean)  # package spring nodes; You must provide a valid family template path that will be used for all input geometry objects. The project units(and not the templates) will be used to determine the size of the output geometry. The provided category will be used only if the family template supports it. If not, the default template category will be used instead. Likewise, the family material(provided as a string) will be set only if a material with that name exists in the template. If not, the default material will be used instead ("By Category"). For void cuts, the material settings will be ignored. The Subcategory name is an optional input. If you'd like to skip assigning a Subcategory to any new instance, simply use null. The node expects a unique family name for each geometry object. The rest of the input lists will be processed as if the node lacing is set to longest.
cutGeometry = Custom[Element.CutGeometry](elementToBeCut=getItemAtIndex@L2, cuttingElement=byGeometry.instance, lacing=CrossProduct)  # package Clockwork for Dynamo 2.x; Adds a solid-solid cut for two model elements (if possible).
code_block_8 = CodeBlock(a=python_script_2) { a[0]; }
