# Dynamo graph 5.0 Void Cut_with multiple windows.dyn "Void Cut_with multiple windows" (Dynamo 2.6.1.8786)
# packages: Rhythm 2021.4.2, Genius Loci 2021.4.13, spring nodes 110.0.2, Orchid 206.3.0.7800, Clockwork for Dynamo 2.x 2.3.0

# group: Select Windows
select_model_elements = DSModelElementsSelection()  # 7 picked in the model

element_host = Custom[Element Host](element=select_model_elements)  # package Genius Loci; Gets the host of the element. Unlike the OOTB node FamilyInstance.GetHost, it also works for elements hosted by a linked document, wall sweeps, foundations, railings and builing pads. Based on a Clockwork's node
code_block = CodeBlock { "Width"; }
ʳʰʸᵗʰᵐ_elements = Rhythm.Revit.Elements.Elements.GetParameterValueByNameTypeOrInstance(element=element_host, parameterName=code_block)

# group: Select walls
select_model_elements_2 = DSModelElementsSelection()  # 10 picked in the model

id = Element.Id(element=select_model_elements_2)
id_2 = Element.Id(element=element_host)
python_script = Python(IN[0]=id, IN[1]=id_2)
# ---------- python_script.python (19 lines) ----------
# Load the Python Standard and DesignScript Libraries
import sys
import clr
clr.AddReference('ProtoGeometry')
from Autodesk.DesignScript.Geometry import *

# The inputs to this node will be stored as a list in the IN variables.
total=IN[0]
host=IN[1]

indexes=[]
for ind, i in enumerate(total):
	if i not in host:
		indexes.append(ind)

# Place your code below this line

# Assign your output to the OUT variable.
OUT = indexes
# ----------------------------------------
getItemAtIndex = List.GetItemAtIndex(list=select_model_elements_2, index=python_script)
faces = Element.Faces(element=getItemAtIndex)
clean = Orchid.Common.List.Clean(list=faces)

# group: Getting the longest surface
python_script_2 = Python(IN[0]=clean)
# ---------- python_script_2.python (19 lines) ----------
# Load the Python Standard and DesignScript Libraries
import sys
import clr
clr.AddReference('ProtoGeometry')
from Autodesk.DesignScript.Geometry import *

# The inputs to this node will be stored as a list in the IN variables.

surfaces=[]
others=[]
for i in IN[0]:
	for ind, j in enumerate(i):
		if ind==0:
			surfaces.append(j)
		else:
			others.append(j)
		

OUT = surfaces
# ----------------------------------------

boundingBox = Element.BoundingBox(element=select_model_elements)
toCuboid = BoundingBox.ToCuboid(boundingBox=boundingBox)
centroid = Solid.Centroid(solid=toCuboid)
X = Point.X(point=centroid)
Y = Point.Y(point=centroid)
Z = Point.Z(point=centroid)
code_block_2 = CodeBlock { "FIn height"; }
ʳʰʸᵗʰᵐ_elements_2 = Rhythm.Revit.Elements.Elements.GetParameterValueByNameTypeOrInstance(element=select_model_elements, parameterName=code_block_2)
new_z = Python(IN[0]=Z, IN[1]=ʳʰʸᵗʰᵐ_elements_2)
# ---------- new_z.python (18 lines) ----------
# Load the Python Standard and DesignScript Libraries
import sys
import clr
clr.AddReference('ProtoGeometry')
from Autodesk.DesignScript.Geometry import *

centroid_h=IN[0]
fin_h=IN[1]

centroid_new=[]

for ind, i in enumerate(centroid_h):
	if type(fin_h[ind])==float:
		centroid_new.append((2*i+float(fin_h[ind]))/2)
	else:
		centroid_new.append(i)

OUT= centroid_new
# ----------------------------------------
byCoordinates = Point.ByCoordinates(x=X, y=Y, z=new_z)
code_block_3 = CodeBlock { "Width"; }
ʳʰʸᵗʰᵐ_elements_3 = Rhythm.Revit.Elements.Elements.GetParameterValueByNameTypeOrInstance(element=select_model_elements, parameterName=code_block_3)
code_block_4 = CodeBlock { 5000; }
code_block_5 = CodeBlock { "Height"; }
ʳʰʸᵗʰᵐ_elements_4 = Rhythm.Revit.Elements.Elements.GetParameterValueByNameTypeOrInstance(element=select_model_elements, parameterName=code_block_5)
byLengths = Cuboid.ByLengths(origin=byCoordinates, width=ʳʰʸᵗʰᵐ_elements_3, length=code_block_4, height=ʳʰʸᵗʰᵐ_elements_4)
ZAxis = Vector.ZAxis()
element_getrotation = Custom[Element GetRotation](element=select_model_elements)  # package Genius Loci; Calculates the rotation angle between the given element and the X axis. Works for point/ line/ sketch based elements and link instances.
code_block_6 = CodeBlock(a=element_getrotation) { angle=a-180; }
rotate = Geometry.Rotate(geometry=byLengths, origin=centroid, axis=ZAxis, degrees=code_block_6)
vertices = Topology.Vertices(topology=rotate)
pointGeometry = Vertex.PointGeometry(vertex=vertices)
python_script_3 = Python(IN[0]=pointGeometry)
# ---------- python_script_3.python (16 lines) ----------
# Load the Python Standard and DesignScript Libraries
import sys
import clr
clr.AddReference('ProtoGeometry')
from Autodesk.DesignScript.Geometry import *

# The inputs to this node will be stored as a list in the IN variables.
pnts=IN[0]

def loc(n):
	return [n[5], n[6]]


result=list(map(loc,pnts))

OUT = result
# ----------------------------------------
X_2 = Point.X(point=python_script_3)
new_x = Python(IN[0]=X_2)
# ---------- new_x.python (14 lines) ----------
# Load the Python Standard and DesignScript Libraries
import sys
import clr
clr.AddReference('ProtoGeometry')
from Autodesk.DesignScript.Geometry import *

# The inputs to this node will be stored as a list in the IN variables.
y=IN[0]

def av(n):
	return (n[0])

result= list(map(av,y))
OUT = result
# ----------------------------------------
Y_2 = Point.Y(point=python_script_3)
new_y = Python(IN[0]=Y_2)
# ---------- new_y.python (14 lines) ----------
# Load the Python Standard and DesignScript Libraries
import sys
import clr
clr.AddReference('ProtoGeometry')
from Autodesk.DesignScript.Geometry import *

# The inputs to this node will be stored as a list in the IN variables.
y=IN[0]

def av(n):
	return (n[0]+n[1])/2

result= list(map(av,y))
OUT = result
# ----------------------------------------
Z_2 = Point.Z(point=python_script_3)
new_z_2 = Python(IN[0]=Z_2)
# ---------- new_z_2.python (14 lines) ----------
# Load the Python Standard and DesignScript Libraries
import sys
import clr
clr.AddReference('ProtoGeometry')
from Autodesk.DesignScript.Geometry import *

# The inputs to this node will be stored as a list in the IN variables.
y=IN[0]

def av(n):
	return n[0]

result= list(map(av,y))
OUT = result
# ----------------------------------------
byCoordinates_2 = Point.ByCoordinates(x=new_x, y=new_y, z=new_z_2)
python_script_4 = Python(IN[0]=pointGeometry)
# ---------- python_script_4.python (16 lines) ----------
# Load the Python Standard and DesignScript Libraries
import sys
import clr
clr.AddReference('ProtoGeometry')
from Autodesk.DesignScript.Geometry import *

# The inputs to this node will be stored as a list in the IN variables.
pnts=IN[0]

def loc(n):
	return [n[4], n[7]]


result=list(map(loc,pnts))

OUT = result
# ----------------------------------------
X_3 = Point.X(point=python_script_4)
new_x_2 = Python(IN[0]=X_3)  # same code as new_x
Y_3 = Point.Y(point=python_script_4)
new_y_2 = Python(IN[0]=Y_3)  # same code as new_y
Z_3 = Point.Z(point=python_script_4)
new_z_3 = Python(IN[0]=Z_3)  # same code as new_z_2
byCoordinates_3 = Point.ByCoordinates(x=new_x_2, y=new_y_2, z=new_z_3)
byStartPointEndPoint = Line.ByStartPointEndPoint(startPoint=byCoordinates_2, endPoint=byCoordinates_3)

# group: Intersection point
python_script_5 = Python(IN[0]=python_script_2, IN[1]=byStartPointEndPoint)
# ---------- python_script_5.python (26 lines) ----------
# Load the Python Standard and DesignScript Libraries
import sys
import clr
clr.AddReference('ProtoGeometry')
from Autodesk.DesignScript.Geometry import *

# The inputs to this node will be stored as a list in the IN variables.
surfaces=IN[0]
line=IN[1]
points=[]
index_l=[]
index_w=[]
for ind, i in enumerate(surfaces):
	index_w1=[]
	for ind1, j in enumerate(line):
		boo1=str(j.DoesIntersect(i))
		if boo1=="True":
			index_w.append(ind)	
			pt=j.Intersect(i)
			points.append(pt)
	#index_w.append(set(index_w1))
		
# Place your code below this line

# Assign your output to the OUT variable.
OUT = points, index_w
# ----------------------------------------

code_block_7 = CodeBlock(a=python_script_5) { a[1]; }
getItemAtIndex_2 = List.GetItemAtIndex(list=getItemAtIndex, index=code_block_7)
flatten = List.Flatten(list=getItemAtIndex_2)
family_types = FamilyTypes("Rough Openings:Rough Openings")
code_block_8 = CodeBlock(a=python_script_5) { a[0]; }
flatten_2 = List.Flatten(list=code_block_8)
byPoints = Custom[Springs.HostedInstance.ByPoints](host=flatten, type=family_types, point=flatten_2)  # package spring nodes; Creates hosted family instances(doors/windows) at the specified points. You can feed either a single family type or a unique type for each instance.
cutGeometry = Custom[Element.CutGeometry](elementToBeCut=flatten, cuttingElement=byPoints)  # package Clockwork for Dynamo 2.x; Adds a solid-solid cut for two model elements (if possible).
