# Dynamo graph 5.1 Void Cut_with multiple windows1.dyn "Void Cut_with multiple windows1" (Dynamo 2.6.1.8786)
# packages: Rhythm 2021.4.2, Genius Loci 2021.4.13, spring nodes 110.0.2, Clockwork for Dynamo 2.x 2.3.0, Orchid 206.3.0.7800, WombatDynamo 1.3.2

# group: Select Windows
select_model_elements = DSModelElementsSelection()  # 15 picked in the model

element_host = Custom[Element Host](element=select_model_elements)  # package Genius Loci; Gets the host of the element. Unlike the OOTB node FamilyInstance.GetHost, it also works for elements hosted by a linked document, wall sweeps, foundations, railings and builing pads. Based on a Clockwork's node
code_block = CodeBlock { "Width"; }
ʳʰʸᵗʰᵐ_elements = Rhythm.Revit.Elements.Elements.GetParameterValueByNameTypeOrInstance(element=element_host, parameterName=code_block)

# group: Select walls
select_model_elements_2 = DSModelElementsSelection()  # 170 picked in the model

id = Element.Id(element=select_model_elements_2)
id_2 = Element.Id(element=element_host)
python_script = Python(IN[0]=id, IN[1]=id_2)
# ---------- python_script.python (19 lines) ----------
# Load the Python Standard and DesignScript Libraries
import sys
import clr
clr.AddReference('ProtoGeometry')
from Autodesk.DesignScript.Geometry import *

# The inputs to this node will be stored as a list in the IN variables.
total=IN[0]
host=IN[1]

indexes=[]
for ind, i in enumerate(total):
	if i not in host:
		indexes.append(ind)

# Place your code below this line

# Assign your output to the OUT variable.
OUT = indexes
# ----------------------------------------
getItemAtIndex = List.GetItemAtIndex(list=select_model_elements_2, index=python_script)
faces = Element.Faces(element=getItemAtIndex)

# group: Getting the longest surface
python_script_2 = Python(IN[0]=faces)
# ---------- python_script_2.python (23 lines) ----------
# Load the Python Standard and DesignScript Libraries
import sys
import clr
clr.AddReference('ProtoGeometry')
from Autodesk.DesignScript.Geometry import *

# The inputs to this node will be stored as a list in the IN variables.

surfaces=[]
others=[]
index=[]
for ind, i in enumerate(IN[0]):
	if i!=[] and i!=None and type(i)==list:
		for ind1, j in enumerate(i):
			if ind1==0:
				surfaces.append(j)
				index.append(ind)
			else:
				others.append(j)
	else:	
		surfaces.append('')	

OUT = surfaces
# ----------------------------------------

solids = Element.Solids(element=select_model_elements)
clean = List.Clean(list=solids)
centroid = Solid.Centroid(solid=clean)
volume = Solid.Volume(solid=clean)
python_script_3 = Python(IN[0]=centroid, IN[1]=volume)
# ---------- python_script_3.python (23 lines) ----------
# Load the Python Standard and DesignScript Libraries
import sys
import clr
clr.AddReference('ProtoGeometry')
from Autodesk.DesignScript.Geometry import *

# The inputs to this node will be stored as a list in the IN variables.
cen=IN[0]
vol=IN[1]

cen1=[]
index1=[]
for ind, i in enumerate(vol):
	cen_ind=[]
	cen_list=cen[ind]
	if i!=[]:	
		index1.append(ind)
		cen_val=max(i)
		ind_val=i.index(cen_val)
		cen_ind.append(cen_list[ind_val])
	cen1.append(cen_ind)

OUT= cen1,index1
# ----------------------------------------
code_block_2 = CodeBlock(a=python_script_3) { a[0]; }
clean_2 = Orchid.Common.List.Clean(list=code_block_2)
flatten = List.Flatten(list=clean_2)
X = Point.X(point=flatten)
Y = Point.Y(point=flatten)
Z = Point.Z(point=flatten)
byCoordinates = Point.ByCoordinates(x=X, y=Y, z=Z)
code_block_3 = CodeBlock(a=python_script_3) { a[1]; }
getItemAtIndex_2 = List.GetItemAtIndex(list=select_model_elements, index=code_block_3)
code_block_4 = CodeBlock { "Width"; }
ʳʰʸᵗʰᵐ_elements_2 = Rhythm.Revit.Elements.Elements.GetParameterValueByNameTypeOrInstance(element=getItemAtIndex_2, parameterName=code_block_4)

# group: Should not match with width or height
code_block_5 = CodeBlock { 3000; }

code_block_6 = CodeBlock { "Height"; }
ʳʰʸᵗʰᵐ_elements_3 = Rhythm.Revit.Elements.Elements.GetParameterValueByNameTypeOrInstance(element=getItemAtIndex_2, parameterName=code_block_6)
byLengths = Cuboid.ByLengths(origin=byCoordinates, width=ʳʰʸᵗʰᵐ_elements_2, length=code_block_5, height=ʳʰʸᵗʰᵐ_elements_3)
ZAxis = Vector.ZAxis()
getItemAtIndex_3 = List.GetItemAtIndex(list=select_model_elements, index=code_block_3)
element_getrotation = Custom[Element GetRotation](element=getItemAtIndex_3)  # package Genius Loci; Calculates the rotation angle between the given element and the X axis. Works for point/ line/ sketch based elements and link instances.
code_block_7 = CodeBlock(a=element_getrotation) { angle=a-180; }
rotate = Geometry.Rotate(geometry=byLengths, origin=byCoordinates, axis=ZAxis, degrees=code_block_7)
edges = Topology.Edges(topology=rotate)
curveGeometry = Edge.CurveGeometry(edge=edges)
length = Curve.Length(curve=curveGeometry)
startVertex = Edge.StartVertex(edge=edges)
pointGeometry = Vertex.PointGeometry(vertex=startVertex)
Z_2 = Point.Z(point=pointGeometry)
python_script_4 = Python(IN[0]=length, IN[1]=code_block_5, IN[2]=Z_2, IN[3]=edges)
# ---------- python_script_4.python (39 lines) ----------
# Load the Python Standard and DesignScript Libraries
import sys
import clr
clr.AddReference('ProtoGeometry')
from Autodesk.DesignScript.Geometry import *

# The inputs to this node will be stored as a list in the IN variables.

edge_len=IN[0]
edge_len_constraint=IN[1]
point_z=IN[2]
edges=IN[3]

index=[]
pts_1=[]
for ind, i in enumerate(edge_len):
	index_sub=[]	
	pts=point_z[ind]
	pt_min=round(min(pts))
	pts_1.append(int(pt_min))
	points=[]
	for ind1, j in enumerate(i):
		x=round(pts[ind1])		
		y=round(j)
		if y==edge_len_constraint:
			if x==pt_min:
				index_sub.append(ind1)
	index.append(index_sub)

edge=[]
for ind, i in enumerate(edges):
	x=index[ind]
	edge_sub=[]
	for  ind1, j in enumerate(i):
		if ind1 in x:
			edge_sub.append(j)
	edge.append(edge_sub)			
	
OUT=edge
# ----------------------------------------
startVertex_2 = Edge.StartVertex(edge=python_script_4)
pointGeometry_2 = Vertex.PointGeometry(vertex=startVertex_2)
X_2 = Point.X(point=pointGeometry_2)
endVertex = Edge.EndVertex(edge=python_script_4)
pointGeometry_3 = Vertex.PointGeometry(vertex=endVertex)
X_3 = Point.X(point=pointGeometry_3)
Y_2 = Point.Y(point=pointGeometry_2)

# group: Line 1 Start x
python_script_5 = Python(IN[0]=X_2)
# ---------- python_script_5.python (16 lines) ----------
# Load the Python Standard and DesignScript Libraries
import sys
import clr
clr.AddReference('ProtoGeometry')
from Autodesk.DesignScript.Geometry import *

# The inputs to this node will be stored as a list in the IN variables.
pnts=IN[0]

def loc(n):
	return n[0]


result=list(map(loc,pnts))

OUT = result
# ----------------------------------------
python_script_6 = Python(IN[0]=Y_2)  # same code as python_script_5

Y_3 = Point.Y(point=pointGeometry_3)

# group: Line 2 End
python_script_7 = Python(IN[0]=X_3)
# ---------- python_script_7.python (16 lines) ----------
# Load the Python Standard and DesignScript Libraries
import sys
import clr
clr.AddReference('ProtoGeometry')
from Autodesk.DesignScript.Geometry import *

# The inputs to this node will be stored as a list in the IN variables.
pnts=IN[0]

def loc(n):
	return n[1]


result=list(map(loc,pnts))

OUT = result
# ----------------------------------------
python_script_8 = Python(IN[0]=Y_3)  # same code as python_script_7

# group: x point- start
python_script_9 = Python(IN[0]=python_script_5, IN[1]=python_script_7)
# ---------- python_script_9.python (12 lines) ----------
# Load the Python Standard and DesignScript Libraries
import sys
import clr
clr.AddReference('ProtoGeometry')
from Autodesk.DesignScript.Geometry import *

# The inputs to this node will be stored as a list in the IN variables.
pt1=IN[0]
pt2=IN[1]

av= list(map(lambda x,y: (x+y)/2, pt1, pt2))
OUT=av
# ----------------------------------------

# group: y poiint start
python_script_10 = Python(IN[0]=python_script_6, IN[1]=python_script_8)  # same code as python_script_9

Z_3 = Point.Z(point=pointGeometry_2)

# group: Z Coordinate
python_script_11 = Python(IN[0]=Z_3)
# ---------- python_script_11.python (9 lines) ----------
# Load the Python Standard and DesignScript Libraries
import sys
import clr
clr.AddReference('ProtoGeometry')
from Autodesk.DesignScript.Geometry import *

pts=IN[0]

OUT=list(map(lambda x: x[0], pts))
# ----------------------------------------

byCoordinates_2 = Point.ByCoordinates(x=python_script_9, y=python_script_10, z=python_script_11)

# group: Line 2 Start
python_script_12 = Python(IN[0]=X_2)  # same code as python_script_7
python_script_13 = Python(IN[0]=Y_2)  # same code as python_script_7

# group: Line 1 end
python_script_14 = Python(IN[0]=X_3)  # same code as python_script_5
python_script_15 = Python(IN[0]=Y_3)  # same code as python_script_5

# group: x point end
python_script_16 = Python(IN[0]=python_script_12, IN[1]=python_script_14)  # same code as python_script_9

# group: y point end
python_script_17 = Python(IN[0]=python_script_13, IN[1]=python_script_15)  # same code as python_script_9

byCoordinates_3 = Point.ByCoordinates(x=python_script_16, y=python_script_17, z=python_script_11)
byStartPointEndPoint = Line.ByStartPointEndPoint(startPoint=byCoordinates_2, endPoint=byCoordinates_3)

# group: Intersection point
python_script_18 = Python(IN[0]=python_script_2, IN[1]=byStartPointEndPoint)
# ---------- python_script_18.python (27 lines) ----------
# Load the Python Standard and DesignScript Libraries
import sys
import clr
clr.AddReference('ProtoGeometry')
from Autodesk.DesignScript.Geometry import *

# The inputs to this node will be stored as a list in the IN variables.
surfaces=IN[0]
line=IN[1]
points=[]
index_l=[]
index_w=[]

for ind, i in enumerate(surfaces):
	index_w1=[]
	pts=[]
	if i!='':
		for ind1, j in enumerate(line):
			if j!='':
				boo1=str(j.DoesIntersect(i))
				if boo1=="True":
					index_w.append(ind)	
					pt=j.Intersect(i)
					points.append(pt)
	
		
OUT = points, index_w
# ----------------------------------------

code_block_8 = CodeBlock(a=python_script_18) { a[1]; }
getItemAtIndex_4 = List.GetItemAtIndex(list=getItemAtIndex, index=code_block_8)
flatten_2 = List.Flatten(list=getItemAtIndex_4)
family_types = FamilyTypes("Rough Openings:Rough Openings")
code_block_9 = CodeBlock(a=python_script_18) { a[0]; }
flatten_3 = List.Flatten(list=code_block_9)
byPoints = Custom[Springs.HostedInstance.ByPoints](host=flatten_2, type=family_types, point=flatten_3)  # package spring nodes; Creates hosted family instances(doors/windows) at the specified points. You can feed either a single family type or a unique type for each instance.
cutGeometry = Custom[Element.CutGeometry](elementToBeCut=flatten_2, cuttingElement=byPoints)  # package Clockwork for Dynamo 2.x; Adds a solid-solid cut for two model elements (if possible).
categories = Categories("OST_Walls")
all_elements_of_category = ElementsOfCategory(Category=categories)
element_level = Custom[Element Level](element=select_model_elements)  # package Genius Loci; Gets an element's level. Based on a Clockwork's node
level = Custom[Element.Level](element=flatten_2)  # package Clockwork for Dynamo 2.x; Gets an element's level
byPointHostTypeAndLevel = WombatDynamo.FamilyInstance.ByPointHostTypeAndLevel(location=flatten_3, host=flatten_2, familyType=family_types, level=level)
