# Dynamo graph 5.4 Final - Void Cut_with multiple windows with Linked Data  (1).dyn "5.4 Final - Void Cut_with multiple windows with Linked Data (1)" (Dynamo 2.5.0.7460)
# packages: bimorphNodes 3.0.3, archi-lab.net 2021.25.2721, Genius Loci 2021.5.18, Orchid 203.3.0.7815, Rhythm 2020.1.22, spring nodes 204.1.0, Clockwork for Dynamo 2.x 2.3.0

# group: Window Parameters
code_block = CodeBlock { "Width"; }
code_block_2 = CodeBlock { "Height"; }

# group: All walls are required as there is no check with linked files
categories = Categories("OST_Walls")
all_elements_of_category = ElementsOfCategory(Category=categories)

solids = Element.Solids(element=all_elements_of_category)

# group: Linked File Data
getDocuments = archilab.Revit.Selection.Select.GetDocuments()
categories_2 = Categories("OST_Windows")
ofCategory = Revit.LinkElement.OfCategory(linkInstance=getDocuments.Link_Instance, Category=categories_2)

code_block_3 = CodeBlock(a=ofCategory) { a[7][0..10]; }
solids_2 = Revit.LinkElement.Solids(linkElement=code_block_3)

# group: Windows centroids and solids
centroid = Solid.Centroid(solid=solids_2)
volume = Solid.Volume(solid=solids_2)

python_script = Python(IN[0]=centroid, IN[1]=volume)
# ---------- python_script.python (24 lines) ----------
# Load the Python Standard and DesignScript Libraries
import sys
import clr
clr.AddReference('ProtoGeometry')
from Autodesk.DesignScript.Geometry import *

# The inputs to this node will be stored as a list in the IN variables.
cen=IN[0]
vol=IN[1]

cen1=[]
index1=[]
for ind, i in enumerate(vol):
	
	
	if i!=[] and i!=None and type(i)==list:	
		index1.append(ind)
		cen_list=cen[ind]		
		cen_val=max(i)
		ind_val=i.index(cen_val)
		cen1.append(cen_list[ind_val])
		#cen1.append(cen_ind)

OUT= cen1,index1
# ----------------------------------------
code_block_4 = CodeBlock(a=python_script) { a[0]; }
# note: Custom Node: Orchid v. 206.3.0.7800
clean = Orchid.Common.List.Clean(list=code_block_4)
flatten = List.Flatten(list=clean)
X = Point.X(point=flatten)
Y = Point.Y(point=flatten)
Z = Point.Z(point=flatten)
byCoordinates = Point.ByCoordinates(x=X, y=Y, z=Z)
element = Revit.LinkElement.Element(linkElement=code_block_3)
code_block_5 = CodeBlock(a=python_script) { a[1]; }
getItemAtIndex = List.GetItemAtIndex(list=element, index=code_block_5)
code_block_6 = CodeBlock { "AZA_Foro muratura interna Larghezza"; }
# note: Custom Node: Rhythm v.2021.4.2
ʳʰʸᵗʰᵐ_elements = Rhythm.Revit.Elements.Elements.GetParameterValueByNameTypeOrInstance(element=getItemAtIndex, parameterName=code_block_6)

# group: Should not match with width or height
code_block_7 = CodeBlock { 2000; }

code_block_8 = CodeBlock { "AZA_Foro muratura interna Altezza"; }
ʳʰʸᵗʰᵐ_elements_2 = Rhythm.Revit.Elements.Elements.GetParameterValueByNameTypeOrInstance(element=getItemAtIndex, parameterName=code_block_8)
byLengths = Cuboid.ByLengths(origin=byCoordinates, width=ʳʰʸᵗʰᵐ_elements, length=code_block_7, height=ʳʰʸᵗʰᵐ_elements_2)
ZAxis = Vector.ZAxis()
getItemAtIndex_2 = List.GetItemAtIndex(list=element, index=code_block_5)
# note: Custom Node: GeniusLoci v.2021.4.13
element_getrotation = Custom[Element GetRotation](element=getItemAtIndex_2)  # package Genius Loci; Calculates the rotation angle between the given element and the X axis. Works for point/ line/ sketch based elements and link instances.
code_block_9 = CodeBlock(a=element_getrotation) { angle=a-180; }
rotate = Geometry.Rotate(geometry=byLengths, origin=byCoordinates, axis=ZAxis, degrees=code_block_9)
clean_2 = Orchid.Common.List.Clean(list=rotate)
python_script_2 = Python(IN[0]=solids, IN[1]=clean_2)
# ---------- python_script_2.python (23 lines) ----------
# Load the Python Standard and DesignScript Libraries
import sys
import clr
clr.AddReference('ProtoGeometry')
from Autodesk.DesignScript.Geometry import *

# The inputs to this node will be stored as a list in the IN variables.
wall=IN[0]
cuboid=IN[1]
index=[]

for ind, i in enumerate(cuboid):
	sub=[]
	for ind1, j in enumerate(wall):
		if j!=[] and j!=None and j!='':
			boo=str(Geometry.DoesIntersect(i,j[0]))
			if boo=="True":
				sub.append(ind1)
	index.append(sub)

			
					
OUT=index
# ----------------------------------------
getItemAtIndex_3 = List.GetItemAtIndex(list=all_elements_of_category, index=python_script_2)
flatten_2 = List.Flatten(list=getItemAtIndex_3)

# group: JUST TO GET THE SUFACES OF THE AREA
faces = Element.Faces(element=flatten_2)

area = Surface.Area(surface=faces)

# group: Getting the longest surface
python_script_3 = Python(IN[0]=faces, IN[1]=area)
# ---------- python_script_3.python (23 lines) ----------
# Load the Python Standard and DesignScript Libraries
import sys
import clr
clr.AddReference('ProtoGeometry')
from Autodesk.DesignScript.Geometry import *

# The inputs to this node will be stored as a list in the IN variables.

surfaces=[]
others=[]
index=[]
for ind, i in enumerate(IN[0]):
	
	if i!=[] and i!=None and type(i)==list:
		areas=IN[1][ind]
		area=max(areas)
		others.append(area)
		ind1=areas.index(area)
		surfaces.append(i[ind1])
	else:	
		surfaces.append('')	

OUT = surfaces
# ----------------------------------------

edges = Topology.Edges(topology=clean_2)
curveGeometry = Edge.CurveGeometry(edge=edges)
length = Curve.Length(curve=curveGeometry)
startVertex = Edge.StartVertex(edge=edges)
pointGeometry = Vertex.PointGeometry(vertex=startVertex)
Z_2 = Point.Z(point=pointGeometry)

# group: To get the two base lines of the cuboid
python_script_4 = Python(IN[0]=length, IN[1]=code_block_7, IN[2]=Z_2, IN[3]=edges)
# ---------- python_script_4.python (41 lines) ----------
# Load the Python Standard and DesignScript Libraries
import sys
import clr
clr.AddReference('ProtoGeometry')
from Autodesk.DesignScript.Geometry import *

# The inputs to this node will be stored as a list in the IN variables.

edge_len=IN[0]
edge_len_constraint=IN[1]
point_z=IN[2]
edges=IN[3]

index=[]
pts_1=[]
for ind, i in enumerate(edge_len):
	index_sub=[]	
	pts=point_z[ind]
	if pts!=[] and pts!=None and type(pts)==list:
		pt_min=round(min(pts))
		pts_1.append(int(pt_min))
	points=[]
	if i!=None and type(i)==list:
		for ind1, j in enumerate(i):
			x=round(pts[ind1])		
			y=round(j)
			if y==edge_len_constraint:
				if x==pt_min:
					index_sub.append(ind1)
		index.append(index_sub)

edge=[]
for ind, i in enumerate(edges):
	x=index[ind]
	edge_sub=[]
	for  ind1, j in enumerate(i):
		if ind1 in x:
			edge_sub.append(j)
	edge.append(edge_sub)			
	
OUT=edge
# ----------------------------------------

startVertex_2 = Edge.StartVertex(edge=python_script_4)
pointGeometry_2 = Vertex.PointGeometry(vertex=startVertex_2)
X_2 = Point.X(point=pointGeometry_2)
endVertex = Edge.EndVertex(edge=python_script_4)
pointGeometry_3 = Vertex.PointGeometry(vertex=endVertex)
X_3 = Point.X(point=pointGeometry_3)
Y_2 = Point.Y(point=pointGeometry_2)

# group: Line 1 Start x
python_script_5 = Python(IN[0]=X_2)
# ---------- python_script_5.python (16 lines) ----------
# Load the Python Standard and DesignScript Libraries
import sys
import clr
clr.AddReference('ProtoGeometry')
from Autodesk.DesignScript.Geometry import *

# The inputs to this node will be stored as a list in the IN variables.
pnts=IN[0]

def loc(n):
	return n[0]


result=list(map(loc,pnts))

OUT = result
# ----------------------------------------
python_script_6 = Python(IN[0]=Y_2)  # same code as python_script_5

Y_3 = Point.Y(point=pointGeometry_3)

# group: Line 2 End
python_script_7 = Python(IN[0]=X_3)
# ---------- python_script_7.python (16 lines) ----------
# Load the Python Standard and DesignScript Libraries
import sys
import clr
clr.AddReference('ProtoGeometry')
from Autodesk.DesignScript.Geometry import *

# The inputs to this node will be stored as a list in the IN variables.
pnts=IN[0]

def loc(n):
	return n[1]


result=list(map(loc,pnts))

OUT = result
# ----------------------------------------
python_script_8 = Python(IN[0]=Y_3)  # same code as python_script_7

# group: x point- start
python_script_9 = Python(IN[0]=python_script_5, IN[1]=python_script_7)
# ---------- python_script_9.python (12 lines) ----------
# Load the Python Standard and DesignScript Libraries
import sys
import clr
clr.AddReference('ProtoGeometry')
from Autodesk.DesignScript.Geometry import *

# The inputs to this node will be stored as a list in the IN variables.
pt1=IN[0]
pt2=IN[1]

av= list(map(lambda x,y: (x+y)/2, pt1, pt2))
OUT=av
# ----------------------------------------

# group: y poiint start
python_script_10 = Python(IN[0]=python_script_6, IN[1]=python_script_8)  # same code as python_script_9

Z_3 = Point.Z(point=pointGeometry_2)

# group: Z Coordinate
python_script_11 = Python(IN[0]=Z_3)
# ---------- python_script_11.python (9 lines) ----------
# Load the Python Standard and DesignScript Libraries
import sys
import clr
clr.AddReference('ProtoGeometry')
from Autodesk.DesignScript.Geometry import *

pts=IN[0]

OUT=list(map(lambda x: x[0], pts))
# ----------------------------------------

byCoordinates_2 = Point.ByCoordinates(x=python_script_9, y=python_script_10, z=python_script_11)

# group: Line 2 Start
python_script_12 = Python(IN[0]=X_2)  # same code as python_script_7
python_script_13 = Python(IN[0]=Y_2)  # same code as python_script_7

# group: Line 1 end
python_script_14 = Python(IN[0]=X_3)  # same code as python_script_5
python_script_15 = Python(IN[0]=Y_3)  # same code as python_script_5

# group: x point end
python_script_16 = Python(IN[0]=python_script_12, IN[1]=python_script_14)  # same code as python_script_9

# group: y point end
python_script_17 = Python(IN[0]=python_script_13, IN[1]=python_script_15)  # same code as python_script_9

byCoordinates_3 = Point.ByCoordinates(x=python_script_16, y=python_script_17, z=python_script_11)

# group: LINE PASSING THROUGH THE MIDDLE OF WINDOW AT THE BASE
byStartPointEndPoint = Line.ByStartPointEndPoint(startPoint=byCoordinates_2, endPoint=byCoordinates_3)

# group: Intersection point
python_script_18 = Python(IN[0]=python_script_3, IN[1]=byStartPointEndPoint)
# ---------- python_script_18.python (29 lines) ----------
# Load the Python Standard and DesignScript Libraries
import sys
import clr
clr.AddReference('ProtoGeometry')
from Autodesk.DesignScript.Geometry import *

# The inputs to this node will be stored as a list in the IN variables.
surfaces=IN[0]
line=IN[1]
points=[]
index_l=[]
index_w=[]

for ind, i in enumerate(surfaces):
	index_w1=[]
	pts=[]
	index_l1=[]
	if i!='':
		for ind1, j in enumerate(line):
			if j!='':
				boo1=str(j.DoesIntersect(i))
				if boo1=="True":
					index_w.append(ind)	
					pt=j.Intersect(i)
					points.append(pt)
					index_l.append(ind1)
	
		
OUT = points, index_w, index_l
# ----------------------------------------

# group: Elements at intersection
code_block_10 = CodeBlock(a=python_script_18) { a[1]; }

getItemAtIndex_4 = List.GetItemAtIndex(list=flatten_2, index=code_block_10)
flatten_3 = List.Flatten(list=getItemAtIndex_4)
id = Element.Id(element=flatten_3)
id_2 = Element.Id(element=getItemAtIndex_3@L2)
python_script_19 = Python(IN[0]=id, IN[1]=id_2)
# ---------- python_script_19.python (29 lines) ----------
# Load the Python Standard and DesignScript Libraries
import sys
import clr
clr.AddReference('ProtoGeometry')
from Autodesk.DesignScript.Geometry import *

# The inputs to this node will be stored as a list in the IN variables.
walls1=[str(i) for i in IN[0]]
int_walls=[str(i) for i in IN[1]]

walls=[]
index=[]
index2=[]
for ind, i in enumerate(int_walls):
	sub_w=[]
	sub_i=[]
	sub_i2=[]
	for ind1, j in enumerate(walls1):
		if j in i:
			sub_w.append(j)
			sub_i.append(ind1)
		
	walls.append(sub_w)
	index.append(sub_i)

for i in index:
	index2.append(i[0])

OUT= index, index2				
# ----------------------------------------
code_block_11 = CodeBlock(a=python_script_19) { a[0]; }
getItemAtIndex_5 = List.GetItemAtIndex(list=flatten_3, index=code_block_11)
flatten_4 = List.Flatten(list=getItemAtIndex_5)
code_block_12 = CodeBlock(a=python_script_19) { a[1]; }
flatten_5 = List.Flatten(list=code_block_12)
getItemAtIndex_6 = List.GetItemAtIndex(list=flatten_3, index=flatten_5)

# group: INPUT
family_types = FamilyTypes("3IM_DYN_void Cut:Rough Openings")

# group: Intersection Points
code_block_13 = CodeBlock(a=python_script_18) { a[0]; }

flatten_6 = List.Flatten(list=code_block_13)
getItemAtIndex_7 = List.GetItemAtIndex(list=flatten_6, index=flatten_5)
byPoints = Custom[Springs.HostedInstance.ByPoints](host=getItemAtIndex_6, type=family_types, point=getItemAtIndex_7)  # package spring nodes; Creates hosted family instances(doors/windows) at the specified points. You can feed either a single family type or a unique type for each instance.

# group: Void Parameters
code_block_14 = CodeBlock { "Width"; }
code_block_15 = CodeBlock { "Height"; }

code_block_16 = CodeBlock(a=python_script_18) { a[2]; }
getItemAtIndex_8 = List.GetItemAtIndex(list=getItemAtIndex_2, index=code_block_16)
code_block_17 = CodeBlock { "AZA_Foro muratura interna Larghezza"; }
ʳʰʸᵗʰᵐ_elements_3 = Rhythm.Revit.Elements.Elements.GetParameterValueByNameTypeOrInstance(element=getItemAtIndex_8, parameterName=code_block_17)
ʳʰʸᵗʰᵐ_elements_4 = Rhythm.Revit.Elements.Elements.SetParameterByNameTypeOrInstance(element=byPoints, parameterName=code_block_14, value=ʳʰʸᵗʰᵐ_elements_3)
code_block_18 = CodeBlock { "AZA_Foro muratura interna Altezza"; }
ʳʰʸᵗʰᵐ_elements_5 = Rhythm.Revit.Elements.Elements.GetParameterValueByNameTypeOrInstance(element=getItemAtIndex_8, parameterName=code_block_18)
ʳʰʸᵗʰᵐ_elements_6 = Rhythm.Revit.Elements.Elements.SetParameterByNameTypeOrInstance(element=ʳʰʸᵗʰᵐ_elements_4, parameterName=code_block_15, value=ʳʰʸᵗʰᵐ_elements_5)
python_script_20 = Python(IN[0]=getItemAtIndex_5, IN[1]=ʳʰʸᵗʰᵐ_elements_6)
# ---------- python_script_20.python (16 lines) ----------
# Load the Python Standard and DesignScript Libraries
import sys
import clr
clr.AddReference('ProtoGeometry')
from Autodesk.DesignScript.Geometry import *

# The inputs to this node will be stored as a list in the IN variables.
walls=IN[0]
voids=IN[1]
voids_new=[]
for ind, i in enumerate(walls):
	sub=[]
	for ind1,j in enumerate(i):
		sub.append(voids[ind])
	voids_new.append(sub)
OUT=voids_new
# ----------------------------------------
flatten_7 = List.Flatten(list=python_script_20)
cutGeometry = Custom[Element.CutGeometry](elementToBeCut=flatten_4, cuttingElement=flatten_7)  # package Clockwork for Dynamo 2.x; Adds a solid-solid cut for two model elements (if possible).
python_script_21 = Python(IN[0]=getItemAtIndex_5, IN[1]=ʳʰʸᵗʰᵐ_elements_6)  # frozen
# ---------- python_script_21.python (32 lines) ----------
import clr
clr.AddReference('RevitAPI')
from Autodesk.Revit.DB import *
from System.Collections.Generic import *
clr.AddReference("RevitServices")
import RevitServices
from RevitServices.Persistence import DocumentManager
from RevitServices.Transactions import TransactionManager

doc = DocumentManager.Instance.CurrentDBDocument
items1 = UnwrapElement(IN[0])
items2 = UnwrapElement(IN[1])

def CutGeometry(doc, item1, item2):
	try:
		SolidSolidCutUtils.AddCutBetweenSolids(doc,item1,item2)
		return True
	except:
		try:
			InstanceVoidCutUtils.AddInstanceVoidCut(doc,item1,item2)
			return True
		except: return False

TransactionManager.Instance.EnsureInTransaction(doc)


if isinstance(IN[0], list):
	for ind, i in enumerate(IN[0]):
		OUT=CutGeometry(doc,i,IN[1][ind])


TransactionManager.Instance.TransactionTaskDone()
# ----------------------------------------
