# Dynamo graph 5.7 Final - Void Cut_with multiple windows with Linked Data  (1).dyn "5.7 Final - Void Cut_with multiple windows with Linked Data (1)" (Dynamo 2.5.0.7460)
# packages: bimorphNodes 3.0.3, archi-lab.net 2021.25.2721, Rhythm 2020.1.22, spring nodes 204.1.0, Clockwork for Dynamo 2.x 2.3.0, Genius Loci 2021.5.18, Sastrugi 2.0.0

# group: Window Parameters
code_block = CodeBlock { "Width"; }
code_block_2 = CodeBlock { "Height"; }

# group: Linked File Data
getDocuments = archilab.Revit.Selection.Select.GetDocuments()
categories = Categories("OST_Windows")
ofCategory = Revit.LinkElement.OfCategory(linkInstance=getDocuments.Link_Instance, Category=categories)

code_block_3 = CodeBlock(a=ofCategory) { a[8][0..78]; }
location = Custom[Element.Location+](element=code_block_3)  # package Clockwork for Dynamo 2.x; Returns the location of an element as point, curve or curve loop, along with some booleans to help filtering the results. Unlike the OOTB Element.GetLocation node, it also retunrs sketch lines of sketch-based elements like floor slabs as well as the element's rotation property.
X = Point.X(point=location.points)
Y = Point.Y(point=location.points)
Z = Point.Z(point=location.points)
element = Revit.LinkElement.Element(linkElement=code_block_3)
code_block_4 = CodeBlock { "AZA_Foro muratura interna Altezza"; }
# note: Custom Node: Rhythm v.2021.4.2
ʳʰʸᵗʰᵐ_elements = Rhythm.Revit.Elements.Elements.GetParameterValueByNameTypeOrInstance(element=element, parameterName=code_block_4)
half_height = Python(IN[0]=ʳʰʸᵗʰᵐ_elements)
# ---------- half_height.python (8 lines) ----------
# Load the Python Standard and DesignScript Libraries
import sys
import clr
clr.AddReference('ProtoGeometry')
from Autodesk.DesignScript.Geometry import *

# The inputs to this node will be stored as a list in the IN variables.
OUT=[i/2 for i in IN[0]]
# ----------------------------------------
new_z = CodeBlock(z1=Z, half_height=half_height) { z=z1+half_height; }
origin_cuboids = Point.ByCoordinates(x=X, y=Y, z=new_z)
code_block_5 = CodeBlock { "AZA_Foro muratura interna Larghezza"; }
ʳʰʸᵗʰᵐ_elements_2 = Rhythm.Revit.Elements.Elements.GetParameterValueByNameTypeOrInstance(element=element, parameterName=code_block_5)
code_block_6 = CodeBlock { 1000; }
byLengths = Cuboid.ByLengths(origin=origin_cuboids, width=ʳʰʸᵗʰᵐ_elements_2, length=code_block_6, height=ʳʰʸᵗʰᵐ_elements)
ZAxis = Vector.ZAxis()
element_getrotation = Custom[Element GetRotation](element=element)  # package Genius Loci; Calculates the rotation angle between the given element and the X axis. Works for point/ line/ sketch based elements and link instances.
code_block_7 = CodeBlock(a=element_getrotation) { angle=a-180; }
rotate = Geometry.Rotate(geometry=byLengths, origin=origin_cuboids, axis=ZAxis, degrees=code_block_7)

# group: All walls are required as there is no check with linked files
categories_2 = Categories("OST_Walls")
all_elements_of_category = ElementsOfCategory(Category=categories_2)

intersectsSolid = Revit.Element.IntersectsSolid(solids=rotate, elements=all_elements_of_category)
code_block_8 = CodeBlock(a=intersectsSolid.Element) { a; }

# group: JUST TO GET THE SUFACES OF THE AREA
faces = Element.Faces(element=intersectsSolid.Element)

area = Surface.Area(surface=faces)

# group: Getting the longest surface
python_script = Python(IN[0]=faces, IN[1]=area)
# ---------- python_script.python (29 lines) ----------
# Load the Python Standard and DesignScript Libraries
import sys
import clr
clr.AddReference('ProtoGeometry')
from Autodesk.DesignScript.Geometry import *

# The inputs to this node will be stored as a list in the IN variables.

surfaces=[]
others=[]
index=[]
for ind, i in enumerate(IN[0]):
	sub=[]
	if i!=[] and i!=None and type(i)==list:
		sub_areas=IN[1][ind]
	
		for ind1, j in enumerate(i):
			areas=sub_areas[ind1]
			if type(areas)==list and areas!=[]:
				area=max(areas)
				
				ind2=areas.index(area)
				sub.append(j[ind2])
			else:
				sub.append('')
	else:	
		sub.append('')	
	surfaces.append(sub)
OUT = surfaces
# ----------------------------------------

faces_2 = Topology.Faces(topology=rotate)
surfaceGeometry = Face.SurfaceGeometry(face=faces_2)
python_script_2 = Python(IN[0]=surfaceGeometry)
# ---------- python_script_2.python (8 lines) ----------
# Load the Python Standard and DesignScript Libraries
import sys
import clr
clr.AddReference('ProtoGeometry')
from Autodesk.DesignScript.Geometry import *

# The inputs to this node will be stored as a list in the IN variables.
OUT=[i[4] for i in IN[0]]
# ----------------------------------------
surface_plane = Custom[❄_Surface Plane](InputSurfaces=python_script_2)  # package Sastrugi; (Sastrugi_Geometry) This node will extract a plane that best fits a surface.
normal = Plane.Normal(plane=surface_plane)
code_block_9 = CodeBlock { 1000; }
byStartPointDirectionLength = Line.ByStartPointDirectionLength(startPoint=origin_cuboids, direction=normal, length=code_block_9)
code_block_10 = CodeBlock { 2000; }
extendStart = Curve.ExtendStart(curve=byStartPointDirectionLength, distance=code_block_10)
extendEnd = Curve.ExtendEnd(curve=extendStart, distance=code_block_10)
flatten = List.Flatten(list=extendEnd)

# group: Intersection point
python_script_3 = Python(IN[0]=python_script, IN[1]=flatten)
# ---------- python_script_3.python (34 lines) ----------
# Load the Python Standard and DesignScript Libraries
import sys
import clr
clr.AddReference('ProtoGeometry')
from Autodesk.DesignScript.Geometry import *

# The inputs to this node will be stored as a list in the IN variables.
surfaces1=IN[0]
line=IN[1]
points=[]
index_l=[]
index_w=[]

for ind, i in enumerate(line):
	index_w1=[]
	pts=[]
	index_l1=[]
	surfaces=surfaces1[ind]
	if i!='':
		for ind1, j in enumerate(surfaces):
			if j!='':
				boo1=str(j.DoesIntersect(i))
				if boo1=="True":
					index_l1.append(ind)	
					pt=j.Intersect(i)
					pts.append(pt)
					index_w1.append(ind1)
					
					
		index_l.append(index_l1)
		points.append(pts)
		index_w.append(index_w1)
		
OUT = points, index_w, index_l
# ----------------------------------------

# group: Elements at intersection
code_block_11 = CodeBlock(a=python_script_3) { a[1]; }

python_script_4 = Python(IN[0]=code_block_8, IN[1]=code_block_11)
# ---------- python_script_4.python (20 lines) ----------
# Load the Python Standard and DesignScript Libraries
import sys
import clr
clr.AddReference('ProtoGeometry')
from Autodesk.DesignScript.Geometry import *

# The inputs to this node will be stored as a list in the IN variables.
index=IN[1]
elements=IN[0]
elem=[]
for ind, i in enumerate(index):
	element_sub=elements[ind]
	sub=[]
	for ind1, j in enumerate(i):
		s=element_sub[j]
		sub.append(s)
	elem.append(sub)


OUT=elem
# ----------------------------------------
flatten_2 = List.Flatten(list=python_script_4)
python_script_5 = Python(IN[0]=python_script_4)
# ---------- python_script_5.python (15 lines) ----------
# Load the Python Standard and DesignScript Libraries
import sys
import clr
clr.AddReference('ProtoGeometry')
from Autodesk.DesignScript.Geometry import *

# The inputs to this node will be stored as a list in the IN variables.
points1=IN[0]
points=[]
for j in points1:
	if j!=[] and j!="" and j!=None and len(j)>2:
		points.append(j[1])
	if j!=[] and j!="" and j!=None and len(j)==1:
		points.append(j[0])
OUT=points
# ----------------------------------------

# group: INPUT
family_types = FamilyTypes("3IM_DYN_void Cut:Rough Openings")

# group: Intersection Points
code_block_12 = CodeBlock(a=python_script_3) { a[0]; }

X_2 = Point.X(point=code_block_12)
Y_2 = Point.Y(point=code_block_12)
byCoordinates = Point.ByCoordinates(x=X_2, y=Y_2, z=Z)
python_script_6 = Python(IN[0]=byCoordinates)
# ---------- python_script_6.python (13 lines) ----------
# Load the Python Standard and DesignScript Libraries
import sys
import clr
clr.AddReference('ProtoGeometry')
from Autodesk.DesignScript.Geometry import *

# The inputs to this node will be stored as a list in the IN variables.
points1=IN[0]
points=[]
for j in points1:
	if j!=[] and j!="" and j!=None:
		points.append(j[0])
OUT=points
# ----------------------------------------
flatten_3 = List.Flatten(list=python_script_6)
byPoints = Custom[Springs.HostedInstance.ByPoints](host=python_script_5, type=family_types, point=flatten_3)  # package spring nodes; Creates hosted family instances(doors/windows) at the specified points. You can feed either a single family type or a unique type for each instance.

# group: Void Parameters
code_block_13 = CodeBlock { "Width"; }
code_block_14 = CodeBlock { "Height"; }

code_block_15 = CodeBlock { "AZA_Foro muratura interna Larghezza"; }
ʳʰʸᵗʰᵐ_elements_3 = Rhythm.Revit.Elements.Elements.GetParameterValueByNameTypeOrInstance(element=element, parameterName=code_block_15)
ʳʰʸᵗʰᵐ_elements_4 = Rhythm.Revit.Elements.Elements.SetParameterByNameTypeOrInstance(element=byPoints, parameterName=code_block_13, value=ʳʰʸᵗʰᵐ_elements_3)
code_block_16 = CodeBlock { "AZA_Foro muratura interna Altezza"; }
ʳʰʸᵗʰᵐ_elements_5 = Rhythm.Revit.Elements.Elements.GetParameterValueByNameTypeOrInstance(element=element, parameterName=code_block_16)
ʳʰʸᵗʰᵐ_elements_6 = Rhythm.Revit.Elements.Elements.SetParameterByNameTypeOrInstance(element=ʳʰʸᵗʰᵐ_elements_4, parameterName=code_block_14, value=ʳʰʸᵗʰᵐ_elements_5)
python_script_7 = Python(IN[0]=python_script_4, IN[1]=ʳʰʸᵗʰᵐ_elements_6)
# ---------- python_script_7.python (16 lines) ----------
# Load the Python Standard and DesignScript Libraries
import sys
import clr
clr.AddReference('ProtoGeometry')
from Autodesk.DesignScript.Geometry import *

# The inputs to this node will be stored as a list in the IN variables.
walls=IN[0]
voids=IN[1]
voids_new=[]
for ind, i in enumerate(walls):
	sub=[]
	for ind1,j in enumerate(i):
		sub.append(voids[ind])
	voids_new.append(sub)
OUT=voids_new
# ----------------------------------------
flatten_4 = List.Flatten(list=python_script_7)
cutGeometry = Custom[Element.CutGeometry](elementToBeCut=flatten_2, cuttingElement=flatten_4)  # package Clockwork for Dynamo 2.x; Adds a solid-solid cut for two model elements (if possible).
reverse = Vector.Reverse(vector=normal)
code_block_17 = CodeBlock(a=python_script_3) { a[2]; }
