# Dynamo graph 2.0 Plcing layers on a flat floor.dyn (Dynamo 2.6.1.8786)
# packages: archi-lab.net 2021.25.2621, Clockwork for Dynamo 2.x 2.3.0, Orchid 206.3.0.7800

# group: Floor to layer
categories = Categories("OST_FloorTags")
all_elements_of_category = ElementsOfCategory(Category=categories)

tag_host_element = Custom[Tag Host Element](tag=all_elements_of_category)  # frozen; package archi-lab.net; This node will retrieve an element that is hosting a given tag.

# group: Layer 1
geometry = Element.Geometry(element=tag_host_element)
ZAxis = Vector.ZAxis()
code_block = CodeBlock { "Thickness"; }
getParameterValueByName = Element.GetParameterValueByName(element=tag_host_element, parameterName=code_block)
translate = Geometry.Translate(geometry=geometry, direction=ZAxis, distance=getParameterValueByName)
categories_2 = Categories("OST_Floors")
materials = Custom[Element.Materials+](element=tag_host_element)  # package Clockwork for Dynamo 2.x; Retrieves all materials from a given element. Unlike the OOTB node Element.GetMaterials, it also retrieves QTO information.
code_block_2 = CodeBlock(a=materials.materials) { a[0]; }
python_script = Python(IN[0]=tag_host_element)
# ---------- python_script.python (8 lines) ----------
# Load the Python Standard and DesignScript Libraries
import sys
import clr
clr.AddReference('ProtoGeometry')
from Autodesk.DesignScript.Geometry import *

# The inputs to this node will be stored as a list in the IN variables.
OUT= ['Layer1'+str((ind+1)) for ind, i in enumerate(IN[0]) ]
# ----------------------------------------
byGeometry = DirectShape.ByGeometry(geometry=translate, category=categories_2, material=code_block_2, name=python_script)

# group: Base Floor Top Vertices (Please Keep the base Floor Flat)
tag_host_element_2 = Custom[Tag Host Element](tag=all_elements_of_category)
solids = Element.Solids(element=tag_host_element_2)
vertices = Topology.Vertices(topology=solids@L1)
pointGeometry = Vertex.PointGeometry(vertex=vertices)
Z = Point.Z(point=pointGeometry)
python_script_2 = Python(IN[0]=pointGeometry, IN[1]=Z)
# ---------- python_script_2.python (36 lines) ----------
# Load the Python Standard and DesignScript Libraries
import sys
import clr
clr.AddReference('ProtoGeometry')
from Autodesk.DesignScript.Geometry import *

# The inputs to this node will be stored as a list in the IN variables.

point_old=IN[0]
point_z=IN[1]
points=[]
for ind, i in enumerate(point_z):
	a_max=max(i)
	sub_p=[]
	sub_i=[]
	pt_list=point_old[ind]
	for ind1, j in enumerate(i):
		if j==a_max:
			sub_p.append(pt_list[ind1])
	points.append(sub_p)			
	

p1=[]
p2= []
p3=[]
p4=[]

for ind, i in enumerate(points):
	p1.append(i[0])
	p2.append(i[1])
	p3.append(i[2])
	p4.append(i[3])
	
	
	
OUT= p1,p2,p3,p4
# ----------------------------------------

# group: Height of Layer 1
code_block_3 = CodeBlock { 60; }

# group: Slope in degrees
code_block_4 = CodeBlock { 3; }

# group: Layer 1
YAxis = Vector.YAxis()
code_block_5 = CodeBlock(p=python_script_2) { p[0]; }
code_block_6 = CodeBlock(p=python_script_2) { p[1]; }
code_block_7 = CodeBlock(p=python_script_2) { p[3]; }
code_block_8 = CodeBlock(p=python_script_2) { p[2]; }
byCornerPoints = Rectangle.ByCornerPoints(p1=code_block_5, p2=code_block_6, p3=code_block_7, p4=code_block_8)
ZAxis_2 = Vector.ZAxis()
width = Rectangle.Width(rectangle=byCornerPoints)
code_block_9 = CodeBlock(thickness=code_block_3, l=width, angle=code_block_4) { thickness+(l*DSCore.Math.Tan(angle)); }
translate_2 = Geometry.Translate(geometry=byCornerPoints, direction=ZAxis_2, distance=code_block_9)
center = Polygon.Center(polygon=byCornerPoints)
XAxis = Vector.XAxis()
rotate = Geometry.Rotate(geometry=translate_2, origin=center, axis=XAxis, degrees=code_block_4)
python_script_3 = Python(IN[0]=byCornerPoints, IN[1]=rotate)
# ---------- python_script_3.python (49 lines) ----------
import clr #This is .NET's Common Language Runtime. It's an execution environment
#that is able to execute code from several different languages.
import sys #sys is a fundamental Python library - here, we're using it to load in
#the standard IronPython libraries
sys.path.append('C:\Program Files (x86)\IronPython 2.7\Lib') #Imports the
#standard IronPython libraries, which cover everything from servers and
#encryption through to regular expressions.
import System #The System namespace at the root of .NET
from System import Array #.NET class for handling array information
from System.Collections.Generic import * #Lets you handle generics. Revit's API
#sometimes wants hard-typed 'generic' lists, called ILists. If you don't need
#these you can delete this line.
clr.AddReference('ProtoGeometry')  #A Dynamo library for its proxy geometry
#classes. You'll only need this if you're interacting with geometry.
from Autodesk.DesignScript.Geometry import * #Loads everything in Dynamo's
#geometry library
clr.AddReference("RevitNodes") #Dynamo's nodes for Revit
import Revit #Loads in the Revit namespace in RevitNodes
clr.ImportExtensions(Revit.Elements) #More loading of Dynamo's Revit libraries
clr.ImportExtensions(Revit.GeometryConversion) #More loading of Dynamo's
#Revit libraries. You'll only need this if you're interacting with geometry.
clr.AddReference("RevitServices") #Dynamo's classes for handling Revit documents
import RevitServices 
from RevitServices.Persistence import DocumentManager #An internal Dynamo class
#that keeps track of the document that Dynamo is currently attached to
from RevitServices.Transactions import TransactionManager #A Dynamo class for
#opening and closing transactions to change the Revit document's database

clr.AddReference("RevitAPI") #Adding reference to Revit's API DLLs
clr.AddReference("RevitAPIUI") #Adding reference to Revit's API DLLs

import Autodesk #Loads the Autodesk namespace
from Autodesk.Revit.DB import * #Loading Revit's API classes
from Autodesk.Revit.UI import * #Loading Revit's API UI classes  

doc = DocumentManager.Instance.CurrentDBDocument #Finally, setting up handles to the active Revit document
uiapp = DocumentManager.Instance.CurrentUIApplication #Setting a handle to the active Revit UI document
app = uiapp.Application  #Setting a handle to the currently-open instance of the Revit application
uidoc = uiapp.ActiveUIDocument #Setting a handle to the currently-open instance of the Revit UI application

#######OK NOW YOU CAN CODE########

base_rect=IN[0]
sup_rect=IN[1]

solids=[]
for ind, i in enumerate(base_rect):
	solids.append([i,sup_rect[ind]])
OUT=solids
# ----------------------------------------

# group: Layer 2
YAxis_2 = Vector.YAxis()
ZAxis_3 = Vector.ZAxis()
code_block_10 = CodeBlock { 500; }
width_2 = Rectangle.Width(rectangle=byCornerPoints)
code_block_11 = CodeBlock { 0; }
code_block_12 = CodeBlock(thickness=code_block_10, l=width_2, angle=code_block_11) { thickness+(l*DSCore.Math.Tan(angle)); }
translate_3 = Geometry.Translate(geometry=rotate, direction=ZAxis_3, distance=code_block_12)
center_2 = Polygon.Center(polygon=rotate)
XAxis_2 = Vector.XAxis()
rotate_2 = Geometry.Rotate(geometry=translate_3, origin=center_2, axis=XAxis_2, degrees=code_block_11)
python_script_4 = Python(IN[0]=rotate, IN[1]=rotate_2)  # same code as python_script_3

# group: Solid
byLoft = Solid.ByLoft(crossSections=python_script_4)

# group: Layer 4
categories_3 = Categories("OST_Floors")
materials_2 = Material("Wood")
python_script_5 = Python(IN[0]=byLoft)
# ---------- python_script_5.python (8 lines) ----------
# Load the Python Standard and DesignScript Libraries
import sys
import clr
clr.AddReference('ProtoGeometry')
from Autodesk.DesignScript.Geometry import *

# The inputs to this node will be stored as a list in the IN variables.
OUT= ['Layer4'+str((ind+1)) for ind, i in enumerate(IN[0]) ]
# ----------------------------------------
byGeometry_2 = DirectShape.ByGeometry(geometry=byLoft, category=categories_3, material=materials_2, name=python_script_5)

# group: Solid
byLoft_2 = Solid.ByLoft(crossSections=python_script_3)

# group: Layer 4
categories_4 = Categories("OST_Floors")
materials_3 = Material("Glass")
python_script_6 = Python(IN[0]=byLoft_2)  # same code as python_script_5
byGeometry_3 = DirectShape.ByGeometry(geometry=byLoft_2, category=categories_4, material=materials_3, name=python_script_6)
