# Dynamo graph 2. Assigning Codes.dyn (Dynamo 2.5.0.7460)
# packages: Rhythm 2020.1.22, Clockwork for Dynamo 2.x 2.3.0, Modelical 2.2.19

# group: Instead of "Select Model Elements"
categories = Categories()  # nothing selected
all_elements_of_category = ElementsOfCategory(Category=categories)

select_model_elements = DSModelElementsSelection()  # 2647 picked in the model; graph input

# group: Parameter
code_block = CodeBlock { "B6_1D_Level"; }
ʳʰʸᵗʰᵐ_elements = Rhythm.Revit.Elements.Elements.GetParameterValueByNameTypeOrInstance(element=select_model_elements, parameterName=code_block)
code_block_2 = CodeBlock { "B6_1D_Zone"; }
ʳʰʸᵗʰᵐ_elements_2 = Rhythm.Revit.Elements.Elements.GetParameterValueByNameTypeOrInstance(element=select_model_elements, parameterName=code_block_2)
code_block_3 = CodeBlock { "B6_1D_Sub-Zone"; }
ʳʰʸᵗʰᵐ_elements_3 = Rhythm.Revit.Elements.Elements.GetParameterValueByNameTypeOrInstance(element=select_model_elements, parameterName=code_block_3)
code_block_4 = CodeBlock { "B6_1D_Building"; }
ʳʰʸᵗʰᵐ_elements_4 = Rhythm.Revit.Elements.Elements.GetParameterValueByNameTypeOrInstance(element=select_model_elements, parameterName=code_block_4)

file_path = Filename(".\Digipro_Code_Track.xlsx")  # graph input
file_from_path = FileObject(path=file_path)
code_block_5 = CodeBlock { "Sheet1"; }
code_block_6 = CodeBlock { true; false; }
importExcel = Data.ImportExcel(file=file_from_path, sheetName=code_block_5, readAsStrings=code_block_6.out0, showExcel=code_block_6.out1)
transpose = List.Transpose(lists=importExcel)

# group: Code1
code_block_7 = CodeBlock(column=transpose) { column[0]; }
code_block_8 = CodeBlock(column=transpose) { column[1]; }

# group: Code2
code_block_9 = CodeBlock(column=transpose) { column[3]; }
code_block_10 = CodeBlock(column=transpose) { column[4]; }

# group: Code3
code_block_11 = CodeBlock(column=transpose) { column[7]; }
code_block_12 = CodeBlock(column=transpose) { column[8]; }

# group: Code4
code_block_13 = CodeBlock(column=transpose) { column[11]; }
code_block_14 = CodeBlock(column=transpose) { column[12]; }

# group: Code5
code_block_15 = CodeBlock(column=transpose) { column[15]; }
code_block_16 = CodeBlock(column=transpose) { column[16]; }

# group: Code6
code_block_17 = CodeBlock(column=transpose) { column[19]; }
code_block_18 = CodeBlock(column=transpose) { column[20]; }

python_script = Python(IN[0]=code_block_7, IN[1]=code_block_8, IN[2]=code_block_9, IN[3]=code_block_10, IN[4]=code_block_11, IN[5]=code_block_12, IN[6]=code_block_13, IN[7]=code_block_14, IN[8]=code_block_15, IN[9]=code_block_16, IN[10]=code_block_17, IN[11]=code_block_18)  # frozen
# ---------- python_script.python (31 lines) ----------
# Load the Python Standard and DesignScript Libraries
import sys
import clr
clr.AddReference('ProtoGeometry')
from Autodesk.DesignScript.Geometry import *

code1=filter(None, IN[0])
code2=filter(None, IN[1])
code3=filter(None, IN[2])
code4=filter(None, IN[3])
code5=filter(None, IN[4])
code6=filter(None, IN[5])
code7=filter(None, IN[6])
code8=filter(None, IN[7])
code9=filter(None, IN[8])
code10=filter(None, IN[9])
code11=filter(None, IN[10])
code12=filter(None, IN[11])

############## Code




def data(n):
	return n[4::]
	
def data1(n):
	return n[1::]
	
OUT= data(code1), data1(code2), data(code3), data1(code4), data(code5), data1(code6), data(code7), data1(code8), data(code9), data1(code10), data(code11), data1(code12)
# ----------------------------------------

# group: Change as per requirements
code1 = CodeBlock { "01"; }
code2 = CodeBlock { "01"; }

total_number_of_code_parameters = CodeBlock { 6; }  # "Total number of code parameters to consider"
python_script_2 = Python(IN[0]=ʳʰʸᵗʰᵐ_elements, IN[1]=ʳʰʸᵗʰᵐ_elements_2, IN[2]=ʳʰʸᵗʰᵐ_elements_3, IN[3]=python_script, IN[4]=code1, IN[5]=code2, IN[6]=ʳʰʸᵗʰᵐ_elements_4, IN[7]=select_model_elements, IN[8]=total_number_of_code_parameters)
# ---------- python_script_2.python (75 lines) ----------
# Load the Python Standard and DesignScript Libraries
import sys
import clr
clr.AddReference('ProtoGeometry')
from Autodesk.DesignScript.Geometry import *

# The inputs to this node will be stored as a list in the IN variables.
level=IN[0]
zone=IN[1]
sub_zone=IN[2]
hlev=IN[6]

codes=IN[3]
code1=IN[4]
code2=IN[5]
cod_len=IN[8]

code_lev_codes=codes[8]
code_lev=codes[9]

code_zon_codes=codes[6]
code_zon=codes[7]

code_szon_codes=codes[10]
code_szon=codes[11]

code_hlev_codes=codes[4]
code_hlev=codes[5]


codes_new=[]

index=[]
for i in range(len(zone)):
	zon1=zone[i]
	lev1=level[i]
	zones1=sub_zone[i]
	hlev1=hlev[i]
	
	sub_code=[code1, code2]
	if hlev1 in code_hlev:
		indhl=code_hlev.index(hlev1)
		codhl=code_hlev_codes[indhl]
		sub_code.append(codhl)
		
	if zon1 in code_zon:
		indz=code_zon.index(zon1)
		codz=code_zon_codes[indz]		
		sub_code.append(codz)
		
	if lev1 in code_lev:
		indl=code_lev.index(lev1)
		codl=code_lev_codes[indl]
		sub_code.append(codl)
	
	if zones1 in code_szon:
		indzs=code_szon.index(zones1)
		codsz=code_szon_codes[indzs]
		sub_code.append(codsz)
	
	#codes_new.append(sub_code)
	
	if len(sub_code)==cod_len:
		index.append(i)
		codes_new.append('-'.join(sub_code))

OUT=codes_new, index
	
	
	
	
	
	
	
	
# ----------------------------------------
code_block_19 = CodeBlock(a=python_script_2) { a[0]; }

# group: Comparison sheet
file_path_2 = Filename(".\ZNM-3IM-LD-ZZ.xlsx")

file_from_path_2 = FileObject(path=file_path_2)
code_block_20 = CodeBlock { "ObjectCodeComparison"; }
code_block_21 = CodeBlock { true; false; }
importExcel_2 = Data.ImportExcel(file=file_from_path_2, sheetName=code_block_20, readAsStrings=code_block_21.out0, showExcel=code_block_21.out1)
transpose_2 = List.Transpose(lists=importExcel_2)
code_block_22 = CodeBlock(a=transpose_2) { a[0][1..92]; }
python_script_3 = Python(IN[0]=code_block_19, IN[1]=code_block_22)
# ---------- python_script_3.python (21 lines) ----------
# Load the Python Standard and DesignScript Libraries
import sys
import clr
clr.AddReference('ProtoGeometry')
from Autodesk.DesignScript.Geometry import *

# The inputs to this node will be stored as a list in the IN variables.
code_new=IN[0]
code_com=IN[1]
index=[]
index_not=[]
code_not=[]
code=[]
for ind, i in enumerate(code_new):
	if i not in code_com:
		code_not.append(i)
		index_not.append(ind)
	else:
		code.append(i)
		index.append(ind)
OUT= code, index, set(code_not), index_not
# ----------------------------------------
code_in_model = CodeBlock(a=python_script_3) { a[2]; }
code_in_model_2 = CodeBlock(a=python_script_3) { a[0]; }
index = CodeBlock(a=python_script_3) { a[3]; }
getItemAtIndex = List.GetItemAtIndex(list=select_model_elements, index=index)
selectInRevit = Custom[SelectInRevit](ElemsOrIDs=getItemAtIndex)  # package Modelical; Select elements in Revit by Element or ID
code_block_23 = CodeBlock(a=python_script_2) { a[1]; }
getItemAtIndex_2 = List.GetItemAtIndex(list=select_model_elements, index=code_block_23)
index_2 = CodeBlock(a=python_script_3) { a[1]; }
getItemAtIndex_3 = List.GetItemAtIndex(list=getItemAtIndex_2, index=index_2)

# group: Missing Data
python_script_4 = Python(IN[0]=ʳʰʸᵗʰᵐ_elements, IN[1]=ʳʰʸᵗʰᵐ_elements_2, IN[2]=ʳʰʸᵗʰᵐ_elements_3, IN[3]=ʳʰʸᵗʰᵐ_elements_4)
# ---------- python_script_4.python (25 lines) ----------
# Load the Python Standard and DesignScript Libraries
import sys
import clr
clr.AddReference('ProtoGeometry')
from Autodesk.DesignScript.Geometry import *

# The inputs to this node will be stored as a list in the IN variables.
pm1=IN[0]
om2=IN[1]
pm3=IN[2]
pm4=IN[3]
final=[]
for ind, i in enumerate(pm1):
	pm41=pm4[ind]
	pm21=pm3[ind]
	pm31=pm3[ind]
	if pm31==[] or pm21==[] or pm41==[] or pm31==None or pm21==None or pm41==None or pm31=='' or pm21=='' or pm41=='':
		final.append(ind)
		
	else:
		pass
	
OUT=final
		
		
# ----------------------------------------

getItemAtIndex_4 = List.GetItemAtIndex(list=select_model_elements, index=python_script_4)
code_block_24 = CodeBlock { "Digipro_Object Code"; }
ʳʰʸᵗʰᵐ_elements_5 = Rhythm.Revit.Elements.Elements.SetParameterByNameTypeOrInstance(element=getItemAtIndex_2, parameterName=code_block_24, value=code_block_19)
passthrough = Custom[Passthrough](passThrough=getItemAtIndex_4, waitFor=ʳʰʸᵗʰᵐ_elements_5)  # frozen; package Clockwork for Dynamo 2.x; Forces a sequential order of execution. The node wired into the output of the Passthrough node will be executed *after* the node wired into the waitFor input (e.g. important for some Revit operations). The value of the passThrough input will be passed on to the node wired into the output port of the Passthrough node.
selectInRevit_2 = Custom[SelectInRevit](ElemsOrIDs=passthrough)
code_block_25 = CodeBlock { "Phase Created"; }
ʳʰʸᵗʰᵐ_elements_6 = Rhythm.Revit.Elements.Elements.GetParameterValueByNameTypeOrInstance(element=ʳʰʸᵗʰᵐ_elements_5, parameterName=code_block_25)
name = Element.Name(element=ʳʰʸᵗʰᵐ_elements_6)
code_block_26 = CodeBlock { "Existing"; }
python_script_5 = Python(IN[0]=name, IN[1]=code_block_26)
# ---------- python_script_5.python (17 lines) ----------
# Load the Python Standard and DesignScript Libraries
import sys
import clr
clr.AddReference('ProtoGeometry')
from Autodesk.DesignScript.Geometry import *

# The inputs to this node will be stored as a list in the IN variables.
params=IN[0]
sub=IN[1]
final=[]
for ind, i in enumerate(params):
	if i!=[] and i!=None:
		if sub in i:
			final.append(ind)
OUT=final
	
	
# ----------------------------------------
getItemAtIndex_5 = List.GetItemAtIndex(list=ʳʰʸᵗʰᵐ_elements_5, index=python_script_5)
code_block_27 = CodeBlock { "Digipro_Object Code"; }
python_script_6 = Python(IN[0]=getItemAtIndex_5)
# ---------- python_script_6.python (8 lines) ----------
# Load the Python Standard and DesignScript Libraries
import sys
import clr
clr.AddReference('ProtoGeometry')
from Autodesk.DesignScript.Geometry import *

# The inputs to this node will be stored as a list in the IN variables.
OUT=["" for i in range(len(IN[0]))]
# ----------------------------------------
ʳʰʸᵗʰᵐ_elements_7 = Rhythm.Revit.Elements.Elements.SetParameterByNameTypeOrInstance(element=getItemAtIndex_5, parameterName=code_block_27, value=python_script_6)
code_block_28 = CodeBlock { "B6_1D_Element_Category"; }
ʳʰʸᵗʰᵐ_elements_8 = Rhythm.Revit.Elements.Elements.GetParameterValueByNameTypeOrInstance(element=select_model_elements, parameterName=code_block_28)
code_block_29 = CodeBlock { "Void"; }
python_script_7 = Python(IN[0]=ʳʰʸᵗʰᵐ_elements_8, IN[1]=code_block_29)
# ---------- python_script_7.python (17 lines) ----------
# Load the Python Standard and DesignScript Libraries
import sys
import clr
clr.AddReference('ProtoGeometry')
from Autodesk.DesignScript.Geometry import *

# The inputs to this node will be stored as a list in the IN variables.
params=IN[0]
sub=IN[1]
final=[]
for ind, i in enumerate(params):
	if i!=None:
		if sub in i:
			final.append(ind)
OUT=final
	
	
# ----------------------------------------
getItemAtIndex_6 = List.GetItemAtIndex(list=select_model_elements, index=python_script_7)
code_block_30 = CodeBlock { "Digipro_Object Code"; }
python_script_8 = Python(IN[0]=getItemAtIndex_6)  # same code as python_script_6
setParameterByName = Element.SetParameterByName(element=getItemAtIndex_6, parameterName=code_block_30, value=python_script_8)
selectInRevit_3 = Custom[SelectInRevit](ElemsOrIDs=getItemAtIndex_6)
