# Dynamo graph 3. Assigning Codes- Voids and existing Codes removal.dyn (Dynamo 2.5.0.7460)
# packages: Rhythm 2020.1.22, Modelical 2.2.19

select_model_elements = DSModelElementsSelection()  # 2647 picked in the model; graph input
code_block = CodeBlock { "B6_1D_Element_Category"; }
ʳʰʸᵗʰᵐ_elements = Rhythm.Revit.Elements.Elements.GetParameterValueByNameTypeOrInstance(element=select_model_elements, parameterName=code_block)  # frozen
code_block_2 = CodeBlock { "Void"; }
python_script = Python(IN[0]=ʳʰʸᵗʰᵐ_elements, IN[1]=code_block_2)
# ---------- python_script.python (17 lines) ----------
# Load the Python Standard and DesignScript Libraries
import sys
import clr
clr.AddReference('ProtoGeometry')
from Autodesk.DesignScript.Geometry import *

# The inputs to this node will be stored as a list in the IN variables.
params=IN[0]
sub=IN[1]
final=[]
for ind, i in enumerate(params):
	if i!=None:
		if sub in i:
			final.append(ind)
OUT=final
	
	
# ----------------------------------------
getItemAtIndex = List.GetItemAtIndex(list=select_model_elements, index=python_script)
selectInRevit = Custom[SelectInRevit](ElemsOrIDs=getItemAtIndex)  # package Modelical; Select elements in Revit by Element or ID
code_block_3 = CodeBlock { "Digipro_Object Code"; }
python_script_2 = Python(IN[0]=getItemAtIndex)
# ---------- python_script_2.python (8 lines) ----------
# Load the Python Standard and DesignScript Libraries
import sys
import clr
clr.AddReference('ProtoGeometry')
from Autodesk.DesignScript.Geometry import *

# The inputs to this node will be stored as a list in the IN variables.
OUT=["" for i in range(len(IN[0]))]
# ----------------------------------------
setParameterByName = Element.SetParameterByName(element=getItemAtIndex, parameterName=code_block_3, value=python_script_2)
code_block_4 = CodeBlock { "Phase Created"; }
ʳʰʸᵗʰᵐ_elements_2 = Rhythm.Revit.Elements.Elements.GetParameterValueByNameTypeOrInstance(element=select_model_elements, parameterName=code_block_4)  # frozen
name = Element.Name(element=ʳʰʸᵗʰᵐ_elements_2)
code_block_5 = CodeBlock { "Existing"; }
python_script_3 = Python(IN[0]=name, IN[1]=code_block_5)
# ---------- python_script_3.python (17 lines) ----------
# Load the Python Standard and DesignScript Libraries
import sys
import clr
clr.AddReference('ProtoGeometry')
from Autodesk.DesignScript.Geometry import *

# The inputs to this node will be stored as a list in the IN variables.
params=IN[0]
sub=IN[1]
final=[]
for ind, i in enumerate(params):
	if i!=[] and i!=None:
		if sub in i:
			final.append(ind)
OUT=final
	
	
# ----------------------------------------
getItemAtIndex_2 = List.GetItemAtIndex(list=select_model_elements, index=python_script_3)
code_block_6 = CodeBlock { "Digipro_Object Code"; }
python_script_4 = Python(IN[0]=getItemAtIndex_2)  # same code as python_script_2
ʳʰʸᵗʰᵐ_elements_3 = Rhythm.Revit.Elements.Elements.SetParameterByNameTypeOrInstance(element=getItemAtIndex_2, parameterName=code_block_6, value=python_script_4)
code_block_7 = CodeBlock { "Digipro_Object Code"; }
ʳʰʸᵗʰᵐ_elements_4 = Rhythm.Revit.Elements.Elements.GetParameterValueByNameTypeOrInstance(element=select_model_elements, parameterName=code_block_7)
file_path = Filename("..\..\..\..\..\..\Downloads\ZNM_Object Code Dictionary and Programme_REV11 (1).xlsx")
file_from_path = FileObject(path=file_path)
code_block_8 = CodeBlock { "Sheet1"; }
code_block_9 = CodeBlock { true; false; }
importExcel = Data.ImportExcel(file=file_from_path, sheetName=code_block_8, readAsStrings=code_block_9.out0, showExcel=code_block_9.out1)
transpose = List.Transpose(lists=importExcel)
python_script_5 = Python(IN[0]=transpose)
# ---------- python_script_5.python (19 lines) ----------
# Load the Python Standard and DesignScript Libraries
import sys
import clr
clr.AddReference('ProtoGeometry')
from Autodesk.DesignScript.Geometry import *

data=IN[0]

c1=data[0]
c2=data[1]
c3=data[2]
c4=data[3]
c5=data[4]
c6=data[5]
final=[]
for ind, i in enumerate(c1):
	x=i+'-'+c2[ind]+'-'+c3[ind]+'-'+c4[ind]+'-'+c5[ind]+'-'+c6[ind]
	final.append(x)
OUT=final
# ----------------------------------------
python_script_6 = Python(IN[0]=ʳʰʸᵗʰᵐ_elements_4, IN[1]=python_script_5)
# ---------- python_script_6.python (15 lines) ----------
# Load the Python Standard and DesignScript Libraries
import sys
import clr
clr.AddReference('ProtoGeometry')
from Autodesk.DesignScript.Geometry import *

# The inputs to this node will be stored as a list in the IN variables.
params=IN[0]
codes=IN[1]
final=[]
for ind, i in enumerate(params):	
	if i!=None and i!=[] and i!="":
		if i not in codes:
			final.append(ind)
OUT=final
# ----------------------------------------
getItemAtIndex_3 = List.GetItemAtIndex(list=select_model_elements, index=python_script_6)
selectInRevit_2 = Custom[SelectInRevit](ElemsOrIDs=getItemAtIndex_3)
