# Dynamo graph 2. Assigning Ratio.dyn (Dynamo 2.6.1.8786)
# packages: Rhythm 2020.1.22

# group: Instead of "Select Model Elements"
categories = Categories("OST_Floors")
all_elements_of_category = ElementsOfCategory(Category=categories)

# group: Parameter
code_block = CodeBlock { "B6_1D_Element_Category"; }
ʳʰʸᵗʰᵐ_elements = Rhythm.Revit.Elements.Elements.GetParameterValueByNameTypeOrInstance(element=all_elements_of_category, parameterName=code_block)
code_block_2 = CodeBlock { "B6_1D_Level"; }
ʳʰʸᵗʰᵐ_elements_2 = Rhythm.Revit.Elements.Elements.GetParameterValueByNameTypeOrInstance(element=all_elements_of_category, parameterName=code_block_2)

python_script = Python(IN[0]=ʳʰʸᵗʰᵐ_elements)
# ---------- python_script.python (14 lines) ----------
# Load the Python Standard and DesignScript Libraries
import sys
import clr
clr.AddReference('ProtoGeometry')
from Autodesk.DesignScript.Geometry import *

# The inputs to this node will be stored as a list in the IN variables.
para=IN[0]
index=[]
for ind, i in enumerate(para):
	if i!=[] and i!=None and i!="":
		index.append(ind)
		
OUT= index
# ----------------------------------------
getItemAtIndex = List.GetItemAtIndex(list=all_elements_of_category, index=python_script)
getItemAtIndex_2 = List.GetItemAtIndex(list=ʳʰʸᵗʰᵐ_elements_2, index=python_script)
getItemAtIndex_3 = List.GetItemAtIndex(list=ʳʰʸᵗʰᵐ_elements, index=python_script)
file_path = Filename("..\..\..\..\..\..\Downloads\Modified TENDER - RFN - Rebar ratio analysis - R011.xlsx")
file_from_path = FileObject(path=file_path)
code_block_3 = CodeBlock { "Sheet2"; }
code_block_4 = CodeBlock { true; false; }
importExcel = Data.ImportExcel(file=file_from_path, sheetName=code_block_3, readAsStrings=code_block_4.out0, showExcel=code_block_4.out1)
transpose = List.Transpose(lists=importExcel)

# group: Columns of Excel
code_block_5 = CodeBlock(column=transpose) { column[2]; }
code_block_6 = CodeBlock(column=transpose) { column[3]; }
code_block_7 = CodeBlock(column=transpose) { column[4]; }
code_block_8 = CodeBlock(column=transpose) { column[5]; }
code_block_9 = CodeBlock(column=transpose) { column[6]; }
code_block_10 = CodeBlock(column=transpose) { column[7]; }
code_block_11 = CodeBlock(column=transpose) { column[8]; }
code_block_12 = CodeBlock(column=transpose) { column[9]; }
code_block_13 = CodeBlock(column=transpose) { column[10]; }
code_block_14 = CodeBlock(column=transpose) { column[11]; }
code_block_15 = CodeBlock(column=transpose) { column[12]; }
code_block_16 = CodeBlock(column=transpose) { column[13]; }
code_block_17 = CodeBlock(column=transpose) { column[14]; }

code_block_18 = CodeBlock(column=transpose) { column[15]; }
code_block_19 = CodeBlock(column=transpose) { column[16]; }
code_block_20 = CodeBlock(column=transpose) { column[17]; }
code_block_21 = CodeBlock(column=transpose) { column[18]; }
code_block_22 = CodeBlock(column=transpose) { column[19]; }
code_block_23 = CodeBlock(column=transpose) { column[20]; }
code_block_24 = CodeBlock(column=transpose) { column[21]; }
python_script_2 = Python(IN[0]=code_block_5, IN[1]=code_block_6, IN[2]=code_block_7, IN[3]=code_block_8, IN[4]=code_block_9, IN[5]=code_block_10, IN[6]=code_block_11, IN[7]=code_block_12, IN[8]=code_block_13, IN[9]=code_block_14, IN[10]=code_block_15, IN[11]=code_block_16, IN[12]=code_block_17, IN[13]=code_block_18, IN[14]=code_block_19, IN[15]=code_block_20, IN[16]=code_block_21, IN[17]=code_block_22, IN[18]=code_block_23, IN[19]=code_block_24)
# ---------- python_script_2.python (50 lines) ----------
# Load the Python Standard and DesignScript Libraries
import sys
import clr
clr.AddReference('ProtoGeometry')
from Autodesk.DesignScript.Geometry import *


########## Grey

levels=IN[0]
levels=levels[2:21:3]
pilecap=IN[1][4:23:3]
tie=IN[2][4:23:3]

beam_og=IN[3][4:23:3]
footing=IN[4][4:23:3]
raft=IN[5][4:23:3]

slab=IN[6][4:23:3]
col=IN[7][4:23:3]
sus_beam=IN[8][4:23:3]
sus_slab=IN[9][4:23:3]
ret_wal=IN[10][4:23:3]
s_wall=IN[11][4:23:3]
c_wall=IN[12][4:23:3]
wall=IN[13][4:23:3]
upstand=IN[14][4:23:3]
stair=IN[15][4:23:3]
post=IN[16][4:23:3]
corbel=IN[17][4:23:3]
step=IN[18][4:23:3]
landing=IN[19][4:23:3]

############# White

drum=IN[1][26]
ring=IN[2][26]
falconry=IN[3][26]
lift_core=IN[4][26]
sus_slab_soff=IN[5][26]
vip_canopy=IN[6][26]
wall_to_skylight=IN[7][26]

grey= [levels, pilecap, tie, beam_og, footing, raft, slab, col, sus_beam, sus_slab, ret_wal, s_wall, c_wall, wall, upstand, stair, post, corbel , step, landing]
white=[drum, ring, falconry, lift_core, sus_slab_soff, vip_canopy, wall_to_skylight]

grey_element_name=[IN[1][0], IN[2][0], IN[3][0], IN[4][0],IN[5][0], IN[6][0],IN[7][0], IN[8][0],IN[9][0], IN[10][0],IN[11][0], IN[12][0],IN[13][0], IN[14][0],IN[15][0], IN[16][0], IN[17][0], IN[18][0], IN[19][0]]

white_element_name=[IN[1][23], IN[2][23], IN[3][23], IN[4][23],IN[5][23], IN[6][23],IN[7][23]]
OUT= grey, white, grey_element_name, white_element_name
# ----------------------------------------
grey_ratio_with_level = CodeBlock(a=python_script_2) { a[0]; }
code_block_25 = CodeBlock(a=grey_ratio_with_level) { a[0]; }
white_ratio = CodeBlock(a=python_script_2) { a[1]; }
grey_element_names = CodeBlock(a=python_script_2) { a[2]; }
white_element_name = CodeBlock(a=python_script_2) { a[3]; }
restOfItems = List.RestOfItems(list=grey_ratio_with_level)
python_script_3 = Python(IN[0]=getItemAtIndex_2, IN[1]=getItemAtIndex_3, IN[2]=code_block_25, IN[3]=white_ratio, IN[4]=grey_element_names, IN[5]=white_element_name, IN[7]=restOfItems)  # unwired: IN[6]
# ---------- python_script_3.python (61 lines) ----------
# Load the Python Standard and DesignScript Libraries
import sys
import clr
clr.AddReference('ProtoGeometry')
from Autodesk.DesignScript.Geometry import *

# The inputs to this node will be stored as a list in the IN variables.
levels=IN[0]
elem_cat_name=IN[1]

#####################

grey_ratio=IN[7]
white_ratio=IN[3]

grey_elem_name=IN[4]
whit_elem_name=IN[5]
excel_name=IN[2]
excel_name=[i.replace(" ", "") for i in excel_name]

ratio=[]
index=[]


###########  Grey Concrete Data
for ind, i in enumerate(elem_cat_name):
			
	if i!=[] and i!=None and "White" not in i:
		lev=levels[ind]
############ Checking Levels in Excel		

		if lev in excel_name:
			ind_n=excel_name.index(lev)	
			
			
############ Checking if excel item names in the string i

		for ind1, j in enumerate(grey_elem_name):
			if j=="Wall":
				item=grey_ratio[ind1]
				rat=item[ind_n]				
				ratio.append(rat)
				index.append(ind)			
			elif j in i:
				item=grey_ratio[ind1]
				rat=item[ind_n]				
				ratio.append(rat)
				index.append(ind)
				
############# White Concrete Data			

	elif "White" in i:	
		
		for ind1, j in enumerate(whit_elem_name):	
			if j in i:
				index.append(ind)
				rat=white_ratio[ind1]					
				ratio.append(rat)		
	

OUT=  index, ratio
# ----------------------------------------
code_block_26 = CodeBlock(a=python_script_3) { a[0]; }
getItemAtIndex_4 = List.GetItemAtIndex(list=getItemAtIndex, index=code_block_26)
code_block_27 = CodeBlock { "B6_2D_ST_Tender RFT Ratio"; }
code_block_28 = CodeBlock(a=python_script_3) { a[1]; }
toNumber = String.ToNumber(str=code_block_28)
ʳʰʸᵗʰᵐ_elements_3 = Rhythm.Revit.Elements.Elements.SetParameterByNameTypeOrInstance(element=getItemAtIndex_4, parameterName=code_block_27, value=toNumber)
python_script_4 = Python(IN[0]=getItemAtIndex_3)
# ---------- python_script_4.python (15 lines) ----------
# Load the Python Standard and DesignScript Libraries
import sys
import clr
clr.AddReference('ProtoGeometry')
from Autodesk.DesignScript.Geometry import *

# The inputs to this node will be stored as a list in the IN variables.
name=IN[0]
names=[]
index=[]
for ind, i in enumerate(name):
	if "White" in i:
		names.append(i)
		index.append(ind)
OUT = names, index
# ----------------------------------------
