# Dynamo graph Mass Moment of inertia (Work In Progress).dyn "Mass Moment of inertia" (Dynamo 2.5.0.7460)
# packages: MeshToolkit 3.0.0

select_model_element = DSModelElementSelection()  # 1 picked in the model
solids = Element.Solids(element=select_model_element)
bySolid = PolySurface.BySolid(solid=solids)  # frozen
surfaces = PolySurface.Surfaces(polySurface=bySolid)
area = Surface.Area(surface=surfaces)
flatten = List.Flatten(list=area)
python_script = Python(IN[0]=flatten)
# ---------- python_script.python (13 lines) ----------
# Load the Python Standard and DesignScript Libraries
import sys
import clr
clr.AddReference('ProtoGeometry')
from Autodesk.DesignScript.Geometry import *

# The inputs to this node will be stored as a list in the IN variables.
area=IN[0]

minimum=min(area)

ind=area.index(minimum)
OUT=ind
# ----------------------------------------
getItemAtIndex = List.GetItemAtIndex(list=surfaces@L2, index=python_script)
code_block = CodeBlock { 50; }
byGeometry = Autodesk.Dynamo.MeshToolkit.Mesh.ByGeometry(inputGeometry=getItemAtIndex, maxGridLines=code_block)
triangles = Autodesk.Dynamo.MeshToolkit.Mesh.Triangles(mesh=byGeometry)

# group: Actual Section Centroid
code_block_2 = CodeBlock { 5; }
thicken = Surface.Thicken(surface=getItemAtIndex, thickness=code_block_2)
centroid = Solid.Centroid(solid=thicken)

X = Point.X(point=centroid)
code_block_3 = CodeBlock(a=X) { -1*a; }
Y = Point.Y(point=centroid)
code_block_4 = CodeBlock(a=Y) { -1*a; }
Z = Point.Z(point=centroid)
code_block_5 = CodeBlock(a=Z) { -1*a; }
translate = Geometry.Translate(geometry=triangles, xTranslation=code_block_3, yTranslation=code_block_4, zTranslation=code_block_5)  # frozen
vertices = Topology.Vertices(topology=translate)
pointGeometry = Vertex.PointGeometry(vertex=vertices)
X_2 = Point.X(point=pointGeometry@L2)
Y_2 = Point.Y(point=pointGeometry@L2)
Z_2 = Point.Z(point=pointGeometry@L2)
code_block_6 = CodeBlock { 5; }
thicken_2 = Surface.Thicken(surface=translate, thickness=code_block_6)
centroid_2 = Solid.Centroid(solid=thicken_2)
X_3 = Point.X(point=centroid_2@L2)
Y_3 = Point.Y(point=centroid_2@L2)
Z_3 = Point.Z(point=centroid_2@L2)
area_2 = Surface.Area(surface=translate)
python_script_2 = Python(IN[0]=X_2, IN[1]=Y_2, IN[2]=Z_2, IN[3]=X_3, IN[4]=Y_3, IN[5]=Z_3, IN[6]=area_2)
# ---------- python_script_2.python (40 lines) ----------
# Load the Python Standard and DesignScript Libraries
import sys
import clr
clr.AddReference('ProtoGeometry')
from Autodesk.DesignScript.Geometry import *

import math
# The inputs to this node will be stored as a list in the IN variables.
trix=IN[0]
triy=IN[1]
triz=IN[2]
area=IN[4][0]
centroidx=IN[3][0]
centroidy=IN[4][0]
centroidz=IN[5][0]
moi=[]

for ind, y in enumerate(triy):
	#y=triy[ind]
	z=triz[ind]
	y1=float(y[0])
	y2=float(y[1])
	y3=float(y[2])
	z1=float(z[0])
	z2=float(z[1])
	z3=float(z[2])
	
	moment=(((y1*y1)+(y1*y2)+(y2*y2))*((z1*y2)-(z2*y1))+((y2*y2)+(y3*y2)+(y3*y3))*((z2*y3)-(z3*y2))+((y3*y3)+(y3*y1)+(y1*y1))*((z3*y1)-(z1*y3)))/12
	
	moi.append(moment)

AD=[]

for i in range(len(centroidx)):
	x=math.sqrt(float(centroidy[i])*float(centroidy[i])+float(centroidz[i])*float(centroidz[i]))
	ad=area[i]*x*x + moi[i]
	AD.append(ad)

AD=sum(AD)
OUT=AD
# ----------------------------------------
translate_2 = Geometry.Translate(geometry=centroid, xTranslation=code_block_3, yTranslation=code_block_4, zTranslation=code_block_5)
translate_3 = Geometry.Translate(geometry=getItemAtIndex, xTranslation=code_block_3, yTranslation=code_block_4, zTranslation=code_block_5)
vertices_2 = Topology.Vertices(topology=translate_3)
pointGeometry_2 = Vertex.PointGeometry(vertex=vertices_2)
X_4 = Point.X(point=pointGeometry_2@L2)
Y_4 = Point.Y(point=pointGeometry_2@L2)
Z_4 = Point.Z(point=pointGeometry_2@L2)
code_block_7 = CodeBlock { 5; }
thicken_3 = Surface.Thicken(surface=translate_3, thickness=code_block_7)
centroid_3 = Solid.Centroid(solid=thicken_3)
area_3 = Surface.Area(surface=translate_3)
python_script_3 = Python(IN[0]=X_4, IN[1]=Y_4, IN[2]=Z_4, IN[3]=centroid_3, IN[4]=area_3)
# ---------- python_script_3.python (29 lines) ----------
# Load the Python Standard and DesignScript Libraries
import sys
import clr
clr.AddReference('ProtoGeometry')
from Autodesk.DesignScript.Geometry import *

# The inputs to this node will be stored as a list in the IN variables.
trix=IN[0]
triy=IN[1]
triz=IN[2]

trix=trix[0]+[trix[0][-1]]
triy=triy[0]+[triy[0][-1]]
triz=triz[0]+[triz[0][-1]]

centroid=IN[3]
moi=[]
for  i in range(len(centroid)):
	sub=[]
	for j in range(len(trix)-1):
		yi=triy[j]
		yi1=triy[j+1]
		zi=triz[j]
		zi1=triz[j+1]
		
		moment=(yi*zi1 - yi1*zi)*(yi*yi+yi*yi1+yi1*yi1)/12	
		sub.append(moment)
	moi.append(sum(sub))
OUT=moi
# ----------------------------------------
centroid_4 = Solid.Centroid(solid=solids)
X_5 = Point.X(point=centroid_4)
code_block_8 = CodeBlock(a=X_5) { -1*a; }
Y_5 = Point.Y(point=centroid_4)
code_block_9 = CodeBlock(a=Y_5) { -1*a; }
Z_5 = Point.Z(point=centroid_4)
code_block_10 = CodeBlock(a=Z_5) { -1*a; }
translate_4 = Geometry.Translate(geometry=solids, xTranslation=code_block_8, yTranslation=code_block_9, zTranslation=code_block_10)
XZ = Plane.XZ()
split = Geometry.Split(geometry=translate_4, other=XZ)
centroid_5 = Solid.Centroid(solid=split)
X_6 = Point.X(point=centroid_5)
Y_6 = Point.Y(point=centroid_5)
Z_6 = Point.Z(point=centroid_5)
volume = Solid.Volume(solid=split)
python_script_4 = Python(IN[0]=X_6, IN[1]=Y_6, IN[2]=Z_6, IN[3]=volume)
# ---------- python_script_4.python (29 lines) ----------
# Load the Python Standard and DesignScript Libraries
import sys
import clr
clr.AddReference('ProtoGeometry')
from Autodesk.DesignScript.Geometry import *

# The inputs to this node will be stored as a list in the IN variables.
x1=IN[0][0][0]
y1=IN[1][0][0]
z1=IN[2][0][0]

x2=IN[0][0][1]
y2=IN[1][0][1]
z2=IN[2][0][1]

v1=IN[3][0][0]
v2=IN[3][0][1]
import math

d1=math.sqrt(float(x1)*float(x1)+float(y1)*float(y1)+float(z1)*float(z1))

d2=math.sqrt(float(x2)*float(x2)+float(y2)*float(y2)+float(z2)*float(z2))

m1=float(v1)*d1*d1
m2=float(v2)*d2*d2

m=m1+m2

OUT=m
# ----------------------------------------
YZ = Plane.YZ()
split_2 = Geometry.Split(geometry=translate_4, other=YZ)
centroid_6 = Solid.Centroid(solid=split_2)
X_7 = Point.X(point=centroid_6)
Y_7 = Point.Y(point=centroid_6)
Z_7 = Point.Z(point=centroid_6)
volume_2 = Solid.Volume(solid=split_2)
python_script_5 = Python(IN[0]=X_7, IN[1]=Y_7, IN[2]=Z_7, IN[3]=volume_2)  # same code as python_script_4
XY = Plane.XY()
split_3 = Geometry.Split(geometry=translate_4, other=XY)
centroid_7 = Solid.Centroid(solid=split_3)
X_8 = Point.X(point=centroid_7)
Y_8 = Point.Y(point=centroid_7)
Z_8 = Point.Z(point=centroid_7)
volume_3 = Solid.Volume(solid=split_3)
python_script_6 = Python(IN[0]=X_8, IN[1]=Y_8, IN[2]=Z_8, IN[3]=volume_3)  # same code as python_script_4
byGeometry_2 = Autodesk.Dynamo.MeshToolkit.Mesh.ByGeometry(inputGeometry=solids)
triangles_2 = Autodesk.Dynamo.MeshToolkit.Mesh.Triangles(mesh=byGeometry_2)
