# Dynamo graph Final Cutting the ribs.dyn "v5" (Dynamo 2.5.0.7460)
# packages: Rhythm 2020.1.22, bimorphNodes 3.0.3, Clockwork for Dynamo 2.x 2.3.0, spring nodes 204.1.0, Modelical 2.2.19, Orchid 203.3.0.7815, Sastrugi 2.0.0

select_model_elements = DSModelElementsSelection()  # 452 picked in the model
code_block = CodeBlock { "B6_1D_Element_Category"; }
ʳʰʸᵗʰᵐ_elements = Rhythm.Revit.Elements.Elements.GetParameterValueByNameTypeOrInstance(element=select_model_elements, parameterName=code_block)
code_block_2 = CodeBlock { "rib"; true; }
contains = String.Contains(str=ʳʰʸᵗʰᵐ_elements, searchFor=code_block_2.out0, ignoreCase=code_block_2.out1)
filterByBoolMask = List.FilterByBoolMask(list=select_model_elements, mask=contains)
code_block_3 = CodeBlock(a=filterByBoolMask.in) { a; }
code_block_4 = CodeBlock { true; }
ne = contains != code_block_4
filterByBoolMask_2 = List.FilterByBoolMask(list=select_model_elements, mask=ne)
code_block_5 = CodeBlock(a=filterByBoolMask_2.in) { a; }
intersectsElement = Revit.Element.IntersectsElement(elementSetA=code_block_3, elementSetB=code_block_5)
python_script = Python(IN[0]=intersectsElement.Element, IN[1]=intersectsElement.intersectsWith)
# ---------- python_script.python (17 lines) ----------
# Load the Python Standard and DesignScript Libraries
import sys
import clr
clr.AddReference('ProtoGeometry')
from Autodesk.DesignScript.Geometry import *

# The inputs to this node will be stored as a list in the IN variables.
walls=IN[0]
ribs=IN[1]
ribsf=[]
wallsf=[]
for ind, i in enumerate(walls):
	if i!=[] and i!="" and i!=None:
		wallsf.append(i)
		ribsf.append(ribs[ind])

OUT=wallsf, ribsf
# ----------------------------------------
code_block_6 = CodeBlock(a=python_script) { a[0]; }

# group: Walls Solids
solids = Revit.LinkElement.Solids(linkElement=code_block_6)
python_script_2 = Python(IN[0]=solids)
# ---------- python_script_2.python (17 lines) ----------
# Load the Python Standard and DesignScript Libraries
import sys
import clr
clr.AddReference('ProtoGeometry')
from Autodesk.DesignScript.Geometry import *

# The inputs to this node will be stored as a list in the IN variables.
walls=IN[0]
final=[]
for i in walls:
	sub=[]
	if i!=None and i!=[]:
		for j in i:
			if j!=[] and j!=None:
				sub.append(j)
		final.append(sub)
OUT= final		
# ----------------------------------------
python_script_3 = Python(IN[0]=python_script_2)
# ---------- python_script_3.python (18 lines) ----------
# Load the Python Standard and DesignScript Libraries
import sys
import clr
clr.AddReference('ProtoGeometry')
from Autodesk.DesignScript.Geometry import *

# The inputs to this node will be stored as a list in the IN variables.
geom=IN[0]
from functools import reduce

final=[]
for i in geom:
	if i!=None and i!=[]:
		x=reduce(lambda x,y:x+y,i)
		final.append(x)
	else:
		final.append([])
OUT=final
# ----------------------------------------

code_block_7 = CodeBlock(a=python_script) { a[1]; }

# group: Ribs
solids_2 = Revit.LinkElement.Solids(linkElement=code_block_7)
flatten = List.Flatten(list=solids_2)

# group: Intersection Checker
python_script_4 = Python(IN[0]=python_script_3, IN[1]=flatten)
# ---------- python_script_4.python (36 lines) ----------
# Load the Python Standard and DesignScript Libraries
import sys
import clr
clr.AddReference('ProtoGeometry')
from Autodesk.DesignScript.Geometry import *

# The inputs to this node will be stored as a list in the IN variables.
walls=IN[0]
ribs=IN[1]

faces=[]
ribsf=[]
indexw=[]
indexr=[]
for ind, i in enumerate(ribs):
	subw=[]
	subr=[]
	subiw=[]
	subri=[]
	if i!=None and i!=[] and i!='':
		face=walls[ind]
		if face!=None and face!=[] and face!="":		
			for ind1, j in enumerate(face):
				if j!=None and j!=[]:
					boo=i.DoesIntersect(j)
					if boo==True:
						subw.append(j)
						subiw.append(ind1)
			ribsf.append(i)
			indexr.append(ind)			
			faces.append(subw)
			indexw.append(subiw)

OUT= indexr, ribsf, indexw, faces
	
	
# ----------------------------------------

surface_index = CodeBlock(a=python_script_4) { a[2]; }

# group: Ribs
ribs_solids = CodeBlock(a=python_script_4) { a[1]; }

surface = CodeBlock(a=python_script_4) { a[3]; }

# group: Intersection Volume Out
python_script_5 = Python(IN[0]=ribs_solids, IN[1]=surface)
# ---------- python_script_5.python (21 lines) ----------
# Load the Python Standard and DesignScript Libraries
import sys
import clr
clr.AddReference('ProtoGeometry')
from Autodesk.DesignScript.Geometry import *

ribs=IN[0]
surface=IN[1]
surfaces=[]
for ind, i in enumerate(ribs):
	surf=surface[ind]
	sub=[]
	if surf!=[] and surf!=None and surf!='':
		try:
			for j in surf:
				x=Geometry.Intersect(i,j)
				sub.append(x)
			surfaces.append(sub)
		except:
			surfaces.append([])
OUT=surfaces
# ----------------------------------------

# group: union
python_script_6 = Python(IN[0]=python_script_5)
# ---------- python_script_6.python (34 lines) ----------
# Load the Python Standard and DesignScript Libraries
import sys
import clr
clr.AddReference('ProtoGeometry')
from Autodesk.DesignScript.Geometry import *

# The inputs to this node will be stored as a list in the IN varif

from functools import reduce

solids=IN[0]
final=[]
for i in solids:
	if i!=[] and i!=None:
		x=reduce(lambda x,y : x+y, i)
		final.append(x)
	else:
		final.append([])
sol=[]
for i in final:
	if i==[]:
		sol.append([])
	
	elif len(i)==1:
		sol.append(i[0])
	else:
		ini=i[0]
		sub=[ini]
		for j in range(1,len(i)-1):
			ini1=Solid.Union(sub[0],i[j])
			sub[0]=ini1
		sol.append(sub[0])
		
OUT=sol
# ----------------------------------------

python_script_7 = Python(IN[0]=ribs_solids, IN[1]=python_script_6)
# ---------- python_script_7.python (18 lines) ----------
# Load the Python Standard and DesignScript Libraries
import sys
import clr
clr.AddReference('ProtoGeometry')
from Autodesk.DesignScript.Geometry import *

# The inputs to this node will be stored as a list in the IN variables.
ribs=IN[0]
solids=IN[1]
final=[]
for ind, i in enumerate(solids):
	rib=ribs[ind]
	try:
		r1=Solid.Difference(rib,i)
		final.append(r1)
	except:
		final.append([])
OUT=final
# ----------------------------------------
ribs_index = CodeBlock(a=python_script_4) { a[0]; }
getItemAtIndex = List.GetItemAtIndex(list=code_block_7, index=ribs_index)

# group: New Names
name = Custom[Element.Name+](element=getItemAtIndex)  # package Clockwork for Dynamo 2.x; Gets an element's name. Unlike the OOTB node, this node should work for all Revit elements that have names and will also return the localized names of system parameters, parameter groups, display unit types, parameter types, unit symbol types and unit types.
python_script_8 = Python(IN[0]=name)
# ---------- python_script_8.python (20 lines) ----------
# Load the Python Standard and DesignScript Libraries
import sys
import clr
clr.AddReference('ProtoGeometry')
from Autodesk.DesignScript.Geometry import *

# The inputs to this node will be stored as a list in the IN variables.
sol=IN[0]

l=len(sol)

names=[]
for i in sol:
	name=i+"_new"
	if name not in names:
		names.append(name)
	else:
		names.append(name+'1')
# Assign your output to the OUT variable.
OUT = names
# ----------------------------------------

materials = Material("Concrete, Cast In Situ")
name_2 = Material.Name(material=materials)

# group: Refined Families
boolean = BoolSelector(false)
file_path = Filename("..\..\..\..\..\..\..\ProgramData\Autodesk\RVT 2021\Family Templates\English\Metric Generic Model.rft")
categories = Categories("OST_GenericModel")
ꟿ_familyinstance_bygeometry = Custom[ꟿ FamilyInstance.ByGeometry](geometry=python_script_7, familyTemplatePath=file_path, familyName=python_script_8, category=categories, materialName=name_2, lacing=Longest)  # frozen; package spring nodes; You must provide a valid family template path that will be used for all input geometry objects. The project units(and not the templates) will be used to determine the size of the output geometry. The provided category will be used only if the family template supports it. If not, the default template category will be used instead. Likewise, the family material(provided as a string) will be set only if a material with that name exists in the template. If not, the default material will be used instead ("By Category"). For void cuts, the material settings will be ignored. The Subcategory name is an optional input. If you'd like to skip assigning a Subcategory to any new instance, simply use null. The node expects a unique family name for each geometry object. The rest of the input lists will be processed as if the node lacing is set to longest.

selectInRevit = Custom[SelectInRevit]()  # frozen; package Modelical; Select elements in Revit by Element or ID; unwired: ElemsOrIDs

# group: Planes with max. area
faces = Element.Faces(element=getItemAtIndex)
area = Surface.Area(surface=faces)
python_script_9 = Python(IN[0]=area, IN[1]=faces)
# ---------- python_script_9.python (16 lines) ----------
# Load the Python Standard and DesignScript Libraries
import sys
import clr
clr.AddReference('ProtoGeometry')
from Autodesk.DesignScript.Geometry import *

# The inputs to this node will be stored as a list in the IN variables.
area=IN[0]
surface=IN[1]
final=[]
for ind, i in enumerate(area):
	surf=surface[ind]
	x=max(i)
	ind1=i.index(x)
	final.append(surf[ind1])
OUT=final
# ----------------------------------------
surface_plane = Custom[❄_Surface Plane](InputSurfaces=python_script_9)  # package Sastrugi; (Sastrugi_Geometry) This node will extract a plane that best fits a surface.

# group: Angle between Plane and Original Z axis
origin = Plane.Origin(plane=surface_plane)
normal = Plane.Normal(plane=surface_plane)
ZAxis = Vector.ZAxis()
XAxis = Plane.XAxis(plane=surface_plane)
angleAboutAxis = Vector.AngleAboutAxis(vector=ZAxis, otherVector=XAxis, rotationAxis=normal)

code_block_8 = CodeBlock(a=angleAboutAxis) { -a; }

# group: Plane Rotation
rotate = Geometry.Rotate(geometry=surface_plane, origin=origin, axis=normal, degrees=code_block_8)

# group: Wall Inter. Centroid
centroid = Solid.Centroid(solid=python_script_6)

# group: Plane origin and centroid of intersection difference
X = Point.X(point=origin)
X_2 = Point.X(point=centroid)
Y = Point.Y(point=origin)
Y_2 = Point.Y(point=centroid)
Z = Point.Z(point=origin)
Z_2 = Point.Z(point=centroid)

flatten_2 = List.Flatten(list=X)
flatten_3 = List.Flatten(list=Y)
flatten_4 = List.Flatten(list=Z)
python_script_10 = Python(IN[0]=flatten_2, IN[1]=X_2, IN[2]=flatten_3, IN[3]=Y_2, IN[4]=flatten_4, IN[5]=Z_2)
# ---------- python_script_10.python (24 lines) ----------
# Load the Python Standard and DesignScript Libraries
import sys
import clr
clr.AddReference('ProtoGeometry')
from Autodesk.DesignScript.Geometry import *

# The inputs to this node will be stored as a list in the IN variables.
x=[]
y=[]
z=[]
for ind, i in enumerate(IN[0]):
	y1=IN[1][ind]
	z1=IN[2][ind]
	x2=IN[3][ind]
	y2=IN[4][ind]
	z2=IN[5][ind]
	if i!=[] and y1!=[] and z1!=[] and x2!='' and y2!="" and z2!='':
		x.append(x2-i)
		y.append(y2-y1)
		z.append(z2-z1)
OUT=x, y, z
	
	
	
# ----------------------------------------
code_block_9 = CodeBlock(a=python_script_10) { a[0]; }
code_block_10 = CodeBlock(a=python_script_10) { a[1]; }
code_block_11 = CodeBlock(a=python_script_10) { a[2]; }

# group: Translating Plane
translate = Geometry.Translate(geometry=rotate, xTranslation=code_block_9, yTranslation=code_block_10, zTranslation=code_block_11)
code_block_12 = CodeBlock { 1000; }
byWidthLength = Rectangle.ByWidthLength(plane=translate, width=code_block_12, length=code_block_12)

YAxis = Plane.YAxis(plane=translate)

# group: 1. Wall Translation by 5 units
code_block_13 = CodeBlock { 50; }
translate_2 = Geometry.Translate(geometry=python_script_6, direction=YAxis, distance=code_block_13)

python_script_11 = Python(IN[0]=python_script_7, IN[1]=translate_2)
# ---------- python_script_11.python (18 lines) ----------
# Load the Python Standard and DesignScript Libraries
import sys
import clr
clr.AddReference('ProtoGeometry')
from Autodesk.DesignScript.Geometry import *

# The inputs to this node will be stored as a list in the IN variables.
ribs=IN[0]
solids=IN[1]
final=[]
for ind, i in enumerate(solids):
	rib=ribs[ind]
	try:
		r1=Solid.Difference(rib,i[0])
		final.append(r1)
	except:
		final.append([])
OUT=final
# ----------------------------------------
volume = Solid.Volume(solid=python_script_11)

# group: Vector
YAxis_2 = Plane.YAxis(plane=translate)
reverse = Vector.Reverse(vector=YAxis_2)
origin_2 = Plane.Origin(plane=translate)

# group: 1. Wall Translation by 5 units
code_block_14 = CodeBlock { 50; }
translate_3 = Geometry.Translate(geometry=python_script_6, direction=reverse, distance=code_block_14)

python_script_12 = Python(IN[0]=python_script_7, IN[1]=translate_3)  # same code as python_script_11
volume_2 = Solid.Volume(solid=python_script_12)
python_script_13 = Python(IN[0]=python_script_11, IN[1]=volume, IN[2]=python_script_12, IN[3]=volume_2)
# ---------- python_script_13.python (24 lines) ----------
# Load the Python Standard and DesignScript Libraries
import sys
import clr
clr.AddReference('ProtoGeometry')
from Autodesk.DesignScript.Geometry import *

# The inputs to this node will be stored as a list in the IN variables.
sol1=IN[0]
vol1=IN[1]
sol2=IN[2]
vol2=IN[3]
sol=[]
for ind, i in enumerate(sol1):
	vol1s=vol1[ind]
	sol2s=sol2[ind]
	vol2s=vol2[ind]
	if i!=[] and i!=None and sol2s!=[] and sol2s!=None:
		if vol1s<vol2s:
			sol.append(sol2s)
		else:
			sol.append(i)
	else:
		sol.append([])
OUT=sol
# ----------------------------------------

# group: Refined Instances
categories_2 = Categories("OST_GenericModel")
materials_2 = Material("Concrete, Cast In Situ")
byGeometry = DirectShape.ByGeometry(geometry=python_script_13, category=categories_2, material=materials_2, name=python_script_8)
selectInRevit_2 = Custom[SelectInRevit](ElemsOrIDs=byGeometry)

origin_3 = Plane.Origin(plane=translate)

# group: Line To visualise Axis
code_block_15 = CodeBlock { 100; }
byStartPointDirectionLength = Line.ByStartPointDirectionLength(startPoint=origin_3, direction=YAxis, length=code_block_15)

code_block_16 = CodeBlock { 1000; }
byStartPointDirectionLength_2 = Line.ByStartPointDirectionLength(startPoint=origin_2, direction=reverse, length=code_block_16)
origin_4 = Plane.Origin(plane=translate)
normal_2 = Plane.Normal(plane=translate)

# group: Line To visualise Axis
code_block_17 = CodeBlock { 1000; }
byStartPointDirectionLength_3 = Line.ByStartPointDirectionLength(startPoint=origin_4, direction=normal_2, length=code_block_17)

normal_3 = Plane.Normal(plane=translate)

# group: Vector
origin_5 = Plane.Origin(plane=translate)
reverse_2 = Vector.Reverse(vector=normal_3)

code_block_18 = CodeBlock { 1000; }
byStartPointDirectionLength_4 = Line.ByStartPointDirectionLength(startPoint=origin_5, direction=reverse_2, length=code_block_18)

# group: Non_ Refined Instances
python_script_14 = Python(IN[0]=ribs_solids, IN[1]=python_script_6)  # same code as python_script_7
categories_3 = Categories("OST_GenericModel")
materials_3 = Material("Concrete, Cast In Situ")
byGeometry_2 = DirectShape.ByGeometry(geometry=python_script_14, category=categories_3, material=materials_3, name=python_script_8)
selectInRevit_3 = Custom[SelectInRevit](ElemsOrIDs=byGeometry_2)
