# Dynamo graph v2.dyn (Dynamo 2.5.0.7460)
# packages: Rhythm 2020.1.22, bimorphNodes 3.0.3, Modelical 2.2.19

select_model_elements = DSModelElementsSelection()  # 209 picked in the model
code_block = CodeBlock { "B6_1D_Element_Category"; }
ʳʰʸᵗʰᵐ_elements = Rhythm.Revit.Elements.Elements.GetParameterValueByNameTypeOrInstance(element=select_model_elements, parameterName=code_block)
code_block_2 = CodeBlock { "rib"; true; }
contains = String.Contains(str=ʳʰʸᵗʰᵐ_elements, searchFor=code_block_2.out0, ignoreCase=code_block_2.out1)
filterByBoolMask = List.FilterByBoolMask(list=select_model_elements, mask=contains)
code_block_3 = CodeBlock(a=filterByBoolMask.in) { a; }
code_block_4 = CodeBlock { true; }
ne = contains != code_block_4
filterByBoolMask_2 = List.FilterByBoolMask(list=select_model_elements, mask=ne)
code_block_5 = CodeBlock(a=filterByBoolMask_2.in) { a; }
intersectsElement = Revit.Element.IntersectsElement(elementSetA=code_block_3, elementSetB=code_block_5)
python_script = Python(IN[0]=intersectsElement.Element, IN[1]=intersectsElement.intersectsWith)
# ---------- python_script.python (17 lines) ----------
# Load the Python Standard and DesignScript Libraries
import sys
import clr
clr.AddReference('ProtoGeometry')
from Autodesk.DesignScript.Geometry import *

# The inputs to this node will be stored as a list in the IN variables.
walls=IN[0]
ribs=IN[1]
ribsf=[]
wallsf=[]
for ind, i in enumerate(walls):
	if i!=[] and i!="" and i!=None:
		wallsf.append(i)
		ribsf.append(ribs[ind])

OUT=wallsf, ribsf
# ----------------------------------------
code_block_6 = CodeBlock(a=python_script) { a[0]; }
flatten = List.Flatten(list=code_block_6)
faces = Element.Faces(element=flatten)
code_block_7 = CodeBlock(a=python_script) { a[1]; }
geometry = Element.Geometry(element=code_block_7)
python_script_2 = Python(IN[0]=faces, IN[1]=geometry)
# ---------- python_script_2.python (35 lines) ----------
# Load the Python Standard and DesignScript Libraries
import sys
import clr
clr.AddReference('ProtoGeometry')
from Autodesk.DesignScript.Geometry import *

# The inputs to this node will be stored as a list in the IN variables.
walls=IN[0]
ribs=IN[1]

faces=[]
ribsf=[]
indexw=[]
indexr=[]
for ind, i in enumerate(ribs):
	subw=[]
	subr=[]
	subiw=[]
	subri=[]
	if i!=None and i!=[] and i!='':
		face=walls[ind]
		if face!=None and face!=[] and face!="":		
			for ind1, j in enumerate(face):
				boo=i[0].DoesIntersect(j)
				if boo==True:
					subw.append(j)
					subiw.append(ind1)
			ribsf.append(i)
			indexr.append(ind)			
			faces.append(subw)
			indexw.append(subiw)

OUT= indexr, ribsf, indexw, faces
	
	
# ----------------------------------------
ribs_index = CodeBlock(a=python_script_2) { a[0]; }
surface_index = CodeBlock(a=python_script_2) { a[2]; }
selectInRevit = Custom[SelectInRevit]()  # package Modelical; Select elements in Revit by Element or ID; unwired: ElemsOrIDs
ribs_solids = CodeBlock(a=python_script_2) { a[1]; }
surface = CodeBlock(a=python_script_2) { a[3]; }
python_script_3 = Python(IN[0]=ribs_solids, IN[1]=surface)
# ---------- python_script_3.python (19 lines) ----------
# Load the Python Standard and DesignScript Libraries
import sys
import clr
clr.AddReference('ProtoGeometry')
from Autodesk.DesignScript.Geometry import *

ribs=IN[0]
surface=IN[1]
surfaces=[]
for ind, i in enumerate(ribs):
	surf=surface[ind]
	sub=[]
	if surf!=[] and surf!=None and surf!='':
		for j in surf:
			x=Geometry.Intersect(j,i[0])
			sub.append(x)
		surfaces.append(sub)

OUT=surfaces
# ----------------------------------------
python_script_4 = Python(IN[0]=python_script_3)
# ---------- python_script_4.python (15 lines) ----------
# Load the Python Standard and DesignScript Libraries
import sys
import clr
clr.AddReference('ProtoGeometry')
from Autodesk.DesignScript.Geometry import *

# The inputs to this node will be stored as a list in the IN variables.
geom=IN[0]
from functools import reduce

final=[]
for i in geom:
	x=reduce(lambda x,y:x+y,i)
	final.append(x)
OUT=final
# ----------------------------------------
code_block_8 = CodeBlock { 1000; false; }
thicken = Surface.Thicken(surface=python_script_4, thickness=code_block_8.out0, both_sides=code_block_8.out1)
area = Surface.Area(surface=surface)
python_script_5 = Python(IN[0]=surface, IN[1]=area)
# ---------- python_script_5.python (22 lines) ----------
# Load the Python Standard and DesignScript Libraries
import sys
import clr
clr.AddReference('ProtoGeometry')
from Autodesk.DesignScript.Geometry import *

# The inputs to this node will be stored as a list in the IN variables.
surface=IN[0]
area=IN[1]
surfacen=[]
for ind, i in enumerate(area):
	if i!=[] and i!=None:
		surf=surface[ind]
		zipped=zip(i,surf)
		sortedpair=sorted(zipped)
		tuples=zip(*sortedpair)

		arean, surfn=[list(tuple) for tuple in tuples]
		surfacen.append(surfn)
	else:
		surfacen.append([])
OUT=surfacen
# ----------------------------------------
area_2 = Surface.Area(surface=python_script_4)
code_block_9 = CodeBlock { 10; }
thicken_2 = Surface.Thicken(surface=python_script_3, thickness=code_block_9)
centroid = Solid.Centroid(solid=thicken_2)
normalAtPoint = Surface.NormalAtPoint(surface=python_script_4, point=centroid)
code_block_10 = CodeBlock { 1500; }
byStartPointDirectionLength = Line.ByStartPointDirectionLength(startPoint=centroid, direction=normalAtPoint, length=code_block_10)
Z = Vector.Z(vector=normalAtPoint)
