# Dynamo graph Final Surface Area of ribs.dyn (Dynamo 2.6.1.8786)
# packages: bimorphNodes 3.0.3, Sastrugi 2.0.0, Rhythm 2020.1.22, Modelical 2.2.19

select_model_elements = DSModelElementsSelection()  # 668 picked in the model
code_block = CodeBlock { "Comments"; }
ʳʰʸᵗʰᵐ_elements = Rhythm.Revit.Elements.Elements.GetParameterValueByNameTypeOrInstance(element=select_model_elements, parameterName=code_block)
code_block_2 = CodeBlock { "RIB"; true; }
contains = String.Contains(str=ʳʰʸᵗʰᵐ_elements, searchFor=code_block_2.out0, ignoreCase=code_block_2.out1)
filterByBoolMask = List.FilterByBoolMask(list=select_model_elements, mask=contains)
code_block_3 = CodeBlock(a=filterByBoolMask.in) { a; }
name = Element.Name(element=code_block_3)
faces = Element.Faces(element=code_block_3@L2)
code_block_4 = CodeBlock(a=faces) { a[0]; }
code_block_5 = CodeBlock { 10; }
thicken = Surface.Thicken(surface=code_block_4, thickness=code_block_5)
centroid = Solid.Centroid(solid=thicken)
Z = Point.Z(point=centroid)
round = Math.Round(number=Z)
python_script = Python(IN[0]=round)
# ---------- python_script.python (29 lines) ----------
# Load the Python Standard and DesignScript Libraries
import sys
import clr
clr.AddReference('ProtoGeometry')
from Autodesk.DesignScript.Geometry import *

# The inputs to this node will be stored as a list in the IN variables.
num=IN[0]
finalmin=[]
finalmax=[]
for i in num:
	if i!=None:
		Min=min(i)
		Max=max(i)
		submin=[]
		submax=[]
	
		for ind1, j in enumerate(i):
			if j==Min:
				submin.append(ind1)
			elif j==Max:
				submax.append(ind1)
		finalmin.append(submin)
		finalmax.append(submax)
	else:
		finalmin.append(None)
		finalmax.append(None)		
	
OUT= finalmin, finalmax
# ----------------------------------------
min = CodeBlock(a=python_script) { a[0]; }
getItemAtIndex = List.GetItemAtIndex(list=code_block_4@L2, index=min@L2)
max = CodeBlock(a=python_script) { a[1]; }
getItemAtIndex_2 = List.GetItemAtIndex(list=code_block_4@L2, index=max@L2)
code_block_6 = CodeBlock { "Lateral Area"; }
area = Surface.Area(surface=code_block_4)
sum = Math.Sum(values=area)

# group: Planes with max. area
faces_2 = Element.Faces(element=code_block_3)
area_2 = Surface.Area(surface=faces_2)
python_script_2 = Python(IN[0]=area_2, IN[1]=faces_2)
# ---------- python_script_2.python (19 lines) ----------
# Load the Python Standard and DesignScript Libraries
import sys
import clr
clr.AddReference('ProtoGeometry')
from Autodesk.DesignScript.Geometry import *

# The inputs to this node will be stored as a list in the IN variables.
area=IN[0]
surface=IN[1]
final=[]
for ind, i in enumerate(area):
	if i!=None:
		surf=surface[ind]
		x=max(i)
		ind1=i.index(x)
		final.append(surf[ind1])
	else:
		final.append(None)
OUT=final
# ----------------------------------------
surface_plane = Custom[❄_Surface Plane](InputSurfaces=python_script_2)  # package Sastrugi; (Sastrugi_Geometry) This node will extract a plane that best fits a surface.

# group: Angle between Plane and Original Z axis
origin = Plane.Origin(plane=surface_plane)
normal = Plane.Normal(plane=surface_plane)
ZAxis = Vector.ZAxis()
XAxis = Plane.XAxis(plane=surface_plane)
angleAboutAxis = Vector.AngleAboutAxis(vector=ZAxis, otherVector=XAxis, rotationAxis=normal)

code_block_7 = CodeBlock(a=angleAboutAxis) { -a; }

# group: Plane Rotation
rotate = Geometry.Rotate(geometry=surface_plane, origin=origin, axis=normal, degrees=code_block_7)

# group: Ribs
solids = Revit.LinkElement.Solids(linkElement=code_block_3)
flatten = List.Flatten(list=solids)
centroid_2 = Solid.Centroid(solid=flatten)

byTwoPoints = Vector.ByTwoPoints(start=origin, end=centroid_2)

# group: BB
boundingBox = Element.BoundingBox(element=code_block_3)
toCuboid = BoundingBox.ToCuboid(boundingBox=boundingBox)
centroid_3 = Solid.Centroid(solid=toCuboid)

# group: Plane rotation and Translation to Centroid of Bounding Box
translate = Geometry.Translate(geometry=rotate, direction=byTwoPoints)
origin_2 = Plane.Origin(plane=translate)
byTwoPoints_2 = Vector.ByTwoPoints(start=origin_2, end=centroid_3)
translate_2 = Geometry.Translate(geometry=translate, direction=byTwoPoints_2)

X = Point.X(point=centroid_3)
Y = Point.Y(point=centroid_3)
Z_2 = Point.Z(point=centroid_2)
byCoordinates = Point.ByCoordinates(x=X, y=Y, z=Z_2)

# group: Creating a line from centroid and selecting a point at 0.6
byTwoPoints_3 = Vector.ByTwoPoints(start=origin_2, end=byCoordinates)
code_block_8 = CodeBlock { 4000; }
byStartPointDirectionLength = Line.ByStartPointDirectionLength(startPoint=origin_2, direction=byTwoPoints_3, length=code_block_8)
code_block_9 = CodeBlock { 0.6; }
pointAtParameter = Curve.PointAtParameter(curve=byStartPointDirectionLength, param=code_block_9)

# group: Translating point in z axis
flatten_2 = List.Flatten(list=pointAtParameter)
X_2 = Point.X(point=flatten_2)
Y_2 = Point.Y(point=flatten_2)
Z_3 = Point.Z(point=flatten_2)
code_block_10 = CodeBlock(a=Z_3) { a-1000; }
byCoordinates_2 = Point.ByCoordinates(x=X_2, y=Y_2, z=code_block_10)

# group: Plane to new point
byTwoPoints_4 = Vector.ByTwoPoints(start=origin_2, end=byCoordinates_2)
translate_3 = Geometry.Translate(geometry=translate_2, direction=byTwoPoints_4)

# group: Local Coordinate and local planes
byPlane = CoordinateSystem.ByPlane(plane=translate_3)
YZPlane = CoordinateSystem.YZPlane(coordinateSystem=byPlane)
ZXPlane = CoordinateSystem.ZXPlane(coordinateSystem=byPlane)

# group: Translating Plane
code_block_11 = CodeBlock { 5000; 1000; }
byWidthLength = Rectangle.ByWidthLength(plane=YZPlane, width=code_block_11.out0, length=code_block_11.out1)

# group: Translating Plane
code_block_12 = CodeBlock { 2000; 8000; }
byWidthLength_2 = Rectangle.ByWidthLength(plane=ZXPlane, width=code_block_12.out0, length=code_block_12.out1)

# group: Surface by Planes
byPatch = Surface.ByPatch(closedCurve=byWidthLength)
byPatch_2 = Surface.ByPatch(closedCurve=byWidthLength_2)
list_create = List.Create(item0=byPatch, item1=byPatch_2)
transpose = List.Transpose(lists=list_create)
byJoinedSurfaces = PolySurface.ByJoinedSurfaces(surfaces=transpose)
byJoinedSurfaces_2 = PolySurface.ByJoinedSurfaces(surfaces=byJoinedSurfaces)

# group: Normal to Surface
code_block_13 = CodeBlock { 0.5; }
pointAtParameter_2 = Surface.PointAtParameter(surface=code_block_4, u=code_block_13, v=code_block_13)
code_block_14 = CodeBlock { 0.5; }
normalAtParameter = Surface.NormalAtParameter(surface=code_block_4, u=code_block_14, v=code_block_14)
code_block_15 = CodeBlock { 10000; }
byStartPointDirectionLength_2 = Line.ByStartPointDirectionLength(startPoint=pointAtParameter_2, direction=normalAtParameter, length=code_block_15)

direction = Line.Direction(line=byStartPointDirectionLength_2)
Z_4 = Vector.Z(vector=direction)
round_2 = Math.Round(number=Z_4)
maximumItem = List.MaximumItem(list=round_2)
code_block_16 = CodeBlock(x=round_2, max=maximumItem) { x==max||x==-10000; }
filterByBoolMask_2 = List.FilterByBoolMask(list=code_block_4@L2, mask=code_block_16@L2)
code_block_17 = CodeBlock(a=filterByBoolMask_2.in) { a; }

# group: Intersection Checker
python_script_3 = Python(IN[0]=byJoinedSurfaces_2, IN[1]=byStartPointDirectionLength_2, IN[2]=code_block_4, IN[3]=code_block_17)
# ---------- python_script_3.python (38 lines) ----------
# Load the Python Standard and DesignScript Libraries
import sys
import clr
clr.AddReference('ProtoGeometry')
from Autodesk.DesignScript.Geometry import *

# The inputs to this node will be stored as a list in the IN variables.
solids=IN[0]
lines=IN[1]
surfaces=IN[2]
surfacesb=IN[3]

final=[]

for ind, i in enumerate(solids):	
	line=lines[ind]
	surface=surfaces[ind]
	sub=[]
	if i!=None:
		for ind1, j in enumerate(line):
			surf=surface[ind1]
			boo=j.DoesIntersect(i)
			if boo==True:
			
				sub.append(surf)
		final.append(sub)
	else:
		final.append(None)
finalf=[]
for ind, i in enumerate(final):
	if i!=None:
		
		surfb=surfacesb[ind]
		f=i+surfb
		finalf.append(f)
	else:
		finalf.append(None)
OUT=finalf
# ----------------------------------------

area_3 = Surface.Area(surface=python_script_3)
sum_2 = Math.Sum(values=area_3)
python_script_4 = Python(IN[0]=sum, IN[1]=sum_2)
# ---------- python_script_4.python (15 lines) ----------
# Load the Python Standard and DesignScript Libraries
import sys
import clr
clr.AddReference('ProtoGeometry')
from Autodesk.DesignScript.Geometry import *

# The inputs to this node will be stored as a list in the IN variables.
OUT=[i-IN[1][ind] for ind, i in enumerate(IN[0]) if i!=None]
final=[]
for ind, i in enumerate(IN[0]):
	if i!=None:
		final.append(i-IN[1][ind])
	else:
		final.append([])
OUT=final
# ----------------------------------------
code_block_18 = CodeBlock(a=python_script_4) { a/1000000; }
setParameterByName = Element.SetParameterByName(element=code_block_3, parameterName=code_block_6, value=code_block_18)
filterByBoolMask_3 = List.FilterByBoolMask(list=byStartPointDirectionLength_2, mask=code_block_16)
python_script_5 = Python()  # unwired: IN[0], IN[1], IN[2]
# ---------- python_script_5.python (29 lines) ----------
# Load the Python Standard and DesignScript Libraries
import sys
import clr
clr.AddReference('ProtoGeometry')
from Autodesk.DesignScript.Geometry import *

# The inputs to this node will be stored as a list in the IN variables.
solids=IN[0]
lines=IN[1]
surfaces=IN[2]

final=[]

for ind, i in enumerate(solids):	
	line=lines[ind]
	surface=surfaces[ind]
	sub=[]
	if i!=None:
		for ind1, j in enumerate(line):
			surf=surface[ind1]
			boo=j.DoesIntersect(i)
			if boo==True:
			
				sub.append(surf)
		final.append(sub)
	else:
		final.append(None)

OUT=final
# ----------------------------------------
select_model_elements_2 = DSModelElementsSelection()  # 668 picked in the model
selectInRevit = Custom[SelectInRevit](ElemsOrIDs=filterByBoolMask.in)  # package Modelical; Select elements in Revit by Element or ID
