# Dynamo graph Views from Linked File data.dyn (Dynamo 2.6.1.8786)
# packages: bimorphNodes 3.0.3, archi-lab.net 2021.25.2721, Synthesize toolkit 11.9.3

duplicate_options = DuplicateOptionsUi("WithDetailing")
getDocuments = archilab.Revit.Selection.Select.GetDocuments()
categories = Categories("OST_Views")
ofCategory = Revit.LinkElement.OfCategory(linkInstance=getDocuments.Link_Instance, Category=categories)
code_block = CodeBlock(a=ofCategory) { a[11]; }
element = Revit.LinkElement.Element(linkElement=code_block)
flatten = List.Flatten(list=element)  # frozen
code_block_2 = CodeBlock(a=flatten) { a[0..10]; }
name = Element.Name(element=code_block_2)
python_script = Python(IN[0]=name)
# ---------- python_script.python (19 lines) ----------
# Load the Python Standard and DesignScript Libraries
import sys
import clr
clr.AddReference('ProtoGeometry')
from Autodesk.DesignScript.Geometry import *

# The inputs to this node will be stored as a list in the IN variables.
views=IN[0]
final=[]
suffix=" Dup Link"
for i in views:
	if i!=None and i!=[]:
		final.append(i+suffix)

	else:
		final.append([])


OUT=final
# ----------------------------------------
python_script_2 = Python(IN[0]=code_block_2, IN[1]=python_script)
# ---------- python_script_2.python (29 lines) ----------
import clr
clr.AddReference('RevitAPI')
import Autodesk
from Autodesk.Revit.DB import *

clr.AddReference('RevitServices')
import RevitServices
from RevitServices.Persistence import DocumentManager
from RevitServices.Transactions import TransactionManager
from System.Collections.Generic import*

doc = DocumentManager.Instance.CurrentDBDocument

elements = UnwrapElement(IN[0]) if isinstance(IN[0],list) else [UnwrapElement(IN[0])]
names = IN[1] if isinstance(IN[1],list) else [IN[1]]
newElems=[]

idList = List[ElementId]([elem.Id for elem in elements])

TransactionManager.Instance.EnsureInTransaction(doc)
copyid = ElementTransformUtils.CopyElements(doc, idList, doc, Transform.Identity, CopyPasteOptions())
for id,name in zip(copyid,names) :
	newElem = doc.GetElement(id)
	newElem.Name = unicode(name)
	newElems.append(newElem)
TransactionManager.Instance.TransactionTaskDone()

if isinstance(IN[0], list): OUT = newElems
else: OUT = newElems[0]
# ----------------------------------------
copyFromLinkInstance = Custom[SP.Doc.CopyFromLinkInstance]()  # package Synthesize toolkit; The node will use the total transformation of the link instance to copy the input elements into the local document.; unwired: VARLinkInstance, VARelement
code_block_3 = CodeBlock(a=code_block) { a[0..10]; }
copyToActiveDocument = Revit.LinkElement.CopyToActiveDocument(linkElements=code_block_3)
