# Dynamo graph 3. Title Blocks and sheet parameter assignment.dyn "Title Blocks Copy" (Dynamo 2.5.0.7460)
# packages: Rhythm 2020.1.22

categories = Categories("OST_Sheets")
all_elements_of_category = ElementsOfCategory(Category=categories)
name = Element.Name(element=all_elements_of_category)
python_script = Python(IN[0]=all_elements_of_category, IN[1]=name)
# ---------- python_script.python (23 lines) ----------
# Load the Python Standard and DesignScript Libraries
import sys
import clr
clr.AddReference('ProtoGeometry')
from Autodesk.DesignScript.Geometry import *

# The inputs to this node will be stored as a list in the IN variables.
sub="Tower Footprint"

sheets=IN[0]
names=IN[1]
index=[]
namef=[]
sheetf=[]
for ind, i in enumerate(names):
	sheet=sheets[ind]
	if i!=None and i!=[] and i!='':
		if i.endswith(sub):
			sheetf.append(sheet)
			namef.append(i)			


OUT=sheetf, namef
# ----------------------------------------
code_block = CodeBlock(a=python_script) { a[0]; }
sheetNumber = Sheet.SheetNumber(sheet=code_block)

# group: Sheet num to control param.
code_block_2 = CodeBlock { 55; }

python_script_2 = Python(IN[0]=code_block, IN[1]=sheetNumber, IN[2]=code_block_2)
# ---------- python_script_2.python (42 lines) ----------
# Load the Python Standard and DesignScript Libraries
import sys
import clr
clr.AddReference('ProtoGeometry')
from Autodesk.DesignScript.Geometry import *

# The inputs to this node will be stored as a list in the IN variables.
number=IN[1]
sheets=IN[0]
sub1="1002"
sub2="1003"
sub3="1004"
sub0="1000"
sheet_orig=[]
sheet_sub=[]

for ind, i in enumerate(number):
	sheet=sheets[ind]
	x=int(i[1:3])
	if x>=IN[2]:
		if i.endswith(sub1):
			subnum=i[0:3]
			sheet_sub.append(sheet)
			for ind1, j in enumerate(number):
				if j.startswith(subnum) and j.endswith(sub0):
					sheet_orig.append(sheets[ind1])
		elif i.endswith(sub2):
			subnum=i[0:3]
			sheet_sub.append(sheet)
			for ind1, j in enumerate(number):
				if j.startswith(subnum) and j.endswith(sub0):
					sheet_orig.append(sheets[ind1])
	
		elif i.endswith(sub3):
			subnum=i[0:3]
			sheet_sub.append(sheet)
			for ind1, j in enumerate(number):
				if j.startswith(subnum) and j.endswith(sub0):
					sheet_orig.append(sheets[ind1])
				
OUT=sheet_sub, sheet_orig
	
# ----------------------------------------
sub = CodeBlock(a=python_script_2) { a[0]; }

# group: Parameters
code_block_3 = CodeBlock { "Reference drawing number 01"; }
code_block_4 = CodeBlock { "Reference drawing number 02"; }
code_block_5 = CodeBlock { "Reference drawing number 04"; }
code_block_6 = CodeBlock { "Reference drawing number 03"; }
code_block_7 = CodeBlock { "00 Revision description"; }
code_block_8 = CodeBlock { "Reference drawing number 01"; }
code_block_9 = CodeBlock { "00 Revision date"; }
code_block_10 = CodeBlock { "00 Revision number"; }
code_block_11 = CodeBlock { "B6_ORG"; }
code_block_12 = CodeBlock { "B6_PRO"; }
code_block_13 = CodeBlock { "Drawing title 03"; }
code_block_14 = CodeBlock { "Drawing title 02"; }
code_block_15 = CodeBlock { "Drawing title 01"; }
code_block_16 = CodeBlock { "00 Revision approved by"; }
code_block_17 = CodeBlock { "00 Revision checked by"; }
code_block_18 = CodeBlock { "00 Revision drawn by"; }
code_block_19 = CodeBlock { "B6_Drawing Number"; }
code_block_20 = CodeBlock { "B6_Sheet"; }
code_block_21 = CodeBlock { "B6_Rev No."; }
code_block_22 = CodeBlock { "B6_LEV"; }
code_block_23 = CodeBlock { "B6_ZO"; }
code_block_24 = CodeBlock { "B6_DIS"; }
code_block_25 = CodeBlock { "B6_TOD"; }

orig_1000 = CodeBlock(a=python_script_2) { a[1]; }

# group: Values
ʳʰʸᵗʰᵐ_elements = Rhythm.Revit.Elements.Elements.GetParameterValueByNameTypeOrInstance(element=orig_1000, parameterName=code_block_3)
ʳʰʸᵗʰᵐ_elements_2 = Rhythm.Revit.Elements.Elements.GetParameterValueByNameTypeOrInstance(element=orig_1000, parameterName=code_block_4)
ʳʰʸᵗʰᵐ_elements_3 = Rhythm.Revit.Elements.Elements.GetParameterValueByNameTypeOrInstance(element=orig_1000, parameterName=code_block_5)
ʳʰʸᵗʰᵐ_elements_4 = Rhythm.Revit.Elements.Elements.GetParameterValueByNameTypeOrInstance(element=orig_1000, parameterName=code_block_6)
ʳʰʸᵗʰᵐ_elements_5 = Rhythm.Revit.Elements.Elements.GetParameterValueByNameTypeOrInstance(element=orig_1000, parameterName=code_block_7)
ʳʰʸᵗʰᵐ_elements_6 = Rhythm.Revit.Elements.Elements.GetParameterValueByNameTypeOrInstance(element=orig_1000, parameterName=code_block_8)
ʳʰʸᵗʰᵐ_elements_7 = Rhythm.Revit.Elements.Elements.GetParameterValueByNameTypeOrInstance(element=orig_1000, parameterName=code_block_9)
ʳʰʸᵗʰᵐ_elements_8 = Rhythm.Revit.Elements.Elements.GetParameterValueByNameTypeOrInstance(element=orig_1000, parameterName=code_block_10)
ʳʰʸᵗʰᵐ_elements_9 = Rhythm.Revit.Elements.Elements.GetParameterValueByNameTypeOrInstance(element=orig_1000, parameterName=code_block_11)
ʳʰʸᵗʰᵐ_elements_10 = Rhythm.Revit.Elements.Elements.GetParameterValueByNameTypeOrInstance(element=orig_1000, parameterName=code_block_12)
ʳʰʸᵗʰᵐ_elements_11 = Rhythm.Revit.Elements.Elements.GetParameterValueByNameTypeOrInstance(element=orig_1000, parameterName=code_block_13)
ʳʰʸᵗʰᵐ_elements_12 = Rhythm.Revit.Elements.Elements.GetParameterValueByNameTypeOrInstance(element=orig_1000, parameterName=code_block_14)
ʳʰʸᵗʰᵐ_elements_13 = Rhythm.Revit.Elements.Elements.GetParameterValueByNameTypeOrInstance(element=orig_1000, parameterName=code_block_15)
ʳʰʸᵗʰᵐ_elements_14 = Rhythm.Revit.Elements.Elements.GetParameterValueByNameTypeOrInstance(element=orig_1000, parameterName=code_block_16)
ʳʰʸᵗʰᵐ_elements_15 = Rhythm.Revit.Elements.Elements.GetParameterValueByNameTypeOrInstance(element=orig_1000, parameterName=code_block_17)
ʳʰʸᵗʰᵐ_elements_16 = Rhythm.Revit.Elements.Elements.GetParameterValueByNameTypeOrInstance(element=orig_1000, parameterName=code_block_18)
ʳʰʸᵗʰᵐ_elements_17 = Rhythm.Revit.Elements.Elements.GetParameterValueByNameTypeOrInstance(element=orig_1000, parameterName=code_block_20)
ʳʰʸᵗʰᵐ_elements_18 = Rhythm.Revit.Elements.Elements.GetParameterValueByNameTypeOrInstance(element=orig_1000, parameterName=code_block_21)
ʳʰʸᵗʰᵐ_elements_19 = Rhythm.Revit.Elements.Elements.GetParameterValueByNameTypeOrInstance(element=orig_1000, parameterName=code_block_22)
ʳʰʸᵗʰᵐ_elements_20 = Rhythm.Revit.Elements.Elements.GetParameterValueByNameTypeOrInstance(element=orig_1000, parameterName=code_block_23)
ʳʰʸᵗʰᵐ_elements_21 = Rhythm.Revit.Elements.Elements.GetParameterValueByNameTypeOrInstance(element=orig_1000, parameterName=code_block_24)
ʳʰʸᵗʰᵐ_elements_22 = Rhythm.Revit.Elements.Elements.GetParameterValueByNameTypeOrInstance(element=orig_1000, parameterName=code_block_25)

python_script_3 = Python(IN[0]=sheetNumber)
# ---------- python_script_3.python (13 lines) ----------
# Load the Python Standard and DesignScript Libraries
import sys
import clr
clr.AddReference('ProtoGeometry')
from Autodesk.DesignScript.Geometry import *

# The inputs to this node will be stored as a list in the IN variables.
dataEnteringNode = IN

# Place your code below this line

# Assign your output to the OUT variable.
OUT=[i[4::] for i in IN[0]]
# ----------------------------------------

# group: Set Parameter
ʳʰʸᵗʰᵐ_elements_23 = Rhythm.Revit.Elements.Elements.SetParameterByNameTypeOrInstance(element=sub, parameterName=code_block_3, value=ʳʰʸᵗʰᵐ_elements)
ʳʰʸᵗʰᵐ_elements_24 = Rhythm.Revit.Elements.Elements.SetParameterByNameTypeOrInstance(element=sub, parameterName=code_block_4, value=ʳʰʸᵗʰᵐ_elements_2)
ʳʰʸᵗʰᵐ_elements_25 = Rhythm.Revit.Elements.Elements.SetParameterByNameTypeOrInstance(element=sub, parameterName=code_block_5, value=ʳʰʸᵗʰᵐ_elements_3)
ʳʰʸᵗʰᵐ_elements_26 = Rhythm.Revit.Elements.Elements.SetParameterByNameTypeOrInstance(element=sub, parameterName=code_block_6, value=ʳʰʸᵗʰᵐ_elements_4)
ʳʰʸᵗʰᵐ_elements_27 = Rhythm.Revit.Elements.Elements.SetParameterByNameTypeOrInstance(element=sub, parameterName=code_block_7, value=ʳʰʸᵗʰᵐ_elements_5)
ʳʰʸᵗʰᵐ_elements_28 = Rhythm.Revit.Elements.Elements.SetParameterByNameTypeOrInstance(element=sub, parameterName=code_block_8, value=ʳʰʸᵗʰᵐ_elements_6)
ʳʰʸᵗʰᵐ_elements_29 = Rhythm.Revit.Elements.Elements.SetParameterByNameTypeOrInstance(element=sub, parameterName=code_block_9, value=ʳʰʸᵗʰᵐ_elements_7)
ʳʰʸᵗʰᵐ_elements_30 = Rhythm.Revit.Elements.Elements.SetParameterByNameTypeOrInstance(element=sub, parameterName=code_block_10, value=ʳʰʸᵗʰᵐ_elements_8)
ʳʰʸᵗʰᵐ_elements_31 = Rhythm.Revit.Elements.Elements.SetParameterByNameTypeOrInstance(element=sub, parameterName=code_block_11, value=ʳʰʸᵗʰᵐ_elements_9)
ʳʰʸᵗʰᵐ_elements_32 = Rhythm.Revit.Elements.Elements.SetParameterByNameTypeOrInstance(element=sub, parameterName=code_block_12, value=ʳʰʸᵗʰᵐ_elements_10)
ʳʰʸᵗʰᵐ_elements_33 = Rhythm.Revit.Elements.Elements.SetParameterByNameTypeOrInstance(element=sub, parameterName=code_block_13, value=ʳʰʸᵗʰᵐ_elements_11)
ʳʰʸᵗʰᵐ_elements_34 = Rhythm.Revit.Elements.Elements.SetParameterByNameTypeOrInstance(element=sub, parameterName=code_block_14, value=ʳʰʸᵗʰᵐ_elements_12)
ʳʰʸᵗʰᵐ_elements_35 = Rhythm.Revit.Elements.Elements.SetParameterByNameTypeOrInstance(element=sub, parameterName=code_block_15, value=ʳʰʸᵗʰᵐ_elements_13)
ʳʰʸᵗʰᵐ_elements_36 = Rhythm.Revit.Elements.Elements.SetParameterByNameTypeOrInstance(element=sub, parameterName=code_block_16, value=ʳʰʸᵗʰᵐ_elements_14)
ʳʰʸᵗʰᵐ_elements_37 = Rhythm.Revit.Elements.Elements.SetParameterByNameTypeOrInstance(element=sub, parameterName=code_block_17, value=ʳʰʸᵗʰᵐ_elements_15)
ʳʰʸᵗʰᵐ_elements_38 = Rhythm.Revit.Elements.Elements.SetParameterByNameTypeOrInstance(element=sub, parameterName=code_block_18, value=ʳʰʸᵗʰᵐ_elements_16)
ʳʰʸᵗʰᵐ_elements_39 = Rhythm.Revit.Elements.Elements.SetParameterByNameTypeOrInstance(element=sub, parameterName=code_block_19, value=python_script_3)
ʳʰʸᵗʰᵐ_elements_40 = Rhythm.Revit.Elements.Elements.SetParameterByNameTypeOrInstance(element=sub, parameterName=code_block_20, value=ʳʰʸᵗʰᵐ_elements_17)
ʳʰʸᵗʰᵐ_elements_41 = Rhythm.Revit.Elements.Elements.SetParameterByNameTypeOrInstance(element=sub, parameterName=code_block_21, value=ʳʰʸᵗʰᵐ_elements_18)
ʳʰʸᵗʰᵐ_elements_42 = Rhythm.Revit.Elements.Elements.SetParameterByNameTypeOrInstance(element=sub, parameterName=code_block_22, value=ʳʰʸᵗʰᵐ_elements_19)
ʳʰʸᵗʰᵐ_elements_43 = Rhythm.Revit.Elements.Elements.SetParameterByNameTypeOrInstance(element=sub, parameterName=code_block_23, value=ʳʰʸᵗʰᵐ_elements_20)
ʳʰʸᵗʰᵐ_elements_44 = Rhythm.Revit.Elements.Elements.SetParameterByNameTypeOrInstance(element=sub, parameterName=code_block_24, value=ʳʰʸᵗʰᵐ_elements_21)
ʳʰʸᵗʰᵐ_elements_45 = Rhythm.Revit.Elements.Elements.SetParameterByNameTypeOrInstance(element=sub, parameterName=code_block_25, value=ʳʰʸᵗʰᵐ_elements_22)

sub_2 = CodeBlock(a=python_script_2) { a[0]; }
ʳʰʸᵗʰᵐ_sheet_titleblock = Rhythm.Revit.Elements.Sheet.Titleblock(viewSheet=sub_2)
flatten = List.Flatten(list=ʳʰʸᵗʰᵐ_sheet_titleblock)
orig_1000_2 = CodeBlock(a=python_script_2) { a[1]; }
ʳʰʸᵗʰᵐ_sheet_titleblock_2 = Rhythm.Revit.Elements.Sheet.Titleblock(viewSheet=orig_1000_2)
python_script_4 = Python(IN[0]=ʳʰʸᵗʰᵐ_sheet_titleblock_2)
# ---------- python_script_4.python (13 lines) ----------
# Load the Python Standard and DesignScript Libraries
import sys
import clr
clr.AddReference('ProtoGeometry')
from Autodesk.DesignScript.Geometry import *

# The inputs to this node will be stored as a list in the IN variables.
dataEnteringNode = IN

# Place your code below this line

# Assign your output to the OUT variable.
OUT=[i[0] for i in IN[0]]
# ----------------------------------------

# group: Title Block Parameters
code_block_26 = CodeBlock { "Approved By"; }
getParameterValueByName = Element.GetParameterValueByName(element=python_script_4, parameterName=code_block_26)
ʳʰʸᵗʰᵐ_elements_46 = Rhythm.Revit.Elements.Elements.SetParameterByNameTypeOrInstance(element=flatten, parameterName=code_block_26, value=getParameterValueByName)
code_block_27 = CodeBlock { "Drawn By"; }
getParameterValueByName_2 = Element.GetParameterValueByName(element=python_script_4, parameterName=code_block_27)
ʳʰʸᵗʰᵐ_elements_47 = Rhythm.Revit.Elements.Elements.SetParameterByNameTypeOrInstance(element=flatten, parameterName=code_block_27, value=getParameterValueByName_2)
code_block_28 = CodeBlock { "Checked By"; }
getParameterValueByName_3 = Element.GetParameterValueByName(element=python_script_4, parameterName=code_block_28)
ʳʰʸᵗʰᵐ_elements_48 = Rhythm.Revit.Elements.Elements.SetParameterByNameTypeOrInstance(element=flatten, parameterName=code_block_28, value=getParameterValueByName_3)
