# Dynamo graph 3.2 Creating callouts_new.dyn (Dynamo 2.5.0.7460)
# packages: designtech 1.0.8

# group: Selecting Family type of view (Structural Plan_Sheet No)
element_types = ElementTypes("ViewFamilyType")
all_elements_of_type = ElementsOfType(element_type=element_types)
name = Element.Name(element=all_elements_of_type)
code_block = CodeBlock(a=all_elements_of_type) { a[20]; }

# group: Filtering views in which callouts need to be created and filtering process needs to be modified as per the need
categories = Categories("OST_Views")
all_elements_of_category = ElementsOfCategory(Category=categories)
name_2 = Element.Name(element=all_elements_of_category)
code_block_2 = CodeBlock { "TOWER FOOTPRINT -GA PLAN VIEW"; }
python_script = Python(IN[0]=name_2, IN[1]=code_block_2)
# ---------- python_script.python (31 lines) ----------
# Load the Python Standard and DesignScript Libraries
import sys
import clr
clr.AddReference('ProtoGeometry')
from Autodesk.DesignScript.Geometry import *

# The inputs to this node will be stored as a list in the IN variables.
sub=IN[1]
names=IN[0]
final=[]
index=[]
for ind, i in enumerate(names):
	if i!=None and i!=[]:
	
		if sub in i:
			final.append(i)
			index.append(ind)

sub1="LEVEL 58"
sub2="LEVEL 59"
sub3="LEVEL 60"

final2=[]
index2=[]
for ind,i in enumerate(final):
	if sub1 in i or sub2 in i or sub3 in i:
		final2.append(i)
		index2.append(index[ind])


OUT=final2, index2
# ----------------------------------------
code_block_3 = CodeBlock(a=python_script) { a[1]; }
getItemAtIndex = List.GetItemAtIndex(list=all_elements_of_category, index=code_block_3)

# group: Base Callout Layout selection
select_model_elements = DSModelElementsSelection()  # 14 picked in the model

# group: Callout Geometry without header
python_script_2 = Python(IN[0]=select_model_elements)
# ---------- python_script_2.python (48 lines) ----------
# Load the Python Standard and DesignScript Libraries
import sys
import clr
clr.AddReference('ProtoGeometry')
clr.AddReference("RevitAPI")
clr.AddReference("RevitAPIUI")
from Autodesk.DesignScript.Geometry import *
from Autodesk.Revit.DB import *
from Autodesk.Revit.UI import *

clr.AddReference("RevitServices")
import RevitServices
from RevitServices.Persistence import DocumentManager
from RevitServices.Transactions import TransactionManager

clr.AddReference("RevitNodes")
import Revit
clr.ImportExtensions(Revit.Elements)
clr.ImportExtensions(Revit.GeometryConversion)

doc=DocumentManager.Instance.CurrentDBDocument
uiapp=DocumentManager.Instance.CurrentUIApplication
app=uiapp.Application
uidoc=DocumentManager.Instance.CurrentUIApplication.ActiveUIDocument

if isinstance(IN[0],list):
	callouts=UnwrapElement(IN[0])
	toggle=0
else:
	callouts=[UnwrapElement(IN[0])]
	toggle=1

listout=[]
region=[]
for x in callouts:
	regions=View.GetCropRegionShapeManagerForReferenceCallout(doc,x.Id).GetCropShape()
	if len(regions)>0:
		lines=[y.ToProtoType() for y in regions[0]]
		listout.append(lines)
	else:
		listout.append([])
if toggle==0:
	OUT=listout
else:
	OUT=lines
	
	
	
# ----------------------------------------

# group: Curves of Base Callouts
startPoint = Curve.StartPoint(curve=python_script_2)
byCornerPoints = Rectangle.ByCornerPoints(points=startPoint)

# group: Selecting opposite points of rectangle
python_script_3 = Python(IN[0]=startPoint)
# ---------- python_script_3.python (13 lines) ----------
# Load the Python Standard and DesignScript Libraries
import sys
import clr
clr.AddReference('ProtoGeometry')
from Autodesk.DesignScript.Geometry import *

# The inputs to this node will be stored as a list in the IN variables.
dataEnteringNode = IN

# Place your code below this line

# Assign your output to the OUT variable.
OUT = [i[0] for i in IN[0]], [i[2] for i in IN[0]]
# ----------------------------------------
code_block_4 = CodeBlock(a=python_script_3) { a[0]; }
code_block_5 = CodeBlock(a=python_script_3) { a[1]; }

# group: Matching list size of views with points
python_script_4 = Python(IN[0]=getItemAtIndex, IN[1]=code_block_4)
# ---------- python_script_4.python (13 lines) ----------
# Load the Python Standard and DesignScript Libraries
import sys
import clr
clr.AddReference('ProtoGeometry')
from Autodesk.DesignScript.Geometry import *

# The inputs to this node will be stored as a list in the IN variables.
dataEnteringNode = IN

# Place your code below this line

# Assign your output to the OUT variable.
OUT =[[i]*len(IN[1]) for i in IN[0]]
# ----------------------------------------
python_script_5 = Python(IN[0]=code_block_4, IN[1]=getItemAtIndex)
# ---------- python_script_5.python (13 lines) ----------
# Load the Python Standard and DesignScript Libraries
import sys
import clr
clr.AddReference('ProtoGeometry')
from Autodesk.DesignScript.Geometry import *

# The inputs to this node will be stored as a list in the IN variables.
dataEnteringNode = IN

# Place your code below this line

# Assign your output to the OUT variable.
OUT=[IN[0]]*len(IN[1])
# ----------------------------------------
python_script_6 = Python(IN[0]=code_block_5, IN[1]=getItemAtIndex)
# ---------- python_script_6.python (13 lines) ----------
# Load the Python Standard and DesignScript Libraries
import sys
import clr
clr.AddReference('ProtoGeometry')
from Autodesk.DesignScript.Geometry import *

# The inputs to this node will be stored as a list in the IN variables.
dataEnteringNode = IN

# Place your code below this line

# Assign your output to the OUT variable.
OUT =[IN[0]]*len(IN[1])
# ----------------------------------------

createCallout = dtRevit.View.CreateCallout(hostView=python_script_4, calloutType=code_block, pt1=python_script_5, pt2=python_script_6)
