# Dynamo graph V2.dyn (Dynamo 2.6.1.8786)
# packages: Genius Loci 2021.5.18, Data-Shapes 2021.2.94, Modelical 2.2.19

element_types = ElementTypes("DimensionType")
all_elements_of_type = ElementsOfType(element_type=element_types)
name = Element.Name(element=all_elements_of_type)
code_block = CodeBlock(a=all_elements_of_type) { a[23]; }
current = Document.Current()
activeView = Document.ActiveView(document=current)
categories = Categories("OST_PipeFitting")
element_types_2 = ElementTypes("RevitLinkInstance")
all_elements_of_type_2 = ElementsOfType(element_type=element_types_2)
code_block_2 = CodeBlock(a=all_elements_of_type_2) { a[15]; }
selectByCategoryInHostView = Custom[SelectByCategoryInHostView](view=activeView, category=categories, docOrRevitLinkInstance=code_block_2)  # package Genius Loci; Collects the elements of the given document by category and host view (3D view or Plan View). The transform CS is returned only with a LinkInstance input.
code_block_3 = CodeBlock(a=selectByCategoryInHostView.Elements) { a; }
familyinstance_references = Custom[FamilyInstance References](familyInstance=code_block_3)  # package Genius Loci; Returns all references and references names.
code_block_4 = CodeBlock()
# ---------- code_block_4.designscript (2 lines) ----------
["Center (Left/Right)",
"Center (Front/Back)"];
# ----------------------------------------
indexOf = List.IndexOf(list=familyinstance_references.ReferenceName@L2, element=code_block_4@L2, lacing=Longest)
getItemAtIndex = List.GetItemAtIndex(list=familyinstance_references.Reference@L2, index=indexOf@L2)
transpose = List.Transpose(lists=getItemAtIndex)
code_block_5 = CodeBlock(l=transpose) { vert= l[0]; hori=l[1]; }
all_elements_in_view_s = Custom[All Elements In View(s)](Views=activeView)  # package Data-Shapes; Retrieves all visible element in a view or a set of views
string_from_object = FromObject(obj=all_elements_in_view_s)
code_block_6 = CodeBlock { "Grid"; }
code_block_7 = CodeBlock { true; }
contains = String.Contains(str=string_from_object, searchFor=code_block_6, ignoreCase=code_block_7)
filterByBoolMask = List.FilterByBoolMask(list=all_elements_in_view_s, mask=contains)
code_block_8 = CodeBlock(a=filterByBoolMask.in) { a; }
flatten = List.Flatten(list=code_block_8)
curve = Grid.Curve(grid=flatten)
code_block_9 = CodeBlock { 0; }
tangentAtParameter = Curve.TangentAtParameter(curve=curve, param=code_block_9)
XAxis = Vector.XAxis()
isParallel = Vector.IsParallel(vector=tangentAtParameter, other=XAxis)
filterByBoolMask_2 = List.FilterByBoolMask(list=flatten, mask=isParallel)
code_block_10 = CodeBlock(hori=filterByBoolMask_2.in) { hori; }
element_reference = Custom[Element Reference](element=code_block_10)  # package Genius Loci; Gets the reference of a geometric object or a dimension or a reference plane.
filterByBoolMask_3 = List.FilterByBoolMask(list=curve, mask=isParallel)
vertical_curve = CodeBlock(vert=filterByBoolMask_3.out) { vert; }
getLocation = Element.GetLocation(element=code_block_3)
closestPointTo = Geometry.ClosestPointTo(geometry=vertical_curve, other=getLocation, lacing=CrossProduct)
X = Point.X(point=closestPointTo)
X_2 = Point.X(point=getLocation)
Y = Point.Y(point=closestPointTo)
Y_2 = Point.Y(point=getLocation)
python_script = Python(IN[0]=X, IN[1]=X_2, IN[2]=Y, IN[3]=Y_2)
# ---------- python_script.python (31 lines) ----------
# Load the Python Standard and DesignScript Libraries
import sys
import clr
clr.AddReference('ProtoGeometry')
from Autodesk.DesignScript.Geometry import *

# The inputs to this node will be stored as a list in the IN variables.
x1=IN[0]
x2=IN[1]
y1=IN[2]
y2=IN[3]
final=[]
fin=[]
import math

for ind, i in enumerate(x1):
	y11=y1[ind]
	sub=[]
	sub_index=[]
	
	for ind1, j in enumerate(i):
		x21=x2[ind1]		
		y21=y2[ind1]	
	
		d=math.sqrt((x21-j)*(x21-j) + (y21- y11[ind1])*(y21- y11[ind1]))	
		sub.append(d)
	final.append(sub)



OUT=final
# ----------------------------------------
transpose_2 = List.Transpose(lists=python_script)
python_script_2 = Python(IN[0]=transpose_2)
# ---------- python_script_2.python (15 lines) ----------
# Load the Python Standard and DesignScript Libraries
import sys
import clr
clr.AddReference('ProtoGeometry')
from Autodesk.DesignScript.Geometry import *

# The inputs to this node will be stored as a list in the IN variables.
d=IN[0]
final=[]
for i in d:
	Min=min(i)
	ind=i.index(Min)
	final.append(ind)
	
OUT=final
# ----------------------------------------
python_script_3 = Python(IN[0]=element_reference, IN[1]=python_script_2)
# ---------- python_script_3.python (20 lines) ----------
# Load the Python Standard and DesignScript Libraries
import sys
import clr
clr.AddReference('ProtoGeometry')
from Autodesk.DesignScript.Geometry import *

# The inputs to this node will be stored as a list in the IN variables.
ref=IN[0]
indexes=IN[1]
final=[]

for ind, i in enumerate(indexes):
	
	final.append(ref[i])



OUT=final		

	
# ----------------------------------------
python_script_4 = Python(IN[0]=code_block_5.hori, IN[1]=python_script_3)
# ---------- python_script_4.python (14 lines) ----------
# Load the Python Standard and DesignScript Libraries
import sys
import clr
clr.AddReference('ProtoGeometry')
from Autodesk.DesignScript.Geometry import *

# The inputs to this node will be stored as a list in the IN variables.
ref1=IN[0]
ref2=IN[1]
final=[]
for ind, i in enumerate(ref1):
	ref2s=ref2[ind]
	final.append([i,ref2s])
OUT=final
# ----------------------------------------
code_block_11 = CodeBlock(vert=filterByBoolMask_2.out) { vert; }
element_reference_2 = Custom[Element Reference](element=code_block_11)
python_script_5 = Python(IN[0]=element_reference_2, IN[1]=python_script_2)  # same code as python_script_3
python_script_6 = Python(IN[0]=code_block_5.vert, IN[1]=python_script_5)  # same code as python_script_4
join = List.Join(list0=python_script_4, list1=python_script_6)
code_block_12 = CodeBlock(a=join) { a[1..10]; }
byCoordinates = Point.ByCoordinates(x=X_2, y=Y_2)
horiz_curve = CodeBlock(hori=filterByBoolMask_3.in) { hori; }
closestPointTo_2 = Geometry.ClosestPointTo(geometry=horiz_curve, other=getLocation, lacing=CrossProduct)
X_3 = Point.X(point=closestPointTo_2)
Y_3 = Point.Y(point=closestPointTo_2)
python_script_7 = Python(IN[0]=X_3, IN[1]=X_2, IN[2]=Y_3, IN[3]=Y_2)  # same code as python_script
transpose_3 = List.Transpose(lists=python_script_7)
python_script_8 = Python(IN[0]=transpose_3)  # same code as python_script_2
python_script_9 = Python(IN[0]=closestPointTo_2, IN[1]=python_script_8)
# ---------- python_script_9.python (26 lines) ----------
# Load the Python Standard and DesignScript Libraries
import sys
import clr
clr.AddReference('ProtoGeometry')
from Autodesk.DesignScript.Geometry import *

# The inputs to this node will be stored as a list in the IN variables.
index1=IN[1]
points=IN[0]
points0=points[0]
points1=points[1]	
points2=points[2]
points3=points[3]
final=[]
for ind, i in enumerate(index1):
	if i==0:
		final.append(points0[ind])	
	if i==1:
		final.append(points1[ind])
	if i==2:
		final.append(points2[ind])
	if i==3:
		final.append(points3[ind])
OUT=final		

	
# ----------------------------------------
byStartPointEndPoint = Line.ByStartPointEndPoint(startPoint=byCoordinates, endPoint=python_script_9)
XAxis_2 = Vector.XAxis()
code_block_13 = CodeBlock { 300; }
translate = Geometry.Translate(geometry=byStartPointEndPoint, direction=XAxis_2, distance=code_block_13)
python_script_10 = Python(IN[0]=closestPointTo, IN[1]=python_script_2)
# ---------- python_script_10.python (29 lines) ----------
# Load the Python Standard and DesignScript Libraries
import sys
import clr
clr.AddReference('ProtoGeometry')
from Autodesk.DesignScript.Geometry import *

# The inputs to this node will be stored as a list in the IN variables.
index1=IN[1]
points=IN[0][0]
final=[]

points0=points[0]
points1=points[1]	
points2=points[2]
points3=points[3]

for ind, i in enumerate(index1):
	if i==0:
		final.append(points[ind])	
	if i==1:
		final.append(points[ind])
	if i==2:
		final.append(points[ind])
	if i==3:
		final.append(points[ind])

OUT=final		

	
# ----------------------------------------
byStartPointEndPoint_2 = Line.ByStartPointEndPoint(startPoint=byCoordinates, endPoint=python_script_10)
YAxis = Vector.YAxis()
translate_2 = Geometry.Translate(geometry=byStartPointEndPoint_2, direction=YAxis, distance=code_block_13)
join_2 = List.Join(list0=translate, list1=translate_2)
code_block_14 = CodeBlock(a=join_2) { a[1..10]; }
byLine = ReferencePlane.ByLine(line=code_block_14)
byCurve = ModelCurve.ByCurve(curve=code_block_14)
code_block_15 = CodeBlock(e=byCurve) { e.Curve; }
byElements = Dimension.ByElements(view=activeView, referenceElements=byLine, line=code_block_15)
selectInRevit = Custom[SelectInRevit]()  # package Modelical; Select elements in Revit by Element or ID; unwired: ElemsOrIDs
