# Dynamo graph V2_testfile.dyn (Dynamo 2.6.1.8786)
# packages: Data-Shapes 2022.2.96, Modelical 2.2.19, Genius Loci 2021.7.30

current = Document.Current()
activeView = Document.ActiveView(document=current)
categories = Categories("OST_Walls")
all_elements_of_category = ElementsOfCategory(Category=categories)
code_block = CodeBlock { "Base Constraint"; }
getParameterValueByName = Element.GetParameterValueByName(element=all_elements_of_category, parameterName=code_block)
name = Element.Name(element=getParameterValueByName)
code_block_2 = CodeBlock { "Level 2"; }
code_block_3 = CodeBlock { "Top Constraint"; }
getParameterValueByName_2 = Element.GetParameterValueByName(element=all_elements_of_category, parameterName=code_block_3)
name_2 = Element.Name(element=getParameterValueByName_2)
python_script = Python(IN[0]=name, IN[1]=code_block_2, IN[2]=name_2)
# ---------- python_script.python (20 lines) ----------
# Load the Python Standard and DesignScript Libraries
import sys
import clr
clr.AddReference('ProtoGeometry')
from Autodesk.DesignScript.Geometry import *

# The inputs to this node will be stored as a list in the IN variables.
params=IN[0]
base=IN[1]
top=IN[2]
final=[]

for ind, i in enumerate(params):
	top_c=top[ind]
	if i!=None and top_c!=None:
		if i==base and top_c!=base:
			final.append(ind)


OUT=final
# ----------------------------------------
getItemAtIndex = List.GetItemAtIndex(list=all_elements_of_category, index=python_script)
code_block_4 = CodeBlock(a=getItemAtIndex) { a; }
element_reference = Custom[Element Reference](element=code_block_4)  # package Genius Loci; Gets the reference of a geometric object or a dimension or a reference plane.
python_script_2 = Python(IN[0]=element_reference)
# ---------- python_script_2.python (45 lines) ----------
import clr
import sys
sys.path.append('C:\Program Files (x86)\IronPython 2.7\Lib')
import System
from System import Array
from System.Collections.Generic import *
clr.AddReference('ProtoGeometry')
from Autodesk.DesignScript.Geometry import *
clr.AddReference("RevitNodes")
import Revit
clr.ImportExtensions(Revit.Elements)
clr.ImportExtensions(Revit.GeometryConversion)
clr.AddReference("RevitServices")
import RevitServices
from RevitServices.Persistence import DocumentManager 
from RevitServices.Transactions import TransactionManager 

clr.AddReference("RevitAPI")
clr.AddReference("RevitAPIUI")

import Autodesk 
from Autodesk.Revit.DB import *
from Autodesk.Revit.UI import *

doc = DocumentManager.Instance.CurrentDBDocument
uiapp = DocumentManager.Instance.CurrentUIApplication 
app = uiapp.Application 
uidoc = uiapp.ActiveUIDocument

# The inputs to this node will be stored as a list in the IN variables.
elements=IN[0]
final=[]
reflist=list()

for i in elements:
	
	refelem=doc.GetElement(i)
	final.append(refelem)






OUT=final
# ----------------------------------------
getLocation = Element.GetLocation(element=code_block_4)
startPoint = Curve.StartPoint(curve=getLocation)
X = Point.X(point=startPoint)
Y = Point.Y(point=startPoint)
byCoordinates = Point.ByCoordinates(x=X, y=Y)
activeView_2 = Document.ActiveView(document=current)
all_elements_in_view_s = Custom[All Elements In View(s)](Views=activeView_2)  # package Data-Shapes; Retrieves all visible element in a view or a set of views
string_from_object = FromObject(obj=all_elements_in_view_s)
code_block_5 = CodeBlock { "Grid"; }
code_block_6 = CodeBlock { true; }
contains = String.Contains(str=string_from_object, searchFor=code_block_5, ignoreCase=code_block_6)
filterByBoolMask = List.FilterByBoolMask(list=all_elements_in_view_s, mask=contains)
code_block_7 = CodeBlock(a=filterByBoolMask.in) { a; }
flatten = List.Flatten(list=code_block_7)
code_block_8 = CodeBlock(a=flatten) { a[0..12]; }
curve = Grid.Curve(grid=code_block_8)
code_block_9 = CodeBlock { 0; }
tangentAtParameter = Curve.TangentAtParameter(curve=curve, param=code_block_9)
XAxis = Vector.XAxis()
isParallel = Vector.IsParallel(vector=tangentAtParameter, other=XAxis)
filterByBoolMask_2 = List.FilterByBoolMask(list=curve, mask=isParallel)
horiz_curve = CodeBlock(hori=filterByBoolMask_2.in) { hori; }
python_script_3 = Python(IN[0]=horiz_curve, IN[1]=startPoint)
# ---------- python_script_3.python (34 lines) ----------
# Load the Python Standard and DesignScript Libraries
import sys
import clr
clr.AddReference('ProtoGeometry')
from Autodesk.DesignScript.Geometry import *
import math
# The inputs to this node will be stored as a list in the IN variables.

final=[]

grids=IN[0]
points=IN[1]

for i in points:
	sub=[]
	sub_ind=[]
	for ind, j in enumerate(grids):
		pt=Geometry.ClosestPointTo(j,i)
		pointx=pt.X
		pointy=pt.Y
		pointz=pt.Z
		sub_ind.append([pointx,pointy,pointz])
		squared=pointx*pointx+pointy*pointy
		root=math.sqrt(squared)
		sub.append(root)
		
	Min=min(sub)
	ind1=sub.index(Min)
	final_sub=sub_ind[ind1]
	final.append(final_sub)
	
	

OUT=final
# ----------------------------------------
transpose = List.Transpose(lists=python_script_3)
code_block_10 = CodeBlock(a=transpose) { a[0]; }
code_block_11 = CodeBlock(a=transpose) { a[1]; }
byCoordinates_2 = Point.ByCoordinates(x=code_block_10, y=code_block_11)
byStartPointEndPoint = Line.ByStartPointEndPoint(startPoint=byCoordinates, endPoint=byCoordinates_2)
XAxis_2 = Vector.XAxis()
code_block_12 = CodeBlock { 300; }
translate = Geometry.Translate(geometry=byStartPointEndPoint, direction=XAxis_2, distance=code_block_12)
vertical_curve = CodeBlock(vert=filterByBoolMask_2.out) { vert; }
python_script_4 = Python(IN[0]=vertical_curve, IN[1]=startPoint)
# ---------- python_script_4.python (34 lines) ----------
# Load the Python Standard and DesignScript Libraries
import sys
import clr
clr.AddReference('ProtoGeometry')
from Autodesk.DesignScript.Geometry import *
import math
# The inputs to this node will be stored as a list in the IN variables.

final=[]

grids=IN[0]
points=IN[1]

for i in points:
	sub=[]
	sub_ind=[]
	for ind, j in enumerate(grids):
		pt=Geometry.ClosestPointTo(j,i)
		pointx=pt.X
		pointy=pt.Y
		pointz=pt.Z
		sub_ind.append([pointx,pointy])
		squared=pointx*pointx+pointy*pointy
		root=math.sqrt(squared)
		sub.append(root)
		
	Min=min(sub)
	ind1=sub.index(Min)
	final_sub=sub_ind[ind1]
	final.append(final_sub)
	
	

OUT=final
# ----------------------------------------
transpose_2 = List.Transpose(lists=python_script_4)
code_block_13 = CodeBlock(a=transpose_2) { a[0]; }
code_block_14 = CodeBlock(a=transpose_2) { a[1]; }
byCoordinates_3 = Point.ByCoordinates(x=code_block_13, y=code_block_14)
byStartPointEndPoint_2 = Line.ByStartPointEndPoint(startPoint=byCoordinates, endPoint=byCoordinates_3)
YAxis = Vector.YAxis()
translate_2 = Geometry.Translate(geometry=byStartPointEndPoint_2, direction=YAxis, distance=code_block_12)
python_script_5 = Python(IN[0]=translate, IN[1]=translate_2)
# ---------- python_script_5.python (22 lines) ----------
# Load the Python Standard and DesignScript Libraries
import sys
import clr
clr.AddReference('ProtoGeometry')
from Autodesk.DesignScript.Geometry import *

# The inputs to this node will be stored as a list in the IN variables.
final1=[]
final2=[]
point1=IN[0]
point2=IN[1]

for ind, i in enumerate(point1):
	pt2=point2[ind]
	
	if i!=None and pt2!=None:
		final1.append([i,pt2])
		



OUT=final1
# ----------------------------------------
flatten_2 = List.Flatten(list=python_script_5)
byCurve = ModelCurve.ByCurve(curve=flatten_2)
code_block_15 = CodeBlock(e=byCurve) { e.Curve; }
byElements = Dimension.ByElements(view=activeView, referenceElements=python_script_2, line=code_block_15)
selectInRevit = Custom[SelectInRevit]()  # package Modelical; Select elements in Revit by Element or ID; unwired: ElemsOrIDs
endPoint = Curve.EndPoint(curve=getLocation)
name_3 = Element.Name(element=code_block_8)
