# Dynamo graph V4.dyn (Dynamo 2.6.1.8786)
# packages: Genius Loci 2021.7.30, designtech 1.0.8

current = Document.Current()
activeView = Document.ActiveView(document=current)
select_model_elements = DSModelElementsSelection()  # 5 picked in the model
element_reference = Custom[Element Reference](element=select_model_elements)  # package Genius Loci; Gets the reference of a geometric object or a dimension or a reference plane.
python_script = Python(IN[0]=element_reference)
# ---------- python_script.python (44 lines) ----------
import clr
import sys
sys.path.append('C:\Program Files (x86)\IronPython 2.7\Lib')
import System
from System import Array
from System.Collections.Generic import *
clr.AddReference('ProtoGeometry')
from Autodesk.DesignScript.Geometry import *
clr.AddReference("RevitNodes")
import Revit
clr.ImportExtensions(Revit.Elements)
clr.ImportExtensions(Revit.GeometryConversion)
clr.AddReference("RevitServices")
import RevitServices
from RevitServices.Persistence import DocumentManager 
from RevitServices.Transactions import TransactionManager 

clr.AddReference("RevitAPI")
clr.AddReference("RevitAPIUI")

import Autodesk 
from Autodesk.Revit.DB import *
from Autodesk.Revit.UI import *

doc = DocumentManager.Instance.CurrentDBDocument
uiapp = DocumentManager.Instance.CurrentUIApplication 
app = uiapp.Application 
uidoc = uiapp.ActiveUIDocument

# The inputs to this node will be stored as a list in the IN variables.
elements=IN[0]
final=[]
reflist=list()

if type(elements)==list:

	for i in elements:
	
		refelem=doc.GetElement(i)
		final.append(refelem)
else:
	final=doc.GetElement(elements)

OUT=final
# ----------------------------------------
getLocation = Element.GetLocation(element=select_model_elements)
endPoint = Curve.EndPoint(curve=getLocation)
X = Point.X(point=endPoint)
Y = Point.Y(point=endPoint)
byCoordinates = Point.ByCoordinates(x=X, y=Y)
select_model_elements_2 = DSModelElementsSelection()  # 13 picked in the model
curve = Grid.Curve(grid=select_model_elements_2)
code_block = CodeBlock { 0; }
tangentAtParameter = Curve.TangentAtParameter(curve=curve, param=code_block)
XAxis = Vector.XAxis()
isParallel = Vector.IsParallel(vector=tangentAtParameter, other=XAxis)
filterByBoolMask = List.FilterByBoolMask(list=curve, mask=isParallel)
horiz_curve = CodeBlock(hori=filterByBoolMask.in) { hori; }
python_script_2 = Python(IN[0]=horiz_curve, IN[1]=endPoint)
# ---------- python_script_2.python (34 lines) ----------
# Load the Python Standard and DesignScript Libraries
import sys
import clr
clr.AddReference('ProtoGeometry')
from Autodesk.DesignScript.Geometry import *
import math
# The inputs to this node will be stored as a list in the IN variables.

final=[]

grids=IN[0]
points=IN[1]

for i in points:
	sub=[]
	sub_ind=[]
	for ind, j in enumerate(grids):
		pt=Geometry.ClosestPointTo(j,i)
		pointx=pt.X
		pointy=pt.Y
		pointz=pt.Z
		sub_ind.append([pointx,pointy,pointz])
		squared=pointx*pointx+pointy*pointy
		root=math.sqrt(squared)
		sub.append(root)
		
	Min=min(sub)
	ind1=sub.index(Min)
	final_sub=sub_ind[ind1]
	final.append(final_sub)
	
	

OUT=final
# ----------------------------------------
transpose = List.Transpose(lists=python_script_2)
code_block_2 = CodeBlock(a=transpose) { a[0]; }
code_block_3 = CodeBlock(a=transpose) { a[1]; }
byCoordinates_2 = Point.ByCoordinates(x=code_block_2, y=code_block_3)
byStartPointEndPoint = Line.ByStartPointEndPoint(startPoint=byCoordinates, endPoint=byCoordinates_2)
XAxis_2 = Vector.XAxis()
code_block_4 = CodeBlock { 1000; }
translate = Geometry.Translate(geometry=byStartPointEndPoint, direction=XAxis_2, distance=code_block_4)
vertical_curve = CodeBlock(vert=filterByBoolMask.out) { vert; }
python_script_3 = Python(IN[0]=vertical_curve, IN[1]=endPoint)
# ---------- python_script_3.python (34 lines) ----------
# Load the Python Standard and DesignScript Libraries
import sys
import clr
clr.AddReference('ProtoGeometry')
from Autodesk.DesignScript.Geometry import *
import math
# The inputs to this node will be stored as a list in the IN variables.

final=[]

grids=IN[0]
points=IN[1]

for i in points:
	sub=[]
	sub_ind=[]
	for ind, j in enumerate(grids):
		pt=Geometry.ClosestPointTo(j,i)
		pointx=pt.X
		pointy=pt.Y
		pointz=pt.Z
		sub_ind.append([pointx,pointy])
		squared=pointx*pointx+pointy*pointy
		root=math.sqrt(squared)
		sub.append(root)
		
	Min=min(sub)
	ind1=sub.index(Min)
	final_sub=sub_ind[ind1]
	final.append(final_sub)
	
	

OUT=final
# ----------------------------------------
transpose_2 = List.Transpose(lists=python_script_3)
code_block_5 = CodeBlock(a=transpose_2) { a[0]; }
code_block_6 = CodeBlock(a=transpose_2) { a[1]; }
byCoordinates_3 = Point.ByCoordinates(x=code_block_5, y=code_block_6)
byStartPointEndPoint_2 = Line.ByStartPointEndPoint(startPoint=byCoordinates, endPoint=byCoordinates_3)
YAxis = Vector.YAxis()
translate_2 = Geometry.Translate(geometry=byStartPointEndPoint_2, direction=YAxis, distance=code_block_4)
python_script_4 = Python(IN[0]=translate, IN[1]=translate_2)
# ---------- python_script_4.python (22 lines) ----------
# Load the Python Standard and DesignScript Libraries
import sys
import clr
clr.AddReference('ProtoGeometry')
from Autodesk.DesignScript.Geometry import *

# The inputs to this node will be stored as a list in the IN variables.
final1=[]
final2=[]
point1=IN[0]
point2=IN[1]

for ind, i in enumerate(point1):
	pt2=point2[ind]
	
	if i!=None and pt2!=None:
		final1.append([i,pt2])
		



OUT=final1
# ----------------------------------------
flatten = List.Flatten(list=python_script_4)
byCurve = ModelCurve.ByCurve(curve=flatten)
code_block_7 = CodeBlock(e=byCurve) { e.Curve; }
startPoint = Curve.StartPoint(curve=flatten)
point = dtGeometry.Deconstruct.Point(point=startPoint)
endPoint_2 = Curve.EndPoint(curve=flatten)
point_2 = dtGeometry.Deconstruct.Point(point=endPoint_2)
python_script_5 = Python(IN[0]=point.x, IN[1]=point.y, IN[2]=point_2.x, IN[3]=point_2.y)
# ---------- python_script_5.python (30 lines) ----------
# Load the Python Standard and DesignScript Libraries
import sys
import clr
clr.AddReference('ProtoGeometry')
from Autodesk.DesignScript.Geometry import *

# The inputs to this node will be stored as a list in the IN variables.
x1=IN[0]
y1=IN[1]

x2=IN[2]
y2=IN[3]

final=[]
index=[]
for i in range(len(x1)):
	x11=round(x1[i])
	y11=round(y1[i])

	x21=round(x2[i])
	y21=round(y2[i])	

	sub=[x11,y11,x21,y21]
	if sub not in final:
		final.append(sub)
		index.append(i)
	


OUT=index
# ----------------------------------------
getItemAtIndex = List.GetItemAtIndex(list=code_block_7, index=python_script_5)
byElements = Dimension.ByElements(view=activeView, referenceElements=python_script, line=getItemAtIndex)
length = Curve.Length(curve=flatten)
python_script_6 = Python(IN[0]=length)
# ---------- python_script_6.python (13 lines) ----------
# Load the Python Standard and DesignScript Libraries
import sys
import clr
clr.AddReference('ProtoGeometry')
from Autodesk.DesignScript.Geometry import *

# The inputs to this node will be stored as a list in the IN variables.
dataEnteringNode = IN

# Place your code below this line

# Assign your output to the OUT variable.
OUT = set(IN[0])
# ----------------------------------------
name = Element.Name(element=select_model_elements)
code_block_8 = CodeBlock { "Opening"; }
python_script_7 = Python(IN[0]=select_model_elements, IN[1]=name, IN[2]=code_block_8)  # frozen
# ---------- python_script_7.python (23 lines) ----------
# Load the Python Standard and DesignScript Libraries
import sys
import clr
clr.AddReference('ProtoGeometry')
from Autodesk.DesignScript.Geometry import *

# The inputs to this node will be stored as a list in the IN variables.
elems=IN[0]
names=IN[1]
string=IN[2]
final=[]
if type(elems)==list:
	elems=elems
else:
	elems=[elems]
for ind, i in enumerate(names):
	elem=elems[ind]
	if string not in i:
		final.append(elem)



OUT=final
# ----------------------------------------
name_2 = Element.Name(element=python_script_7)
python_script_8 = Python(IN[0]=horiz_curve, IN[1]=endPoint)
# ---------- python_script_8.python (33 lines) ----------
# Load the Python Standard and DesignScript Libraries
import sys
import clr
clr.AddReference('ProtoGeometry')
from Autodesk.DesignScript.Geometry import *
import math
# The inputs to this node will be stored as a list in the IN variables.

final=[]

grids=IN[0]
points=IN[1]
sub=[]
sub_ind=[]

for ind, j in enumerate(grids):
	pt=Geometry.ClosestPointTo(j,points)
	pointx=pt.X
	pointy=pt.Y
	pointz=pt.Z
	sub_ind.append([pointx,pointy,pointz])
	squared=pointx*pointx+pointy*pointy
	root=math.sqrt(squared)
	sub.append(root)
		
Min=min(sub)
ind1=sub.index(Min)
final_sub=sub_ind[ind1]
final.append(final_sub)
	
	

OUT=final, ind1
# ----------------------------------------
code_block_9 = CodeBlock(a=python_script_8) { a[0]; }
filterByBoolMask_2 = List.FilterByBoolMask(list=select_model_elements_2, mask=isParallel)
code_block_10 = CodeBlock(a=python_script_8) { a[1]; }
getItemAtIndex_2 = List.GetItemAtIndex(list=filterByBoolMask_2.in, index=code_block_10)
python_script_9 = Python(IN[0]=vertical_curve, IN[1]=endPoint)  # same code as python_script_8
code_block_11 = CodeBlock(a=python_script_9) { a[0]; }
code_block_12 = CodeBlock(a=python_script_9) { a[1]; }
getItemAtIndex_3 = List.GetItemAtIndex(list=filterByBoolMask_2.out, index=code_block_12)
startPoint_2 = Curve.StartPoint(curve=getLocation)
code_block_13 = CodeBlock(a=startPoint_2) { a[0]; }
