# Dynamo graph 1. Adding Filters to multiple files.dyn (Dynamo 2.6.1.8786)
# packages: archi-lab.net 2021.25.2721

# group: Templates and Filters
view_type = ViewTypesUi("View Template")
getByType = archilab.Revit.Views.Views.GetByType(viewType=view_type)
uniqueItems = List.UniqueItems(list=getByType)
flatten = List.Flatten(list=uniqueItems)
name = Element.Name(element=flatten)
filters = View.Filters(view=uniqueItems)
flatten_2 = List.Flatten(list=filters)

# group: Excel Data
file_path = Filename(".\test1.xlsx")
file_from_path = FileObject(path=file_path)
code_block = CodeBlock { "Sheet1"; true; false; }
importExcel = Data.ImportExcel(file=file_from_path, sheetName=code_block.out0, readAsStrings=code_block.out1, showExcel=code_block.out2)
restOfItems = List.RestOfItems(list=importExcel)
transpose = List.Transpose(lists=restOfItems)
templte_name = CodeBlock(a=transpose) { a[1]; }
filter_name = CodeBlock(a=transpose) { a[0]; }

# group: Getting Template as per excel
python_script = Python(IN[0]=name, IN[1]=templte_name)
# ---------- python_script.python (41 lines) ----------
import clr
import sys
sys.path.append('C:\Program Files (x86)\IronPython 2.7\Lib')
import System
from System import Array
from System.Collections.Generic import *
clr.AddReference('ProtoGeometry')
from Autodesk.DesignScript.Geometry import *
clr.AddReference("RevitNodes")
import Revit
clr.ImportExtensions(Revit.Elements)
clr.ImportExtensions(Revit.GeometryConversion)
clr.AddReference("RevitServices")
import RevitServices
from RevitServices.Persistence import DocumentManager 
from RevitServices.Transactions import TransactionManager 

clr.AddReference("RevitAPI")
clr.AddReference("RevitAPIUI")

import Autodesk 
from Autodesk.Revit.DB import *
from Autodesk.Revit.UI import *

doc = DocumentManager.Instance.CurrentDBDocument
uiapp = DocumentManager.Instance.CurrentUIApplication 
app = uiapp.Application 
uidoc = uiapp.ActiveUIDocument

final=[]

filter_excel=IN[1]
names=IN[0]

for i in filter_excel:
	if i in names:
		ind=names.index(i)
		final.append(ind)


OUT=final
# ----------------------------------------
getItemAtIndex = List.GetItemAtIndex(list=flatten, index=python_script)

name_2 = Element.Name(element=flatten_2)

# group: Getting Filter as per excel
python_script_2 = Python(IN[0]=name_2, IN[1]=filter_name)  # same code as python_script
getItemAtIndex_2 = List.GetItemAtIndex(list=flatten_2, index=python_script_2)

addFilter = View.AddFilter(view=getItemAtIndex, parameterFilter=getItemAtIndex_2)
