# Dynamo graph 2. Adding multiple Filters to simgle template.dyn (Dynamo 2.6.1.8786)
# packages: archi-lab.net 2021.25.2721, Data-Shapes 2022.2.96

# group: Templates and Filters
view_type = ViewTypesUi("View Template")
getByType = archilab.Revit.Views.Views.GetByType(viewType=view_type)
uniqueItems = List.UniqueItems(list=getByType)
flatten = List.Flatten(list=uniqueItems)
name = Element.Name(element=flatten)
filters = View.Filters(view=uniqueItems)
flatten_2 = List.Flatten(list=filters)
name_2 = Element.Name(element=flatten_2)

# group: Template Selection
code_block = CodeBlock { "Apply Filter"; }
code_block_2 = CodeBlock { "Run"; "true"; "Cancel"; 400; }
code_block_3 = CodeBlock { "Select Template"; }
listview_data = Custom[Listview Data](InputName=code_block_3, Keys=name, Values=flatten)  # package Data-Shapes; Create data for ListView input in UI.MultiInputForm ++ . Check out www.data-shapes.net for more infos.

# group: Filter Selection
code_block_4 = CodeBlock { "Select Filter"; }
listview_data_2 = Custom[Listview Data](InputName=code_block_4, Keys=name_2, Values=flatten_2)
code_block_5 = CodeBlock { "Delete Filter Name"; }

list_create = List.Create(item0=listview_data, item1=listview_data_2)
inputgroup_data = Custom[InputGroup Data](Inputs=list_create)  # package Data-Shapes; Creates a group of inputs for UI.MultipleInputForm ++ . Check out www.data-shapes.net for more infos !

# group (continued): Template Selection
multipleinputform = Custom[MultipleInputForm ++](Description_optional=code_block, ButtonText_optional=code_block_2.out0, Inputs=inputgroup_data, Toggle=code_block_2.out1, CancelButtonText_optional=code_block_2.out2, Width_optional=code_block_2.out3)  # package Data-Shapes; Create a form with multiple inputs. see www.data-shapes.net for tutorials and infos!
template = CodeBlock(a=multipleinputform.User_Inputs) { a[0]; }

filter = CodeBlock(a=multipleinputform.User_Inputs) { a[1]; }
addFilter = View.AddFilter(view=template, parameterFilter=filter)
