# Dynamo graph Placing Views on sheets.dyn "21-5-2021 Placing Views on sheets" (Dynamo 2.6.1.8786)
# packages: Data-Shapes 2021.2.94

# group: Getting all views and sheets
categories = Categories("OST_Sheets")
all_elements_of_category = ElementsOfCategory(Category=categories)
sheetNumber = Sheet.SheetNumber(sheet=all_elements_of_category)
categories_2 = Categories("OST_Views")
# note: Custom Node: Clockwork v.2.3.0
all_elements_of_category_2 = ElementsOfCategory(Category=categories_2)

name = Element.Name(element=all_elements_of_category_2)

# group: Interface
code_block = CodeBlock { "Place Views"; }
code_block_2 = CodeBlock { "Run"; true; "Cancel"; 400; }
code_block_3 = CodeBlock { "Sheet and views"; }
# note: Custom Node: Data-Shapes v.2021.2.94
listview_data = Custom[Listview Data](Keys=sheetNumber, Values=all_elements_of_category)  # package Data-Shapes; Create data for ListView input in UI.MultiInputForm ++ . Check out www.data-shapes.net for more infos.
listview_data_2 = Custom[Listview Data](Keys=name, Values=all_elements_of_category_2)
list_create = List.Create(item0=listview_data, item1=listview_data_2)
inputgroup_data = Custom[InputGroup Data](GroupTitle=code_block_3, Inputs=list_create)  # package Data-Shapes; Creates a group of inputs for UI.MultipleInputForm ++ . Check out www.data-shapes.net for more infos !
multipleinputform = Custom[MultipleInputForm ++](Description_optional=code_block, ButtonText_optional=code_block_2.out0, Inputs=inputgroup_data, Toggle=code_block_2.out1, CancelButtonText_optional=code_block_2.out2, Width_optional=code_block_2.out3)  # package Data-Shapes; Create a form with multiple inputs. see www.data-shapes.net for tutorials and infos!

code_block_4 = CodeBlock(a=multipleinputform.User_Inputs) { a[0]; a[1]; }

# group: Viewport Creation
python_script = Python(IN[0]=code_block_4.out0, IN[1]=code_block_4.out1)
# ---------- python_script.python (62 lines) ----------
import clr #This is .NET's Common Language Runtime. It's an execution environment
#that is able to execute code from several different languages.
import sys #sys is a fundamental Python library - here, we're using it to load in
#the standard IronPython libraries
sys.path.append('C:\Program Files (x86)\IronPython 2.7\Lib') #Imports the
#standard IronPython libraries, which cover everything from servers and
#encryption through to regular expressions.
import System #The System namespace at the root of .NET
from System import Array #.NET class for handling array information
from System.Collections.Generic import * #Lets you handle generics. Revit's API
#sometimes wants hard-typed 'generic' lists, called ILists. If you don't need
#these you can delete this line.
clr.AddReference('ProtoGeometry')  #A Dynamo library for its proxy geometry
#classes. You'll only need this if you're interacting with geometry.
from Autodesk.DesignScript.Geometry import * #Loads everything in Dynamo's
#geometry library
clr.AddReference("RevitNodes") #Dynamo's nodes for Revit
import Revit #Loads in the Revit namespace in RevitNodes
clr.ImportExtensions(Revit.Elements) #More loading of Dynamo's Revit libraries
clr.ImportExtensions(Revit.GeometryConversion) #More loading of Dynamo's
#Revit libraries. You'll only need this if you're interacting with geometry.
clr.AddReference("RevitServices") #Dynamo's classes for handling Revit documents
import RevitServices 
from RevitServices.Persistence import DocumentManager #An internal Dynamo class
#that keeps track of the document that Dynamo is currently attached to
from RevitServices.Transactions import TransactionManager #A Dynamo class for
#opening and closing transactions to change the Revit document's database

clr.AddReference("RevitAPI") #Adding reference to Revit's API DLLs
clr.AddReference("RevitAPIUI") #Adding reference to Revit's API DLLs

import Autodesk #Loads the Autodesk namespace
from Autodesk.Revit.DB import * #Loading Revit's API classes
from Autodesk.Revit.UI import * #Loading Revit's API UI classes  

doc = DocumentManager.Instance.CurrentDBDocument #Finally, setting up handles to the active Revit document
uiapp = DocumentManager.Instance.CurrentUIApplication #Setting a handle to the active Revit UI document
app = uiapp.Application  #Setting a handle to the currently-open instance of the Revit application
uidoc = uiapp.ActiveUIDocument #Setting a handle to the currently-open instance of the Revit UI application



################## Code


doc = DocumentManager.Instance.CurrentDBDocument
app = DocumentManager.Instance.CurrentUIApplication.Application


views = [UnwrapElement(i) for i in IN[1]]
sheet = UnwrapElement(IN[0])

view_ports = []
TransactionManager.Instance.EnsureInTransaction(doc)
for view in views:
	if Viewport.CanAddViewToSheet(doc, sheet[0].Id, view.Id):
		viewport = Viewport.Create(doc, sheet[0].Id, view.Id, XYZ(0,0,0))
		view_ports.append(viewport)
TransactionManager.Instance.TransactionTaskDone()

# Assign your output to the OUT variable.
OUT = view_ports
# ----------------------------------------
