# Dynamo graph Final- Batch Processing.dyn (Dynamo 2.6.1.8786)
# packages: Orchid 203.3.0.7815, Clockwork for Dynamo 2.x 2.3.0, DynaMEP 1.2.8, Rhythm 2020.1.22

# group: Opening Documents in Background
directory_path = Directory("C:\Users\ASUS\Downloads\Revit samples\New folder")
fromPath = Orchid.Common.Directory.FromPath(path=directory_path)
contents = Orchid.Common.Directory.Contents(directory=fromPath)

# group: Interchanging the position of elements in list, has effects on execution of script to execute
code_block = CodeBlock(a=contents) { [a[1],a[0]]; }

ʳʰʸᵗʰᵐ_applications = Rhythm.Revit.Application.Applications.OpenDocumentFile(filePath=code_block)

# group: Script to execute -- Change it as per your requirements. (Do not have script to delete elements or parameters--- Doesn't work properly)
categories = Categories("OST_Walls")
code_block_2 = CodeBlock { "Comments"; }

ʳʰʸᵗʰᵐ_collector = Rhythm.Revit.Selection.Collector.ElementsOfCategoryInDocument(document=ʳʰʸᵗʰᵐ_applications, category=categories)

# group (continued): Script to execute -- Change it as per your requirements. (Do not have script to delete elements or parameters--- Doesn't work properly)
python_script = Python(IN[0]=ʳʰʸᵗʰᵐ_collector)
# ---------- python_script.python (16 lines) ----------
# Load the Python Standard and DesignScript Libraries
import sys
import clr
clr.AddReference('ProtoGeometry')
from Autodesk.DesignScript.Geometry import *

# The inputs to this node will be stored as a list in the IN variables.
elements=IN[0]
final=[]
for i in elements:
	sub=[]
	for j in range(len(i)):
		sub.append("p "+str(j))
	final.append(sub)

OUT=final
# ----------------------------------------
setParameterValueByName = RevitModel.Element.SetParameterValueByName(element=ʳʰʸᵗʰᵐ_collector, parameterName=code_block_2, values=python_script)

# group: Closing Documents
passthrough = Custom[Passthrough](passThrough=ʳʰʸᵗʰᵐ_applications, waitFor=setParameterValueByName)  # package Clockwork for Dynamo 2.x; Forces a sequential order of execution. The node wired into the output of the Passthrough node will be executed *after* the node wired into the waitFor input (e.g. important for some Revit operations). The value of the passThrough input will be passed on to the node wired into the output port of the Passthrough node.
code_block_3 = CodeBlock { true; }

ʳʰʸᵗʰᵐ_applications_2 = Rhythm.Revit.Application.Applications.CloseDocument(document=passthrough, save=code_block_3)
