# Dynamo graph Sample.dyn "2. Purge Multiple" (Dynamo 2.5.0.7460)
# packages: Orchid 203.3.0.7815, Rhythm 2020.1.22, Clockwork for Dynamo 2.x 2.3.0, archi-lab.net 2021.25.2721

code_block = CodeBlock { true; }

# group: Opening Documents in Background
directory_path = Directory("C:\Users\ASUS\Downloads\test1")
fromPath = Orchid.Common.Directory.FromPath(path=directory_path)
contents = Orchid.Common.Directory.Contents(directory=fromPath)
ʳʰʸᵗʰᵐ_applications = Rhythm.Revit.Application.Applications.OpenDocumentFile(filePath=contents, detachFromCentral=code_block)

# group: Element types
element_types = ElementTypes("ParameterElement")
ʳʰʸᵗʰᵐ_collector = Rhythm.Revit.Selection.Collector.ElementsOfTypeInDocument(document=ʳʰʸᵗʰᵐ_applications, elementType=element_types)
element_types_2 = ElementTypes("SharedParameterElement")
ʳʰʸᵗʰᵐ_collector_2 = Rhythm.Revit.Selection.Collector.ElementsOfTypeInDocument(document=ʳʰʸᵗʰᵐ_applications, elementType=element_types_2)

# group: Parameter List
list_create = List.Create(item0=ʳʰʸᵗʰᵐ_collector, item1=ʳʰʸᵗʰᵐ_collector_2)

# group: Getting Unique Items in each sublist
python_script = Python(IN[0]=list_create)
# ---------- python_script.python (25 lines) ----------
# Load the Python Standard and DesignScript Libraries
import sys
import clr
clr.AddReference('ProtoGeometry')
from Autodesk.DesignScript.Geometry import *

# The inputs to this node will be stored as a list in the IN variables.
final=[]

params=IN[0][0]

for i in params:
	sub=[]
	for j in i:
		if j not in sub:
			if j!=None:
				sub.append(j)
			else:
				sub.append([])
	final.append(sub)




OUT=final
# ----------------------------------------

# group (continued): Parameter List
name = Element.Name(element=python_script)

# group: Excel Data
file_path = Filename(".\RequiredParameters.xlsx")
file_from_path = FileObject(path=file_path)
code_block_2 = CodeBlock { "Template"; }
code_block_3 = CodeBlock { true; false; }
importExcel = Data.ImportExcel(file=file_from_path, sheetName=code_block_2, readAsStrings=code_block_3.out0, showExcel=code_block_3.out1)
transpose = List.Transpose(lists=importExcel)
flatten = List.Flatten(list=transpose)

code_block_4 = CodeBlock(a=flatten) { a[0..34]; }

# group: Filter
python_script_2 = Python(IN[0]=name, IN[1]=code_block_4)
# ---------- python_script_2.python (22 lines) ----------
# Load the Python Standard and DesignScript Libraries
import sys
import clr
clr.AddReference('ProtoGeometry')
from Autodesk.DesignScript.Geometry import *

# The inputs to this node will be stored as a list in the IN variables.
file_para=IN[0]
new_para=IN[1]

purge_list=[]
purge_index=[]
for ind, i in enumerate(file_para):
	sub=[]
	sub_i=[]
	for ind1,j in enumerate(i):
		if j not in new_para:
			sub.append(j)
			sub_i.append(ind1)
	purge_list.append(sub)
	purge_index.append(sub_i)	
OUT= purge_list, purge_index
# ----------------------------------------

# group: Index
code_block_5 = CodeBlock(a=python_script_2) { a[1]; }

getItemAtIndex = List.GetItemAtIndex(list=python_script@L2, index=code_block_5@L2)
delete = archilab.Revit.Elements.Elements.Delete(element=getItemAtIndex)  # frozen

# group: Closing Documents
passthrough = Custom[Passthrough](passThrough=ʳʰʸᵗʰᵐ_applications, waitFor=delete)  # frozen; package Clockwork for Dynamo 2.x; Forces a sequential order of execution. The node wired into the output of the Passthrough node will be executed *after* the node wired into the waitFor input (e.g. important for some Revit operations). The value of the passThrough input will be passed on to the node wired into the output port of the Passthrough node.
code_block_6 = CodeBlock { true; }
ʳʰʸᵗʰᵐ_applications_2 = Rhythm.Revit.Application.Applications.CloseDocument(document=passthrough, save=code_block_6)

python_script_3 = Python(IN[0]=contents)
# ---------- python_script_3.python (17 lines) ----------
# Load the Python Standard and DesignScript Libraries
import sys
import clr
clr.AddReference('ProtoGeometry')
from Autodesk.DesignScript.Geometry import *

# The inputs to this node will be stored as a list in the IN variables.
sub1=".00"

final=[]
docs=IN[0]

for i in docs:
	if sub1 not in i:
		final.append(i)
	
OUT=final
# ----------------------------------------
code_block_7 = CodeBlock(a=python_script_3) { [a[1],a[0],a[2]]; }
name_2 = Element.Name(element=getItemAtIndex)
python_script_4 = Python(IN[0]=name_2, IN[1]=ʳʰʸᵗʰᵐ_applications)  # frozen
# ---------- python_script_4.python (69 lines) ----------
import clr

clr.AddReference("RevitServices")
import RevitServices
from RevitServices.Persistence import DocumentManager
from RevitServices.Transactions import TransactionManager
# doc = DocumentManager.Instance.CurrentDBDocument

clr.AddReference("RevitAPI")
import Autodesk
from Autodesk.Revit.DB import *

clr.AddReference("RevitNodes")
import Revit
clr.ImportExtensions(Revit.Elements)
clr.ImportExtensions(Revit.GeometryConversion)

final=[]

# input[0]
elements = IN[0]
filepath=IN[1]
open_options=OpenOptions()

# params id
todelete = []

# check/make list
if not isinstance(elements, list):
	elements = [elements]

inputdocs = tolist(UnwrapElement(IN[1]))

#Part of script from Clockwork
for inputdoc in inputdocs :
	
	if inputdoc.GetType().ToString() == "Autodesk.Revit.DB.Document":
		doc = inputdoc
		
		
		
		TransactionManager.Instance.EnsureInTransaction(doc)
		res = [doc.Delete(i) for i in todelete]
		# end transaction				
		TransactionManager.Instance.TransactionTaskDone()
		
		
		
		
# collect parameters
parameters = FilteredElementCollector(doc).OfClass(ParameterElement).ToElements()

# loop input params
for elem in elements:
	# loop existing params
	for param in parameters:
		# if name found
		if param.Name == elem:
			# append id to delete list
			todelete.append(param.Id)

# start transaction

# delete from document
res = [doc.Delete(i) for i in todelete]
# end transaction				
TransactionManager.Instance.TransactionTaskDone()

OUT = res
# ----------------------------------------
code_block_8 = CodeBlock(a=contents) { [a[1],a[0],a[2]]; }
python_script_5 = Python()  # frozen; unwired: IN[0], IN[1]
# ---------- python_script_5.python (47 lines) ----------
#Copyright(c) 2016, Dimitar Venkov
# @5devene, dimitar.ven@gmail.com

import clr
clr.AddReference('RevitAPI')
from Autodesk.Revit.DB import*
clr.AddReference('RevitServices')
import RevitServices
from RevitServices.Persistence import DocumentManager
from RevitServices.Transactions import TransactionManager

def tolist(obj1):
	if hasattr(obj1,"__iter__"): return obj1
	else: return [obj1]

elems = UnwrapElement(tolist(IN[0]))
inputdocs = tolist(UnwrapElement(IN[1]))

#Part of script from Clockwork
for inputdoc in inputdocs :
	if inputdoc == None:
		doc = DocumentManager.Instance.CurrentDBDocument
	elif inputdoc.GetType().ToString() == "Autodesk.Revit.DB.Document":
		doc = inputdoc
	elif inputdoc.GetType().ToString() == "Autodesk.Revit.DB.RevitLinkInstance":
		doc = inputdoc.GetLinkDocument()
	else: doc = None
	
	TransactionManager.Instance.ForceCloseTransaction()
	t = Transaction(doc,'delete')
	t.Start()

deleted, failed = [], []

for e in elems:
	id = None
	try:
		id = e.Id
		del_id = doc.Delete(id)
		deleted.extend([d.ToString() for d in del_id])
	except:
		if id is not None:
			failed.append(id.ToString() )
s = set(deleted)
failed1 = [x for x in failed if x not in s]
t.Commit()
OUT = len(deleted), ';'.join(deleted), ';'.join(failed1)
# ----------------------------------------
delete_2 = Element.Delete()  # unwired: element
