# Dynamo graph 1. Delete Copy Elem_Player.dyn (Dynamo 2.6.1.8786)
# packages: Synthesize toolkit 11.9.3, Modelical 2.2.19

# group: Checking for duplicates by looking at the names
# note: Check if any duplicates are available by suffix "Copy" or "numbered"??
python_all_elements_in_all = Custom[Python All Elements In All Document]()  # package Synthesize toolkit; Python All Elements In All Document
name = Element.Name(element=python_all_elements_in_all)
python_script = Python(IN[0]=name)
# ---------- python_script.python (19 lines) ----------
# Load the Python Standard and DesignScript Libraries
import sys
import clr
clr.AddReference('ProtoGeometry')
from Autodesk.DesignScript.Geometry import *

# The inputs to this node will be stored as a list in the IN variables.
dataEnteringNode = IN

# Place your code below this line

final=[]

for ind, i in enumerate(IN[0]):
	if isinstance(i,str):
		if "copy" in i.lower() or "duplicate" in i.lower():
			final.append(ind)
			
OUT=final
# ----------------------------------------
getItemAtIndex = List.GetItemAtIndex(list=python_all_elements_in_all, index=python_script)
id = Element.Id(element=getItemAtIndex)

file_path = Filename("C:\Users\139\Desktop\3-INM\Scripts Library\Scripts To Use\Repetetive\66. Exporting Project Details to Excel\sq.xlsx")  # graph input
file_from_path = FileObject(path=file_path)

# group: Duplicates
code_block = CodeBlock { "Duplicates"; true; false; }
importExcel = Data.ImportExcel(file=file_from_path, sheetName=code_block.out0, readAsStrings=code_block.out1, showExcel=code_block.out2)
transpose = List.Transpose(lists=importExcel)
code_block_2 = CodeBlock(a=transpose) { a[1]; }
python_script_2 = Python(IN[0]=code_block_2)
# ---------- python_script_2.python (13 lines) ----------
# Load the Python Standard and DesignScript Libraries
import sys
import clr
clr.AddReference('ProtoGeometry')
from Autodesk.DesignScript.Geometry import *

# The inputs to this node will be stored as a list in the IN variables.
dataEnteringNode = IN

# Place your code below this line

# Assign your output to the OUT variable.
OUT = [int(i) for i in IN[0][1::] if i!=None]
# ----------------------------------------

python_script_3 = Python(IN[0]=id, IN[1]=python_script_2)
# ---------- python_script_3.python (13 lines) ----------
# Load the Python Standard and DesignScript Libraries
import sys
import clr
clr.AddReference('ProtoGeometry')
from Autodesk.DesignScript.Geometry import *

# The inputs to this node will be stored as a list in the IN variables.
dataEnteringNode = IN

# Place your code below this line

# Assign your output to the OUT variable.
OUT = [i for i in IN[0] if i not in IN[1]]
# ----------------------------------------
deleteElements = Custom[DeleteElements](elemOrId=python_script_3)  # package Modelical; Delete Revit elements by element or by ID
