# Dynamo graph 11. Delete Shared Param_player.dyn (Dynamo 2.6.1.8786)
# packages: Modelical 2.2.19

# group: Shared Parameter
element_types = ElementTypes("SharedParameterElement")
all_elements_of_type = ElementsOfType(element_type=element_types)
id = Element.Id(element=all_elements_of_type)

file_path = Filename("C:\Users\139\Desktop\3-INM\Scripts Library\Scripts To Use\Repetetive\66. Exporting Project Details to Excel\sq.xlsx")  # graph input
file_from_path = FileObject(path=file_path)
code_block = CodeBlock { "Shared Parameter"; true; false; }
importExcel = Data.ImportExcel(file=file_from_path, sheetName=code_block.out0, readAsStrings=code_block.out1, showExcel=code_block.out2)
transpose = List.Transpose(lists=importExcel)
scopeB = CodeBlock(a=transpose) { a[0]; }
python_script = Python(IN[0]=scopeB)
# ---------- python_script.python (13 lines) ----------
# Load the Python Standard and DesignScript Libraries
import sys
import clr
clr.AddReference('ProtoGeometry')
from Autodesk.DesignScript.Geometry import *

# The inputs to this node will be stored as a list in the IN variables.
dataEnteringNode = IN

# Place your code below this line

# Assign your output to the OUT variable.
OUT = [int(i) for i in IN[0][2::] if i!=None]
# ----------------------------------------
python_script_2 = Python(IN[0]=id, IN[1]=python_script)
# ---------- python_script_2.python (13 lines) ----------
# Load the Python Standard and DesignScript Libraries
import sys
import clr
clr.AddReference('ProtoGeometry')
from Autodesk.DesignScript.Geometry import *

# The inputs to this node will be stored as a list in the IN variables.
dataEnteringNode = IN

# Place your code below this line

# Assign your output to the OUT variable.
OUT = [i for i in IN[0] if i not in IN[1]]
# ----------------------------------------
deleteElements = Custom[DeleteElements](elemOrId=python_script_2)  # package Modelical; Delete Revit elements by element or by ID
