# Dynamo graph 2. Delete Brow Org_player.dyn (Dynamo 2.6.1.8786)
# packages: Modelical 2.2.19

file_path = Filename("C:\Users\139\Desktop\3-INM\Scripts Library\Scripts To Use\Repetetive\66. Exporting Project Details to Excel\sq.xlsx")  # graph input
file_from_path = FileObject(path=file_path)

# group: Browser Organisation
code_block = CodeBlock { "Browser organisation"; true; false; }
importExcel = Data.ImportExcel(file=file_from_path, sheetName=code_block.out0, readAsStrings=code_block.out1, showExcel=code_block.out2)
transpose = List.Transpose(lists=importExcel)
br_orga = CodeBlock(a=transpose) { a[1]; }
python_script = Python(IN[0]=br_orga)
# ---------- python_script.python (13 lines) ----------
# Load the Python Standard and DesignScript Libraries
import sys
import clr
clr.AddReference('ProtoGeometry')
from Autodesk.DesignScript.Geometry import *

# The inputs to this node will be stored as a list in the IN variables.
dataEnteringNode = IN

# Place your code below this line

# Assign your output to the OUT variable.
OUT = [int(i) for i in IN[0][1::] if i!=None]
# ----------------------------------------

# group: Browser Organisation
element_types = ElementTypes("BrowserOrganization")
all_elements_of_type = ElementsOfType(element_type=element_types)
id = Element.Id(element=all_elements_of_type)
python_script_2 = Python(IN[0]=id, IN[1]=python_script)
# ---------- python_script_2.python (13 lines) ----------
# Load the Python Standard and DesignScript Libraries
import sys
import clr
clr.AddReference('ProtoGeometry')
from Autodesk.DesignScript.Geometry import *

# The inputs to this node will be stored as a list in the IN variables.
dataEnteringNode = IN

# Place your code below this line

# Assign your output to the OUT variable.
OUT = [i for i in IN[0] if i not in IN[1]]
# ----------------------------------------
deleteElements = Custom[DeleteElements](elemOrId=python_script_2)  # package Modelical; Delete Revit elements by element or by ID
