# Dynamo graph 3. Delete View_player.dyn (Dynamo 2.6.1.8786)
# packages: Modelical 2.2.19

file_path = Filename("C:\Users\139\Desktop\3-INM\Scripts Library\Scripts To Use\Repetetive\66. Exporting Project Details to Excel\sq.xlsx")  # graph input
file_from_path = FileObject(path=file_path)
code_block = CodeBlock { "Browser organisation"; true; false; }

# group: Views
importExcel = Data.ImportExcel(file=file_from_path, sheetName=code_block.out0, readAsStrings=code_block.out1, showExcel=code_block.out2)
transpose = List.Transpose(lists=importExcel)
views = CodeBlock(a=transpose) { a[3]; }
python_script = Python(IN[0]=views)
# ---------- python_script.python (13 lines) ----------
# Load the Python Standard and DesignScript Libraries
import sys
import clr
clr.AddReference('ProtoGeometry')
from Autodesk.DesignScript.Geometry import *

# The inputs to this node will be stored as a list in the IN variables.
dataEnteringNode = IN

# Place your code below this line

# Assign your output to the OUT variable.
OUT = [int(i) for i in IN[0][1::] if i!=None]
# ----------------------------------------

# group: View Name and Detail
categories = Categories("OST_Views")
all_elements_of_category = ElementsOfCategory(Category=categories)
python_script_2 = Python(IN[0]=all_elements_of_category)
# ---------- python_script_2.python (13 lines) ----------
# Load the Python Standard and DesignScript Libraries
import sys
import clr
clr.AddReference('ProtoGeometry')
from Autodesk.DesignScript.Geometry import *

# The inputs to this node will be stored as a list in the IN variables.
dataEnteringNode = IN

# Place your code below this line

# Assign your output to the OUT variable.
OUT = [i for i in IN[0] if i!=None]
# ----------------------------------------
id = Element.Id(element=python_script_2)
python_script_3 = Python(IN[0]=id, IN[1]=python_script)
# ---------- python_script_3.python (13 lines) ----------
# Load the Python Standard and DesignScript Libraries
import sys
import clr
clr.AddReference('ProtoGeometry')
from Autodesk.DesignScript.Geometry import *

# The inputs to this node will be stored as a list in the IN variables.
dataEnteringNode = IN

# Place your code below this line

# Assign your output to the OUT variable.
OUT = [i for i in IN[0] if i not in IN[1]]
# ----------------------------------------
deleteElements = Custom[DeleteElements](elemOrId=python_script_3)  # package Modelical; Delete Revit elements by element or by ID
