# Dynamo graph 4. Delete Family_player.dyn (Dynamo 2.6.1.8786)
# packages: Modelical 2.2.19, Clockwork for Dynamo 1.x 1.31.1, archi-lab.net 2021.25.2721

# group: Background
getAll = archilab.Revit.Elements.Categories.GetAll()
code_block = CodeBlock(a=getAll.Model) { a; }
all_family_types_of_category = Custom[All Family Types Of Category](category=code_block)  # package Clockwork for Dynamo 1.x; Gets all family types/symbols of a given category in the model (does *not *work for system families)
python_script = Python(IN[0]=all_family_types_of_category)
# ---------- python_script.python (22 lines) ----------
# Load the Python Standard and DesignScript Libraries
import sys
import clr
clr.AddReference('ProtoGeometry')
from Autodesk.DesignScript.Geometry import *

# The inputs to this node will be stored as a list in the IN variables.
dataEnteringNode = IN

# Place your code below this line

final=[]
index=[]
index2=[]

for ind, i in enumerate(IN[0]):
	if i==None:
		index.append(ind)
	else:
		final.append(i)
		index2.append(ind)
OUT=final,index,index2
# ----------------------------------------
code_block_2 = CodeBlock(a=python_script) { a[0]; }
family = FamilyType.Family(familyType=code_block_2)
id = Element.Id(element=family)
flatten = List.Flatten(list=id)

file_path = Filename("C:\Users\139\Desktop\3-INM\Scripts Library\Scripts To Use\Repetetive\66. Exporting Project Details to Excel\sq.xlsx")  # graph input
file_from_path = FileObject(path=file_path)
code_block_3 = CodeBlock { "Family Instance Detail"; true; false; }
importExcel = Data.ImportExcel(file=file_from_path, sheetName=code_block_3.out0, readAsStrings=code_block_3.out1, showExcel=code_block_3.out2)
transpose = List.Transpose(lists=importExcel)
family_2 = CodeBlock(a=transpose) { a[2]; }
python_script_2 = Python(IN[0]=family_2)
# ---------- python_script_2.python (13 lines) ----------
# Load the Python Standard and DesignScript Libraries
import sys
import clr
clr.AddReference('ProtoGeometry')
from Autodesk.DesignScript.Geometry import *

# The inputs to this node will be stored as a list in the IN variables.
dataEnteringNode = IN

# Place your code below this line

# Assign your output to the OUT variable.
OUT = [int(i) for i in IN[0][1::] if i!=None]
# ----------------------------------------
python_script_3 = Python(IN[0]=flatten, IN[1]=python_script_2)
# ---------- python_script_3.python (13 lines) ----------
# Load the Python Standard and DesignScript Libraries
import sys
import clr
clr.AddReference('ProtoGeometry')
from Autodesk.DesignScript.Geometry import *

# The inputs to this node will be stored as a list in the IN variables.
dataEnteringNode = IN

# Place your code below this line

# Assign your output to the OUT variable.
OUT = [i for i in IN[0] if i not in IN[1]]
# ----------------------------------------
deleteElements = Custom[DeleteElements](elemOrId=python_script_3)  # package Modelical; Delete Revit elements by element or by ID
