# Dynamo graph 7. Delete Groups_player.dyn (Dynamo 2.6.1.8786)
# packages: Synthesize toolkit 11.9.3, Clockwork for Dynamo 1.x 1.31.1, Modelical 2.2.19

file_path = Filename("C:\Users\139\Desktop\3-INM\Scripts Library\Scripts To Use\Repetetive\66. Exporting Project Details to Excel\sq.xlsx")  # graph input
file_from_path = FileObject(path=file_path)
code_block = CodeBlock { "Model Groups"; true; false; }
importExcel = Data.ImportExcel(file=file_from_path, sheetName=code_block.out0, readAsStrings=code_block.out1, showExcel=code_block.out2)
transpose = List.Transpose(lists=importExcel)
group_type = CodeBlock(a=transpose) { a[1]; }
python_script = Python(IN[0]=group_type)
# ---------- python_script.python (13 lines) ----------
# Load the Python Standard and DesignScript Libraries
import sys
import clr
clr.AddReference('ProtoGeometry')
from Autodesk.DesignScript.Geometry import *

# The inputs to this node will be stored as a list in the IN variables.
dataEnteringNode = IN

# Place your code below this line

# Assign your output to the OUT variable.
OUT = [int(i) for i in IN[0][1::] if i!=None]
# ----------------------------------------

# group: Groups
typeCollector = Custom[BVN.ModelGroup.TypeCollector]()  # package Synthesize toolkit; Returns all the types (not instances) from all model groups in the project
groups = Custom[GroupType.Groups](groupType=typeCollector)  # package Clockwork for Dynamo 1.x; Returns all group instances of a given group type
id = Element.Id(element=groups)
flatten = List.Flatten(list=id)

groups_2 = CodeBlock(a=transpose) { a[3]; }
python_script_2 = Python(IN[0]=groups_2)  # same code as python_script
python_script_3 = Python(IN[0]=flatten, IN[1]=python_script_2)
# ---------- python_script_3.python (13 lines) ----------
# Load the Python Standard and DesignScript Libraries
import sys
import clr
clr.AddReference('ProtoGeometry')
from Autodesk.DesignScript.Geometry import *

# The inputs to this node will be stored as a list in the IN variables.
dataEnteringNode = IN

# Place your code below this line

# Assign your output to the OUT variable.
OUT = [i for i in IN[0] if i not in IN[1]]
# ----------------------------------------
deleteElements = Custom[DeleteElements](elemOrId=python_script_3)  # package Modelical; Delete Revit elements by element or by ID
