# Dynamo graph Copying Family to a folder from the project.dyn (Dynamo 2.6.1.8786)
# packages: Clockwork for Dynamo 1.x 1.31.1

# group: Family Directory
directory_path = Directory("C:\Users\139\Desktop\fam_test")

# group: Copying Family into the folder
element_types = ElementTypes("Family")
all_elements_of_type = ElementsOfType(element_type=element_types)
name = Family.Name(family=all_elements_of_type)
code_block = CodeBlock(dir=directory_path, a=name) { dir+"\\"+a+".rfa"; }
python_script = Python(IN[0]=code_block, IN[1]=all_elements_of_type)  # frozen
# ---------- python_script.python (34 lines) ----------
# Load the Python Standard and DesignScript Libraries
import sys
import clr
clr.AddReference('ProtoGeometry')
from Autodesk.DesignScript.Geometry import *
clr.AddReference('RevitAPI')
import Autodesk

clr.AddReference('RevitServices')
import RevitServices
from RevitServices.Persistence import DocumentManager
from RevitServices.Transactions import TransactionManager

doc =DocumentManager.Instance.CurrentDBDocument


#Cloase all transactions

path=IN[0]
fam=IN[1]
trans=TransactionManager.Instance
trans.ForceCloseTransaction()
fam=map(UnwrapElement,fam)
family=[]
for i in range(len(fam)):
	try:
		famdoc=doc.EditFamily(fam[i])
		famdoc.SaveAs(path[i])
		famdoc.Close(False)
		
	except:
		pass
OUT=family
# The inputs to this node will be stored as a list in the IN variables.
# ----------------------------------------

passthrough = Custom[Passthrough](passThrough=directory_path, waitFor=python_script)  # package Clockwork for Dynamo 1.x; Forces a sequential order of execution. The node wired into the output of the Passthrough node will be executed *after* the node wired into the waitFor input (e.g. important for some Revit operations). The value of the passThrough input will be passed on to the node wired into the output port of the Passthrough node.

# group: Checking which elements are Non Editable elements
contents = Custom[Directory.Contents+](directoryPath=passthrough)  # package Clockwork for Dynamo 1.x; Unlike the built-in node Directory.Contents, this node browses a directory recursively and returns all relevant files contained in subfolders as well.
python_script_2 = Python(IN[0]=contents)
# ---------- python_script_2.python (14 lines) ----------
# Load the Python Standard and DesignScript Libraries
import sys
import clr
clr.AddReference('ProtoGeometry')
from Autodesk.DesignScript.Geometry import *

# The inputs to this node will be stored as a list in the IN variables.
dataEnteringNode = IN

# Place your code below this line

# Assign your output to the OUT variable.
f = [i.split('\\')[5] for i in IN[0]]
OUT=[i.split('.rfa')[0] for i in f]
# ----------------------------------------
python_script_3 = Python(IN[0]=python_script_2, IN[1]=name)
# ---------- python_script_3.python (17 lines) ----------
# Load the Python Standard and DesignScript Libraries
import sys
import clr
clr.AddReference('ProtoGeometry')
from Autodesk.DesignScript.Geometry import *

# The inputs to this node will be stored as a list in the IN variables.
dataEnteringNode = IN
path=IN[0]
fam=IN[1]
fin=[]
index=[]
for ind, i in enumerate(fam):
	if i not in path:
		index.append(ind)
#OUT=fin
OUT=index
# ----------------------------------------
getItemAtIndex = List.GetItemAtIndex(list=name, index=python_script_3)
getItemAtIndex_2 = List.GetItemAtIndex(list=all_elements_of_type, index=python_script_3)
