# Dynamo graph V1 Delete Elements.dyn "Deleting Elements" (Dynamo 2.6.1.8786)

file_path = Filename("C:\Users\139\Desktop\3-INM\Scripts Library\Scripts To Use\Repetetive\66. Exporting Project Details to Excel\sq.xlsx")
file_from_path = FileObject(path=file_path)
code_block = CodeBlock { "Shared Parameter"; true; false; }
importExcel = Data.ImportExcel(file=file_from_path, sheetName=code_block.out0, readAsStrings=code_block.out1, showExcel=code_block.out2)
transpose = List.Transpose(lists=importExcel)
scopeB = CodeBlock(a=transpose) { a[0]; }
python_script = Python(IN[0]=scopeB)
# ---------- python_script.python (13 lines) ----------
# Load the Python Standard and DesignScript Libraries
import sys
import clr
clr.AddReference('ProtoGeometry')
from Autodesk.DesignScript.Geometry import *

# The inputs to this node will be stored as a list in the IN variables.
dataEnteringNode = IN

# Place your code below this line

# Assign your output to the OUT variable.
OUT = [int(i) for i in IN[0][2::] if i!=None]
# ----------------------------------------
code_block_2 = CodeBlock { "Family Instance Detail"; true; false; }
importExcel_2 = Data.ImportExcel(file=file_from_path, sheetName=code_block_2.out0, readAsStrings=code_block_2.out1, showExcel=code_block_2.out2)
transpose_2 = List.Transpose(lists=importExcel_2)
family = CodeBlock(a=transpose_2) { a[2]; }
python_script_2 = Python(IN[0]=family)
# ---------- python_script_2.python (13 lines) ----------
# Load the Python Standard and DesignScript Libraries
import sys
import clr
clr.AddReference('ProtoGeometry')
from Autodesk.DesignScript.Geometry import *

# The inputs to this node will be stored as a list in the IN variables.
dataEnteringNode = IN

# Place your code below this line

# Assign your output to the OUT variable.
OUT = [int(i) for i in IN[0][1::] if i!=None]
# ----------------------------------------
family_type = CodeBlock(a=transpose_2) { a[4]; }
python_script_3 = Python(IN[0]=family_type)  # same code as python_script_2
code_block_3 = CodeBlock { "Datum"; true; false; }
importExcel_3 = Data.ImportExcel(file=file_from_path, sheetName=code_block_3.out0, readAsStrings=code_block_3.out1, showExcel=code_block_3.out2)
transpose_3 = List.Transpose(lists=importExcel_3)
grids = CodeBlock(a=transpose_3) { a[5]; }
python_script_4 = Python(IN[0]=grids)  # same code as python_script_2
scopeB_2 = CodeBlock(a=transpose_3) { a[8]; }
python_script_5 = Python(IN[0]=scopeB_2)  # same code as python_script_2
level = CodeBlock(a=transpose_3) { a[1]; }
python_script_6 = Python(IN[0]=level)  # same code as python_script_2
code_block_4 = CodeBlock { "Model Groups"; true; false; }
importExcel_4 = Data.ImportExcel(file=file_from_path, sheetName=code_block_4.out0, readAsStrings=code_block_4.out1, showExcel=code_block_4.out2)
transpose_4 = List.Transpose(lists=importExcel_4)
groups = CodeBlock(a=transpose_4) { a[3]; }
python_script_7 = Python(IN[0]=groups)  # same code as python_script_2
group_type = CodeBlock(a=transpose_4) { a[1]; }
python_script_8 = Python(IN[0]=group_type)  # same code as python_script_2
code_block_5 = CodeBlock { "Browser organisation"; true; false; }
importExcel_5 = Data.ImportExcel(file=file_from_path, sheetName=code_block_5.out0, readAsStrings=code_block_5.out1, showExcel=code_block_5.out2)
transpose_5 = List.Transpose(lists=importExcel_5)
views = CodeBlock(a=transpose_5) { a[3]; }
python_script_9 = Python(IN[0]=views)  # same code as python_script_2
br_orga = CodeBlock(a=transpose_5) { a[1]; }
python_script_10 = Python(IN[0]=br_orga)  # same code as python_script_2
code_block_6 = CodeBlock { "Duplicates"; true; false; }
importExcel_6 = Data.ImportExcel(file=file_from_path, sheetName=code_block_6.out0, readAsStrings=code_block_6.out1, showExcel=code_block_6.out2)
transpose_6 = List.Transpose(lists=importExcel_6)
code_block_7 = CodeBlock(a=transpose_6) { a[1]; }
python_script_11 = Python(IN[0]=code_block_7)  # same code as python_script_2
