# Dynamo graph V2-All project Info.dyn (Dynamo 2.6.1.8786)
# packages: Clockwork for Dynamo 1.x 1.31.1, Data-Shapes 2022.2.96, archi-lab.net 2021.25.2721, Genius Loci 2021.7.30, spring nodes 110.0.2, Synthesize toolkit 11.9.3

# group: File Path and excel data filling
file_path = Filename(".\sq-ls1.xlsx")

# group: Parameter Groups
string = StringInput("Shared Parameter")
code_block = CodeBlock { [null]; 1; true; }
string_2 = StringInput("Parameter Group")
parametergroup_list = Custom[ParameterGroup list]()  # package Data-Shapes; List of all parameter groups
join = List.Join(list0=string_2, list1=code_block.out0, list2=parametergroup_list)
exportExcel = Data.ExportExcel(filePath=file_path, sheetName=string, startRow=code_block.out1, startCol=code_block.out1, data=join)  # frozen

# group: Levels in Project
code_block_2 = CodeBlock { [["Levels","Id"]]; }
categories = Categories("OST_Levels")
all_elements_of_category = ElementsOfCategory(Category=categories)
name = Element.Name(element=all_elements_of_category)
id = Element.Id(element=all_elements_of_category)
list_create = List.Create(item0=name, item1=id)
transpose = List.Transpose(lists=list_create)
join_2 = List.Join(list0=transpose)

# group: Grids in Project
code_block_3 = CodeBlock { [["Grids","Id"]]; }
categories_2 = Categories("OST_Grids")
all_elements_of_category_2 = ElementsOfCategory(Category=categories_2)
name_2 = Element.Name(element=all_elements_of_category_2)
id_2 = Element.Id(element=all_elements_of_category_2)
list_create_2 = List.Create(item0=name_2, item1=id_2)
transpose_2 = List.Transpose(lists=list_create_2)
join_3 = List.Join(list0=transpose_2)

# group: Scope Boxes in Project
code_block_4 = CodeBlock { [["ScopeBox","Id"]]; }
categories_3 = Categories("OST_VolumeOfInterest")
all_elements_of_category_3 = ElementsOfCategory(Category=categories_3)
name_3 = Element.Name(element=all_elements_of_category_3)
id_3 = Element.Id(element=all_elements_of_category_3)
list_create_3 = List.Create(item0=name_3, item1=id_3)
transpose_3 = List.Transpose(lists=list_create_3)
join_4 = List.Join(list0=transpose_3)

# group: Browser Organisation
code_block_5 = CodeBlock { [["Browser Organization","Id"]]; }
element_types = ElementTypes("BrowserOrganization")
all_elements_of_type = ElementsOfType(element_type=element_types)
name_4 = Element.Name(element=all_elements_of_type)
id_4 = Element.Id(element=all_elements_of_type)
list_create_4 = List.Create(item0=name_4, item1=id_4)
transpose_4 = List.Transpose(lists=list_create_4)
join_5 = List.Join(list0=transpose_4)

# group: Shared Parameter
element_types_2 = ElementTypes("SharedParameterElement")
all_elements_of_type_2 = ElementsOfType(element_type=element_types_2)
id_5 = Element.Id(element=all_elements_of_type_2)
name_5 = Element.Name(element=all_elements_of_type_2)
list_create_5 = List.Create(item0=id_5, item1=name_5)
transpose_5 = List.Transpose(lists=list_create_5)

# group: Shared Parameter List
passThrough = Custom[PassThrough]()  # package archi-lab.net; Ripped this off from Clockwork. Sorry Andy.; unwired: passThrough, waitFor
string_3 = StringInput("Shared Parameter")
string_4 = StringInput("Shared Parameter List")
code_block_6 = CodeBlock(a=string_4) { [["Id",a]]; 2; 0; true; }
sharedParameterFile = Parameter.SharedParameterFile()
code_block_7 = CodeBlock(a=sharedParameterFile) { [[a,null]]; }
join_6 = List.Join(list0=transpose_5, list1=code_block_7)
exportExcel_2 = Data.ExportExcel(filePath=file_path, sheetName=string_3, startRow=code_block_6.out1, startCol=code_block_6.out2, data=join_6)

# group: Project Information
projectInfo = Custom[Document.ProjectInfo]()  # package Clockwork for Dynamo 1.x; Gets the project information.
basePoint = Coordinates.BasePoint()
surveyPoint = Coordinates.SurveyPoint()
designOptions = Custom[Document.DesignOptions]()  # package Clockwork for Dynamo 1.x; Returns all design options in the model, grouped by design option set
list_create_6 = List.Create(item0=projectInfo.OrganizationName, item1=projectInfo.OrganizationDescription, item2=projectInfo.BuildingName, item3=projectInfo.Author, item4=projectInfo.IssueDate, item5=projectInfo.Status, item6=projectInfo.ClientName, item7=projectInfo.Address, item8=projectInfo.Name, item9=projectInfo.Number, item10=basePoint, item11=surveyPoint, item12=designOptions.DesignOptions)

python_script = Python(IN[0]=list_create_6)
# ---------- python_script.python (28 lines) ----------
# Load the Python Standard and DesignScript Libraries
import sys
import clr
clr.AddReference('ProtoGeometry')
from Autodesk.DesignScript.Geometry import *

# The inputs to this node will be stored as a list in the IN variables.
dataEnteringNode = IN

# Place your code below this line

# Assign your output to the OUT variable.

lst1=['Org. Name', 'Org. Description', 'Building name',
		'Author', 'Issue date', 'Status', 'Client Name',
		'Address', 'Name', 'Number', 'Base Point', 'Survey Point',
		'Design Options']
		
lst2=IN[0]
final=[]
for ind, i in enumerate(lst1):
	dat=lst2[ind]
	if isinstance(dat,list):
		for j in dat:
			final.append([i,j])
	else:
		final.append([i,dat])
OUT=final
# ----------------------------------------

# group: Project Information
passThrough_2 = Custom[PassThrough](passThrough=file_path, waitFor=exportExcel_2)
string_5 = StringInput("Project Information")
code_block_8 = CodeBlock { 1; true; }
exportExcel_3 = Data.ExportExcel(filePath=passThrough_2, sheetName=string_5, startRow=code_block_8.out0, startCol=code_block_8.out0, data=python_script)

# group: Levels in Datum
passThrough_3 = Custom[PassThrough](passThrough=passThrough_2, waitFor=exportExcel_3)
string_6 = StringInput("Datum")
code_block_9 = CodeBlock { 1; 0; true; }
exportExcel_4 = Data.ExportExcel(filePath=passThrough_3, sheetName=string_6, startRow=code_block_9.out0, startCol=code_block_9.out1, data=join_2)

# group: Grids in Datum
passThrough_4 = Custom[PassThrough](passThrough=passThrough_3, waitFor=exportExcel_4)
string_7 = StringInput("Datum")
code_block_10 = CodeBlock { 1; 4; true; }
exportExcel_5 = Data.ExportExcel(filePath=passThrough_4, sheetName=string_7, startRow=code_block_10.out0, startCol=code_block_10.out1, data=join_3)

# group: Scope Boxes in Datum
passThrough_5 = Custom[PassThrough](passThrough=passThrough_4, waitFor=exportExcel_5)
string_8 = StringInput("Datum")
code_block_11 = CodeBlock { 1; 8; true; }
exportExcel_6 = Data.ExportExcel(filePath=passThrough_5, sheetName=string_8, startRow=code_block_11.out0, startCol=code_block_11.out1, data=join_4)

# group: Line Styles
categories_4 = Categories("OST_Lines")
get_category_properties = Custom[Get Category Properties](category=categories_4)  # package Genius Loci; Get the Line Patterns, weights, colors and materials for a given category.
code_block_12 = CodeBlock(a=get_category_properties.SubCategory) { a; }
string_from_object = FromObject(obj=code_block_12)
python_script_2 = Python(IN[0]=string_from_object)
# ---------- python_script_2.python (13 lines) ----------
# Load the Python Standard and DesignScript Libraries
import sys
import clr
clr.AddReference('ProtoGeometry')
from Autodesk.DesignScript.Geometry import *

# The inputs to this node will be stored as a list in the IN variables.
dataEnteringNode = IN

# Place your code below this line

# Assign your output to the OUT variable.
OUT = [i.split('- ')[1] for i in IN[0]]
# ----------------------------------------
code_block_13 = CodeBlock(a=get_category_properties.Line_Pattern_Name) { a; }
code_block_14 = CodeBlock(a=get_category_properties.Projection_Line_Weight) { a; }
code_block_15 = CodeBlock(a=get_category_properties.Line_Colors) { a; }
string_from_object_2 = FromObject(obj=code_block_15)
python_script_3 = Python(IN[0]=python_script_2, IN[1]=code_block_13, IN[2]=code_block_14, IN[3]=string_from_object_2)
# ---------- python_script_3.python (18 lines) ----------
# Load the Python Standard and DesignScript Libraries
import sys
import clr
clr.AddReference('ProtoGeometry')
from Autodesk.DesignScript.Geometry import *

# The inputs to this node will be stored as a list in the IN variables.
dataEnteringNode = IN

# Place your code below this line
final=[]
# Assign your output to the OUT variable.
for ind, i in enumerate(IN[0]):
	pattern=IN[1][ind]
	weight=IN[2][ind]
	color=IN[3][ind]
	final.append([i,weight,color,pattern])
OUT=final
# ----------------------------------------

# group: Line Styles in Datum
passThrough_6 = Custom[PassThrough](passThrough=passThrough_5, waitFor=exportExcel_6)
string_9 = StringInput("Datum")
code_block_16 = CodeBlock { 1; 12; true; }
exportExcel_7 = Data.ExportExcel(filePath=passThrough_6, sheetName=string_9, startRow=code_block_16.out0, startCol=code_block_16.out1, data=python_script_3)

# group: Revit Links and DWG files
getDocuments = archilab.Revit.Selection.Select.GetDocuments()
code_block_17 = CodeBlock(a=getDocuments.Link_Name) { a; }
python_script_4 = Python(IN[0]=code_block_17)
# ---------- python_script_4.python (13 lines) ----------
# Load the Python Standard and DesignScript Libraries
import sys
import clr
clr.AddReference('ProtoGeometry')
from Autodesk.DesignScript.Geometry import *

# The inputs to this node will be stored as a list in the IN variables.
dataEnteringNode = IN

# Place your code below this line

# Assign your output to the OUT variable.
OUT = [i.split(" :")[0] for i in IN[0]]
# ----------------------------------------
code_block_18 = CodeBlock(a=python_script_4) { a; }
element_types_3 = ElementTypes("ImportInstance")
all_elements_of_type_3 = ElementsOfType(element_type=element_types_3)
code_block_19 = CodeBlock { "Name"; }
getParameterValueByName = Element.GetParameterValueByName(element=all_elements_of_type_3, parameterName=code_block_19)
code_block_20 = CodeBlock(a=getParameterValueByName) { a; }
list_create_7 = List.Create(item0=code_block_18, item1=code_block_20)
transpose_6 = List.Transpose(lists=list_create_7)

# group: Line Styles in Datum
passThrough_7 = Custom[PassThrough](passThrough=passThrough_6, waitFor=exportExcel_7)
string_10 = StringInput("Datum")
code_block_21 = CodeBlock { 1; 18; true; }
exportExcel_8 = Data.ExportExcel(filePath=passThrough_7, sheetName=string_10, startRow=code_block_21.out0, startCol=code_block_21.out1, data=transpose_6)

# group: Group Detail
typeCollector = Custom[BVN.ModelGroup.TypeCollector]()  # package Synthesize toolkit; Returns all the types (not instances) from all model groups in the project
name_6 = ElementType.Name(elementType=typeCollector)
id_6 = Element.Id(element=typeCollector)
groups = Custom[GroupType.Groups](groupType=typeCollector)  # package Clockwork for Dynamo 1.x; Returns all group instances of a given group type
name_7 = Element.Name(element=groups)
python_script_5 = Python(IN[0]=name_7)
# ---------- python_script_5.python (13 lines) ----------
# Load the Python Standard and DesignScript Libraries
import sys
import clr
clr.AddReference('ProtoGeometry')
from Autodesk.DesignScript.Geometry import *

# The inputs to this node will be stored as a list in the IN variables.
dataEnteringNode = IN

# Place your code below this line

# Assign your output to the OUT variabl
OUT=[i[0] if i!=[] else None for i in IN[0]]
# ----------------------------------------
id_7 = Element.Id(element=groups)
python_script_6 = Python(IN[0]=id_7)  # same code as python_script_5
list_create_8 = List.Create(item0=name_6, item1=id_6, item2=python_script_5, item3=python_script_6)
transpose_7 = List.Transpose(lists=list_create_8)
join_7 = List.Join(list0=transpose_7)
members = Custom[Group.Members](group=groups)  # package Clockwork for Dynamo 1.x; Retrieves the members of a group
code_block_22 = CodeBlock { [["Group Types","Id", "Group","Id"]]; }

# group: Model Group
passThrough_8 = Custom[PassThrough](passThrough=passThrough_7, waitFor=exportExcel_8)
string_11 = StringInput("Model Groups")
code_block_23 = CodeBlock { 1; 0; true; }
exportExcel_9 = Data.ExportExcel(filePath=passThrough_8, sheetName=string_11, startRow=code_block_23.out0, startCol=code_block_23.out1, data=join_7)

# group: Category- Family - Type - Instance Count
getAll = archilab.Revit.Elements.Categories.GetAll()
code_block_24 = CodeBlock(a=getAll.Model) { a; }
all_family_types_of_category = Custom[All Family Types Of Category](category=code_block_24)  # package Clockwork for Dynamo 1.x; Gets all family types/symbols of a given category in the model (does *not *work for system families)
python_script_7 = Python(IN[0]=all_family_types_of_category)
# ---------- python_script_7.python (22 lines) ----------
# Load the Python Standard and DesignScript Libraries
import sys
import clr
clr.AddReference('ProtoGeometry')
from Autodesk.DesignScript.Geometry import *

# The inputs to this node will be stored as a list in the IN variables.
dataEnteringNode = IN

# Place your code below this line

final=[]
index=[]
index2=[]

for ind, i in enumerate(IN[0]):
	if i==None:
		index.append(ind)
	else:
		final.append(i)
		index2.append(ind)
OUT=final,index,index2
# ----------------------------------------
code_block_25 = CodeBlock(a=python_script_7) { a[0]; }
family = FamilyType.Family(familyType=code_block_25)
name_8 = Family.Name(family=family)
categories_strings = FromObject(obj=code_block_24)
code_block_26 = CodeBlock(a=python_script_7) { a[2]; }
categories_with_family_types = List.GetItemAtIndex(list=categories_strings, index=code_block_26)
python_script_8 = Python(IN[0]=name_8, IN[1]=categories_with_family_types)
# ---------- python_script_8.python (13 lines) ----------
# Load the Python Standard and DesignScript Libraries
import sys
import clr
clr.AddReference('ProtoGeometry')
from Autodesk.DesignScript.Geometry import *

# The inputs to this node will be stored as a list in the IN variables.
dataEnteringNode = IN

# Place your code below this line

# Assign your output to the OUT variable.
OUT = [[i]*len(IN[0][ind]) for ind, i in enumerate(IN[1])]
# ----------------------------------------
flatten = List.Flatten(list=python_script_8)
flatten_2 = List.Flatten(list=name_8)
id_8 = Element.Id(element=family)
flatten_3 = List.Flatten(list=id_8)
name_9 = FamilyType.Name(familyType=code_block_25)
flatten_4 = List.Flatten(list=name_9)
id_9 = Element.Id(element=code_block_25)
flatten_5 = List.Flatten(list=id_9)
code_block_27 = CodeBlock { [["Category", "Family","Id", "Family Type","Id", "Instance Count"]]; }

# group: Instance Count
byFamilyType = FamilyInstance.ByFamilyType(familyType=code_block_25)
python_script_9 = Python(IN[0]=byFamilyType)
# ---------- python_script_9.python (19 lines) ----------
# Load the Python Standard and DesignScript Libraries
import sys
import clr
clr.AddReference('ProtoGeometry')
from Autodesk.DesignScript.Geometry import *

# The inputs to this node will be stored as a list in the IN variables.
dataEnteringNode = IN

# Place your code below this line
final=[]
# Assign your outpt to the OUT variable.
for i in IN[0]:
	sub=[]
	for j in i:
		sub.append(len(j))
		
	final.append(sub)
OUT=final
# ----------------------------------------

# group (continued): Category- Family - Type - Instance Count
flatten_6 = List.Flatten(list=python_script_9)
list_create_9 = List.Create(item0=flatten, item1=flatten_2, item2=flatten_3, item3=flatten_4, item4=flatten_5, item5=flatten_6)
transpose_8 = List.Transpose(lists=list_create_9)
join_8 = List.Join(list0=transpose_8)

# group: Family Type
passThrough_9 = Custom[PassThrough](passThrough=passThrough_8, waitFor=exportExcel_9)
string_12 = StringInput("Family Instance Detail")
code_block_28 = CodeBlock { 1; 0; true; }
exportExcel_10 = Data.ExportExcel(filePath=passThrough_9, sheetName=string_12, startRow=code_block_28.out0, startCol=code_block_28.out1, data=join_8)

# group: Browser Organisation
passThrough_10 = Custom[PassThrough](passThrough=passThrough_9, waitFor=exportExcel_10)
string_13 = StringInput("Browser organisation")
code_block_29 = CodeBlock { 1; 0; true; }
exportExcel_11 = Data.ExportExcel(filePath=passThrough_10, sheetName=string_13, startRow=code_block_29.out0, startCol=code_block_29.out1, data=join_5)

# group: View Name and Detail
categories_5 = Categories("OST_Views")
all_elements_of_category_4 = ElementsOfCategory(Category=categories_5)
python_script_10 = Python(IN[0]=all_elements_of_category_4)
# ---------- python_script_10.python (13 lines) ----------
# Load the Python Standard and DesignScript Libraries
import sys
import clr
clr.AddReference('ProtoGeometry')
from Autodesk.DesignScript.Geometry import *

# The inputs to this node will be stored as a list in the IN variables.
dataEnteringNode = IN

# Place your code below this line

# Assign your output to the OUT variable.
OUT = [i for i in IN[0] if i!=None]
# ----------------------------------------
code_block_30 = CodeBlock { "View Name"; }
getParameterValueByName_2 = Element.GetParameterValueByName(element=python_script_10, parameterName=code_block_30)
python_script_11 = Python(IN[0]=getParameterValueByName_2)
# ---------- python_script_11.python (13 lines) ----------
# Load the Python Standard and DesignScript Libraries
import sys
import clr
clr.AddReference('ProtoGeometry')
from Autodesk.DesignScript.Geometry import *

# The inputs to this node will be stored as a list in the IN variables.
dataEnteringNode = IN

# Place your code below this line

# Assign your output to the OUT variable.
OUT = [i if i!=[] else None for i in IN[0]]
# ----------------------------------------
id_10 = Element.Id(element=python_script_10)
list_create_10 = List.Create(item0=python_script_11, item1=id_10)
transpose_9 = List.Transpose(lists=list_create_10)
join_9 = List.Join(list0=transpose_9)
code_block_31 = CodeBlock { [[ "View Name","Element Id"]]; }

# group: Browser Organisation
passThrough_11 = Custom[PassThrough](passThrough=passThrough_10, waitFor=exportExcel_11)
string_14 = StringInput("Browser organisation")
code_block_32 = CodeBlock { 1; 4; true; }
exportExcel_12 = Data.ExportExcel(filePath=passThrough_11, sheetName=string_14, startRow=code_block_32.out0, startCol=code_block_32.out1, data=join_9)

# group: Checking for duplicates by looking at the names
# note: Check if any duplicates are available by suffix "Copy" or "numbered"??
python_all_elements_in_all = Custom[Python All Elements In All Document]()  # package Synthesize toolkit; Python All Elements In All Document
name_10 = Element.Name(element=python_all_elements_in_all)
python_script_12 = Python(IN[0]=name_10)
# ---------- python_script_12.python (19 lines) ----------
# Load the Python Standard and DesignScript Libraries
import sys
import clr
clr.AddReference('ProtoGeometry')
from Autodesk.DesignScript.Geometry import *

# The inputs to this node will be stored as a list in the IN variables.
dataEnteringNode = IN

# Place your code below this line

final=[]

for ind, i in enumerate(IN[0]):
	if isinstance(i,str):
		if "copy" in i.lower() or "duplicate" in i.lower() or "(1)" in i:
			final.append(ind)
			
OUT=final
# ----------------------------------------
getItemAtIndex = List.GetItemAtIndex(list=name_10, index=python_script_12)
getItemAtIndex_2 = List.GetItemAtIndex(list=python_all_elements_in_all, index=python_script_12)
id_11 = Element.Id(element=getItemAtIndex_2)
list_create_11 = List.Create(item0=getItemAtIndex, item1=id_11)
transpose_10 = List.Transpose(lists=list_create_11)
join_10 = List.Join(list0=transpose_10)
code_block_33 = CodeBlock { [["Element Name","Element ID"]]; }

# group: Duplicates with "Copy" in names
passThrough_12 = Custom[PassThrough](passThrough=passThrough_11, waitFor=exportExcel_12)
string_15 = StringInput("Duplicates")
code_block_34 = CodeBlock { 1; 0; true; }
exportExcel_13 = Data.ExportExcel(filePath=passThrough_12, sheetName=string_15, startRow=code_block_34.out0, startCol=code_block_34.out1, data=join_10)

# group: Family Directory
directory_path = Directory("C:\Users\139\Desktop\fam_test")
directory_from_path = DirectoryObject(path=directory_path)
code_block_35 = CodeBlock { ".rfa"; true; }
getDirectoryContents = FileSystem.GetDirectoryContents(directory=directory_from_path, includeSubdirectories=code_block_35.out1)

# group: Checking which elements are Non Editable elements
python_script_13 = Python(IN[0]=getDirectoryContents.files)
# ---------- python_script_13.python (14 lines) ----------
# Load the Python Standard and DesignScript Libraries
import sys
import clr
clr.AddReference('ProtoGeometry')
from Autodesk.DesignScript.Geometry import *

# The inputs to this node will be stored as a list in the IN variables.
dataEnteringNode = IN

# Place your code below this line

# Assign your output to the OUT variable.
f = [i.split('\\')[-1] for i in IN[0]]
OUT=[i.split('.rfa')[0] for i in f if ".rfa" in i]
# ----------------------------------------

# group: File Size
code_block_36 = CodeBlock { ["Family Name"]; }
join_11 = List.Join(list0=code_block_36, list1=python_script_13)
size = Custom[Springs.File.Size](path=getDirectoryContents.files)  # package spring nodes; Checks the file size. Provide a file path as a string.
python_script_14 = Python(IN[0]=size)
# ---------- python_script_14.python (17 lines) ----------
# Load the Python Standard and DesignScript Libraries
import sys
import clr
clr.AddReference('ProtoGeometry')
from Autodesk.DesignScript.Geometry import *

# The inputs to this node will be stored as a list in the IN variables.
dataEnteringNode = IN

# Place your code below this line

# Assign your output to the OUT variable.
x = [int(i.split(" KB")[0]) for i in IN[0]]
Max=max(x)
ind=x.index(Max)
x=x+[Max]
OUT=x,ind
# ----------------------------------------
code_block_37 = CodeBlock(a=python_script_14) { a[0]; a[1]; }
getItemAtIndex_3 = List.GetItemAtIndex(list=python_script_13, index=code_block_37.out1)
join_12 = List.Join(list0=join_11, list1=getItemAtIndex_3)
code_block_38 = CodeBlock { ["In KB's"]; }
join_13 = List.Join(list0=code_block_38, list1=code_block_37.out0)
list_create_12 = List.Create(item0=join_12, item1=join_13)
transpose_11 = List.Transpose(lists=list_create_12)

# group: Family Size
passThrough_13 = Custom[PassThrough](passThrough=passThrough_12, waitFor=exportExcel_13)
string_16 = StringInput("Family Instance Detail")
code_block_39 = CodeBlock { 1; 8; true; }
exportExcel_14 = Data.ExportExcel(filePath=passThrough_13, sheetName=string_16, startRow=code_block_39.out0, startCol=code_block_39.out1, data=transpose_11)
