# Dynamo graph Mesh from excel.dyn (Dynamo 2.6.1.8786)

# group: Vertex
file_path = Filename("..\Downloads\updated vertex.xlsx")
file_from_path = FileObject(path=file_path)
code_block = CodeBlock { "Sheet4"; false; }
importExcel = Data.ImportExcel(file=file_from_path, sheetName=code_block.out0, showExcel=code_block.out1)
restOfItems = List.RestOfItems(list=importExcel)
transpose = List.Transpose(lists=restOfItems)
code_block_2 = CodeBlock(a=transpose) { a[1]; }
code_block_3 = CodeBlock(a=transpose) { a[2]; }
code_block_4 = CodeBlock(a=transpose) { a[3]; }
byCoordinates = Point.ByCoordinates(x=code_block_2, y=code_block_3, z=code_block_4)

# group: Index
file_from_path_2 = FileObject(path=file_path)
code_block_5 = CodeBlock { "Sheet3"; false; }
importExcel_2 = Data.ImportExcel(file=file_from_path_2, sheetName=code_block_5.out0, showExcel=code_block_5.out1)

restOfItems_2 = List.RestOfItems(list=importExcel_2)

# group (continued): Index
transpose_2 = List.Transpose(lists=restOfItems_2)
python_script = Python(IN[0]=transpose_2)
# ---------- python_script.python (26 lines) ----------
# Load the Python Standard and DesignScript Libraries
import sys
import clr
clr.AddReference('ProtoGeometry')
from Autodesk.DesignScript.Geometry import *

# The inputs to this node will be stored as a list in the IN variables.
dataEnteringNode = IN

# Place your code below this line

# Assign your output to the OUT variable.
inp=IN[0]
final=[]
inp1=inp[3]
for i in inp1:
	if i==None:
		final.append([])
	else:
		final.append(i)
		
final1=[inp[0],inp[1],inp[2],final]



OUT=final1
# ----------------------------------------
transpose_3 = List.Transpose(lists=python_script)
python_script_2 = Python(IN[0]=transpose_3)
# ---------- python_script_2.python (27 lines) ----------
# Load the Python Standard and DesignScript Libraries
import sys
import clr
clr.AddReference('ProtoGeometry')
from Autodesk.DesignScript.Geometry import *

# The inputs to this node will be stored as a list in the IN variables.
dataEnteringNode = IN

# Place your code below this line

# Assign your output to the OUT variable.
inp=IN[0]
final=[]
index=[]
final1=[]
index1=[]
for ind,i in enumerate(inp):
	if [] in i:
		index.append(ind)
		final.append(i)
	elif [] not in i:
		final1.append(i)
		index1.append(ind)
	else:
		pass
OUT=final, final1, index, index1
# ----------------------------------------
code_block_6 = CodeBlock(a=python_script_2) { a[0]; }
transpose_4 = List.Transpose(lists=code_block_6)
code_block_7 = CodeBlock(a=python_script_2) { a[1]; }
transpose_5 = List.Transpose(lists=code_block_7)
code_block_8 = CodeBlock(a=python_script_2) { a[3]; }
code_block_9 = CodeBlock(a=python_script_2) { a[2]; }

# group: Generating Indices
code_block_10 = CodeBlock(x=transpose_4) { IndexGroup.ByIndices(x[0],x[1],x[2]); }
code_block_11 = CodeBlock(x=transpose_5) { IndexGroup.ByIndices(x[0],x[1],x[2],x[3]); }

# group: Organizing the vertex accordingly
python_script_3 = Python(IN[0]=code_block_10, IN[1]=code_block_11, IN[2]=code_block_8, IN[3]=code_block_9)
# ---------- python_script_3.python (26 lines) ----------
# Load the Python Standard and DesignScript Libraries
import sys
import clr
clr.AddReference('ProtoGeometry')
from Autodesk.DesignScript.Geometry import *

# The inputs to this node will be stored as a list in the IN variables.
dataEnteringNode = IN
tri=IN[0]
quad=IN[1]
indq=IN[2]
indt=IN[3]

final=[]
l=len(tri)+len(quad)
lst1=[0]*l

d=dict(zip(indt,tri))
lst2=[d.get(i,j) for i,j in enumerate(lst1)]

d=dict(zip(indq,quad))
lst3=[d.get(i,j) for i,j in enumerate(lst2)]



OUT=lst3
# ----------------------------------------

byPointsFaceIndices = Mesh.ByPointsFaceIndices(vertexPositions=byCoordinates, indices=python_script_3)
categories = Categories("OST_GenericModel")

# group: Write material name
string = StringInput("Earth")

byName = Material.ByName(name=string)
code_block_12 = CodeBlock { "Topo after void cut"; }
byMesh = DirectShape.ByMesh(mesh=byPointsFaceIndices, category=categories, material=byName, name=code_block_12)
