# Dynamo graph Section View using lines.dyn "Section View2" (Dynamo 2.6.1.8786)
# packages: Rhythm 2021.7.3

select_model_elements = DSModelElementsSelection()  # 3 picked in the model
geometry = Element.Geometry(element=select_model_elements)
flatten = List.Flatten(list=geometry)
viewFamilyTypes = ViewFamilyTypes("Building Section")
height = CodeBlock { 10000; }
offset_of_section_from_line = CodeBlock { 0; }
far_clip_offset = CodeBlock { 500; }
python_script = Python(IN[0]=flatten, IN[1]=viewFamilyTypes, IN[2]=height, IN[3]=offset_of_section_from_line, IN[4]=far_clip_offset)
# ---------- python_script.python (74 lines) ----------
import clr
clr.AddReference('RevitAPI')
from Autodesk.Revit.DB import *
clr.AddReference('RevitServices')
from RevitServices.Transactions import TransactionManager
from RevitServices.Persistence import DocumentManager
clr.AddReference('RevitNodes')
import Revit
clr.ImportExtensions(Revit.GeometryConversion)


doc = DocumentManager.Instance.CurrentDBDocument


UIunit = Document.GetUnits(doc).GetFormatOptions(UnitType.UT_Length).DisplayUnits

def tolist(input):
	if isinstance(input,list):
		return input
	else:
		return [input]




curves = tolist(IN[0])
ViewFamilyType = IN[1]
height = UnitUtils.ConvertToInternalUnits(IN[2],UIunit)
offsetFromWall = UnitUtils.ConvertToInternalUnits(IN[3],UIunit)
depth_ = UnitUtils.ConvertToInternalUnits(IN[4],UIunit)

watch = []

def DSCurveToVewSection(c,vft,offset,doc,height,depth):
	locC = c.ToRevitType()
	sp = locC.GetEndPoint(0)
	ep = locC.GetEndPoint(1)
	v = ep-sp
	w = v.GetLength()
	h = 10
	#ViewSectionBoundingBox
	vsBBmin = XYZ(-w/2,0,-offset)
	vsBBmax = XYZ(w/2,height,depth)
	midpoint = sp + 0.5*v
	lineDir = v.Normalize()
	up = XYZ.BasisZ
	viewdir = lineDir.CrossProduct(up).Normalize()
	
	t = Transform.Identity
	t.Origin = midpoint
	t.BasisX = lineDir
	t.BasisY = up
	t.BasisZ = viewdir
	
	vsBB = BoundingBoxXYZ()
	vsBB.Enabled = True
	vsBB.Transform = t
	vsBB.Min = vsBBmin
	vsBB.Max = vsBBmax
	vsBB.set_MinEnabled(0, True)
	vsBB.set_MinEnabled(1, True)
	vsBB.set_MinEnabled(2, True)
	vsBB.set_MaxEnabled(0, True)
	vsBB.set_MaxEnabled(1, True)
	vsBB.set_MaxEnabled(2, True)
	section = ViewSection.CreateSection(doc,ElementId(vft.Id),vsBB)	
	return section
	
TransactionManager.Instance.EnsureInTransaction(doc)
for cvs in curves:
	watch.append(DSCurveToVewSection(cvs,ViewFamilyType,offsetFromWall,doc,height,depth_))
TransactionManager.Instance.TransactionTaskDone

OUT = watch
# ----------------------------------------
