# Dynamo graph v1.dyn (Dynamo 2.6.1.8786)
# packages: Genius Loci 2021.7.30

# group: Set Parameter Base (Do not Unfreeze it)
python_script = Python()  # frozen; unwired: IN[0], IN[1], IN[2]
# ---------- python_script.python (52 lines) ----------
import clr
clr.AddReference("RevitAPI")
from Autodesk.Revit.DB import *

clr.AddReference("RevitServices")
import RevitServices
from RevitServices.Persistence import DocumentManager
from RevitServices.Transactions import TransactionManager

import sys
pyt_path = r'C:\Program Files (x86)\IronPython 2.7\Lib'
sys.path.append(pyt_path)
import System	

elements = UnwrapElement(IN[0]) if isinstance(IN[0],list) else [UnwrapElement(IN[0])]
parameter_names = UnwrapElement(IN[1]) if isinstance(IN[1],list) else [UnwrapElement(IN[1])]
values = UnwrapElement(IN[2]) if isinstance(IN[2],list) else [UnwrapElement(IN[2])]


#Part of script from Clockwork
doc = DocumentManager.Instance.CurrentDBDocument


def setdata(items,params,values):
	for i,param_name in enumerate(params):
		for elem in items: 
		
			params = elem.GetParameters(param_name)
			param = (sorted(params, key = lambda x : x.Id))[0]
			if param == None:
				param = elem.Document.GetElement(elem.GetTypeId()).LookupParameter(param_name)
			if param.StorageType == StorageType.Double:
				param.Set(UnitUtils.ConvertToInternalUnits(values[i],param.DisplayUnitType))
			elif param.StorageType == StorageType.ElementId:
				param.Set(values[i].Id)
			else:
				param.Set(values[i])
		return items

try:
	TransactionManager.Instance.ForceCloseTransaction()
	t = Transaction(doc,'Set')
	t.Start()
	data=setdata(elements,parameter_names,values)
	t.Commit()      
	OUT = data, doc

except:
    # if error accurs anywhere in the process catch it
    import traceback
    errorReport = traceback.format_exc()
    OUT = errorReport
# ----------------------------------------

# group: Parameters
python_script_2 = Python()
# ---------- python_script_2.python (13 lines) ----------
# Load the Python Standard and DesignScript Libraries
import sys
import clr
clr.AddReference('ProtoGeometry')
from Autodesk.DesignScript.Geometry import *

# The inputs to this node will be stored as a list in the IN variables.
dataEnteringNode = IN

# Place your code below this line

# Assign your output to the OUT variable.
OUT = ["1 substrate","2 substrate", "3 substrate","4 substrate","5 substrate","6 substrate", "7 substrate","8 substrate","9 substrate","10 substrate"]
# ----------------------------------------

# group: Material Data
file_path = Filename("..\..\..\..\..\..\Downloads\Copy of CivilReport Coordinate Binari.xlsx")
file_from_path = FileObject(path=file_path)
code_block = CodeBlock { "Sondaggi"; false; }
importExcel = Data.ImportExcel(file=file_from_path, sheetName=code_block.out0, showExcel=code_block.out1)
restOfItems = List.RestOfItems(list=importExcel)
transpose = List.Transpose(lists=restOfItems)
python_script_3 = Python(IN[0]=transpose)
# ---------- python_script_3.python (13 lines) ----------
# Load the Python Standard and DesignScript Libraries
import sys
import clr
clr.AddReference('ProtoGeometry')
from Autodesk.DesignScript.Geometry import *

# The inputs to this node will be stored as a list in the IN variables.
dataEnteringNode = IN

# Place your code below this line
a=IN[0]
# Assign your output to the OUT variable.
OUT = [a[9][0:124],a[12][0:124],a[15][0:124],a[18][0:124],a[21][0:124],a[24][0:124],a[27][0:124],a[30][0:124],a[33][0:124],a[36][0:124]]
# ----------------------------------------
transpose_2 = List.Transpose(lists=python_script_3)

# group: Visibility
restOfItems_2 = List.RestOfItems(list=importExcel)
transpose_3 = List.Transpose(lists=restOfItems_2)
python_script_4 = Python(IN[0]=transpose_3)
# ---------- python_script_4.python (13 lines) ----------
# Load the Python Standard and DesignScript Libraries
import sys
import clr
clr.AddReference('ProtoGeometry')
from Autodesk.DesignScript.Geometry import *

# The inputs to this node will be stored as a list in the IN variables.
dataEnteringNode = IN

# Place your code below this line
a=IN[0]
# Assign your output to the OUT variable.
OUT = a[10][0:124],a[13][0:124],a[16][0:124],a[19][0:124],a[22][0:124],a[25][0:124],a[28][0:124],a[31][0:124],a[34][0:124],a[37][0:124]
# ----------------------------------------
transpose_4 = List.Transpose(lists=python_script_4)

python_script_5 = Python(IN[1]=python_script_2, IN[2]=transpose_4)  # frozen; unwired: IN[0]
# ---------- python_script_5.python (43 lines) ----------
import clr
clr.AddReference("RevitAPI")
from Autodesk.Revit.DB import *

clr.AddReference("RevitServices")
import RevitServices
from RevitServices.Persistence import DocumentManager
from RevitServices.Transactions import TransactionManager

import sys
pyt_path = r'C:\Program Files (x86)\IronPython 2.7\Lib'
sys.path.append(pyt_path)
import System	

elements = UnwrapElement(IN[0]) if isinstance(IN[0],list) else [UnwrapElement(IN[0])]
parameter_names = UnwrapElement(IN[1]) if isinstance(IN[1],list) else [UnwrapElement(IN[1])]
values = UnwrapElement(IN[2]) if isinstance(IN[2],list) else [UnwrapElement(IN[2])]


#Part of script from Clockwork
doc = DocumentManager.Instance.CurrentDBDocument


def setparam(elements,params,values):
	for ind, elem in enumerate(elements):
		
		value=values[ind]
		for ind1, j in enumerate(value):
			para=params[ind1]
			
			par=elem.GetParameters(para)
			parsub=(sorted(par,key=lambda x:x.Id))[0]
					
			parsub.Set(j)
			
		return elements 
TransactionManager.Instance.ForceCloseTransaction()
t = Transaction(doc,'Set')
t.Start()
data=setparam(elements,parameter_names,values)
t.Commit()      
OUT = data			
				
# ----------------------------------------
code_block_2 = CodeBlock { ["1 substrate material","2 substrate material","3 substrate material"]; }
code_block_3 = CodeBlock { [["Earth","Earth","Earth"],["Earth","Earth","Earth"],["Earth","Earth","Earth"]]; }

# group: Material Set
python_script_6 = Python()  # frozen; unwired: IN[0], IN[1], IN[2]
# ---------- python_script_6.python (42 lines) ----------
import clr
clr.AddReference("RevitAPI")
from Autodesk.Revit.DB import *

clr.AddReference("RevitServices")
import RevitServices
from RevitServices.Persistence import DocumentManager
from RevitServices.Transactions import TransactionManager

import sys
pyt_path = r'C:\Program Files (x86)\IronPython 2.7\Lib'
sys.path.append(pyt_path)
import System	

elements = UnwrapElement(IN[0]) if isinstance(IN[0],list) else [UnwrapElement(IN[0])]
parameter_names = UnwrapElement(IN[1]) if isinstance(IN[1],list) else [UnwrapElement(IN[1])]
values = UnwrapElement(IN[2]) if isinstance(IN[2],list) else [UnwrapElement(IN[2])]


#Part of script from Clockwork
doc = DocumentManager.Instance.CurrentDBDocument


def setparam(elements,params,values):
	for ind, elem in enumerate(elements):
		para=params[ind]
		value=values[ind]
		for ind1, j in enumerate(para):
			val=value[ind1]
			par=elem.GetParameters(j)
			parsub=(sorted(par,key=lambda x:x.Id))[0]
					
			parsub.Set(val.Id)
			
		return parsub
TransactionManager.Instance.ForceCloseTransaction()
t = Transaction(doc,'Set')
t.Start()
data=setparam(elements,parameter_names,values)
t.Commit()      
OUT = data			
				
# ----------------------------------------

# group: Point Data
restOfItems_3 = List.RestOfItems(list=importExcel)
transpose_5 = List.Transpose(lists=restOfItems_3)
x = CodeBlock(a=transpose_5) { a[4]; }
python_script_7 = Python(IN[0]=x)
# ---------- python_script_7.python (13 lines) ----------
# Load the Python Standard and DesignScript Libraries
import sys
import clr
clr.AddReference('ProtoGeometry')
from Autodesk.DesignScript.Geometry import *

# The inputs to this node will be stored as a list in the IN variables.
dataEnteringNode = IN

# Place your code below this line

# Assign your output to the OUT variable.
OUT = [i for i in IN[0] if i!=None]
# ----------------------------------------
y = CodeBlock(a=transpose_5) { a[5]; }
python_script_8 = Python(IN[0]=y)  # same code as python_script_7
z = CodeBlock(a=transpose_5) { a[6]; }
python_script_9 = Python(IN[0]=z)  # same code as python_script_7

get_project_locations = Custom[Get Project Locations]()  # package Genius Loci; Works only in Revit 2018 and later. Retrieves the project positions of the given document in the Survey Coordinate System. (Coordinates of Internal origin, project base point and survey point)
X = Point.X(point=get_project_locations.Internal_Origin)
code_block_4 = CodeBlock(a=python_script_7, b=X) { a-b; }
Y = Point.Y(point=get_project_locations.Internal_Origin)
code_block_5 = CodeBlock(a=python_script_8, b=Y) { a-b; }
Z = Point.Z(point=get_project_locations.Internal_Origin)
code_block_6 = CodeBlock(a=python_script_9, b=Z) { a-b; }

# group (continued): Point Data
byCoordinates = Point.ByCoordinates(x=code_block_4, y=code_block_5, z=code_block_6)

# group: Family Instances
family_types = FamilyTypes("GEO_IND_Sondaggio:S18D")
byPoint = FamilyInstance.ByPoint(familyType=family_types, point=byCoordinates)

# group: Parameters
python_script_10 = Python()
# ---------- python_script_10.python (13 lines) ----------
# Load the Python Standard and DesignScript Libraries
import sys
import clr
clr.AddReference('ProtoGeometry')
from Autodesk.DesignScript.Geometry import *

# The inputs to this node will be stored as a list in the IN variables.
dataEnteringNode = IN

# Place your code below this line

# Assign your output to the OUT variable.
OUT = ["1 substrate material","2 substrate material", "3 substrate material","4 substrate material","5 substrate material","6 substrate material", "7 substrate material","8 substrate material","9 substrate material","10 substrate material"]
# ----------------------------------------
byName = Material.ByName(name=transpose_2)

python_script_11 = Python(IN[0]=byPoint, IN[1]=python_script_10, IN[2]=byName)
# ---------- python_script_11.python (36 lines) ----------
import clr
clr.AddReference("RevitAPI")
from Autodesk.Revit.DB import *

clr.AddReference("RevitServices")
import RevitServices
from RevitServices.Persistence import DocumentManager
from RevitServices.Transactions import TransactionManager

import sys
pyt_path = r'C:\Program Files (x86)\IronPython 2.7\Lib'
sys.path.append(pyt_path)
import System	

elements = UnwrapElement(IN[0]) if isinstance(IN[0],list) else [UnwrapElement(IN[0])]
params = UnwrapElement(IN[1]) if isinstance(IN[1],list) else [UnwrapElement(IN[1])]
values = UnwrapElement(IN[2]) if isinstance(IN[2],list) else [UnwrapElement(IN[2])]


#Part of script from Clockwork
doc = DocumentManager.Instance.CurrentDBDocument

final=[]
TransactionManager.Instance.EnsureInTransaction(doc)
for ind, elem in enumerate(elements):
	value=values[ind]
	for ind1, j in enumerate(value):
		para=params[ind1]
		par=elem.GetParameters(para)
		parsub=(sorted(par,key=lambda x:x.Id))[0]
		parsub.Set(j.Id)
	final.append(elem)	
	
TransactionManager.Instance.TransactionTaskDone()

OUT =final	
# ----------------------------------------

# group: Parameters
python_script_12 = Python()
# ---------- python_script_12.python (13 lines) ----------
# Load the Python Standard and DesignScript Libraries
import sys
import clr
clr.AddReference('ProtoGeometry')
from Autodesk.DesignScript.Geometry import *

# The inputs to this node will be stored as a list in the IN variables.
dataEnteringNode = IN

# Place your code below this line

# Assign your output to the OUT variable.
OUT = ["1 substrate H","2 substrate H", "3 substrate H","4 substrate H","5 substrate H","6 substrate H", "7 substrate H","8 substrate H","9 substrate H","10 substrate H"]
# ----------------------------------------

# group: Height Data
restOfItems_4 = List.RestOfItems(list=importExcel)
transpose_6 = List.Transpose(lists=restOfItems_4)
python_script_13 = Python(IN[0]=transpose_6)
# ---------- python_script_13.python (13 lines) ----------
# Load the Python Standard and DesignScript Libraries
import sys
import clr
clr.AddReference('ProtoGeometry')
from Autodesk.DesignScript.Geometry import *

# The inputs to this node will be stored as a list in the IN variables.
dataEnteringNode = IN

# Place your code below this line
a=IN[0]
# Assign your output to the OUT variable.
OUT = a[8][0:124],a[11][0:124],a[14][0:124],a[17][0:124],a[20][0:124],a[23][0:124],a[26][0:124],a[29][0:124],a[32][0:124],a[35][0:124]
# ----------------------------------------
transpose_7 = List.Transpose(lists=python_script_13)

python_script_14 = Python(IN[0]=python_script_11, IN[1]=python_script_12, IN[2]=transpose_7)
# ---------- python_script_14.python (36 lines) ----------
import clr
clr.AddReference("RevitAPI")
from Autodesk.Revit.DB import *

clr.AddReference("RevitServices")
import RevitServices
from RevitServices.Persistence import DocumentManager
from RevitServices.Transactions import TransactionManager

import sys
pyt_path = r'C:\Program Files (x86)\IronPython 2.7\Lib'
sys.path.append(pyt_path)
import System	

elements = UnwrapElement(IN[0]) if isinstance(IN[0],list) else [UnwrapElement(IN[0])]
params = UnwrapElement(IN[1]) if isinstance(IN[1],list) else [UnwrapElement(IN[1])]
values = UnwrapElement(IN[2]) if isinstance(IN[2],list) else [UnwrapElement(IN[2])]


#Part of script from Clockwork
doc = DocumentManager.Instance.CurrentDBDocument

final=[]
TransactionManager.Instance.EnsureInTransaction(doc)
for ind, elem in enumerate(elements):
	value=values[ind]
	for ind1, j in enumerate(value):
		para=params[ind1]
		par=elem.GetParameters(para)
		parsub=(sorted(par,key=lambda x:x.Id))[0]
		parsub.Set(UnitUtils.ConvertToInternalUnits(j,parsub.DisplayUnitType))
	final.append(elem)	
	
TransactionManager.Instance.TransactionTaskDone()

OUT =final	
# ----------------------------------------
code_block_7 = CodeBlock { [[1,2,4],[1,2,4],[1,2,4]]; }
code_block_8 = CodeBlock { ["1 substrate H","2 substrate H","3 substrate H"]; }
code_block_9 = CodeBlock { [[1,0,1],[0,1,1],[1,1,0]]; }
code_block_10 = CodeBlock { ["1 substrate","2 substrate","3 substrate"]; }
select_model_elements = DSModelElementsSelection()  # 1 picked in the model
python_script_15 = Python(IN[0]=select_model_elements)  # frozen; unwired: IN[1], IN[2]
# ---------- python_script_15.python (40 lines) ----------
import clr
clr.AddReference("RevitAPI")
from Autodesk.Revit.DB import *

clr.AddReference("RevitServices")
import RevitServices
from RevitServices.Persistence import DocumentManager
from RevitServices.Transactions import TransactionManager

import sys
pyt_path = r'C:\Program Files (x86)\IronPython 2.7\Lib'
sys.path.append(pyt_path)
import System	

elements = UnwrapElement(IN[0]) if isinstance(IN[0],list) else [UnwrapElement(IN[0])]
params = UnwrapElement(IN[1]) if isinstance(IN[1],list) else [UnwrapElement(IN[1])]
values = UnwrapElement(IN[2]) if isinstance(IN[2],list) else [UnwrapElement(IN[2])]


#Part of script from Clockwork
doc = DocumentManager.Instance.CurrentDBDocument

final=[]
TransactionManager.Instance.EnsureInTransaction(doc)
for ind, elem in enumerate(elements):
	value=values[ind]
	sub=[]
	for ind1, j in enumerate(value):
		para=params[ind1]
		par=elem.GetParameters(para)
		parsub=sorted(par,key=lambda x:x.Id)
		parsub1=parsub
		sub.append(parsub1)
		#parsub.Set(j)
	final.append(sub)	
	#final.append(elem)	
	
TransactionManager.Instance.TransactionTaskDone()

OUT =final	
# ----------------------------------------
python_script_16 = Python(IN[0]=python_script_15)
# ---------- python_script_16.python (55 lines) ----------
# Load the Python Standard and DesignScript Libraries
import sys
import clr
clr.AddReference('ProtoGeometry')
from Autodesk.DesignScript.Geometry import *

# The inputs to this node will be stored as a list in the IN variables.
dataEnteringNode = IN

# Place your code below this line

# Assign your output to the OUT variable.


import clr
clr.AddReference("RevitAPI")
from Autodesk.Revit.DB import *

clr.AddReference("RevitServices")
import RevitServices
from RevitServices.Persistence import DocumentManager
from RevitServices.Transactions import TransactionManager

import sys
pyt_path = r'C:\Program Files (x86)\IronPython 2.7\Lib'
sys.path.append(pyt_path)
import System	

elements = UnwrapElement(IN[0]) if isinstance(IN[0],list) else [UnwrapElement(IN[0])]

values = UnwrapElement(IN[2]) if isinstance(IN[2],list) else [UnwrapElement(IN[2])]

x = [i[2][0] for i in IN[1]]

#Part of script from Clockwork
doc = DocumentManager.Instance.CurrentDBDocument

final=[]
TransactionManager.Instance.EnsureInTransaction(doc)
for ind, elem in enumerate(elements):
	value=values[ind]
	sub=[]
	for ind1, j in enumerate(value):
		para=x[ind1]
		par=elem.GetParameters(para)
		parsub=sorted(par,key=lambda x:x.Id)
		parsub1=parsub
		sub.append(parsub1)
		#parsub.Set(j)
	final.append(sub)	
	#final.append(elem)	
	
TransactionManager.Instance.TransactionTaskDone()

OUT =final	
# ----------------------------------------
