# Dynamo graph V1.dyn (Dynamo 2.5.1.7586)
# packages: Civil3DToolkit 1.1.17, Clockwork for Dynamo 2.x 2.3.0

current = Autodesk.AutoCAD.DynamoNodes.Document.Current()

# group: Excel Data
file_path = Filename("C:\Users\139\Downloads\try.xlsx")
file_from_path = FileObject(path=file_path)
code_block = CodeBlock { "Sheet1"; true; false; }
importExcel = Data.ImportExcel(file=file_from_path, sheetName=code_block.out0, readAsStrings=code_block.out1, showExcel=code_block.out2)
code_block_2 = CodeBlock(a=importExcel) { a[1..5]; }
transpose = List.Transpose(lists=code_block_2)

# group: Excel Data
code_block_3 = CodeBlock(a=transpose) { a[0]; }
code_block_4 = CodeBlock(a=transpose) { a[4]; }
pname = CodeBlock(a=transpose) { a[1]; }
code_block_5 = CodeBlock(a=transpose) { a[2]; }
code_block_6 = CodeBlock(a=transpose) { a[3]; }

# group: PropertySet Definition
python_script = Python(IN[0]=code_block_3, IN[1]=code_block_4)
# ---------- python_script.python (12 lines) ----------
pdef=IN[0]
pdes=IN[1]

finalps=[]
finalpd=[]

for ind, i in enumerate(pdef):
	j=pdes[ind]
	if i not in finalps:
		finalps.append(i)
		finalpd.append(j)
OUT=finalps, finalpd
# ----------------------------------------
pset = CodeBlock(a=python_script) { a[0]; }
psetd = CodeBlock(a=python_script) { a[1]; }
code_block_7 = CodeBlock { ["Fitting","Appurtenance","Pressure Pipe"]; }
propertySetDefinitionByParameters = Autodesk.AutoCAD.DynamoNodes.PropertySetsExtensions.PropertySetDefinitionByParameters(name=pset, description=psetd, applyTo=code_block_7)

passthrough = Custom[Passthrough](passThrough=code_block_3, waitFor=propertySetDefinitionByParameters)  # package Clockwork for Dynamo 2.x; Forces a sequential order of execution. The node wired into the output of the Passthrough node will be executed *after* the node wired into the waitFor input (e.g. important for some Revit operations). The value of the passThrough input will be passed on to the node wired into the output port of the Passthrough node.
propertySetDefinitionByName = Autodesk.AutoCAD.DynamoNodes.Document.PropertySetDefinitionByName(document=current, name=passthrough)
propertyDefinitionByParameters = Autodesk.AutoCAD.DynamoNodes.PropertySetsExtensions.PropertyDefinitionByParameters(psetDef=propertySetDefinitionByName, name=pname, description=code_block_5, dataType=code_block_6)
