# Dynamo graph Section Views of Ribs.dyn (Dynamo 2.6.1.8786)
# packages: Rhythm 2021.7.3, DynaMEP 1.2.8

# group: Select Ribs
select_model_elements = DSModelElementsSelection()  # 242 picked in the model

code_block = CodeBlock(a=select_model_elements) { a; }

# group: Planes with max. area
faces = Element.Faces(element=code_block)
area = Surface.Area(surface=faces)
python_script = Python(IN[0]=area, IN[1]=faces)
# ---------- python_script.python (19 lines) ----------
# Load the Python Standard and DesignScript Libraries
import sys
import clr
clr.AddReference('ProtoGeometry')
from Autodesk.DesignScript.Geometry import *

# The inputs to this node will be stored as a list in the IN variables.
area=IN[0]
surface=IN[1]
final=[]
for ind, i in enumerate(area):
	if i!=None:
		surf=surface[ind]
		x=max(i)
		ind1=i.index(x)
		final.append(surf[ind1])
	else:
		final.append(None)
OUT=final
# ----------------------------------------

# group: Lines
perimeterCurves = Surface.PerimeterCurves(surface=python_script)
XY = Plane.XY()
pullOntoPlane = Curve.PullOntoPlane(curve=perimeterCurves, plane=XY)
length = Curve.Length(curve=pullOntoPlane)
python_script_2 = Python(IN[0]=length, IN[1]=pullOntoPlane)
# ---------- python_script_2.python (23 lines) ----------
# Load the Python Standard and DesignScript Libraries
import sys
import clr
clr.AddReference('ProtoGeometry')
from Autodesk.DesignScript.Geometry import *

# The inputs to this node will be stored as a list in the IN variables.
dataEnteringNode = IN
final=[]
# Place your code below this line
for ind, i in enumerate(IN[0]):
	if i!=None:
		crvs=IN[1][ind]
		zipped=zip(i,crvs)
		srt=sorted(zipped)
		tuples=zip(*srt)
		i,crvs=[tuple for tuple in tuples]
		crv=crvs[2]
		final.append(crv)
	else:
		final.append(None)
# Assign your output to the OUT variable.
OUT = final
# ----------------------------------------
code_block_2 = CodeBlock { 2500; }
extendStart = Curve.ExtendStart(curve=python_script_2, distance=code_block_2)
extendEnd = Curve.ExtendEnd(curve=extendStart, distance=code_block_2)
ZAxis = Vector.ZAxis()

getLocation = Element.GetLocation(element=select_model_elements)
Z = Point.Z(point=getLocation)
code_block_3 = CodeBlock { 0.5; }
pointAtParameter = Curve.PointAtParameter(curve=extendEnd, param=code_block_3)
Z_2 = Point.Z(point=pointAtParameter)
code_block_4 = CodeBlock(a=Z, b=Z_2) { a-b-100; }

# group (continued): Lines
translate = Geometry.Translate(geometry=extendEnd, direction=ZAxis, distance=code_block_4)

name = Element.Name(element=select_model_elements)
python_script_3 = Python(IN[0]=translate, IN[1]=name)
# ---------- python_script_3.python (20 lines) ----------
# Load the Python Standard and DesignScript Libraries
import sys
import clr
clr.AddReference('ProtoGeometry')
from Autodesk.DesignScript.Geometry import *

# The inputs to this node 
final=[]
names=[]
# Place your code below this line
for ind, i in enumerate(IN[0]):
	name=IN[1][ind]
	if i!=None:
		final.append(i)
		names.append(name)
	else:
		pass
		
# Assign your output to the OUT variable.
OUT = final,names
# ----------------------------------------
code_block_5 = CodeBlock(a=python_script_3) { a[1]; }
code_block_6 = CodeBlock(a=python_script_3) { a[0]; }
viewFamilyTypes = ViewFamilyTypes("SEC-PM_Brackets")
height = CodeBlock { 6000; }
offset_of_section_from_line = CodeBlock { 0.5; }
far_clip_offset = CodeBlock { 500; }

# group: Create Sections
python_script_4 = Python(IN[0]=code_block_6, IN[1]=viewFamilyTypes, IN[2]=height, IN[3]=offset_of_section_from_line, IN[4]=far_clip_offset)
# ---------- python_script_4.python (74 lines) ----------
import clr
clr.AddReference('RevitAPI')
from Autodesk.Revit.DB import *
clr.AddReference('RevitServices')
from RevitServices.Transactions import TransactionManager
from RevitServices.Persistence import DocumentManager
clr.AddReference('RevitNodes')
import Revit
clr.ImportExtensions(Revit.GeometryConversion)


doc = DocumentManager.Instance.CurrentDBDocument


UIunit = Document.GetUnits(doc).GetFormatOptions(UnitType.UT_Length).DisplayUnits

def tolist(input):
	if isinstance(input,list):
		return input
	else:
		return [input]




curves = tolist(IN[0])
ViewFamilyType = IN[1]
height = UnitUtils.ConvertToInternalUnits(IN[2],UIunit)
offsetFromWall = UnitUtils.ConvertToInternalUnits(IN[3],UIunit)
depth_ = UnitUtils.ConvertToInternalUnits(IN[4],UIunit)

watch = []

def DSCurveToVewSection(c,vft,offset,doc,height,depth):
	locC = c.ToRevitType()
	sp = locC.GetEndPoint(0)
	ep = locC.GetEndPoint(1)
	v = ep-sp
	w = v.GetLength()
	h = 10
	#ViewSectionBoundingBox
	vsBBmin = XYZ(-w/2,0,-offset)
	vsBBmax = XYZ(w/2,height,depth)
	midpoint = sp + 0.5*v
	lineDir = v.Normalize()
	up = XYZ.BasisZ
	viewdir = lineDir.CrossProduct(up).Normalize()
	
	t = Transform.Identity
	t.Origin = midpoint
	t.BasisX = lineDir
	t.BasisY = up
	t.BasisZ = viewdir
	
	vsBB = BoundingBoxXYZ()
	vsBB.Enabled = True
	vsBB.Transform = t
	vsBB.Min = vsBBmin
	vsBB.Max = vsBBmax
	vsBB.set_MinEnabled(0, True)
	vsBB.set_MinEnabled(1, True)
	vsBB.set_MinEnabled(2, True)
	vsBB.set_MaxEnabled(0, True)
	vsBB.set_MaxEnabled(1, True)
	vsBB.set_MaxEnabled(2, True)
	section = ViewSection.CreateSection(doc,ElementId(vft.Id),vsBB)	
	return section
	
TransactionManager.Instance.EnsureInTransaction(doc)
for cvs in curves:
	watch.append(DSCurveToVewSection(cvs,ViewFamilyType,offsetFromWall,doc,height,depth_))
TransactionManager.Instance.TransactionTaskDone

OUT = watch
# ----------------------------------------

code_block_7 = CodeBlock { "View Name"; }
setParameterValueByName = RevitModel.Element.SetParameterValueByName(element=python_script_4, parameterName=code_block_7, values=code_block_5)

# group: File Location to Save DWG (Takes an hour to save 240 Ribs- Please Take caution)
directory_path = Directory("C:\Users\139\Desktop\Paolo")
exportDWG = RevitModel.Export.ExportDWG(Directory=directory_path, filename=code_block_5, view=setParameterValueByName)  # frozen
