# Dynamo graph Replace Structural Framing with another Family Type.dyn (Dynamo 2.6.1.8786)
# packages: Modelical 2.2.19, Clockwork for Dynamo 1.x 1.31.1

select_model_elements = DSModelElementsSelection()  # 30 picked in the model
solids = Element.Solids(element=select_model_elements)
flatten = List.Flatten(list=solids)
faces = Topology.Faces(topology=flatten)
surfaceGeometry = Face.SurfaceGeometry(face=faces)

# group: Selecting the Bottom Face
python_script = Python(IN[0]=surfaceGeometry)
# ---------- python_script.python (13 lines) ----------
# Load the Python Standard and DesignScript Libraries
import sys
import clr
clr.AddReference('ProtoGeometry')
from Autodesk.DesignScript.Geometry import *

# The inputs to this node will be stored as a list in the IN variables.
dataEnteringNode = IN

# Place your code below this line

# Assign your output to the OUT variable.
OUT = [i[0] for i in IN[0]]
# ----------------------------------------

perimeterCurves = Surface.PerimeterCurves(surface=python_script)
python_script_2 = Python(IN[0]=perimeterCurves)  # same code as python_script
code_block = CodeBlock { 0; }
normalAtParameter = Curve.NormalAtParameter(curve=python_script_2, param=code_block)
elementType = Element.ElementType(element=select_model_elements)
code_block_2 = CodeBlock { "Lintel Width"; }
getParameterValueByName = Element.GetParameterValueByName(element=elementType, parameterName=code_block_2)

# group: CenterLine of Lintel
code_block_3 = CodeBlock(a=getParameterValueByName) { a/2; }

translate = Geometry.Translate(geometry=python_script_2, direction=normalAtParameter, distance=code_block_3)
code_block_4 = CodeBlock { "Level"; }
getParameterValueByName_2 = Element.GetParameterValueByName(element=select_model_elements, parameterName=code_block_4)

# group: Select Family type
family_types = FamilyTypes("Structural Lintel Beam:B6_ARC_SLB_200*300mm")

beamByCurve = StructuralFraming.BeamByCurve(curve=translate, level=getParameterValueByName_2, structuralFramingType=family_types)
passthrough = Custom[Passthrough](passThrough=select_model_elements, waitFor=beamByCurve)  # package Clockwork for Dynamo 1.x; Forces a sequential order of execution. The node wired into the output of the Passthrough node will be executed *after* the node wired into the waitFor input (e.g. important for some Revit operations). The value of the passThrough input will be passed on to the node wired into the output port of the Passthrough node.
selectInRevit = Custom[SelectInRevit](ElemsOrIDs=passthrough)  # package Modelical; Select elements in Revit by Element or ID
