# Dynamo graph CopyParameterValuesInAnother_V3(Levels and Zones).dyn (Dynamo 2.6.1.8786)
# packages: Modelical 2.2.19

# group: Categories
categories = Categories("OST_Floors")
categories_2 = Categories("OST_Walls")
categories_3 = Categories("OST_StructuralColumns")
categories_4 = Categories("OST_StructuralFraming")
categories_5 = Categories("OST_Stairs")
categories_6 = Categories("OST_StructuralFoundation")
categories_7 = Categories("OST_GenericModel")

all_elements_of_category = ElementsOfCategory(Category=categories_7)
code_block = CodeBlock { "TAG REF.(OPENING)"; }
getParameterValueByName = Element.GetParameterValueByName(element=all_elements_of_category, parameterName=code_block)
code_block_2 = CodeBlock { "2H"; }
contains = String.Contains(str=getParameterValueByName, searchFor=code_block_2)
filterByBoolMask = List.FilterByBoolMask(list=all_elements_of_category, mask=contains)
watch = Watch(filterByBoolMask.in)  # frozen

# group: Finding elements with the parameter
all_elements_in_active_view = ElementsInView()
getParameterValueByName_2 = Element.GetParameterValueByName(element=all_elements_in_active_view, parameterName=code_block)  # frozen
python_script = Python(IN[0]=getParameterValueByName_2)
# ---------- python_script.python (13 lines) ----------
# Load the Python Standard and DesignScript Libraries
import sys
import clr
clr.AddReference('ProtoGeometry')
from Autodesk.DesignScript.Geometry import *

# The inputs to this node will be stored as a list in the IN variables.
dataEnteringNode = IN

# Place your code below this line

# Assign your output to the OUT variable.
OUT = [ind for ind, i in enumerate(IN[0]) if i!=""]
# ----------------------------------------
getItemAtIndex = List.GetItemAtIndex(list=all_elements_in_active_view, index=python_script)
selectInRevit = Custom[SelectInRevit](ElemsOrIDs=getItemAtIndex)  # package Modelical; Select elements in Revit by Element or ID

code_block_3 = CodeBlock { "TAG REF.(OPENING)"; }
getParameterValueByName_3 = Element.GetParameterValueByName(element=filterByBoolMask.in, parameterName=code_block_3)

# group: Creating Zones and Levels
python_script_2 = Python(IN[0]=getParameterValueByName_3)
# ---------- python_script_2.python (34 lines) ----------
# Load the Python Standard and DesignScript Libraries
import sys
import clr
clr.AddReference('ProtoGeometry')
from Autodesk.DesignScript.Geometry import *

# The inputs to this node will be stored as a list in the IN variables.
dataEnteringNode = IN
final=[]
zone=[]
level=[]
# Place your code below this line
for i in IN[0]:
	li=i.split("-")
	lev=li[0]
	zne="Z"+li[1]
	zone.append(zne)
	if lev=="BM":
		level.append(lev)
	elif lev=="B1":
		level.append(lev)
	elif lev=="B2":
		level.append(lev)
		
	elif lev=="GF":
		level.append("L00")
	elif lev=="GM":
		level.append("L01")
	elif lev=="GA":
		level.append("L02")
	elif lev=="PL":
		level.append("L04")
# Assign your output to the OUT variable.
OUT = level, zone
# ----------------------------------------
level = CodeBlock(a=python_script_2) { a[0]; }
zone = CodeBlock(a=python_script_2) { a[1]; }

# group: Setting Parameter
code_block_4 = CodeBlock { "B6_BW_Opening No."; }
setParameterByName = Element.SetParameterByName(element=filterByBoolMask.in, parameterName=code_block_4, value=getParameterValueByName_3)
code_block_5 = CodeBlock { "B6_1D_Level"; }
setParameterByName_2 = Element.SetParameterByName(element=setParameterByName, parameterName=code_block_5, value=level)
code_block_6 = CodeBlock { "B6_1D_Zone"; }
setParameterByName_3 = Element.SetParameterByName(element=setParameterByName_2, parameterName=code_block_6, value=zone)

selectInRevit_2 = Custom[SelectInRevit](ElemsOrIDs=setParameterByName_3)
