# Dynamo graph Setting Type Parameter.dyn (Dynamo 2.6.1.8786)

select_model_elements = DSModelElementsSelection()  # 76 picked in the model
parameter_name = CodeBlock { "Keynote"; }
parameter_values = CodeBlock { ["aaa","bbb","ccc"]; }
name = Element.Name(element=select_model_elements)
python_script = Python(IN[0]=select_model_elements, IN[1]=parameter_name, IN[2]=parameter_values, IN[3]=name)
# ---------- python_script.python (93 lines) ----------
#Copyright(c) 2015, Konrad K Sobon
# @arch_laboratory, http://archi-lab.net

import clr
clr.AddReference('ProtoGeometry')
from Autodesk.DesignScript.Geometry import *

# Import Element wrapper extension methods
clr.AddReference("RevitNodes")
import Revit
clr.ImportExtensions(Revit.Elements)

# Import geometry conversion extension methods
clr.ImportExtensions(Revit.GeometryConversion)

# Import DocumentManager and TransactionManager
clr.AddReference("RevitServices")
import RevitServices
from RevitServices.Persistence import DocumentManager
from RevitServices.Transactions import TransactionManager

doc = DocumentManager.Instance.CurrentDBDocument
uiapp = DocumentManager.Instance.CurrentUIApplication
app = uiapp.Application

# Import RevitAPI
clr.AddReference("RevitAPI")
import Autodesk
from Autodesk.Revit.DB import *

import System
from System import Array
from System.Collections.Generic import *

# Import ToDSType(bool) extension method
clr.AddReference("RevitNodes")
import Revit
clr.ImportExtensions(Revit.Elements)

import sys
pyt_path = r'C:\Program Files (x86)\IronPython 2.7\Lib'
sys.path.append(pyt_path)

#The inputs to this node will be stored as a list in the IN variable.
dataEnteringNode = IN


paramNames = IN[1]
paramValues = IN[2]
names=IN[3]
if isinstance(IN[0],list):
	elist=IN[0]
else:
	elist=[IN[0]]

if isinstance(IN[3],list):
	enames=IN[3]
else:
	enames=[IN[3]]

if isinstance(IN[1],list):
	paramNames=IN[1]
else:
	paramNames=[IN[1]]
	
elements = []
outList = []


for i in range(0,len(elist)):
    elements.append(UnwrapElement(elist[i]))

TransactionManager.Instance.EnsureInTransaction(doc)
final=[]
sub=[]
for i, values,name in zip(elements, paramValues, enames):
	elemType = doc.GetElement(i.GetTypeId())
	params = elemType.Parameters
	for j in params:
		if j.Definition.Name == paramNames[0]:
			if name not in sub:
				sub.append(name)
				j.Set(values)
				final.append(i)
				
			else:
				final.append([])			
				sub.append(name)
TransactionManager.Instance.TransactionTaskDone()



OUT = final
# ----------------------------------------
