# Dynamo graph Setting Type Parameter_Put data Manually.dyn "Setting Type Parameter_2" (Dynamo 2.6.1.8786)
# packages: bimorphNodes 4.0.13, DynaMEP 1.2.8, Clockwork for Dynamo 1.x 1.31.1

categories = Categories("OST_Schedules")
all_elements_of_category = ElementsOfCategory(Category=categories)

# group: Elementtype Uniqueness
code_block = CodeBlock { true; }
code_block_2 = CodeBlock(a=all_elements_of_category) { [a[6],a[3]]; }
code_block_3 = CodeBlock { 0..10; }
getDataColumns = Revit.Schedule.GetDataColumns(scheduleView=code_block_2, columnIndexes=code_block_3)
python_script = Python(IN[0]=getDataColumns)
# ---------- python_script.python (13 lines) ----------
# Load the Python Standard and DesignScript Libraries
import sys
import clr
clr.AddReference('ProtoGeometry')
from Autodesk.DesignScript.Geometry import *

# The inputs to this node will be stored as a list in the IN variables.
dataEnteringNode = IN

# Place your code below this line

# Assign your output to the OUT variable.
OUT = [[i[0][2::], i[2][2::]] for i in IN[0]]
# ----------------------------------------
python_script_2 = Python(IN[0]=python_script)
# ---------- python_script_2.python (41 lines) ----------
# Load the Python Standard and DesignScript Libraries
import sys
import clr
clr.AddReference('ProtoGeometry')
from Autodesk.DesignScript.Geometry import *

# The inputs to this node will be stored as a list in the IN variables.
dataEnteringNode = IN
final=[]

# Place your code below this line
for ind1, i in enumerate(IN[0]):
	sub=[]
	type=i[0]
	ids=i[1]
	types=[]
	p1_sub=[]
	p2_sub=[]
	
	for ind, j in enumerate(type):
		id=ids[ind]		
		
		
		if j not in types and ":" not in j and j!=[] and j!="":
			types.append(j)
			try:
				if "'" in id:
					id=id.replace("'",'')
					id=int(id)
					sub.append(id)
					
				else:
					id=int(id)
					sub.append(id)
				
			except:
				final.append([])
	final.append(sub)

# Assign your output to the OUT variable.
OUT = final
# ----------------------------------------
byId = RevitModel.Element.ById(id=python_script_2)

# group: Name to choose the Schedule of Interest
name = Element.Name(element=all_elements_of_category)

flatten = List.Flatten(list=byId)
elementType = Element.ElementType(element=flatten)
name_2 = Custom[Element.Name+](element=elementType)  # package Clockwork for Dynamo 1.x; Gets an element's name. Unlike the OOTB node, this node should work for all Revit elements that have names.
python_script_3 = Python(IN[0]=name_2, IN[1]=flatten)
# ---------- python_script_3.python (21 lines) ----------
# Load the Python Standard and DesignScript Libraries
import sys
import clr
clr.AddReference('ProtoGeometry')
from Autodesk.DesignScript.Geometry import *

# The inputs to this node will be stored as a list in the IN variables.
dataEnteringNode = IN
type=IN[0]
elem=IN[1]
# Place your code below this line
final=[]
typs=[]

for ind, i in enumerate(type):
	ele=elem[ind]
	if i not in typs:
		typs.append(i)
		final.append(ele)
# Assign your output to the OUT variable.
OUT = final
# ----------------------------------------

# group: Element type name
name_3 = Element.Name(element=python_script_3)

# group: Parameter Value to Edit
code_block_4 = CodeBlock { "SQ"; }
python_script_4 = Python(IN[0]=name_3, IN[1]=code_block_4)
# ---------- python_script_4.python (13 lines) ----------
# Load the Python Standard and DesignScript Libraries
import sys
import clr
clr.AddReference('ProtoGeometry')
from Autodesk.DesignScript.Geometry import *

# The inputs to this node will be stored as a list in the IN variables.
dataEnteringNode = IN

# Place your code below this line

# Assign your output to the OUT variable.
OUT = [IN[1]]*len(IN[0])
# ----------------------------------------

# group: Parameter Set 1
parameter_name = CodeBlock { "Keynote"; }
python_script_5 = Python(IN[0]=python_script_3, IN[1]=parameter_name, IN[2]=python_script_4, IN[3]=name_3)
# ---------- python_script_5.python (93 lines) ----------
#Copyright(c) 2015, Konrad K Sobon
# @arch_laboratory, http://archi-lab.net

import clr
clr.AddReference('ProtoGeometry')
from Autodesk.DesignScript.Geometry import *

# Import Element wrapper extension methods
clr.AddReference("RevitNodes")
import Revit
clr.ImportExtensions(Revit.Elements)

# Import geometry conversion extension methods
clr.ImportExtensions(Revit.GeometryConversion)

# Import DocumentManager and TransactionManager
clr.AddReference("RevitServices")
import RevitServices
from RevitServices.Persistence import DocumentManager
from RevitServices.Transactions import TransactionManager

doc = DocumentManager.Instance.CurrentDBDocument
uiapp = DocumentManager.Instance.CurrentUIApplication
app = uiapp.Application

# Import RevitAPI
clr.AddReference("RevitAPI")
import Autodesk
from Autodesk.Revit.DB import *

import System
from System import Array
from System.Collections.Generic import *

# Import ToDSType(bool) extension method
clr.AddReference("RevitNodes")
import Revit
clr.ImportExtensions(Revit.Elements)

import sys
pyt_path = r'C:\Program Files (x86)\IronPython 2.7\Lib'
sys.path.append(pyt_path)

#The inputs to this node will be stored as a list in the IN variable.
dataEnteringNode = IN


paramNames = IN[1]
paramValues = IN[2]
names=IN[3]
if isinstance(IN[0],list):
	elist=IN[0]
else:
	elist=[IN[0]]

if isinstance(IN[3],list):
	enames=IN[3]
else:
	enames=[IN[3]]

if isinstance(IN[1],list):
	paramNames=IN[1]
else:
	paramNames=[IN[1]]
	
elements = []
outList = []


for i in range(0,len(elist)):
    elements.append(UnwrapElement(elist[i]))

TransactionManager.Instance.EnsureInTransaction(doc)
final=[]
sub=[]
for i, values,name in zip(elements, paramValues, enames):
	elemType = doc.GetElement(i.GetTypeId())
	params = elemType.Parameters
	for j in params:
		if j.Definition.Name == paramNames[0]:
			if name not in sub:
				sub.append(name)
				j.Set(values)
				final.append(i)
				
			else:
				final.append([])			
				sub.append(name)
TransactionManager.Instance.TransactionTaskDone()



OUT = final
# ----------------------------------------

passthrough = Custom[Passthrough](passThrough=python_script_3, waitFor=python_script_5)  # package Clockwork for Dynamo 1.x; Forces a sequential order of execution. The node wired into the output of the Passthrough node will be executed *after* the node wired into the waitFor input (e.g. important for some Revit operations). The value of the passThrough input will be passed on to the node wired into the output port of the Passthrough node.

# group: Parameter Set 2
parameter_name_2 = CodeBlock { "Model"; }
python_script_6 = Python(IN[0]=passthrough, IN[1]=parameter_name_2, IN[2]=python_script_4, IN[3]=name_3)  # same code as python_script_5
