# Dynamo graph Change Part of Parameter Value V2.dyn (Dynamo 2.6.1.8786)
# packages: DynaMEP 1.2.8

# group: Model elements
select_model_elements = DSModelElementsSelection()  # 95 picked in the model
code_block = CodeBlock { "B6_1D_Construction Joint"; }
getParameterValueByName = Element.GetParameterValueByName(element=select_model_elements, parameterName=code_block)

python_script = Python(IN[0]=getParameterValueByName, IN[1]=select_model_elements)
# ---------- python_script.python (18 lines) ----------
# Load the Python Standard and DesignScript Libraries
import sys
import clr
clr.AddReference('ProtoGeometry')
from Autodesk.DesignScript.Geometry import *

# The inputs to this node will be stored as a list in the IN variables.
dataEnteringNode = IN
elems=[]
code=[]
# Place your code below this line
for ind, i in enumerate(IN[0]):
	elem=IN[1][ind]
	if i!="":
		elems.append(elem)
		code.append(i)
# Assign your output to the OUT variable.
OUT = elems, code
# ----------------------------------------
code_block_2 = CodeBlock(a=python_script) { a[0]; }
code_block_3 = CodeBlock { "Digipro_Object Code"; }
getParameterValueByName_2 = Element.GetParameterValueByName(element=code_block_2, parameterName=code_block_3)
code_block_4 = CodeBlock(a=python_script) { a[1]; }

# group: Excel Data
file_path = Filename("..\..\..\..\..\..\Downloads\ZNM_Object Code Dictionary and Programme_REV12 F 1 (1).xlsx")
file_from_path = FileObject(path=file_path)
code_block_5 = CodeBlock { "REVISED 24102021"; true; false; }
readFromFile = Excel.Read.ReadFromFile(file=file_from_path, sheetName=code_block_5.out0, byColumn=code_block_5.out1)
code_block_6 = CodeBlock(a=readFromFile) { a[20..21]; }
python_script_2 = Python(IN[0]=code_block_6)
# ---------- python_script_2.python (13 lines) ----------
# Load the Python Standard and DesignScript Libraries
import sys
import clr
clr.AddReference('ProtoGeometry')
from Autodesk.DesignScript.Geometry import *

# The inputs to this node will be stored as a list in the IN variables.
dataEnteringNode = IN

# Place your code below this line

# Assign your output to the OUT variable.
OUT = [i[43:58] for i in IN[0]]
# ----------------------------------------
codeblock = CodeBlock(a=python_script_2) { a[1]; }  # "Abbrev."
code = CodeBlock(a=python_script_2) { a[0]; }

python_script_3 = Python(IN[0]=code_block_4, IN[1]=codeblock, IN[2]=code)
# ---------- python_script_3.python (40 lines) ----------
# Load the Python Standard and DesignScript Libraries
import sys
import clr
clr.AddReference('ProtoGeometry')
from Autodesk.DesignScript.Geometry import *

# The inputs to this node will be stored as a list in the IN variables.
dataEnteringNode = IN

# Place your code below this line
excel_cd=IN[2]
excel_na=IN[1]
excel_n=[i[-1] for i in excel_na]
#excel_n=excel_n[0:9]
#excel_cd=excel_cd[0:9]
elem_c=IN[0]
final=[]

for i in elem_c:
	try:
		if i=="3A-5" or i=="3A-6" or i=="3A-7" or i=="3A-8" or i=="2B-1" or i=="2D-5":
			if i in excel_na:
				ind= excel_na.index(i)		
				cd=excel_cd[ind]
				final.append(cd)
			else:	
				final.append([])
		else:
			if i[-1] in excel_n:
				ind= excel_n.index(i[-1])		
				cd=excel_cd[ind]
				final.append(cd)
			else:
				final.append([])
		
	except:
		final.append([])

# Assign your output to the OUT variable.
OUT = final
# ----------------------------------------
python_script_4 = Python(IN[0]=getParameterValueByName_2, IN[1]=python_script_3)
# ---------- python_script_4.python (13 lines) ----------
# Load the Python Standard and DesignScript Libraries
import sys
import clr
clr.AddReference('ProtoGeometry')
from Autodesk.DesignScript.Geometry import *

# The inputs to this node will be stored as a list in the IN variables.
dataEnteringNode = IN

# Place your code below this line

# Assign your output to the OUT variable.
OUT = [i[:-2]+str(int(IN[1][ind])) if i !=[] and IN[1][ind]!=[] else [] for ind, i in enumerate(IN[0])]
# ----------------------------------------
setParameterValueByName = RevitModel.Element.SetParameterValueByName(element=code_block_2, parameterName=code_block_3, values=python_script_4)
