# Dynamo graph Changing Digipro Based on Level.dyn (Dynamo 2.6.1.8786)
# packages: DynaMEP 1.2.8

# group: Model elements
select_model_elements = DSModelElementsSelection()  # 95 picked in the model
code_block = CodeBlock { "B6_1D_Level"; }
getParameterValueByName = Element.GetParameterValueByName(element=select_model_elements, parameterName=code_block)

python_script = Python(IN[0]=getParameterValueByName)
# ---------- python_script.python (18 lines) ----------
# Load the Python Standard and DesignScript Libraries
import sys
import clr
clr.AddReference('ProtoGeometry')
from Autodesk.DesignScript.Geometry import *

# The inputs to this node will be stored as a list in the IN variables.
dataEnteringNode = IN
final=[]
index=[]
# Place your code below this line
for ind, i in enumerate(IN[0]):
	if i=="L00" or i=="L01" or i=="L02" or i=="L03" or i=="L04":
		final.append(i)
		index.append(ind)

# Assign your output to the OUT variable.
OUT = index, final
# ----------------------------------------
code_block_2 = CodeBlock(a=python_script) { a[0]; }
getItemAtIndex = List.GetItemAtIndex(list=select_model_elements, index=code_block_2)
code_block_3 = CodeBlock { "Digipro_Object Code"; }
getParameterValueByName_2 = Element.GetParameterValueByName(element=getItemAtIndex, parameterName=code_block_3)
code_block_4 = CodeBlock(a=python_script) { a[1]; }

# group: Modify for more data
code_block_5 = CodeBlock { ["L00", "L01","L02","L03", "L04"]; }
code_block_6 = CodeBlock { ["003", "004","005","006","007"]; }

# group: New Digipro
python_script_2 = Python(IN[0]=getParameterValueByName_2, IN[1]=code_block_4, IN[2]=code_block_5, IN[3]=code_block_6)
# ---------- python_script_2.python (33 lines) ----------
# Load the Python Standard and DesignScript Libraries
import sys
import clr
clr.AddReference('ProtoGeometry')
from Autodesk.DesignScript.Geometry import *

# The inputs to this node will be stored as a list in the IN variables.
dataEnteringNode = IN

# Place your code below this line
digipro=IN[0]
level=IN[1]
lev_list=IN[2]
lev_code=IN[3]
final=[]

for ind, i in enumerate(digipro):
	if i!=None and i!=[]:
		lev=level[ind]
		x=i.split("-")
		if lev in lev_list:
			ind1=lev_list.index(lev)
			code=lev_code[ind1]
			codfin=[x[0],x[1],x[2],x[3],code,x[5]]
			code_fin="-".join(codfin)
			final.append(code_fin)
		else:
			final.append([])
	else:
		final.append([])
	
# Assign your output to the OUT variable.
OUT = final
# ----------------------------------------

setParameterValueByName = RevitModel.Element.SetParameterValueByName(element=getItemAtIndex, parameterName=code_block_3, values=python_script_2)

# group: Test Function
python_script_3 = Python(IN[0]=getParameterValueByName_2, IN[1]=code_block_4, IN[2]=code_block_5, IN[3]=code_block_6)  # frozen
# ---------- python_script_3.python (33 lines) ----------
# Load the Python Standard and DesignScript Libraries
import sys
import clr
clr.AddReference('ProtoGeometry')
from Autodesk.DesignScript.Geometry import *

# The inputs to this node will be stored as a list in the IN variables.
dataEnteringNode = IN

# Place your code below this line
digipro=IN[0]
level=IN[1]
lev_list=IN[2]
lev_code=IN[3]
final=[]

for ind, i in enumerate(digipro):
	if i!=None and i!=[]:
		lev=level[ind]
		x=i.split("-")
		if lev in lev_list:
			ind1=lev_list.index(lev)
			code=lev_code[ind1]
			codfin=[x[0],x[1],x[2],x[3],"008",x[5]]
			code_fin="-".join(codfin)
			final.append(code_fin)
		else:
			final.append([])
	else:
		final.append([])
	
# Assign your output to the OUT variable.
OUT = final
# ----------------------------------------
