# Dynamo graph IFC-All project Info V2.dyn (Dynamo 2.6.1.8786)
# packages: archi-lab.net 2021.25.2721, Synthesize toolkit 11.9.3, Clockwork for Dynamo 1.x 1.31.1

# group: Levels in Project
categories = Categories("OST_Levels")
all_elements_of_category = ElementsOfCategory(Category=categories)
code_block = CodeBlock { [["Levels","Id"]]; }

# group: View Name and Detail
categories_2 = Categories("OST_Views")
all_elements_of_category_2 = ElementsOfCategory(Category=categories_2)
code_block_2 = CodeBlock { [[ "View Name","Element Id"]]; }
code_block_3 = CodeBlock { "View Name"; }

# group: Ifc Elements
categories_3 = Categories("OST_GenericModel")
al_get_documents = Custom[AL.Get Documents]()  # package Synthesize toolkit; Queries all linked Revit files and retrieves their Name, LinkInstance and Document properties.
code_block_4 = CodeBlock(a=al_get_documents.VARLinkInstance) { a[0]; }
code_block_5 = CodeBlock(a=al_get_documents.VARLinkDoc) { a[0]; }
get_all_elements_from_linked = Custom[Get All Elements From Linked Model](linkDoc=code_block_5, category=categories)  # package archi-lab.net; This node is based on code posted by Julien Benoit. Big thanks to Julien for sharing his work. This node will retrieve all elements of a given category from a given linked model.

# group: Ifc Elements
categories_4 = Categories("OST_GenericModel")
al_get_documents_2 = Custom[AL.Get Documents]()
code_block_6 = CodeBlock(a=al_get_documents_2.VARLinkInstance) { a[0]; }
code_block_7 = CodeBlock(a=al_get_documents_2.VARLinkDoc) { a[0]; }
get_all_elements_from_linked_2 = Custom[Get All Elements From Linked Model](linkDoc=code_block_7, category=categories_2)

# group: Ifc Elements
al_get_documents_3 = Custom[AL.Get Documents]()
code_block_8 = CodeBlock(a=al_get_documents_3.VARLinkInstance) { a[0]; }
code_block_9 = CodeBlock(a=al_get_documents_3.VARLinkDoc) { a[0]; }
getAll = archilab.Revit.Elements.Categories.GetAll()
code_block_10 = CodeBlock(a=getAll.Model) { a; }
python_script = Python(IN[0]=code_block_9, IN[1]=code_block_10)
# ---------- python_script.python (45 lines) ----------
#Copyright(c) 2015, Konrad Sobon
# @arch_laboratory, http://archi-lab.net

# This node is based on Julien Benoit's Element.GetElementFromLinkedFile 
# node. Some slight improvements were made removing unnecessary imports/references.
# Big thank you to Julien for sharing his work. 

import clr
clr.AddReference('ProtoGeometry')
from Autodesk.DesignScript.Geometry import *

# Import RevitAPI
clr.AddReference("RevitAPI")
import Autodesk
from Autodesk.Revit.DB import *

import System

import sys
pyt_path = r'C:\Program Files (x86)\IronPython 2.7\Lib'
sys.path.append(pyt_path)

#The inputs to this node will be stored as a list in the IN variable.
dataEnteringNode = IN

_linkDoc = IN[0]
_category = IN[1]

try:
	errorReport = None
	final=[]
	for cat in _category:
		filter = ElementCategoryFilter(System.Enum.ToObject(BuiltInCategory, cat.Id))
		result = FilteredElementCollector(_linkDoc).WherePasses(filter).WhereElementIsNotElementType().ToElements()
		final.append(result)
except:
	# if error accurs anywhere in the process catch it
	import traceback
	errorReport = traceback.format_exc()

#Assign your output to the OUT variable
if errorReport == None:
	OUT = final
else:
	OUT = errorReport
# ----------------------------------------
flatten = List.Flatten(list=python_script)

# group: Checking for duplicates by looking at the names
code_block_11 = CodeBlock { [["Element Name","Element ID"]]; }
name = Element.Name(element=flatten)

# group: Ifc Elements
al_get_documents_4 = Custom[AL.Get Documents]()
code_block_12 = CodeBlock(a=al_get_documents_4.VARLinkInstance) { a[0]; }
code_block_13 = CodeBlock(a=al_get_documents_4.VARLinkDoc) { a[0]; }

# group: Ifc Elements
getAll_2 = archilab.Revit.Elements.Categories.GetAll()
al_get_documents_5 = Custom[AL.Get Documents]()
code_block_14 = CodeBlock(a=al_get_documents_5.VARLinkDoc) { a[0]; }
code_block_15 = CodeBlock(a=getAll_2.Model) { a; }

# group: Old
python_script_2 = Python(IN[1]=getAll_2.Model)  # frozen; unwired: IN[0]
# ---------- python_script_2.python (45 lines) ----------
#Copyright(c) 2015, Konrad Sobon
# @arch_laboratory, http://archi-lab.net

# This node is based on Julien Benoit's Element.GetElementFromLinkedFile 
# node. Some slight improvements were made removing unnecessary imports/references.
# Big thank you to Julien for sharing his work. 

import clr
clr.AddReference('ProtoGeometry')
from Autodesk.DesignScript.Geometry import *

# Import RevitAPI
clr.AddReference("RevitAPI")
import Autodesk
from Autodesk.Revit.DB import *

import System

import sys
pyt_path = r'C:\Program Files (x86)\IronPython 2.7\Lib'
sys.path.append(pyt_path)

#The inputs to this node will be stored as a list in the IN variable.
dataEnteringNode = IN

_linkDoc = IN[0]
_category = IN[1]

try:
	errorReport = None
	final=[]
	for cat in _category:
		filter = ElementCategoryFilter(System.Enum.ToObject(BuiltInCategory, cat.Id))
		result = FilteredElementCollector(_linkDoc).WherePasses(filter).WhereElementIsElementType().ToElements()
		final.append(result)
except:
	# if error accurs anywhere in the process catch it
	import traceback
	errorReport = traceback.format_exc()

#Assign your output to the OUT variable
if errorReport == None:
	OUT = final
else:
	OUT = errorReport
# ----------------------------------------

# group: To Get Family From Another Document
python_script_3 = Python(IN[0]=code_block_14, IN[1]=code_block_15)  # same code as python_script

python_script_4 = Python(IN[0]=python_script_3, IN[1]=code_block_14)
# ---------- python_script_4.python (63 lines) ----------
# Copyright(c) 2016, Konrad K Sobon
# @arch_laboratory, http://archi-lab.net

# Import Element wrapper extension methods
import clr
clr.AddReference("RevitNodes")
import Revit
clr.ImportExtensions(Revit.Elements)

# Import DocumentManager and TransactionManager
clr.AddReference("RevitServices")
import RevitServices
from RevitServices.Persistence import DocumentManager
from RevitServices.Transactions import TransactionManager
#doc = DocumentManager.Instance.CurrentDBDocument
doc=IN[1]
# Import RevitAPI
clr.AddReference("RevitAPI")
import Autodesk
from Autodesk.Revit.DB import *

import sys
pyt_path = r'C:\Program Files (x86)\IronPython 2.7\Lib'
sys.path.append(pyt_path)

#The inputs to this node will be stored as a list in the IN variable.
dataEnteringNode = IN

def Unwrap(item):
	return UnwrapElement(item)

def ProcessList(_func, _list):
    return map( lambda x: ProcessList(_func, x) if type(x)==list else _func(x), _list )

def GetFamilyType(famInst):
	try:
		id = famInst.GetTypeId()
		if id == ElementId.InvalidElementId:
			return None
		else:
			return doc.GetElement(id)
	except:
		return None
		pass

if isinstance(IN[0], list):
	elements = ProcessList(Unwrap, IN[0])
else:
	elements = [Unwrap(IN[0])]

try:
	errorReport = None
	output = ProcessList(GetFamilyType, elements)
except:
	# if error accurs anywhere in the process catch it
	import traceback
	errorReport = traceback.format_exc()

#Assign your output to the OUT variable
if errorReport == None:
	OUT = output
else:
	OUT = errorReport
# ----------------------------------------
python_script_5 = Python(IN[0]=python_script_4)
# ---------- python_script_5.python (13 lines) ----------
# Load the Python Standard and DesignScript Libraries
import sys
import clr
clr.AddReference('ProtoGeometry')
from Autodesk.DesignScript.Geometry import *

# The inputs to this node will be stored as a list in the IN variables.
dataEnteringNode = IN

# Place your code below this line

# Assign your output to the OUT variable.
OUT = [[None if j==[] else j for j in i] if i!=[] and i!=None else None for i in IN[0]]
# ----------------------------------------
name_2 = ElementType.Name(elementType=python_script_5)
familyName = ElementType.FamilyName(elementType=python_script_5)

# group: Family Type and Family only
id = Element.Id(element=python_script_5)

# group: File Path and excel data filling
file_path = Filename("..\..\..\..\..\Lucia\IFC data export  - Copy.xlsx")  # frozen

# group: Shared Parameter
getAll_3 = archilab.Revit.Elements.Categories.GetAll()
code_block_16 = CodeBlock(a=getAll_3.Model) { a; }
python_script_6 = Python(IN[0]=code_block_13, IN[1]=code_block_16)
# ---------- python_script_6.python (43 lines) ----------
#Copyright(c) 2015, Konrad Sobon
# @arch_laboratory, http://archi-lab.net

# This node is based on Julien Benoit's Element.GetElementFromLinkedFile 
# node. Some slight improvements were made removing unnecessary imports/references.
# Big thank you to Julien for sharing his work. 

import clr
clr.AddReference('ProtoGeometry')
from Autodesk.DesignScript.Geometry import *

# Import RevitAPI
clr.AddReference("RevitAPI")
import Autodesk
from Autodesk.Revit.DB import *

import System

import sys
pyt_path = r'C:\Program Files (x86)\IronPython 2.7\Lib'
sys.path.append(pyt_path)

#The inputs to this node will be stored as a list in the IN variable.
dataEnteringNode = IN

_linkDoc = IN[0]
_category = IN[1]

try:
	errorReport = None
	final=[]
	result = FilteredElementCollector(_linkDoc).OfClass(SharedParameterElement).ToElements()
	final.append(result)
except:
	# if error accurs anywhere in the process catch it
	import traceback
	errorReport = traceback.format_exc()

#Assign your output to the OUT variable
if errorReport == None:
	OUT = final
else:
	OUT = errorReport
# ----------------------------------------
flatten_2 = List.Flatten(list=python_script_6)
id_2 = Element.Id(element=flatten_2)
name_3 = ElementType.Name(elementType=flatten_2)
list_create = List.Create(item0=id_2, item1=name_3)
transpose = List.Transpose(lists=list_create)

# group: Shared Parameter List
string = StringInput("Shared Parameter")
string_2 = StringInput("Shared Parameter List")
code_block_17 = CodeBlock(a=string_2) { [["Id",a]]; 2; 0; true; }
join = List.Join(list0=transpose)
exportExcel = Data.ExportExcel(filePath=file_path, sheetName=string, startRow=code_block_17.out1, startCol=code_block_17.out2, data=join)

passthrough = Custom[Passthrough](passThrough=file_path, waitFor=exportExcel)  # package Clockwork for Dynamo 1.x; Forces a sequential order of execution. The node wired into the output of the Passthrough node will be executed *after* the node wired into the waitFor input (e.g. important for some Revit operations). The value of the passThrough input will be passed on to the node wired into the output port of the Passthrough node.

# group (continued): Levels in Project
name_4 = Element.Name(element=get_all_elements_from_linked)
id_3 = Element.Id(element=get_all_elements_from_linked)
list_create_2 = List.Create(item0=name_4, item1=id_3)
transpose_2 = List.Transpose(lists=list_create_2)
join_2 = List.Join(list0=transpose_2)

# group: Levels in Datum
passThrough = Custom[PassThrough](passThrough=file_path, waitFor=passthrough)  # package archi-lab.net; Ripped this off from Clockwork. Sorry Andy.
string_3 = StringInput("Datum")
code_block_18 = CodeBlock { 1; 0; true; }
exportExcel_2 = Data.ExportExcel(filePath=passThrough, sheetName=string_3, startRow=code_block_18.out0, startCol=code_block_18.out1, data=join_2)

name_5 = Element.Name(element=python_script_3)
python_script_7 = Python(IN[0]=name_5)
# ---------- python_script_7.python (26 lines) ----------
# Load the Python Standard and DesignScript Libraries
import sys
import clr
clr.AddReference('ProtoGeometry')
from Autodesk.DesignScript.Geometry import *

# The inputs to this node will be stored as a list in the IN variables.
dataEnteringNode = IN

# Place your code below this line
inst_=[]
instance=IN[0]	
for i in instance:
	sub=[]
	for k in i:
		if k!=[] and k!=None:
			x=k.split("-")
			x=x[:-1]
			x="-".join(x)
			sub.append(x)
		else:
			sub.append([])
			
	inst_.append(sub)
# Assign your output to the OUT variable.
OUT = inst_
# ----------------------------------------
python_script_8 = Python(IN[0]=python_script_7)
# ---------- python_script_8.python (30 lines) ----------
# Load the Python Standard and DesignScript Libraries
import sys
import clr
clr.AddReference('ProtoGeometry')
from Autodesk.DesignScript.Geometry import *

# The inputs to this node will be stored as a list in the IN variables.
dataEnteringNode = IN

# Place your code below this line
inst_=[]
instance=IN[0]	
for i in instance:
	sub=[]
	for k in i:
		if k!=[] and k!=None:
			x=k.split("-")
			if len(x[-1])>4 and x[-1].isdigit():
				x=x[:-1]
				x="-".join(x)
				sub.append(x)
			else:
				x="-".join(x)
				sub.append(x)
		else:
			sub.append([])
			
	inst_.append(sub)
# Assign your output to the OUT variable.
OUT = inst_
# ----------------------------------------
python_script_9 = Python(IN[0]=python_script_8)  # same code as python_script_5

# group: Old
python_script_10 = Python(IN[0]=name_2, IN[1]=familyName, IN[2]=id)  # frozen
# ---------- python_script_10.python (33 lines) ----------
# Load the Python Standard and DesignScript Libraries
import sys
import clr
clr.AddReference('ProtoGeometry')
from Autodesk.DesignScript.Geometry import *

# The inputs to this node will be stored as a list in the IN variables.
dataEnteringNode = IN
final=[]
fam=[]
count=[]
ids=[]
new_ind=[]
start=0
# Place your code below this line
for ind, i in enumerate(IN[0]):
	type=IN[1][ind]
	id=IN[2][ind]
	if type not in final:
		final.append(type)
		fam.append(i)
		new_ind.append(start)
		ids.append(id)
		start+=1
		count.append(1)
		
	elif type in final:
		
		ind1=final.index(type)
		count[ind1]+=1
	
# Assign your output to the OUT variable.
OUT = fam, final, count,ids
# ----------------------------------------
python_script_11 = Python(IN[0]=name_2, IN[1]=familyName, IN[2]=id)  # frozen
# ---------- python_script_11.python (46 lines) ----------
# Load the Python Standard and DesignScript Libraries
import sys
import clr
clr.AddReference('ProtoGeometry')
from Autodesk.DesignScript.Geometry import *

# The inputs to this node will be stored as a list in the IN variables.
dataEnteringNode = IN
final=[]
fam=[]
count=[]
ids=[]
new_ind=[]
start=0
# Place your code below this line
for ind, i in enumerate(IN[0]):
	type=IN[1][ind]
	id=IN[2][ind]
	subf=[]
	subfam=[]
	subc=[]
	subids=[]
	sub_newind=[]
	sstart=0
	for ind2,j in enumerate(i):
		tipo=type[ind2]
		idsub=id[ind2]
		if tipo not in subf:
			subf.append(tipo)
			subfam.append(j)
			sub_newind.append(start)
			subids.append(idsub)
			sstart+=1
			subc.append(1)
			
		elif tipo in subf:
			
			ind1=subf.index(tipo)
			subc[ind1]+=1
	final.append(subf)
	fam.append(subfam)
	count.append(subc)
	ids.append(subids)
	
# Assign your output to the OUT variable.
OUT = fam, final, count,ids
# ----------------------------------------
python_script_12 = Python(IN[0]=name_2, IN[1]=familyName, IN[2]=id, IN[3]=python_script_9)  # frozen
# ---------- python_script_12.python (56 lines) ----------
# Load the Python Standard and DesignScript Libraries
import sys
import clr
clr.AddReference('ProtoGeometry')
from Autodesk.DesignScript.Geometry import *

# The inputs to this node will be stored as a list in the IN variables.
dataEnteringNode = IN
final=[]
fam=[]
count=[]
ids=[]
new_ind=[]
start=0
instances=IN[3]
instancef=[]
# Place your code below this line
for ind, i in enumerate(IN[0]):
	type=IN[1][ind]
	id=IN[2][ind]
	instance=instances[ind]
	
	###################################
	subf=[]
	subfam=[]
	subinst=[]
	subc=[]
	subids=[]
	sub_newind=[]
	sstart=0
	
	for ind2,inst in enumerate(instance):		
		j=i[ind2]
		tipo=type[ind2]
		idsub=id[ind2]
		if inst not in subinst:
			subinst.append(inst)
			subf.append(tipo)
			subfam.append(j)
			sub_newind.append(start)
			subids.append(idsub)
			sstart+=1
			subc.append(1)
			
		elif inst in subinst:
			
			ind1=subinst.index(inst)
			subc[ind1]+=1
	final.append(subf)
	fam.append(subfam)
	count.append(subc)
	ids.append(subids)
	instancef.append(subinst)
	
# Assign your output to the OUT variable.
OUT = fam, final, count,ids, instancef
# ----------------------------------------

categories_strings = FromObject(obj=code_block_15)
python_script_13 = Python(IN[0]=name_2, IN[1]=familyName, IN[2]=id, IN[3]=python_script_9, IN[4]=categories_strings)
# ---------- python_script_13.python (72 lines) ----------
import sys
import clr
clr.AddReference('ProtoGeometry')
from Autodesk.DesignScript.Geometry import *

# The inputs to this node will be stored as a list in the IN variables.
dataEnteringNode = IN
final=[]
fam=[]
count=[]
ids=[]
new_ind=[]
start=0
instances=IN[3]
instancef=[]
categories=[]
# Place your code below this line
for ind, i in enumerate(IN[0]):
	
	cat=IN[4][ind]
	type=IN[1][ind]
	id=IN[2][ind]
	instance=instances[ind]
	
	if instance==None:
		categories.append(cat)
		final.append(i)
		fam.append(type)
		count.append(0)
		ids.append(None)
		instancef.append(None)
	###################################
	
	elif instance!=None:
		subf=[]
		subfam=[]
		subinst=[]
		subc=[]
		subids=[]
		sub_newind=[]
		subcat=[]
		sstart=0
		for ind2,inst in enumerate(instance):		
			j=i[ind2]
			tipo=type[ind2]
			idsub=id[ind2]
			if inst not in subinst:
				subinst.append(inst)
				subf.append(tipo)
				subfam.append(j)
				sub_newind.append(start)
				subids.append(idsub)
				subcat.append(cat)
				sstart+=1
				subc.append(1)
				
			elif inst in subinst:
				
				ind1=subinst.index(inst)
				subc[ind1]+=1
		
		final.append(subf)
		fam.append(subfam)
		count.append(subc)
		ids.append(subids)
		instancef.append(subinst)
		categories.append(subcat)
	
	
	
# Assign your output to the OUT variable.
OUT = fam, final, count,ids, instancef, categories
# ----------------------------------------

# group (continued): Family Type and Family only
code_block_19 = CodeBlock(a=python_script_13) { a[5]; }
code_block_20 = CodeBlock(a=python_script_13) { a[0]; }
code_block_21 = CodeBlock(a=python_script_13) { a[1]; }
code_block_22 = CodeBlock(a=python_script_13) { a[3]; }
code_block_23 = CodeBlock(a=python_script_13) { a[4]; }
code_block_24 = CodeBlock(a=python_script_13) { a[2]; }

flatten_3 = List.Flatten(list=code_block_19)
flatten_4 = List.Flatten(list=code_block_20)
flatten_5 = List.Flatten(list=code_block_21)
flatten_6 = List.Flatten(list=code_block_22)
flatten_7 = List.Flatten(list=code_block_23)
flatten_8 = List.Flatten(list=code_block_24)
list_create_3 = List.Create(item0=flatten_3, item1=flatten_4, item2=flatten_5, item3=flatten_6, item4=flatten_7, item5=flatten_8)
transpose_3 = List.Transpose(lists=list_create_3)
join_3 = List.Join(list0=transpose_3)

# group: Family Type
passThrough_2 = Custom[PassThrough](passThrough=passThrough, waitFor=exportExcel_2)
string_4 = StringInput("Family Instance Detail")
code_block_25 = CodeBlock { 1; 0; true; }
exportExcel_3 = Data.ExportExcel(filePath=passThrough_2, sheetName=string_4, startRow=code_block_25.out0, startCol=code_block_25.out1, data=join_3)

# group (continued): View Name and Detail
python_script_14 = Python(IN[0]=get_all_elements_from_linked_2)
# ---------- python_script_14.python (13 lines) ----------
# Load the Python Standard and DesignScript Libraries
import sys
import clr
clr.AddReference('ProtoGeometry')
from Autodesk.DesignScript.Geometry import *

# The inputs to this node will be stored as a list in the IN variables.
dataEnteringNode = IN

# Place your code below this line

# Assign your output to the OUT variable.
OUT = [i for i in IN[0] if i!=None]
# ----------------------------------------
getParameterValueByName = Element.GetParameterValueByName(element=python_script_14, parameterName=code_block_3)
python_script_15 = Python(IN[0]=getParameterValueByName)
# ---------- python_script_15.python (13 lines) ----------
# Load the Python Standard and DesignScript Libraries
import sys
import clr
clr.AddReference('ProtoGeometry')
from Autodesk.DesignScript.Geometry import *

# The inputs to this node will be stored as a list in the IN variables.
dataEnteringNode = IN

# Place your code below this line

# Assign your output to the OUT variable.
OUT = [i if i!=[] else None for i in IN[0]]
# ----------------------------------------
id_4 = Element.Id(element=python_script_14)
list_create_4 = List.Create(item0=python_script_15, item1=id_4)
transpose_4 = List.Transpose(lists=list_create_4)
join_4 = List.Join(list0=transpose_4)

# group: View Detail
passThrough_3 = Custom[PassThrough](passThrough=passThrough_2, waitFor=exportExcel_3)
string_5 = StringInput("View Detail")
code_block_26 = CodeBlock { 1; 0; true; }
exportExcel_4 = Data.ExportExcel(filePath=passThrough_3, sheetName=string_5, startRow=code_block_26.out0, startCol=code_block_26.out1, data=join_4)

python_script_16 = Python(IN[0]=name)
# ---------- python_script_16.python (27 lines) ----------
# Load the Python Standard and DesignScript Libraries
import sys
import clr
clr.AddReference('ProtoGeometry')
from Autodesk.DesignScript.Geometry import *

# The inputs to this node will be stored as a list in the IN variables.
dataEnteringNode = IN
names=IN[0]
final=[]
# Place your code below this line
for i in names:
	if i!=None or i!=[]:
		x=i.split("-")
		if len(x[-1])>1:
			x=x[:-1]
			x="-".join(x)
			final.append(x)
#		y="-".join()
		else:
			#x=x[:-2]
			x="-".join(x)
			final.append(x)
	else:
		final.append([])
# Assign your output to the OUT variable.
OUT = final
# ----------------------------------------

# group (continued): Checking for duplicates by looking at the names
python_script_17 = Python(IN[0]=python_script_16)
# ---------- python_script_17.python (22 lines) ----------
# Load the Python Standard and DesignScript Libraries
import sys
import clr
clr.AddReference('ProtoGeometry')
from Autodesk.DesignScript.Geometry import *

# The inputs to this node will be stored as a list in the IN variables.
dataEnteringNode = IN

# Place your code below this line

final=[]

for ind, i in enumerate(IN[0]):
	if isinstance(i,str) and i!=None and i!=[] and i!="":
		x=i.split("-")
		if len(x[-1]) != 2:
			if "copy" in i.lower() or "duplicate" in i.lower() or "(1)" in i or i[-1]=="1" or i[-1]=="2":
				final.append(ind)
				
			
OUT=final
# ----------------------------------------
getItemAtIndex = List.GetItemAtIndex(list=flatten, index=python_script_17)
id_5 = Element.Id(element=getItemAtIndex)
getItemAtIndex_2 = List.GetItemAtIndex(list=python_script_16, index=python_script_17)

python_script_18 = Python(IN[0]=getItemAtIndex_2)
# ---------- python_script_18.python (20 lines) ----------
# Load the Python Standard and DesignScript Libraries
import sys
import clr
clr.AddReference('ProtoGeometry')
from Autodesk.DesignScript.Geometry import *

# The inputs to this node will be stored as a list in the IN variables.
dataEnteringNode = IN
final=[]
# Place your code below this line
for i in IN[0]:
	x=i.split("-")
	if x[-2].isdigit():
		x=x[:-2]+[x[-1]]
		x="-".join(x)
		final.append(x)
	else:
		final.append(i)
# Assign your output to the OUT variable.
OUT = final
# ----------------------------------------

# group (continued): Checking for duplicates by looking at the names
list_create_5 = List.Create(item0=id_5, item1=python_script_18)
transpose_5 = List.Transpose(lists=list_create_5)
join_5 = List.Join(list0=transpose_5)

# group: Duplicates with "Copy" in names
passThrough_4 = Custom[PassThrough](passThrough=passThrough_3, waitFor=exportExcel_4)
string_6 = StringInput("Duplicates")
code_block_27 = CodeBlock { 1; 0; true; }
exportExcel_5 = Data.ExportExcel(filePath=passThrough_4, sheetName=string_6, startRow=code_block_27.out0, startCol=code_block_27.out1, data=join_5)

python_script_19 = Python(IN[0]=python_script_18)
# ---------- python_script_19.python (25 lines) ----------
# Load the Python Standard and DesignScript Libraries
import sys
import clr
clr.AddReference('ProtoGeometry')
from Autodesk.DesignScript.Geometry import *

# The inputs to this node will be stored as a list in the IN variables.
dataEnteringNode = IN

# Place your code below this line
names=IN[0]
final=[]
index=[]
count=[]

for ind, i  in enumerate(names):
	if i not in final:
		final.append(i)
		count.append(1)
		index.append(ind)
	else:
		ind1=final.index(i)
		count[ind1]+=1
# Assign your output to the OUT variable.
OUT = final, count
# ----------------------------------------
transpose_6 = List.Transpose(lists=python_script_19)

# group: Duplicates with "Copy" in names
passThrough_5 = Custom[PassThrough](passThrough=passThrough_4, waitFor=exportExcel_5)
string_7 = StringInput("Duplicates")
code_block_28 = CodeBlock { 1; 4; true; }
exportExcel_6 = Data.ExportExcel(filePath=passThrough_5, sheetName=string_7, startRow=code_block_28.out0, startCol=code_block_28.out1, data=transpose_6)

# group: Old
python_script_20 = Python(IN[0]=code_block_14, IN[1]=code_block_15)  # same code as python_script
flatten_9 = List.Flatten(list=python_script_20)

python_script_21 = Python(IN[0]=python_script_5)
# ---------- python_script_21.python (13 lines) ----------
# Load the Python Standard and DesignScript Libraries
import sys
import clr
clr.AddReference('ProtoGeometry')
from Autodesk.DesignScript.Geometry import *

# The inputs to this node will be stored as a list in the IN variables.
dataEnteringNode = IN

# Place your code below this line

# Assign your output to the OUT variable.
OUT = [[j if j!=None else [] for j in i] if i!=[] and i!=None  else [] for i in IN[0]]
# ----------------------------------------
