# Dynamo graph IFC-All project Info.dyn (Dynamo 2.6.1.8786)
# packages: Clockwork for Dynamo 1.x 1.31.1, archi-lab.net 2021.25.2721, Synthesize toolkit 11.9.3

# group: Scope Boxes in Project
categories = Categories("OST_VolumeOfInterest")
all_elements_of_category = ElementsOfCategory(Category=categories)
code_block = CodeBlock { [["ScopeBox","Id"]]; }

# group: Grids in Project
categories_2 = Categories("OST_Grids")
all_elements_of_category_2 = ElementsOfCategory(Category=categories_2)
code_block_2 = CodeBlock { [["Grids","Id"]]; }

# group: Levels in Project
categories_3 = Categories("OST_Levels")
all_elements_of_category_3 = ElementsOfCategory(Category=categories_3)
code_block_3 = CodeBlock { [["Levels","Id"]]; }

# group: File Path and excel data filling
file_path = Filename("..\..\..\..\..\sq-ls2 - Copy.xlsx")

al_get_documents = Custom[AL.Get Documents]()  # package Synthesize toolkit; Queries all linked Revit files and retrieves their Name, LinkInstance and Document properties.

# group: Project Information
projectInfo = Custom[Document.ProjectInfo](docOrRevitLinkInstance=al_get_documents.VARLinkInstance)  # package Clockwork for Dynamo 1.x; Gets the project information.
basePoint = Coordinates.BasePoint()
surveyPoint = Coordinates.SurveyPoint()
designOptions = Custom[Document.DesignOptions]()  # package Clockwork for Dynamo 1.x; Returns all design options in the model, grouped by design option set
list_create = List.Create(item0=projectInfo.OrganizationName, item1=projectInfo.OrganizationDescription, item2=projectInfo.BuildingName, item3=projectInfo.Author, item4=projectInfo.IssueDate, item5=projectInfo.Status, item6=projectInfo.ClientName, item7=projectInfo.Address, item8=projectInfo.Name, item9=projectInfo.Number, item10=basePoint, item11=surveyPoint, item12=designOptions.DesignOptions)

python_script = Python(IN[0]=list_create)
# ---------- python_script.python (28 lines) ----------
# Load the Python Standard and DesignScript Libraries
import sys
import clr
clr.AddReference('ProtoGeometry')
from Autodesk.DesignScript.Geometry import *

# The inputs to this node will be stored as a list in the IN variables.
dataEnteringNode = IN

# Place your code below this line

# Assign your output to the OUT variable.

lst1=['Org. Name', 'Org. Description', 'Building name',
		'Author', 'Issue date', 'Status', 'Client Name',
		'Address', 'Name', 'Number', 'Base Point', 'Survey Point',
		'Design Options']
		
lst2=IN[0]
final=[]
for ind, i in enumerate(lst1):
	dat=lst2[ind]
	if isinstance(dat,list):
		for j in dat:
			final.append([i,j])
	else:
		final.append([i,dat])
OUT=final
# ----------------------------------------

# group: Project Information
string = StringInput("Project Information")
code_block_4 = CodeBlock { 1; true; }
exportExcel = Data.ExportExcel(filePath=file_path, sheetName=string, startRow=code_block_4.out0, startCol=code_block_4.out0, data=python_script)

# group: Ifc Elements
al_get_documents_2 = Custom[AL.Get Documents]()
code_block_5 = CodeBlock(a=al_get_documents_2.VARLinkDoc) { a[0]; }
get_all_elements_from_linked = Custom[Get All Elements From Linked Model](linkDoc=code_block_5, category=categories_3)  # package archi-lab.net; This node is based on code posted by Julien Benoit. Big thanks to Julien for sharing his work. This node will retrieve all elements of a given category from a given linked model.
categories_4 = Categories("OST_GenericModel")
code_block_6 = CodeBlock(a=al_get_documents_2.VARLinkInstance) { a[0]; }

# group (continued): Levels in Project
name = Element.Name(element=get_all_elements_from_linked)
id = Element.Id(element=get_all_elements_from_linked)
list_create_2 = List.Create(item0=name, item1=id)
transpose = List.Transpose(lists=list_create_2)
join = List.Join(list0=transpose)

# group: Levels in Datum
passThrough = Custom[PassThrough](passThrough=file_path, waitFor=exportExcel)  # package archi-lab.net; Ripped this off from Clockwork. Sorry Andy.
string_2 = StringInput("Datum")
code_block_7 = CodeBlock { 1; 0; true; }
exportExcel_2 = Data.ExportExcel(filePath=passThrough, sheetName=string_2, startRow=code_block_7.out0, startCol=code_block_7.out1, data=join)

# group: Ifc Elements
al_get_documents_3 = Custom[AL.Get Documents]()
code_block_8 = CodeBlock(a=al_get_documents_3.VARLinkDoc) { a[0]; }
get_all_elements_from_linked_2 = Custom[Get All Elements From Linked Model](linkDoc=code_block_8, category=categories_2)
categories_5 = Categories("OST_GenericModel")
code_block_9 = CodeBlock(a=al_get_documents_3.VARLinkInstance) { a[0]; }

# group (continued): Grids in Project
name_2 = Element.Name(element=get_all_elements_from_linked_2)
id_2 = Element.Id(element=get_all_elements_from_linked_2)
list_create_3 = List.Create(item0=name_2, item1=id_2)
transpose_2 = List.Transpose(lists=list_create_3)
join_2 = List.Join(list0=transpose_2)

# group: Grids in Datum
passThrough_2 = Custom[PassThrough](passThrough=passThrough, waitFor=exportExcel_2)
string_3 = StringInput("Datum")
code_block_10 = CodeBlock { 1; 4; true; }
exportExcel_3 = Data.ExportExcel(filePath=passThrough_2, sheetName=string_3, startRow=code_block_10.out0, startCol=code_block_10.out1, data=join_2)

# group: Ifc Elements
al_get_documents_4 = Custom[AL.Get Documents]()
code_block_11 = CodeBlock(a=al_get_documents_4.VARLinkDoc) { a[0]; }
get_all_elements_from_linked_3 = Custom[Get All Elements From Linked Model](linkDoc=code_block_11, category=categories)
categories_6 = Categories("OST_GenericModel")
code_block_12 = CodeBlock(a=al_get_documents_4.VARLinkInstance) { a[0]; }

# group (continued): Scope Boxes in Project
name_3 = Element.Name(element=get_all_elements_from_linked_3)
id_3 = Element.Id(element=get_all_elements_from_linked_3)
list_create_4 = List.Create(item0=name_3, item1=id_3)
transpose_3 = List.Transpose(lists=list_create_4)
join_3 = List.Join(list0=transpose_3)

# group: Scope Boxes in Datum
passThrough_3 = Custom[PassThrough](passThrough=passThrough_2, waitFor=exportExcel_3)
string_4 = StringInput("Datum")
code_block_13 = CodeBlock { 1; 8; true; }
exportExcel_4 = Data.ExportExcel(filePath=passThrough_3, sheetName=string_4, startRow=code_block_13.out0, startCol=code_block_13.out1, data=join_3)

# group: Ifc Elements
al_get_documents_5 = Custom[AL.Get Documents]()
code_block_14 = CodeBlock(a=al_get_documents_5.VARLinkDoc) { a[0]; }
categories_7 = Categories("OST_GenericModel")
code_block_15 = CodeBlock(a=al_get_documents_5.VARLinkInstance) { a[0]; }
get_all_elements_from_linked_4 = Custom[Get All Elements From Linked Model](linkDoc=code_block_14)  # unwired: category

# group: Category- Family - Type - Instance Count
getAll = archilab.Revit.Elements.Categories.GetAll()
code_block_16 = CodeBlock(a=getAll.Model) { a; }
all_family_types_of_category = Custom[All Family Types Of Category](category=code_block_16, docOrRevitLinkInstance=code_block_14)  # package Clockwork for Dynamo 1.x; Gets all family types/symbols of a given category in the model (does *not *work for system families)
python_script_2 = Python(IN[0]=all_family_types_of_category)
# ---------- python_script_2.python (22 lines) ----------
# Load the Python Standard and DesignScript Libraries
import sys
import clr
clr.AddReference('ProtoGeometry')
from Autodesk.DesignScript.Geometry import *

# The inputs to this node will be stored as a list in the IN variables.
dataEnteringNode = IN

# Place your code below this line

final=[]
index=[]
index2=[]

for ind, i in enumerate(IN[0]):
	if i==None:
		index.append(ind)
	else:
		final.append(i)
		index2.append(ind)
OUT=final,index,index2
# ----------------------------------------
code_block_17 = CodeBlock(a=python_script_2) { a[0]; }
family = FamilyType.Family(familyType=code_block_17)
name_4 = Family.Name(family=family)
categories_strings = FromObject(obj=code_block_16)
code_block_18 = CodeBlock(a=python_script_2) { a[2]; }
categories_with_family_types = List.GetItemAtIndex(list=categories_strings, index=code_block_18)
python_script_3 = Python(IN[0]=name_4, IN[1]=categories_with_family_types)
# ---------- python_script_3.python (13 lines) ----------
# Load the Python Standard and DesignScript Libraries
import sys
import clr
clr.AddReference('ProtoGeometry')
from Autodesk.DesignScript.Geometry import *

# The inputs to this node will be stored as a list in the IN variables.
dataEnteringNode = IN

# Place your code below this line

# Assign your output to the OUT variable.
OUT = [[i]*len(IN[0][ind]) for ind, i in enumerate(IN[1])]
# ----------------------------------------
flatten = List.Flatten(list=python_script_3)
flatten_2 = List.Flatten(list=name_4)
id_4 = Element.Id(element=family)
flatten_3 = List.Flatten(list=id_4)
name_5 = FamilyType.Name(familyType=code_block_17)
flatten_4 = List.Flatten(list=name_5)
id_5 = Element.Id(element=code_block_17)
flatten_5 = List.Flatten(list=id_5)
code_block_19 = CodeBlock { [["Category", "Family","Id", "Family Type","Id", "Instance Count"]]; }

# group: Instance Count
byFamilyType = FamilyInstance.ByFamilyType(familyType=code_block_17)
python_script_4 = Python(IN[0]=byFamilyType)
# ---------- python_script_4.python (19 lines) ----------
# Load the Python Standard and DesignScript Libraries
import sys
import clr
clr.AddReference('ProtoGeometry')
from Autodesk.DesignScript.Geometry import *

# The inputs to this node will be stored as a list in the IN variables.
dataEnteringNode = IN

# Place your code below this line
final=[]
# Assign your outpt to the OUT variable.
for i in IN[0]:
	sub=[]
	for j in i:
		sub.append(len(j))
		
	final.append(sub)
OUT=final
# ----------------------------------------

# group (continued): Category- Family - Type - Instance Count
flatten_6 = List.Flatten(list=python_script_4)
list_create_5 = List.Create(item0=flatten, item1=flatten_2, item2=flatten_3, item3=flatten_4, item4=flatten_5, item5=flatten_6)
transpose_4 = List.Transpose(lists=list_create_5)
join_4 = List.Join(list0=transpose_4)

# group: Family Type
passThrough_4 = Custom[PassThrough](passThrough=passThrough_3, waitFor=exportExcel_4)
string_5 = StringInput("Family Instance Detail")
code_block_20 = CodeBlock { 1; 0; true; }
exportExcel_5 = Data.ExportExcel(filePath=passThrough_4, sheetName=string_5, startRow=code_block_20.out0, startCol=code_block_20.out1, data=join_4)

# group: View Name and Detail
categories_8 = Categories("OST_Views")
code_block_21 = CodeBlock { "View Name"; }
all_elements_of_category_4 = ElementsOfCategory(Category=categories_8)
code_block_22 = CodeBlock { [[ "View Name","Element Id"]]; }

# group: Ifc Elements
al_get_documents_6 = Custom[AL.Get Documents]()
code_block_23 = CodeBlock(a=al_get_documents_6.VARLinkDoc) { a[0]; }
get_all_elements_from_linked_5 = Custom[Get All Elements From Linked Model](linkDoc=code_block_23, category=categories_8)
categories_9 = Categories("OST_GenericModel")
code_block_24 = CodeBlock(a=al_get_documents_6.VARLinkInstance) { a[0]; }

# group (continued): View Name and Detail
python_script_5 = Python(IN[0]=get_all_elements_from_linked_5)
# ---------- python_script_5.python (13 lines) ----------
# Load the Python Standard and DesignScript Libraries
import sys
import clr
clr.AddReference('ProtoGeometry')
from Autodesk.DesignScript.Geometry import *

# The inputs to this node will be stored as a list in the IN variables.
dataEnteringNode = IN

# Place your code below this line

# Assign your output to the OUT variable.
OUT = [i for i in IN[0] if i!=None]
# ----------------------------------------
getParameterValueByName = Element.GetParameterValueByName(element=python_script_5, parameterName=code_block_21)
python_script_6 = Python(IN[0]=getParameterValueByName)
# ---------- python_script_6.python (13 lines) ----------
# Load the Python Standard and DesignScript Libraries
import sys
import clr
clr.AddReference('ProtoGeometry')
from Autodesk.DesignScript.Geometry import *

# The inputs to this node will be stored as a list in the IN variables.
dataEnteringNode = IN

# Place your code below this line

# Assign your output to the OUT variable.
OUT = [i if i!=[] else None for i in IN[0]]
# ----------------------------------------
id_6 = Element.Id(element=python_script_5)
list_create_6 = List.Create(item0=python_script_6, item1=id_6)
transpose_5 = List.Transpose(lists=list_create_6)
join_5 = List.Join(list0=transpose_5)

# group: Browser Organisation
passThrough_5 = Custom[PassThrough](passThrough=passThrough_4, waitFor=exportExcel_5)
string_6 = StringInput("Browser organisation")
code_block_25 = CodeBlock { 1; 4; true; }
exportExcel_6 = Data.ExportExcel(filePath=passThrough_5, sheetName=string_6, startRow=code_block_25.out0, startCol=code_block_25.out1, data=join_5)

# group: Ifc Elements
al_get_documents_7 = Custom[AL.Get Documents]()
code_block_26 = CodeBlock(a=al_get_documents_7.VARLinkDoc) { a[0]; }
categories_10 = Categories("OST_GenericModel")
code_block_27 = CodeBlock(a=al_get_documents_7.VARLinkInstance) { a[0]; }

getAll_2 = archilab.Revit.Elements.Categories.GetAll()
code_block_28 = CodeBlock(a=getAll_2.Model) { a; }
python_script_7 = Python(IN[0]=code_block_26, IN[1]=code_block_28)
# ---------- python_script_7.python (45 lines) ----------
#Copyright(c) 2015, Konrad Sobon
# @arch_laboratory, http://archi-lab.net

# This node is based on Julien Benoit's Element.GetElementFromLinkedFile 
# node. Some slight improvements were made removing unnecessary imports/references.
# Big thank you to Julien for sharing his work. 

import clr
clr.AddReference('ProtoGeometry')
from Autodesk.DesignScript.Geometry import *

# Import RevitAPI
clr.AddReference("RevitAPI")
import Autodesk
from Autodesk.Revit.DB import *

import System

import sys
pyt_path = r'C:\Program Files (x86)\IronPython 2.7\Lib'
sys.path.append(pyt_path)

#The inputs to this node will be stored as a list in the IN variable.
dataEnteringNode = IN

_linkDoc = IN[0]
_category = IN[1]

try:
	errorReport = None
	final=[]
	for cat in _category:
		filter = ElementCategoryFilter(System.Enum.ToObject(BuiltInCategory, cat.Id))
		result = FilteredElementCollector(_linkDoc).WherePasses(filter).WhereElementIsNotElementType().ToElements()
		final.append(result)
except:
	# if error accurs anywhere in the process catch it
	import traceback
	errorReport = traceback.format_exc()

#Assign your output to the OUT variable
if errorReport == None:
	OUT = final
else:
	OUT = errorReport
# ----------------------------------------
flatten_7 = List.Flatten(list=python_script_7)

# group: Checking for duplicates by looking at the names
# note: Check if any duplicates are available by suffix "Copy" or "numbered"??
python_all_elements_in_all = Custom[Python All Elements In All Document]()  # package Synthesize toolkit; Python All Elements In All Document
name_6 = Element.Name(element=flatten_7)
python_script_8 = Python(IN[0]=name_6)
# ---------- python_script_8.python (19 lines) ----------
# Load the Python Standard and DesignScript Libraries
import sys
import clr
clr.AddReference('ProtoGeometry')
from Autodesk.DesignScript.Geometry import *

# The inputs to this node will be stored as a list in the IN variables.
dataEnteringNode = IN

# Place your code below this line

final=[]

for ind, i in enumerate(IN[0]):
	if isinstance(i,str):
		if "copy" in i.lower() or "duplicate" in i.lower() or "(1)" in i:
			final.append(ind)
			
OUT=final
# ----------------------------------------
getItemAtIndex = List.GetItemAtIndex(list=name_6, index=python_script_8)
getItemAtIndex_2 = List.GetItemAtIndex(list=flatten_7, index=python_script_8)
id_7 = Element.Id(element=getItemAtIndex_2)
list_create_7 = List.Create(item0=getItemAtIndex, item1=id_7)
transpose_6 = List.Transpose(lists=list_create_7)
join_6 = List.Join(list0=transpose_6)
code_block_29 = CodeBlock { [["Element Name","Element ID"]]; }

# group: Duplicates with "Copy" in names
passThrough_6 = Custom[PassThrough](passThrough=passThrough_5, waitFor=exportExcel_6)
string_7 = StringInput("Duplicates")
code_block_30 = CodeBlock { 1; 0; true; }
exportExcel_7 = Data.ExportExcel(filePath=passThrough_6, sheetName=string_7, startRow=code_block_30.out0, startCol=code_block_30.out1, data=join_6)
