# Dynamo graph V1.dyn (Dynamo 2.6.1.8786)

# group: Side 1
select_model_elements = DSModelElementsSelection()  # 6 picked in the model
geometry = Element.Geometry(element=select_model_elements)
flatten = List.Flatten(list=geometry)

length = Curve.Length(curve=flatten)
planeAtSegmentLength = Curve.PlaneAtSegmentLength(curve=flatten, segmentLength=length)
origin = Plane.Origin(plane=planeAtSegmentLength)
code_block = CodeBlock { 0.5; }
pointAtParameter = Curve.PointAtParameter(curve=flatten, param=code_block)
byTwoPoints = Vector.ByTwoPoints(start=origin, end=pointAtParameter)
translate = Geometry.Translate(geometry=planeAtSegmentLength, direction=byTwoPoints)

# group: Change Plane.Y axis by visully Verifying
origin_2 = Plane.Origin(plane=translate)
YAxis = Plane.YAxis(plane=translate)
code_block_2 = CodeBlock { 90; }

# group: Reverse By looking at thre output
reverse = Vector.Reverse(vector=YAxis)

rotate = Geometry.Rotate(geometry=translate, origin=origin_2, axis=reverse, degrees=code_block_2)

# group: Test
normal = Plane.Normal(plane=rotate)

# group: Visulally Check The Plane Normal Direction
code_block_3 = CodeBlock { 10; }
byStartPointDirectionLength = Line.ByStartPointDirectionLength(startPoint=origin_2, direction=normal, length=code_block_3)

# group: Visulaly Check Axis of Rotation
byStartPointDirectionLength_2 = Line.ByStartPointDirectionLength(startPoint=origin_2, direction=reverse, length=code_block_3)

# group: Side 1
select_model_elements_2 = DSModelElementsSelection()  # 5 picked in the model
geometry_2 = Element.Geometry(element=select_model_elements_2)
flatten_2 = List.Flatten(list=geometry_2)

length_2 = Curve.Length(curve=flatten_2)
planeAtSegmentLength_2 = Curve.PlaneAtSegmentLength(curve=flatten_2, segmentLength=length_2)
origin_3 = Plane.Origin(plane=planeAtSegmentLength_2)
code_block_4 = CodeBlock { 0.5; }
pointAtParameter_2 = Curve.PointAtParameter(curve=flatten_2, param=code_block_4)
byTwoPoints_2 = Vector.ByTwoPoints(start=origin_3, end=pointAtParameter_2)
translate_2 = Geometry.Translate(geometry=planeAtSegmentLength_2, direction=byTwoPoints_2)

# group: Change Plane.Y axis by visully Verifying
origin_4 = Plane.Origin(plane=translate_2)
YAxis_2 = Plane.YAxis(plane=translate_2)
code_block_5 = CodeBlock { 90; }

# group: Reverse By looking at thre output
reverse_2 = Vector.Reverse(vector=YAxis_2)

rotate_2 = Geometry.Rotate(geometry=translate_2, origin=origin_4, axis=reverse_2, degrees=code_block_5)

# group: Test
normal_2 = Plane.Normal(plane=rotate_2)

# group: Visulally Check The Plane Normal Direction
code_block_6 = CodeBlock { 10; }
byStartPointDirectionLength_3 = Line.ByStartPointDirectionLength(startPoint=origin_4, direction=normal_2, length=code_block_6)

# group: Visulaly Check Axis of Rotation
byStartPointDirectionLength_4 = Line.ByStartPointDirectionLength(startPoint=origin_4, direction=reverse_2, length=code_block_6)

XAxis = Plane.XAxis(plane=rotate)

# group: Gradient
code_block_7 = CodeBlock { 1.5; }
rotate_3 = Geometry.Rotate(geometry=rotate, origin=origin_2, axis=XAxis, degrees=code_block_7)

code_block_8 = CodeBlock { 20; }
byWidthLength = Rectangle.ByWidthLength(plane=rotate_3, width=length, length=code_block_8)
byPatch = Surface.ByPatch(closedCurve=byWidthLength)
code_block_9 = CodeBlock(a=code_block_8) { a/2; }
translate_3 = Geometry.Translate(geometry=byPatch, direction=reverse, distance=code_block_9)
XAxis_2 = Plane.XAxis(plane=rotate_2)

# group: Gradient
code_block_10 = CodeBlock { 1.5; }
rotate_4 = Geometry.Rotate(geometry=rotate_2, origin=origin_4, axis=XAxis_2, degrees=code_block_10)

code_block_11 = CodeBlock { 20; }
byWidthLength_2 = Rectangle.ByWidthLength(plane=rotate_4, width=length_2, length=code_block_11)
byPatch_2 = Surface.ByPatch(closedCurve=byWidthLength_2)
code_block_12 = CodeBlock(a=code_block_11) { a/2; }
translate_4 = Geometry.Translate(geometry=byPatch_2, direction=reverse_2, distance=code_block_12)
python_script = Python(IN[0]=translate_3, IN[1]=translate_4)
# ---------- python_script.python (40 lines) ----------
# Load the Python Standard and DesignScript Libraries
import sys
import clr
clr.AddReference('ProtoGeometry')
from Autodesk.DesignScript.Geometry import *

# The inputs to this node will be stored as a list in the IN variables.
dataEnteringNode = IN

# Place your code below this line
final=[]
side1=IN[0]
side2=IN[1]
l1=len(side1)
l2=len(side2)
if l1>=l2:
	pass
else:
	side1,side2=side2,side1

temp=[]
index=[]

for ind1, i in enumerate(side1):
	sub=[]
	temp_sub=[]
	ind_sub=[]
	for ind2, j in enumerate(side2):
		boo=Geometry.DoesIntersect(i,j)
		if boo==True:
			crv=Geometry.Intersect(i,j)
			sub.append(crv)
			ind_sub.append([ind1,ind2])
	final.append(sub)
	index.append(ind_sub)
						


# Assign your output to the OUT variable.
OUT = final, index
# ----------------------------------------
index = CodeBlock(a=python_script) { a[1]; }
python_script_2 = Python(IN[0]=index)
# ---------- python_script_2.python (18 lines) ----------
# Load the Python Standard and DesignScript Libraries
import sys
import clr
clr.AddReference('ProtoGeometry')
from Autodesk.DesignScript.Geometry import *

# The inputs to this node will be stored as a list in the IN variables.
dataEnteringNode = IN

# Place your code below this line
final1=[]
final2=[]
for i in IN[0]:
	for j in i:
		final1.append(j[0])
		final2.append(j[1])
# Assign your output to the OUT variable.
OUT = final1, final2
# ----------------------------------------
code_block_13 = CodeBlock(a=python_script_2) { a[0]; }
code_block_14 = CodeBlock(a=python_script_2) { a[1]; }
curves = CodeBlock(a=python_script) { a[0]; }
length_3 = Curve.Length(curve=curves)
python_script_3 = Python(IN[0]=length_3, IN[1]=curves)
# ---------- python_script_3.python (33 lines) ----------
# Load the Python Standard and DesignScript Libraries
import sys
import clr
clr.AddReference('ProtoGeometry')
from Autodesk.DesignScript.Geometry import *

# The inputs to this node will be stored as a list in the IN variables.
dataEnteringNode = IN
final=[]
def flat(lst):
	_lst=[]
	for i in lst:
		_lst.append(i)
	return _lst
	
# Place your code below this line
for ind, i in enumerate(IN[0]):
	j=IN[1][ind]
	if i==[] or i==None:
		pass
	elif len(i)==1:
		final.append(j[0])
	else:
		x=flat(i)
		y=flat(j)
		Max=max(x)
		ind1=x.index(Max)
		final.append(y[ind1])
		
		
		
# Assign your output to the OUT variable.
OUT = final
# ----------------------------------------
number_slider = DoubleSlider(2, range=0..100 step 0.1)
extendEnd = Curve.ExtendEnd(curve=python_script_3, distance=number_slider)
extendStart = Curve.ExtendStart(curve=extendEnd, distance=number_slider)
flatten_3 = List.Flatten(list=extendStart)
byCurve = ModelCurve.ByCurve(curve=flatten_3)  # frozen
python_script_4 = Python(IN[0]=translate_3, IN[1]=translate_4)
# ---------- python_script_4.python (23 lines) ----------
# Load the Python Standard and DesignScript Libraries
import sys
import clr
clr.AddReference('ProtoGeometry')
from Autodesk.DesignScript.Geometry import *

# The inputs to this node will be stored as a list in the IN variables.
dataEnteringNode = IN

# Place your code below this line
final=[]
side1=IN[0]
side2=IN[1]
l1=len(side1)
l2=len(side2)
if l1>=l2:
	pass
else:
	side1,side2=side2,side1

temp=[]
index=[]
OUT=side1,side2
# ----------------------------------------
index_2 = CodeBlock(a=python_script_4) { a[1]; }
curves_2 = CodeBlock(a=python_script_4) { a[0]; }
