# Dynamo graph Sortig Points and placing balls.dyn (Dynamo 2.6.1.8786)
# packages: Genius Loci 2021.5.18

file_path = Filename("..\..\..\..\..\..\Downloads\CSV\Mound_Walkway2_Gutter_Vertices.csv")
file_from_path = FileObject(path=file_path)
code_block = CodeBlock { "Mound_Walkway2_Gutter_Vertices"; false; }
importExcel = Data.ImportExcel(file=file_from_path, sheetName=code_block.out0, readAsStrings=code_block.out1, showExcel=code_block.out1)
restOfItems = List.RestOfItems(list=importExcel)
transpose = List.Transpose(lists=restOfItems)
code_block_2 = CodeBlock(a=transpose) { a[0]; }
family_types = FamilyTypes("3iM_GEN_3D-Point:3iM_GEN_3D-Point")
XY = Plane.XY()
toCoordinateSystem = Plane.ToCoordinateSystem(plane=XY)
origin = Point.Origin()
ZAxis = Vector.ZAxis()
get_project_locations = Custom[Get Project Locations]()  # package Genius Loci; Works only in Revit 2018 and later. Retrieves the project positions of the given document in the Survey Coordinate System. (Coordinates of Internal origin, project base point and survey point)
code_block_3 = CodeBlock(pbp=get_project_locations.Project_Base_Point) { pbp[1]; }
rotate = CoordinateSystem.Rotate(coordinateSystem=toCoordinateSystem, origin=origin, axis=ZAxis, degrees=code_block_3)
code_block_4 = CodeBlock(a=transpose) { a[1]; }
code_block_5 = CodeBlock(a=code_block_4) { a*1000; }
code_block_6 = CodeBlock(a=transpose) { a[2]; }
code_block_7 = CodeBlock(a=code_block_6) { a*1000; }
code_block_8 = CodeBlock(a=transpose) { a[3]; }
code_block_9 = CodeBlock(a=code_block_8) { a*1000; }
byCartesianCoordinates = Point.ByCartesianCoordinates(cs=rotate, x=code_block_5, y=code_block_7, z=code_block_9)
python_script = Python(IN[0]=byCartesianCoordinates)
# ---------- python_script.python (13 lines) ----------
# Load the Python Standard and DesignScript Libraries
import sys
import clr
clr.AddReference('ProtoGeometry')
from Autodesk.DesignScript.Geometry import *

# The inputs to this node will be stored as a list in the IN variables.
dataEnteringNode = IN

# Place your code below this line

# Assign your output to the OUT variable.
OUT = [i for ind, i in enumerate(IN[0]) if ind%2==0]
# ----------------------------------------
byPoint = FamilyInstance.ByPoint(point=python_script)  # unwired: familyType
python_script_2 = Python(IN[0]=byCartesianCoordinates)
# ---------- python_script_2.python (19 lines) ----------
# Load the Python Standard and DesignScript Libraries
import sys
import clr
clr.AddReference('ProtoGeometry')
from Autodesk.DesignScript.Geometry import *

# The inputs to this node will be stored as a list in the IN variables.
dataEnteringNode = IN

# Place your code below this line
final=[]
count=4
if len(IN[0])%4==0:
	for i in range(len(IN[0])/4):
		
	

# Assign your output to the OUT variable.
OUT = 0
# ----------------------------------------
