# Dynamo graph Placing Voids and Cutting Ring Beams.dyn (Dynamo 2.5.0.7460)
# packages: Clockwork for Dynamo 2.x 2.3.0, Genius Loci 2021.5.18

# group: Select Ring
select_model_element = DSModelElementSelection()  # 1 picked in the model

# group: Convert To solids
python_script = Python(IN[0]=select_model_element)
# ---------- python_script.python (117 lines) ----------
# Load the Python Standard and DesignScript Libraries
import sys
import clr
clr.AddReference('ProtoGeometry')

import clr
import System
from System.Collections.Generic import *

from itertools import repeat

pf_path = System.Environment.GetFolderPath(System.Environment.SpecialFolder.ProgramFilesX86)
import sys
sys.path.append('%s\IronPython 2.7\Lib' %pf_path)
import traceback
import random
import string

clr.AddReference('ProtoGeometry')
from Autodesk.DesignScript.Geometry import *
from Autodesk.DesignScript.Geometry import Point as DynPoint
from Autodesk.DesignScript.Geometry import Line as DynLine
from Autodesk.DesignScript.Geometry import Curve as DynCurve

clr.AddReference('RevitServices')
import RevitServices
from RevitServices.Persistence import DocumentManager
from RevitServices.Transactions import TransactionManager
doc = DocumentManager.Instance.CurrentDBDocument

clr.AddReference('RevitAPI')
from Autodesk.Revit.DB import *
from Autodesk.Revit.DB.Structure import StructuralType

clr.AddReference('RevitNodes')
import Revit
clr.ImportExtensions(Revit.Elements)
clr.ImportExtensions(Revit.GeometryConversion)

def tolist(obj1):
	if hasattr(obj1,'__iter__'): return obj1
	else: return [obj1]

def flatten(x):
    result = []
    try:
    	for el in x:
        	if hasattr(el, "__iter__") and not isinstance(el, basestring):
        	    result.extend(flatten(el))
        	else:
        	    result.append(el)
    except:
    	result = x
    return result

geom = UnwrapElement(IN[0])
if geom != None:
	geom = tolist(geom)
else:
	pass

temp_path = System.IO.Path.GetTempPath()
satOpt = SATExportOptions()
opt1 = Options()
opt1.ComputeReferences = True

#Find a 3D view type
collector1 = FilteredElementCollector(doc)
viewFamilyTypes = collector1.OfClass((ViewFamilyType))
for e in viewFamilyTypes:
	if str(e.ViewFamily) == "ThreeDimensional":
		viewType = e.Id
		break

def NewForm_background(s1):
	try:
		randomname = ''.join([random.choice(string.ascii_letters + string.digits) for n in xrange(5)])
		TransactionManager.Instance.EnsureInTransaction(doc)
		sat_path = '%s%s.sat' % (temp_path, randomname)
		status = True
		finalres = []
		resultgeom = []
		threedeeview = View3D.CreateIsometric(doc, viewType)
		threedeeviewid = threedeeview.Id
		kilist = List[ElementId]([threedeeviewid])
		tid = []
		for each in s1:
			tid.append(each.Id)
		ielements = List[ElementId](tid)
		threedeeview.IsolateElementsTemporary(ielements)
		collectorinside = FilteredElementCollector(doc,threedeeviewid).ToElements()
		elemento = []
		for k in collectorinside:
			elemento.append(int(str(k.Id)))
		for each in s1:
			if int(str(each.Id)) in elemento:
				doc.Export(temp_path, randomname, kilist, satOpt)
				eachlist = Geometry.ImportFromSAT(sat_path)
				tmplist = []
				for e in eachlist:
					tmplist.append(e)
				resultgeom.append(tmplist)
				System.IO.File.Delete(sat_path)
			else:
				resultgeom = [None]
			break
		doc.Delete(threedeeview.Id)
		finalres.append(flatten(resultgeom))
		TransactionManager.Instance.TransactionTaskDone()
		return finalres
	except:
		return traceback.format_exc(),''

result = NewForm_background(geom)
OUT = flatten(result)
satOpt.Dispose()
opt1.Dispose()
# ----------------------------------------

code_block = CodeBlock { 1000; }
scale = Geometry.Scale(geometry=python_script, xamount=code_block, yamount=code_block, zamount=code_block)

# group: Select Model Lines
select_model_elements = DSModelElementsSelection()  # 25 picked in the model
geometry = Element.Geometry(element=select_model_elements)

flatten = List.Flatten(list=geometry)

# group: Getting Lateral Surfaces
faces = Topology.Faces(topology=scale)
surfaceGeometry = Face.SurfaceGeometry(face=faces@L2)
code_block_2 = CodeBlock(a=surfaceGeometry) { a[0]; }
python_script_2 = Python(IN[0]=flatten, IN[1]=surfaceGeometry)
# ---------- python_script_2.python (26 lines) ----------
# Load the Python Standard and DesignScript Libraries
import sys
import clr
clr.AddReference('ProtoGeometry')
from Autodesk.DesignScript.Geometry import *

# The inputs to this node will be stored as a list in the IN variables.
surfaces=IN[1][0]
lines=IN[0]
index=[]
points=[]
for i in lines:
	sub=[]
	pts=[]
	
	if i!=None and i!="" and i!=[]:
		for ind, j in enumerate(surfaces):
			if i!=None and i!="" and i!=[]:
				boo=str(i.DoesIntersect(j))
				if boo=="True":
					pt=Geometry.Intersect(i,j)
					pts.append(pt)
					sub.append(ind)
	index.append(sub)
	points.append(pts)
OUT=index, points	
# ----------------------------------------
code_block_3 = CodeBlock(a=python_script_2) { a[0]; }
getItemAtIndex = List.GetItemAtIndex(list=code_block_2, index=code_block_3)

family_types = FamilyTypes("3-im Ring Void GM:3-im Ring Void GM")
code_block_4 = CodeBlock(a=python_script_2) { a[1]; }
flatten_2 = List.Flatten(list=code_block_4)
byPoint = FamilyInstance.ByPoint(familyType=family_types, point=flatten_2)
code_block_5 = CodeBlock(a=byPoint) { a[13..18]; }
direction = Line.Direction(line=geometry)
XAxis = Vector.XAxis()
angleWithVector = Vector.AngleWithVector(vector=direction, otherVector=XAxis)
code_block_6 = CodeBlock(a=angleWithVector) { a[13..18]; }
code_block_7 = CodeBlock(b=code_block_6) { (180-b-90); }
setRotation = FamilyInstance.SetRotation(familyInstance=code_block_5, degree=code_block_7)
code_block_8 = CodeBlock(a=byPoint) { a[0..12]; }
code_block_9 = CodeBlock(a=byPoint) { a[19..24]; }
list_create = List.Create(item0=code_block_8, item1=code_block_9)
flatten_3 = List.Flatten(list=list_create)
code_block_10 = CodeBlock(a=angleWithVector) { a[0..12]; }
code_block_11 = CodeBlock(a=angleWithVector) { a[19..24]; }
list_create_2 = List.Create(item0=code_block_10, item1=code_block_11)
flatten_4 = List.Flatten(list=list_create_2)
code_block_12 = CodeBlock(b=flatten_4) { (360-b-90); }
element_setrotation = Custom[Element SetRotation](element=flatten_3, degree=code_block_12)  # package Genius Loci; Set the angle of the element around its local Z-axis. (Same as the Rotate command in Revit)
list_create_3 = List.Create(item0=setRotation, item1=element_setrotation)
flatten_5 = List.Flatten(list=list_create_3)
cutGeometry = Custom[Element.CutGeometry](elementToBeCut=select_model_element, cuttingElement=flatten_5)  # package Clockwork for Dynamo 2.x; Adds a solid-solid cut for two model elements (if possible).
YAxis = Vector.YAxis()
