# Dynamo graph Void Creation.dyn "Version 1" (Dynamo 2.5.0.7460)
# packages: Orchid 203.3.0.7815

x = CodeBlock { [0,0,0,0]; }
radius_of_arc = CodeBlock { 500; }
y = CodeBlock(r=radius_of_arc) { [0,0,(r/(DSCore.Math.Sqrt(2))-r),-r]; }
z = CodeBlock(r=radius_of_arc) { [900,0,-r/(DSCore.Math.Sqrt(2)),-r]; }
byCoordinates = Point.ByCoordinates(x=x, y=y, z=z)
code_block = CodeBlock(a=byCoordinates) { a[0]; a[1]; }
byStartPointEndPoint = Line.ByStartPointEndPoint(startPoint=code_block.out0, endPoint=code_block.out1)
code_block_2 = CodeBlock(a=byCoordinates) { a[1]; a[2]; a[3]; }
byThreePoints = Arc.ByThreePoints(firstPoint=code_block_2.out0, secondPoint=code_block_2.out1, thirdPoint=code_block_2.out2)
list_create = List.Create(item0=byStartPointEndPoint, item1=byThreePoints)
byJoinedCurves = PolyCurve.ByJoinedCurves(curves=list_create)
parameterAtPoint = Curve.ParameterAtPoint(curve=byJoinedCurves, point=byCoordinates)
planeAtParameter = Curve.PlaneAtParameter(curve=byJoinedCurves, param=parameterAtPoint)
code_block_3 = CodeBlock { 50; }
byPlaneRadius = Circle.ByPlaneRadius(plane=planeAtParameter, radius=code_block_3)
byLoft = Solid.ByLoft(crossSections=byPlaneRadius, guideCurves=byJoinedCurves)
code_block_4 = CodeBlock { "3-im Ring Void"; }
categories = Categories("OST_GenericModel")
code_block_5 = CodeBlock { "C:\\ProgramData\\Autodesk\\RVT 2021\\Family Templates\\English\\Metric Generic Model.rft"; }
voidByGeometry = FamilyType.VoidByGeometry(solidGeometry=byLoft, name=code_block_4, category=categories, templatePath=code_block_5)  # frozen
materials = Material()  # nothing selected
translate = Geometry.Translate(geometry=byLoft, yTranslation=radius_of_arc, zTranslation=radius_of_arc)
byGeometries = ImportInstance.ByGeometries(geometries=translate)
