# Dynamo graph 1. Surface Area.dyn (Dynamo 2.5.0.7460)
# packages: Rhythm 2020.1.22, Sastrugi 2.0.0

select_model_elements = DSModelElementsSelection()  # 452 picked in the model
code_block = CodeBlock { "B6_1D_Element_Category"; }
ʳʰʸᵗʰᵐ_elements = Rhythm.Revit.Elements.Elements.GetParameterValueByNameTypeOrInstance(element=select_model_elements, parameterName=code_block)
code_block_2 = CodeBlock { "rib"; true; }
contains = String.Contains(str=ʳʰʸᵗʰᵐ_elements, searchFor=code_block_2.out0, ignoreCase=code_block_2.out1)
code_block_3 = CodeBlock { true; }
ne = contains != code_block_3
filterByBoolMask = List.FilterByBoolMask(list=select_model_elements, mask=ne)
code_block_4 = CodeBlock(a=filterByBoolMask.in) { a; }
filterByBoolMask_2 = List.FilterByBoolMask(list=select_model_elements, mask=contains)
code_block_5 = CodeBlock(a=filterByBoolMask_2.in) { a; }
faces = Element.Faces(element=code_block_5@L2)

# group: Planes with max. area
area = Surface.Area(surface=faces)
python_script = Python(IN[0]=area, IN[1]=faces)
# ---------- python_script.python (19 lines) ----------
# Load the Python Standard and DesignScript Libraries
import sys
import clr
clr.AddReference('ProtoGeometry')
from Autodesk.DesignScript.Geometry import *

# The inputs to this node will be stored as a list in the IN variables.
area=IN[0]
surface=IN[1]
final=[]
for ind, i in enumerate(area):
	if i!=None and i!=[] and i!="":
		surf=surface[ind]
		x=max(i)
		ind1=i.index(x)
		final.append(surf[ind1])
	else:
		final.append([])
OUT=final
# ----------------------------------------
faces_2 = Element.Faces()  # frozen; unwired: element

surface_plane = Custom[❄_Surface Plane](InputSurfaces=python_script)  # package Sastrugi; (Sastrugi_Geometry) This node will extract a plane that best fits a surface.

# group: Angle between Plane and Original Z axis
origin = Plane.Origin(plane=surface_plane)
normal = Plane.Normal(plane=surface_plane)
ZAxis = Vector.ZAxis()
XAxis = Plane.XAxis(plane=surface_plane)

angleAboutAxis = Vector.AngleAboutAxis(vector=ZAxis, otherVector=XAxis, rotationAxis=normal)
code_block_6 = CodeBlock(a=angleAboutAxis) { -a; }

# group: Plane Rotation
rotate = Geometry.Rotate(geometry=surface_plane, origin=origin, axis=normal, degrees=code_block_6)

solids = Element.Solids(element=code_block_5)
centroid = Solid.Centroid(solid=solids)
flatten = List.Flatten(list=centroid)
python_script_2 = Python(IN[0]=flatten)
# ---------- python_script_2.python (14 lines) ----------
# Load the Python Standard and DesignScript Libraries
import sys
import clr
clr.AddReference('ProtoGeometry')
from Autodesk.DesignScript.Geometry import *
final=[]
# The inputs to this node will be stored as a list in the IN variables.
for i in IN[0]:
	if i !=[] and i!=None:
		final.append(i)
	else:
		final.append([])		
	
OUT=final
# ----------------------------------------
byTwoPoints = Vector.ByTwoPoints(start=origin, end=python_script_2)
translate = Geometry.Translate(geometry=rotate, direction=byTwoPoints)

# group: Translating Plane
code_block_7 = CodeBlock { 1000; }
byWidthLength = Rectangle.ByWidthLength(plane=translate, width=code_block_7, length=code_block_7)

python_script_3 = Python(IN[0]=area, IN[1]=faces_2)  # frozen
# ---------- python_script_3.python (21 lines) ----------
# Load the Python Standard and DesignScript Libraries
import sys
import clr
clr.AddReference('ProtoGeometry')
from Autodesk.DesignScript.Geometry import *

surfaces=IN[1]
area=IN[0]

surff=[]
areaf=[]
for ind, i in enumerate(area):
	surf=surfaces[ind]
	zipped=zip(i,surf)
	sortzip=sorted(zipped)
	tuples=zip(*sortzip)
	areas,surface=[list(tuple) for tuple in tuples]
	surff.append(surface)
	areaf.append(areas)

OUT=surff,areaf
# ----------------------------------------
code_block_8 = CodeBlock(a=python_script_3) { a[0]; }
code_block_9 = CodeBlock(a=python_script_3) { a[1]; }
translate_2 = Geometry.Translate(geometry=rotate, direction=byTwoPoints)  # frozen

# group: Vector
origin_2 = Plane.Origin(plane=translate_2)
YAxis = Plane.YAxis(plane=translate_2)

reverse = Vector.Reverse(vector=YAxis)
code_block_10 = CodeBlock { 5000; }
byStartPointDirectionLength = Line.ByStartPointDirectionLength(startPoint=origin_2, direction=reverse, length=code_block_10)
endPoint = Curve.EndPoint(curve=byStartPointDirectionLength)
origin_3 = Plane.Origin(plane=translate_2)
YAxis_2 = Plane.YAxis(plane=translate_2)

# group: Line To visualise Axis
code_block_11 = CodeBlock { 5000; }
byStartPointDirectionLength_2 = Line.ByStartPointDirectionLength(startPoint=origin_3, direction=YAxis_2, length=code_block_11)

endPoint_2 = Curve.EndPoint(curve=byStartPointDirectionLength_2)
byStartPointEndPoint = Line.ByStartPointEndPoint(startPoint=endPoint, endPoint=endPoint_2)
endPoint_3 = Curve.EndPoint(curve=byStartPointEndPoint)
flatten_2 = List.Flatten(list=endPoint_3)
ZAxis_2 = Vector.ZAxis()
reverse_2 = Vector.Reverse(vector=ZAxis_2)
code_block_12 = CodeBlock { 1000; }
translate_3 = Geometry.Translate(geometry=python_script_2, direction=reverse_2, distance=code_block_12)
code_block_13 = CodeBlock { 1000; 6000; }
byLengths = Cuboid.ByLengths(origin=translate_3, width=code_block_13.out1, length=code_block_13.out1, height=code_block_13.out0)

# group: Intersection Volume Out
python_script_4 = Python(IN[0]=byLengths, IN[1]=solids)
# ---------- python_script_4.python (22 lines) ----------
# Load the Python Standard and DesignScript Libraries
import sys
import clr
clr.AddReference('ProtoGeometry')
from Autodesk.DesignScript.Geometry import *

ribs=IN[0]
surface=IN[1]
surfaces=[]
for ind, i in enumerate(ribs):
	surf=surface[ind]
	sub=[]
	if surf!=[] and surf!=None and surf!='':
		try:
			for j in surf:
				x=Geometry.Intersect(i,j)
				sub.append(x)
			surfaces.append(sub)
		except:
			surfaces.append(None)
	
OUT=surfaces
# ----------------------------------------

centroid_2 = Solid.Centroid(solid=python_script_4)
flatten_3 = List.Flatten(list=centroid_2)
byTwoPoints_2 = Vector.ByTwoPoints(start=flatten_2, end=flatten_3)
length = Vector.Length(vector=byTwoPoints_2)
startPoint = Curve.StartPoint(curve=byStartPointEndPoint)
flatten_4 = List.Flatten(list=startPoint)
byTwoPoints_3 = Vector.ByTwoPoints(start=flatten_4, end=flatten_3)
length_2 = Vector.Length(vector=byTwoPoints_3)
python_script_5 = Python(IN[0]=length, IN[1]=flatten_2, IN[2]=length_2, IN[3]=flatten_4)
# ---------- python_script_5.python (26 lines) ----------
# Load the Python Standard and DesignScript Libraries
import sys
import clr
clr.AddReference('ProtoGeometry')
from Autodesk.DesignScript.Geometry import *

# The inputs to this node will be stored as a list in the IN variables.
le_1=IN[0]
pt_1=IN[1]

le_2=IN[2]
pt_2=IN[3]

pts=[]
for ind, i in enumerate(le_1):
	pt1=pt_1[ind]
	l2=le_2[ind]
	pt2=pt_2[ind]
	if i!=[] and i!=None:
		if i<l2:
			pts.append(pt2)
		else:
			pts.append(pt1)
	else:
		pts.append([])	
OUT=pts
# ----------------------------------------
direction = Line.Direction()  # unwired: line

# group: Vector
origin_4 = Plane.Origin(plane=translate_2)

normal_2 = Plane.Normal(plane=translate_2)
reverse_3 = Vector.Reverse(vector=normal_2)
code_block_14 = CodeBlock { 1000; }
byStartPointDirectionLength_3 = Line.ByStartPointDirectionLength(startPoint=origin_4, direction=reverse_3, length=code_block_14)
endPoint_4 = Curve.EndPoint(curve=byStartPointDirectionLength_3)
origin_5 = Plane.Origin(plane=translate_2)
normal_3 = Plane.Normal(plane=translate_2)
code_block_15 = CodeBlock { 1000; }
byStartPointDirectionLength_4 = Line.ByStartPointDirectionLength(startPoint=origin_5, direction=normal_3, length=code_block_15)
endPoint_5 = Curve.EndPoint(curve=byStartPointDirectionLength_4)
byStartPointEndPoint_2 = Line.ByStartPointEndPoint(startPoint=endPoint_4, endPoint=endPoint_5)
direction_2 = Line.Direction(line=byStartPointEndPoint_2)
code_block_16 = CodeBlock { 10; }
rotate_2 = Vector.Rotate(vector=direction, axis=direction_2, degrees=code_block_16)
code_block_17 = CodeBlock { 10000; }
byStartPointDirectionLength_5 = Line.ByStartPointDirectionLength(startPoint=python_script_5, direction=rotate_2, length=code_block_17)
code_block_18 = CodeBlock { -10; }
rotate_3 = Vector.Rotate(vector=direction, axis=direction_2, degrees=code_block_18)
code_block_19 = CodeBlock { 10000; }
byStartPointDirectionLength_6 = Line.ByStartPointDirectionLength(startPoint=python_script_5, direction=rotate_3, length=code_block_19)
code_block_20 = CodeBlock { -5; }
rotate_4 = Vector.Rotate(vector=direction, axis=direction_2, degrees=code_block_20)
code_block_21 = CodeBlock { 10000; }
byStartPointDirectionLength_7 = Line.ByStartPointDirectionLength(startPoint=python_script_5, direction=rotate_4, length=code_block_21)
code_block_22 = CodeBlock { 5; }
rotate_5 = Vector.Rotate(vector=direction, axis=direction_2, degrees=code_block_22)
code_block_23 = CodeBlock { 10000; }
byStartPointDirectionLength_8 = Line.ByStartPointDirectionLength(startPoint=python_script_5, direction=rotate_5, length=code_block_23)
code_block_24 = CodeBlock { -20; }
rotate_6 = Vector.Rotate(vector=direction, axis=direction_2, degrees=code_block_24)
code_block_25 = CodeBlock { 10000; }
byStartPointDirectionLength_9 = Line.ByStartPointDirectionLength(startPoint=python_script_5, direction=rotate_6, length=code_block_25)
code_block_26 = CodeBlock { 10; }
rotate_7 = Vector.Rotate(vector=direction, axis=direction_2, degrees=code_block_26)
code_block_27 = CodeBlock { 10000; }
byStartPointDirectionLength_10 = Line.ByStartPointDirectionLength(startPoint=python_script_5, direction=rotate_7, length=code_block_27)
code_block_28 = CodeBlock { -15; }
rotate_8 = Vector.Rotate(vector=direction, axis=direction_2, degrees=code_block_28)
code_block_29 = CodeBlock { 10000; }
byStartPointDirectionLength_11 = Line.ByStartPointDirectionLength(startPoint=python_script_5, direction=rotate_8, length=code_block_29)
code_block_30 = CodeBlock { 15; }
rotate_9 = Vector.Rotate(vector=direction, axis=direction_2, degrees=code_block_30)
code_block_31 = CodeBlock { 10000; }
byStartPointDirectionLength_12 = Line.ByStartPointDirectionLength(startPoint=python_script_5, direction=rotate_9, length=code_block_31)
code_block_32 = CodeBlock { -60; }
rotate_10 = Vector.Rotate(vector=direction, axis=direction_2, degrees=code_block_32)
code_block_33 = CodeBlock { 10000; }
byStartPointDirectionLength_13 = Line.ByStartPointDirectionLength(startPoint=python_script_5, direction=rotate_10, length=code_block_33)
code_block_34 = CodeBlock { 60; }
rotate_11 = Vector.Rotate(vector=direction, axis=direction_2, degrees=code_block_34)
code_block_35 = CodeBlock { 10000; }
byStartPointDirectionLength_14 = Line.ByStartPointDirectionLength(startPoint=python_script_5, direction=rotate_11, length=code_block_35)
code_block_36 = CodeBlock { -30; }
rotate_12 = Vector.Rotate(vector=direction, axis=direction_2, degrees=code_block_36)
code_block_37 = CodeBlock { 10000; }
byStartPointDirectionLength_15 = Line.ByStartPointDirectionLength(startPoint=python_script_5, direction=rotate_12, length=code_block_37)
code_block_38 = CodeBlock { 30; }
rotate_13 = Vector.Rotate(vector=direction, axis=direction_2, degrees=code_block_38)
code_block_39 = CodeBlock { 10000; }
byStartPointDirectionLength_16 = Line.ByStartPointDirectionLength(startPoint=python_script_5, direction=rotate_13, length=code_block_39)
code_block_40 = CodeBlock { -2.5; }
rotate_14 = Vector.Rotate(vector=direction, axis=direction_2, degrees=code_block_40)
code_block_41 = CodeBlock { 10000; }
byStartPointDirectionLength_17 = Line.ByStartPointDirectionLength(startPoint=python_script_5, direction=rotate_14, length=code_block_41)
code_block_42 = CodeBlock { 2.5; }
rotate_15 = Vector.Rotate(vector=direction, axis=direction_2, degrees=code_block_42)
code_block_43 = CodeBlock { 10000; }
byStartPointDirectionLength_18 = Line.ByStartPointDirectionLength(startPoint=python_script_5, direction=rotate_15, length=code_block_43)
code_block_44 = CodeBlock { 5000; }
byPlaneRadius = Circle.ByPlaneRadius(plane=translate_2, radius=code_block_44)
code_block_45 = CodeBlock(a=python_script_2) { a; }
byStartPointEndPoint_3 = Line.ByStartPointEndPoint(startPoint=python_script_5, endPoint=code_block_45)
code_block_46 = CodeBlock { 0.75; }
pointAtParameter = Curve.PointAtParameter(curve=byStartPointEndPoint_3, param=code_block_46)
byTwoPoints_4 = Vector.ByTwoPoints(start=code_block_45, end=pointAtParameter)
translate_4 = Geometry.Translate(geometry=byPlaneRadius, direction=byTwoPoints_4)
code_block_47 = CodeBlock { 30; }
pointsAtEqualChordLength = Curve.PointsAtEqualChordLength(curve=translate_4, divisions=code_block_47)
python_script_6 = Python(IN[0]=pointsAtEqualChordLength)
# ---------- python_script_6.python (19 lines) ----------
# Load the Python Standard and DesignScript Libraries
import sys
import clr
clr.AddReference('ProtoGeometry')
from Autodesk.DesignScript.Geometry import *

# The inputs to this node will be stored as a list in the IN variables.
points=IN[0]

final=[]

for i in points:
	if i[0]!=None and i[0]!=[]:
		x=i[0][16::]+[i[0][0]]
		final.append(x)
	else:
		final.append([])

OUT=final
# ----------------------------------------
code_block_48 = CodeBlock(a=faces_2) { a; }
python_script_7 = Python(IN[0]=pointsAtEqualChordLength)
# ---------- python_script_7.python (13 lines) ----------
# Load the Python Standard and DesignScript Libraries
import sys
import clr
clr.AddReference('ProtoGeometry')
from Autodesk.DesignScript.Geometry import *

# The inputs to this node will be stored as a list in the IN variables.
dataEnteringNode = IN

# Place your code below this line

# Assign your output to the OUT variable.
OUT = [i[0] for i in IN[0]]
# ----------------------------------------
byStartPointEndPoint_4 = Line.ByStartPointEndPoint(startPoint=pointAtParameter, endPoint=python_script_7)
python_script_8 = Python(IN[0]=code_block_48, IN[1]=byStartPointEndPoint_4)
# ---------- python_script_8.python (24 lines) ----------
# Load the Python Standard and DesignScript Libraries
import sys
import clr
clr.AddReference('ProtoGeometry')
from Autodesk.DesignScript.Geometry import *

# The inputs to this node will be stored as a list in the IN variables.
surfaces=IN[0]
lines=IN[1]

surfaceint=[]
for ind, i in enumerate(surfaces):
	line=lines[ind]
	sub=[]
	if line!=None and i!=None:
		for j in i:
			linint=[]
			for k in line:
				boo=j.DoesIntersect(k)
				if boo==True and j not in sub:
					sub.append(j)
	surfaceint.append(sub)
	
OUT=surfaceint
# ----------------------------------------
code_block_49 = CodeBlock { "Lateral Area"; }
code_block_50 = CodeBlock { 0.5; }
pointAtParameter_2 = Surface.PointAtParameter(surface=faces, u=code_block_50, v=code_block_50)
code_block_51 = CodeBlock { 0.5; }
normalAtParameter = Surface.NormalAtParameter(surface=faces, u=code_block_51, v=code_block_51)
code_block_52 = CodeBlock { 1000; }
byStartPointDirectionLength_19 = Line.ByStartPointDirectionLength(startPoint=pointAtParameter_2, direction=normalAtParameter, length=code_block_52)
direction_3 = Line.Direction(line=byStartPointDirectionLength_19)
code_block_53 = CodeBlock(v=direction_3) { v.Z; }
code_block_54 = CodeBlock { 3; }
round = Math.Round(number=code_block_53, digits=code_block_54)
maximumItem = List.MaximumItem(list=round)
minimumItem = List.MinimumItem(list=round)
code_block_55 = CodeBlock(x=round, max=maximumItem, min=minimumItem) { x==max||x==min; }
filterByBoolMask_3 = List.FilterByBoolMask(list=faces, mask=code_block_55)
area_2 = Surface.Area(surface=filterByBoolMask_3.out)
sum = Math.Sum(values=area_2)
code_block_56 = CodeBlock(a=sum) { a/1000000; }
setParameterByName = Element.SetParameterByName(parameterName=code_block_49, value=code_block_56@L2)  # frozen; unwired: element
round_2 = Math.Round(number=code_block_53)
filterByBoolMask_4 = List.FilterByBoolMask(list=byStartPointDirectionLength_19, mask=code_block_55)
code_block_57 = CodeBlock(a=filterByBoolMask_4.in) { a; }
code_block_58 = CodeBlock(a=code_block_5) { a[0..10]; }
code_block_59 = CodeBlock(a=filterByBoolMask_3.out) { a[0]; }
