# Dynamo graph 2. Surface Area.dyn (Dynamo 2.5.0.7460)
# packages: Rhythm 2020.1.22, bimorphNodes 3.0.3, Sastrugi 2.0.0

select_model_elements = DSModelElementsSelection()  # 182 picked in the model
code_block = CodeBlock { "B6_1D_Element_Category"; }
ʳʰʸᵗʰᵐ_elements = Rhythm.Revit.Elements.Elements.GetParameterValueByNameTypeOrInstance(element=select_model_elements, parameterName=code_block)
code_block_2 = CodeBlock { "rib"; true; }
contains = String.Contains(str=ʳʰʸᵗʰᵐ_elements, searchFor=code_block_2.out0, ignoreCase=code_block_2.out1)
filterByBoolMask = List.FilterByBoolMask(list=select_model_elements, mask=contains)
code_block_3 = CodeBlock(a=filterByBoolMask.in) { a; }
code_block_4 = CodeBlock { true; }
ne = contains != code_block_4
filterByBoolMask_2 = List.FilterByBoolMask(list=select_model_elements, mask=ne)
code_block_5 = CodeBlock(a=filterByBoolMask_2.in) { a; }
intersectsElement = Revit.Element.IntersectsElement(elementSetA=code_block_3, elementSetB=code_block_5)  # frozen
python_script = Python(IN[0]=intersectsElement.Element, IN[1]=intersectsElement.intersectsWith)
# ---------- python_script.python (17 lines) ----------
# Load the Python Standard and DesignScript Libraries
import sys
import clr
clr.AddReference('ProtoGeometry')
from Autodesk.DesignScript.Geometry import *

# The inputs to this node will be stored as a list in the IN variables.
walls=IN[0]
ribs=IN[1]
ribsf=[]
wallsf=[]
for ind, i in enumerate(walls):
	if i!=[] and i!="" and i!=None:
		wallsf.append(i)
		ribsf.append(ribs[ind])

OUT=wallsf, ribsf
# ----------------------------------------
code_block_6 = CodeBlock(a=python_script) { a[1]; }
code_block_7 = CodeBlock(a=python_script) { a[0]; }

# group: Walls Solids
solids = Revit.LinkElement.Solids(linkElement=code_block_7)  # frozen
python_script_2 = Python(IN[0]=solids)
# ---------- python_script_2.python (17 lines) ----------
# Load the Python Standard and DesignScript Libraries
import sys
import clr
clr.AddReference('ProtoGeometry')
from Autodesk.DesignScript.Geometry import *

# The inputs to this node will be stored as a list in the IN variables.
walls=IN[0]
final=[]
for i in walls:
	sub=[]
	if i!=None and i!=[]:
		for j in i:
			if j!=[] and j!=None:
				sub.append(j)
		final.append(sub)
OUT= final		
# ----------------------------------------
python_script_3 = Python(IN[0]=python_script_2)
# ---------- python_script_3.python (18 lines) ----------
# Load the Python Standard and DesignScript Libraries
import sys
import clr
clr.AddReference('ProtoGeometry')
from Autodesk.DesignScript.Geometry import *

# The inputs to this node will be stored as a list in the IN variables.
geom=IN[0]
from functools import reduce

final=[]
for i in geom:
	if i!=None and i!=[]:
		x=reduce(lambda x,y:x+y,i)
		final.append(x)
	else:
		final.append([])
OUT=final
# ----------------------------------------

# group: Ribs
solids_2 = Revit.LinkElement.Solids(linkElement=code_block_3)
flatten = List.Flatten(list=solids_2)

# group: Intersection Checker
python_script_4 = Python(IN[0]=python_script_3, IN[1]=flatten)
# ---------- python_script_4.python (36 lines) ----------
# Load the Python Standard and DesignScript Libraries
import sys
import clr
clr.AddReference('ProtoGeometry')
from Autodesk.DesignScript.Geometry import *

# The inputs to this node will be stored as a list in the IN variables.
walls=IN[0]
ribs=IN[1]

faces=[]
ribsf=[]
indexw=[]
indexr=[]
for ind, i in enumerate(ribs):
	subw=[]
	subr=[]
	subiw=[]
	subri=[]
	if i!=None and i!=[] and i!='':
		face=walls[ind]
		if face!=None and face!=[] and face!="":		
			for ind1, j in enumerate(face):
				if j!=None and j!=[]:
					boo=i.DoesIntersect(j)
					if boo==True:
						subw.append(j)
						subiw.append(ind1)
			ribsf.append(i)
			indexr.append(ind)			
			faces.append(subw)
			indexw.append(subiw)

OUT= indexr, ribsf, indexw, faces
	
	
# ----------------------------------------

ribs_index = CodeBlock(a=python_script_4) { a[0]; }
getItemAtIndex = List.GetItemAtIndex(list=code_block_6, index=ribs_index)
faces = Element.Faces(element=getItemAtIndex@L2)

# group: Normal to Surface
code_block_8 = CodeBlock { 0.5; }
pointAtParameter = Surface.PointAtParameter(surface=faces, u=code_block_8, v=code_block_8)
code_block_9 = CodeBlock { 0.5; }
normalAtParameter = Surface.NormalAtParameter(surface=faces, u=code_block_9, v=code_block_9)
code_block_10 = CodeBlock { 1000; }
byStartPointDirectionLength = Line.ByStartPointDirectionLength(startPoint=pointAtParameter, direction=normalAtParameter, length=code_block_10)
direction = Line.Direction(line=byStartPointDirectionLength)

# group: Ribs
ribs_solids = CodeBlock(a=python_script_4) { a[1]; }

surface = CodeBlock(a=python_script_4) { a[3]; }

# group: Intersection Volume Out
python_script_5 = Python(IN[0]=ribs_solids, IN[1]=surface)  # frozen
# ---------- python_script_5.python (21 lines) ----------
# Load the Python Standard and DesignScript Libraries
import sys
import clr
clr.AddReference('ProtoGeometry')
from Autodesk.DesignScript.Geometry import *

ribs=IN[0]
surface=IN[1]
surfaces=[]
for ind, i in enumerate(ribs):
	surf=surface[ind]
	sub=[]
	if surf!=[] and surf!=None and surf!='':
		try:
			for j in surf:
				x=Geometry.Intersect(i,j)
				sub.append(x)
			surfaces.append(sub)
		except:
			surfaces.append([])
OUT=surfaces
# ----------------------------------------

# group: union
python_script_6 = Python(IN[0]=python_script_5)
# ---------- python_script_6.python (34 lines) ----------
# Load the Python Standard and DesignScript Libraries
import sys
import clr
clr.AddReference('ProtoGeometry')
from Autodesk.DesignScript.Geometry import *

# The inputs to this node will be stored as a list in the IN varif

from functools import reduce

solids=IN[0]
final=[]
for i in solids:
	if i!=[] and i!=None:
		x=reduce(lambda x,y : x+y, i)
		final.append(x)
	else:
		final.append([])
sol=[]
for i in final:
	if i==[]:
		sol.append([])
	
	elif len(i)==1:
		sol.append(i[0])
	else:
		ini=i[0]
		sub=[ini]
		for j in range(1,len(i)-1):
			ini1=Solid.Union(sub[0],i[j])
			sub[0]=ini1
		sol.append(sub[0])
		
OUT=sol
# ----------------------------------------

# group: Wall Inter. Centroid
centroid = Solid.Centroid(solid=python_script_6)

surface_index = CodeBlock(a=python_script_4) { a[2]; }

# group: Planes with max. area
faces_2 = Element.Faces(element=code_block_3)
area = Surface.Area(surface=faces_2)
python_script_7 = Python(IN[0]=area, IN[1]=faces_2)
# ---------- python_script_7.python (16 lines) ----------
# Load the Python Standard and DesignScript Libraries
import sys
import clr
clr.AddReference('ProtoGeometry')
from Autodesk.DesignScript.Geometry import *

# The inputs to this node will be stored as a list in the IN variables.
area=IN[0]
surface=IN[1]
final=[]
for ind, i in enumerate(area):
	surf=surface[ind]
	x=max(i)
	ind1=i.index(x)
	final.append(surf[ind1])
OUT=final
# ----------------------------------------
surface_plane = Custom[❄_Surface Plane](InputSurfaces=python_script_7)  # package Sastrugi; (Sastrugi_Geometry) This node will extract a plane that best fits a surface.

# group: Angle between Plane and Original Z axis
origin = Plane.Origin(plane=surface_plane)
normal = Plane.Normal(plane=surface_plane)
ZAxis = Vector.ZAxis()
XAxis = Plane.XAxis(plane=surface_plane)
angleAboutAxis = Vector.AngleAboutAxis(vector=ZAxis, otherVector=XAxis, rotationAxis=normal)

code_block_11 = CodeBlock(a=angleAboutAxis) { -a; }

# group: Plane Rotation
rotate = Geometry.Rotate(geometry=surface_plane, origin=origin, axis=normal, degrees=code_block_11)

boundingBox = Element.BoundingBox(element=code_block_3)
toCuboid = BoundingBox.ToCuboid(boundingBox=boundingBox)
centroid_2 = Solid.Centroid(solid=toCuboid)

# group: Plane origin and centroid of intersection difference
X = Point.X(point=origin)
X_2 = Point.X(point=centroid_2)
Y = Point.Y(point=origin)
Y_2 = Point.Y(point=centroid_2)
Z = Point.Z(point=origin)
Z_2 = Point.Z(point=centroid_2)

flatten_2 = List.Flatten(list=X)
flatten_3 = List.Flatten(list=Y)
flatten_4 = List.Flatten(list=Z)
python_script_8 = Python(IN[0]=flatten_2, IN[1]=X_2, IN[2]=flatten_3, IN[3]=Y_2, IN[4]=flatten_4, IN[5]=Z_2)
# ---------- python_script_8.python (24 lines) ----------
# Load the Python Standard and DesignScript Libraries
import sys
import clr
clr.AddReference('ProtoGeometry')
from Autodesk.DesignScript.Geometry import *

# The inputs to this node will be stored as a list in the IN variables.
x=[]
y=[]
z=[]
for ind, i in enumerate(IN[0]):
	y1=IN[1][ind]
	z1=IN[2][ind]
	x2=IN[3][ind]
	y2=IN[4][ind]
	z2=IN[5][ind]
	if i!=[] and y1!=[] and z1!=[] and x2!='' and y2!="" and z2!='':
		x.append(x2-i)
		y.append(y2-y1)
		z.append(z2-z1)
OUT=x, y, z
	
	
	
# ----------------------------------------
code_block_12 = CodeBlock(a=python_script_8) { a[0]; }
code_block_13 = CodeBlock(a=python_script_8) { a[1]; }
code_block_14 = CodeBlock(a=python_script_8) { a[2]; }

# group: Translating Plane
translate = Geometry.Translate(geometry=rotate, xTranslation=code_block_12, yTranslation=code_block_13, zTranslation=code_block_14)
code_block_15 = CodeBlock { 1000; }
byWidthLength = Rectangle.ByWidthLength(plane=translate, width=code_block_15, length=code_block_15)

origin_2 = Plane.Origin(plane=translate)
YAxis = Plane.YAxis(plane=translate)

# group: Line To visualise Axis
code_block_16 = CodeBlock { 100; }
byStartPointDirectionLength_2 = Line.ByStartPointDirectionLength(startPoint=origin_2, direction=YAxis, length=code_block_16)

# group: Vector
origin_3 = Plane.Origin(plane=translate)
YAxis_2 = Plane.YAxis(plane=translate)
reverse = Vector.Reverse(vector=YAxis_2)

# group: Line to visualise
code_block_17 = CodeBlock { 1000; }
byStartPointDirectionLength_3 = Line.ByStartPointDirectionLength(startPoint=origin_3, direction=reverse, length=code_block_17)

origin_4 = Plane.Origin(plane=translate)
normal_2 = Plane.Normal(plane=translate)

# group: Line To visualise Axis
code_block_18 = CodeBlock { 1000; }
byStartPointDirectionLength_4 = Line.ByStartPointDirectionLength(startPoint=origin_4, direction=normal_2, length=code_block_18)

normal_3 = Plane.Normal(plane=translate)

# group: Vector
origin_5 = Plane.Origin(plane=translate)
reverse_2 = Vector.Reverse(vector=normal_3)

code_block_19 = CodeBlock { 1000; }
byStartPointDirectionLength_5 = Line.ByStartPointDirectionLength(startPoint=origin_5, direction=reverse_2, length=code_block_19)
