# Dynamo graph 3. Surface Area.dyn (Dynamo 2.5.0.7460)
# packages: Rhythm 2020.1.22, bimorphNodes 3.0.3, Sastrugi 2.0.0

select_model_elements = DSModelElementsSelection()  # 182 picked in the model
code_block = CodeBlock { "B6_1D_Element_Category"; }
ʳʰʸᵗʰᵐ_elements = Rhythm.Revit.Elements.Elements.GetParameterValueByNameTypeOrInstance(element=select_model_elements, parameterName=code_block)
code_block_2 = CodeBlock { "rib"; true; }
contains = String.Contains(str=ʳʰʸᵗʰᵐ_elements, searchFor=code_block_2.out0, ignoreCase=code_block_2.out1)
filterByBoolMask = List.FilterByBoolMask(list=select_model_elements, mask=contains)
code_block_3 = CodeBlock(a=filterByBoolMask.in) { a; }

# group: Planes with max. area
faces = Element.Faces(element=code_block_3)
area = Surface.Area(surface=faces)
python_script = Python(IN[0]=area, IN[1]=faces)
# ---------- python_script.python (16 lines) ----------
# Load the Python Standard and DesignScript Libraries
import sys
import clr
clr.AddReference('ProtoGeometry')
from Autodesk.DesignScript.Geometry import *

# The inputs to this node will be stored as a list in the IN variables.
area=IN[0]
surface=IN[1]
final=[]
for ind, i in enumerate(area):
	surf=surface[ind]
	x=max(i)
	ind1=i.index(x)
	final.append(surf[ind1])
OUT=final
# ----------------------------------------
surface_plane = Custom[❄_Surface Plane](InputSurfaces=python_script)  # package Sastrugi; (Sastrugi_Geometry) This node will extract a plane that best fits a surface.

# group: Angle between Plane and Original Z axis
origin = Plane.Origin(plane=surface_plane)
normal = Plane.Normal(plane=surface_plane)
ZAxis = Vector.ZAxis()
XAxis = Plane.XAxis(plane=surface_plane)
angleAboutAxis = Vector.AngleAboutAxis(vector=ZAxis, otherVector=XAxis, rotationAxis=normal)

code_block_4 = CodeBlock(a=angleAboutAxis) { -a; }

# group: Plane Rotation
rotate = Geometry.Rotate(geometry=surface_plane, origin=origin, axis=normal, degrees=code_block_4)

# group: Ribs
solids = Revit.LinkElement.Solids(linkElement=code_block_3)
flatten = List.Flatten(list=solids)
centroid = Solid.Centroid(solid=flatten)

byTwoPoints = Vector.ByTwoPoints(start=origin, end=centroid)
translate = Geometry.Translate(geometry=rotate, direction=byTwoPoints)
origin_2 = Plane.Origin(plane=translate)

# group: BB
boundingBox = Element.BoundingBox(element=code_block_3)
toCuboid = BoundingBox.ToCuboid(boundingBox=boundingBox)
centroid_2 = Solid.Centroid(solid=toCuboid)

byTwoPoints_2 = Vector.ByTwoPoints(start=origin_2, end=centroid_2)
translate_2 = Geometry.Translate(geometry=translate, direction=byTwoPoints_2)

# group: Translating Plane
code_block_5 = CodeBlock { 1000; }
byWidthLength = Rectangle.ByWidthLength(plane=translate_2, width=code_block_5, length=code_block_5)

faces_2 = Element.Faces(element=code_block_3@L2)
code_block_6 = CodeBlock(a=faces_2) { a[0]; }
area_2 = Surface.Area(surface=code_block_6)
sum = Math.Sum(values=area_2)
code_block_7 = CodeBlock(a=sum) { a[0]; }
X = Point.X(point=centroid_2)
Y = Point.Y(point=centroid_2)
Z = Point.Z(point=centroid)
byCoordinates = Point.ByCoordinates(x=X, y=Y, z=Z)
byTwoPoints_3 = Vector.ByTwoPoints(start=origin_2, end=byCoordinates)
code_block_8 = CodeBlock { 4000; }
byStartPointDirectionLength = Line.ByStartPointDirectionLength(startPoint=origin_2, direction=byTwoPoints_3, length=code_block_8)
code_block_9 = CodeBlock { 0.6; }
pointAtParameter = Curve.PointAtParameter(curve=byStartPointDirectionLength, param=code_block_9)
flatten_2 = List.Flatten(list=pointAtParameter)
X_2 = Point.X(point=flatten_2)
Y_2 = Point.Y(point=flatten_2)
Z_2 = Point.Z(point=flatten_2)
code_block_10 = CodeBlock(a=Z_2) { a-1000; }
byCoordinates_2 = Point.ByCoordinates(x=X_2, y=Y_2, z=code_block_10)
code_block_11 = CodeBlock { 3000; 1000; 3000; }
byLengths = Cuboid.ByLengths(origin=byCoordinates_2, width=code_block_11.out0, length=code_block_11.out1, height=code_block_11.out2)

# group: Normal to Surface
code_block_12 = CodeBlock { 0.5; }
pointAtParameter_2 = Surface.PointAtParameter(surface=code_block_6, u=code_block_12, v=code_block_12)
code_block_13 = CodeBlock { 0.5; }
normalAtParameter = Surface.NormalAtParameter(surface=code_block_6, u=code_block_13, v=code_block_13)
code_block_14 = CodeBlock { 4000; }
byStartPointDirectionLength_2 = Line.ByStartPointDirectionLength(startPoint=pointAtParameter_2, direction=normalAtParameter, length=code_block_14)

python_script_2 = Python(IN[0]=byLengths, IN[1]=byStartPointDirectionLength_2, IN[2]=code_block_6)
# ---------- python_script_2.python (25 lines) ----------
# Load the Python Standard and DesignScript Libraries
import sys
import clr
clr.AddReference('ProtoGeometry')
from Autodesk.DesignScript.Geometry import *

# The inputs to this node will be stored as a list in the IN variables.
solids=IN[0]
lines=IN[1]
surfaces=IN[2]
final=[]

for ind, i in enumerate(solids):	
	line=lines[ind]
	surface=surfaces[ind]
	sub=[]
	for ind1, j in enumerate(line):
		surf=surface[ind1]
		boo=j.DoesIntersect(i)
		if boo==True:
			
			sub.append(surf)
	final.append(sub)

OUT=final
# ----------------------------------------
area_3 = Surface.Area(surface=python_script_2)
sum_2 = Math.Sum(values=area_3)
python_script_3 = Python(IN[0]=code_block_7, IN[1]=sum_2)
# ---------- python_script_3.python (8 lines) ----------
# Load the Python Standard and DesignScript Libraries
import sys
import clr
clr.AddReference('ProtoGeometry')
from Autodesk.DesignScript.Geometry import *

# The inputs to this node will be stored as a list in the IN variables.
OUT=[i-IN[1][ind] for ind, i in enumerate(IN[0])]
# ----------------------------------------
name = Element.Name(element=code_block_3)
direction = Line.Direction()  # unwired: line
