# Dynamo graph V1.dyn (Dynamo 2.5.0.7460)

select_model_element = DSModelElementSelection()  # 1 picked in the model
solids = Element.Solids(element=select_model_element)
select_model_elements = DSModelElementsSelection()  # 2 picked in the model
geometry = Element.Geometry(element=select_model_elements)
startPoint = Curve.StartPoint(curve=geometry)
code_block = CodeBlock(a=startPoint) { a[0]; }
endPoint = Curve.EndPoint(curve=geometry)
code_block_2 = CodeBlock(a=endPoint) { a[0]; }
code_block_3 = CodeBlock(a=endPoint) { a[1]; }
byThreePoints = Plane.ByThreePoints(origin=code_block, planePoint=code_block_2, xAxisPoint=code_block_3)
split = Geometry.Split(geometry=solids, other=byThreePoints)
code_block_4 = CodeBlock(a=split) { a[0][0]; }
