# Dynamo graph family parameter change.dyn (Dynamo 2.6.1.8786)
# packages: Clockwork for Dynamo 2.x 2.3.0, Rhythm 2021.4.2, Genius Loci 2021.4.13

categories = Categories("OST_GenericModel")
all_families_of_category = Custom[All Families Of Category](category=categories)  # package Clockwork for Dynamo 2.x; Gets all famiies of a given category in the model (does *not *work for system families)

# group: Location to save family
directory_path = Directory("C:\Users\130\Desktop\WIP\Succesfull Scripts\General Purpose\30. Filling Family Parameters from project and save them in background")

name = Custom[Element.Name+](element=all_families_of_category)  # package Clockwork for Dynamo 2.x; Gets an element's name. Unlike the OOTB node, this node should work for all Revit elements that have names and will also return the localized names of system parameters, parameter groups, display unit types, parameter types, unit symbol types and unit types.
code_block = CodeBlock(dir=directory_path, x=name) { dir+"\\"+x+ ".rfa"; }
all_elements_of_family = Custom[All Elements of Family](family=all_families_of_category)  # package Genius Loci; Get the family instances of the given loadable family.
flatten = List.Flatten(list=all_elements_of_family)
clean = List.Clean(list=flatten)

# group: Excel Data
file_path = Filename(".\AZA_Family Parameters to be fullfilled in Revit.xlsx")
file_from_path = FileObject(path=file_path)
code_block_2 = CodeBlock { "Autocad Output"; true; false; }
importExcel = Data.ImportExcel(file=file_from_path, sheetName=code_block_2.out0, readAsStrings=code_block_2.out1, showExcel=code_block_2.out2)
restOfItems = List.RestOfItems(list=importExcel)
transpose = List.Transpose(lists=restOfItems)

code_block_3 = CodeBlock(a=transpose) { a[0]; a[1]; a[2]; a[3]; }
python_script = Python(IN[0]=clean, IN[1]=code_block_3.out0)
# ---------- python_script.python (31 lines) ----------
import clr
clr.AddReference('RevitAPI')
from Autodesk.Revit.DB import *

names=IN[1]

elements=[UnwrapElement(i) for i in IN[0]]
elem=[]
name=[]
for i in elements:
	
	if hasattr(i,"Name"):
		nam=i.Name
		if nam in names:
		
			elem.append(i)
			name.append(nam)
unique=[]
indexes=[]
for index, i in enumerate(name):
	if i not in unique:
		unique.append(i)
		indexes.append(index)

unique_e=[]
for index, e in enumerate(elem):
	if index in indexes:
		unique_e.append(e)
		
		
OUT= unique_e
# ----------------------------------------
code_block_4 = CodeBlock { "AZA_I"; }
ʳʰʸᵗʰᵐ_elements = Rhythm.Revit.Elements.Elements.SetParameterByNameTypeOrInstance(element=python_script, parameterName=code_block_4, value=code_block_3.out1)
code_block_5 = CodeBlock { "AZA_J"; }
ʳʰʸᵗʰᵐ_elements_2 = Rhythm.Revit.Elements.Elements.SetParameterByNameTypeOrInstance(element=python_script, parameterName=code_block_5, value=code_block_3.out2)
code_block_6 = CodeBlock { "AZA_K"; }
ʳʰʸᵗʰᵐ_elements_3 = Rhythm.Revit.Elements.Elements.SetParameterByNameTypeOrInstance(element=python_script, parameterName=code_block_6, value=code_block_3.out3)
list_create = List.Create(item0=ʳʰʸᵗʰᵐ_elements, item1=ʳʰʸᵗʰᵐ_elements_2, item2=ʳʰʸᵗʰᵐ_elements_3)
passthrough = Custom[Passthrough](passThrough=code_block, waitFor=list_create)  # package Clockwork for Dynamo 2.x; Forces a sequential order of execution. The node wired into the output of the Passthrough node will be executed *after* the node wired into the waitFor input (e.g. important for some Revit operations). The value of the passThrough input will be passed on to the node wired into the output port of the Passthrough node.
python_script_2 = Python(IN[0]=all_families_of_category, IN[1]=passthrough)
# ---------- python_script_2.python (56 lines) ----------
import clr

clr.AddReference('ProtoGeometry')

from Autodesk.DesignScript.Geometry import *



clr.AddReference('RevitAPI')

import Autodesk



clr.AddReference('RevitServices')

import RevitServices

from RevitServices.Persistence import DocumentManager

from RevitServices.Transactions import TransactionManager

doc = DocumentManager.Instance.CurrentDBDocument



#Close all transactions

trans = TransactionManager.Instance

trans.ForceCloseTransaction()



fams = IN[0]

paths = IN[1]



#unwrap the Dynamo elements

fams = map(UnwrapElement, fams)



for i in xrange(len(fams) ):

    famDoc = doc.EditFamily(fams[i])

    famDoc.SaveAs(paths[i])

    famDoc.Close(False)

# Assign your output to the OUT variable.
OUT = 0
# ----------------------------------------
