# Dynamo graph 2. Clash Detection.dyn (Dynamo 2.5.0.7460)
# packages: Rhythm 2021.4.2, bimorphNodes 3.0.3, archi-lab.net 2021.25.2621

# group: Category 1
categories = Categories("OST_Mass")
all_elements_of_category = ElementsOfCategory(Category=categories)

solids = Element.Solids(element=all_elements_of_category)
python_script = Python(IN[0]=solids)
# ---------- python_script.python (19 lines) ----------
# Load the Python Standard and DesignScript Libraries
import sys
import clr
clr.AddReference('ProtoGeometry')
from Autodesk.DesignScript.Geometry import *

# The inputs to this node will be stored as a list in the IN variables.

solids=IN[0]

index=[]
solids_new=[]
for ind, i in enumerate(solids):
	if i==None or i==[]:
		pass
	else:
		index.append(ind)
		solids_new.append(i)
OUT=index, solids_new
# ----------------------------------------
code_block = CodeBlock(a=python_script) { a[1]; }
flatten = List.Flatten(list=code_block)

# group: Linked Files- Category 2 ( Use when you have elements in Linked Files )
getDocuments = archilab.Revit.Selection.Select.GetDocuments()
categories_2 = Categories("OST_Ceilings")
ofCategory = Revit.LinkElement.OfCategory(linkInstance=getDocuments.Link_Instance, Category=categories_2)
element = Revit.LinkElement.Element(linkElement=ofCategory)

flatten_2 = List.Flatten(list=element)
solids_2 = Revit.LinkElement.Solids(linkElement=flatten_2)
python_script_2 = Python(IN[0]=solids_2)  # same code as python_script
code_block_2 = CodeBlock(a=python_script_2) { a[1]; }
flatten_3 = List.Flatten(list=code_block_2)

# group: Clash Detection
python_script_3 = Python(IN[0]=flatten, IN[1]=flatten_3)
# ---------- python_script_3.python (25 lines) ----------
# Load the Python Standard and DesignScript Libraries
import sys
import clr
clr.AddReference('ProtoGeometry')
from Autodesk.DesignScript.Geometry import *

# The inputs to this node will be stored as a list in the IN variables.
rooms=IN[0]
ceiling=IN[1]

rooms1=[]
ceilings=[]
for ind, i in enumerate(rooms):
	ceilings_sub=[]
	sub=[]
	if i!='' and i!= None:
		for ind1, j in enumerate(ceiling):
			if j!='' and j!=None:
				boo1=str(j.DoesIntersect(i))
				if boo1=="True":
					ceilings_sub.append(ind1)
					sub.append(ind)	
	ceilings.append(ceilings_sub)
	rooms1.append(set(sub))					
OUT =rooms1, ceilings				
# ----------------------------------------

# group: Category 1
category_1 = CodeBlock(a=python_script_3) { a[0]; }

getItemAtIndex = List.GetItemAtIndex(list=all_elements_of_category, index=category_1@L2)
code_block_3 = CodeBlock { "Ceiling Bottom Height"; }
flatten_4 = List.Flatten(list=element)

# group: Category 2
category_2 = CodeBlock(a=python_script_3) { a[1]; }

getItemAtIndex_2 = List.GetItemAtIndex(list=flatten_4, index=category_2@L2)
code_block_4 = CodeBlock { "Bottom Height"; }
ʳʰʸᵗʰᵐ_elements = Rhythm.Revit.Elements.Elements.GetParameterValueByNameTypeOrInstance(element=getItemAtIndex_2, parameterName=code_block_4)  # frozen
python_script_4 = Python(IN[0]=ʳʰʸᵗʰᵐ_elements)
# ---------- python_script_4.python (19 lines) ----------
# Load the Python Standard and DesignScript Libraries
import sys
import clr
clr.AddReference('ProtoGeometry')
from Autodesk.DesignScript.Geometry import *

# The inputs to this node will be stored as a list in the IN variables.
height=IN[0]

bottom=[]

for i in height:
	sub=[]
	if i!=[]:
		x=min(i)
		sub.append(x)
	bottom.append(sub)

OUT= bottom
# ----------------------------------------
ʳʰʸᵗʰᵐ_elements_2 = Rhythm.Revit.Elements.Elements.SetParameterByNameTypeOrInstance(element=getItemAtIndex, parameterName=code_block_3, value=python_script_4)
code_block_5 = CodeBlock(a=python_script_2) { a[0]; }
code_block_6 = CodeBlock(a=python_script) { a[0]; }
code_block_7 = CodeBlock { "WBS 1"; }
code_block_8 = CodeBlock { "Type Mark"; }
ʳʰʸᵗʰᵐ_elements_3 = Rhythm.Revit.Elements.Elements.GetParameterValueByNameTypeOrInstance(element=getItemAtIndex_2, parameterName=code_block_8)  # frozen

# group: Parameter value from category 2
python_script_5 = Python(IN[0]=ʳʰʸᵗʰᵐ_elements_3)
# ---------- python_script_5.python (20 lines) ----------
# Load the Python Standard and DesignScript Libraries
import sys
import clr
clr.AddReference('ProtoGeometry')
from Autodesk.DesignScript.Geometry import *

# The inputs to this node will be stored as a list in the IN variables.
names=IN[0]

new=[]

for i in names:
	if i!=[] and isinstance(i,list):
		sub=list(filter(None,i))
		x='+'.join(sub)
		new.append(x)
	elif i!=[] and isinstance(i,str):
		new.append(i)

OUT= new
# ----------------------------------------

ʳʰʸᵗʰᵐ_elements_4 = Rhythm.Revit.Elements.Elements.SetParameterByNameTypeOrInstance(element=getItemAtIndex, parameterName=code_block_7, value=python_script_5)

# group: Category 1
categories_3 = Categories("OST_Floors")
all_elements_of_category_2 = ElementsOfCategory(Category=categories_3)

flatten_5 = List.Flatten(list=getItemAtIndex)
flatten_6 = List.Flatten(list=getItemAtIndex_2)
