# Dynamo graph 3. Clash Detection.dyn (Dynamo 2.5.0.7460)
# packages: BumbleBee 2021.25.3, Genius Loci 2021.5.18

file_path = Filename("No file selected.")
code_block = CodeBlock { true; }
get_worksheet_names = Custom[Get Worksheet Names](filePath=file_path, runIt=code_block)  # frozen; package BumbleBee; This node will query an Excel file and return a list of sheet names that it contains.
XY = Plane.XY()
toCoordinateSystem = Plane.ToCoordinateSystem(plane=XY)
origin = Point.Origin()
ZAxis = Vector.ZAxis()
get_project_locations = Custom[Get Project Locations]()  # package Genius Loci; Works only in Revit 2018 and later. Retrieves the project positions with the survey point of the given document as the origin. (Coordinates of Internal origin, project base point and survey point)
code_block_2 = CodeBlock(pbp=get_project_locations.Project_Base_Point) { pbp[1]; }
rotate = CoordinateSystem.Rotate(coordinateSystem=toCoordinateSystem, origin=origin, axis=ZAxis, degrees=code_block_2)
origin_2 = Point.Origin()
code_block_3 = CodeBlock(int_or=get_project_locations.Internal_Origin) { N_S_Disp=int_or[1]*-1; E_W_Disp=int_or[0]*-1; }
byCartesianCoordinates = Point.ByCartesianCoordinates(cs=rotate, x=code_block_3.E_W_Disp, y=code_block_3.N_S_Disp)
byTwoPoints = Vector.ByTwoPoints(start=origin_2, end=byCartesianCoordinates)
distanceTo = Geometry.DistanceTo(geometry=origin_2, other=byCartesianCoordinates)
translate = CoordinateSystem.Translate(coordinateSystem=rotate, direction=byTwoPoints, distance=distanceTo)
file_from_path = FileObject(path=file_path)
code_block_4 = CodeBlock { "Sheet1"; }
code_block_5 = CodeBlock { true; false; }
importExcel = Data.ImportExcel(file=file_from_path, sheetName=code_block_4, readAsStrings=code_block_5.out0, showExcel=code_block_5.out1)

# group: Drom The first 8-9 rows
code_block_6 = CodeBlock { 8; }
dropItems = List.DropItems(list=importExcel, amount=code_block_6)

transpose = List.Transpose(lists=dropItems)

# group: Columns
clash_name = CodeBlock(a=transpose) { a[1]; }
status = CodeBlock(a=transpose) { a[2]; }
clash_point = CodeBlock(a=transpose) { a[6]; }
item_1_id = CodeBlock(a=transpose) { a[7]; }
item_2_id = CodeBlock(a=transpose) { a[8]; }

python_script = Python(IN[0]=clash_name, IN[1]=status, IN[2]=clash_point, IN[3]=item_1_id, IN[4]=item_2_id)
# ---------- python_script.python (31 lines) ----------
# Load the Python Standard and DesignScript Libraries
import sys
import clr
clr.AddReference('ProtoGeometry')
from Autodesk.DesignScript.Geometry import *

# The inputs to this node will be stored as a list in the IN variables.
clash_name=IN[0]
status=IN[1]
pts=IN[2]
item1=IN[3]
item2=IN[4]

clashn=[]
stat=[]
ptsx=[]
ptsy=[]
ptsz=[]
it1=[]
it2=[]
for ind, i in enumerate(clash_name):
	if i!=[] and i!=None and i!='':
		clashn.append(i)
		stat.append(status[ind])
		ptsx.append(float(pts[2:9]))
		ptsy.append(float(pts[12:19]))
		ptsz.append(float(pts[22:29]))
		it1.append(item1[12:18])
		it2.append(item2[12:18])

OUT= clashn, stat, ptsx, ptsy, ptsz, it1, it2
# ----------------------------------------
ptsx = CodeBlock(a=python_script) { a[2]; }
convert_between_units = DynamoConvert(ptsx, MeasurementType="Length", FromConversion="Meters", ToConversion="Millimeters")
ptsx_2 = CodeBlock(a=python_script) { a[3]; }
convert_between_units_2 = DynamoConvert(ptsx_2, MeasurementType="Length", FromConversion="Meters", ToConversion="Millimeters")
ptsx_3 = CodeBlock(a=python_script) { a[4]; }
convert_between_units_3 = DynamoConvert(ptsx_3, MeasurementType="Length", FromConversion="Meters", ToConversion="Millimeters")
byCartesianCoordinates_2 = Point.ByCartesianCoordinates(cs=translate, x=convert_between_units, y=convert_between_units_2, z=convert_between_units_3)
family_types = FamilyTypes("ABG_GEN_ClashSphere_R20:Typical")
byPoints = AdaptiveComponent.ByPoints(points=byCartesianCoordinates_2, familyType=family_types)
string = StringInput("Clash Name")
clash_name_2 = CodeBlock(a=python_script) { a[0]; }
setParameterByName = Element.SetParameterByName(element=byPoints, parameterName=string, value=clash_name_2)
string_2 = StringInput("Clash Status")
status_2 = CodeBlock(a=python_script) { a[1]; }
setParameterByName_2 = Element.SetParameterByName(element=byPoints, parameterName=string_2, value=status_2)
string_3 = StringInput("Element Id- 1")
setParameterByName_3 = Element.SetParameterByName(element=byPoints, parameterName=string_3)  # unwired: value
string_4 = StringInput("Element Id- 2")
item_1_id_2 = CodeBlock(a=python_script) { a[5]; }
setParameterByName_4 = Element.SetParameterByName(element=byPoints, parameterName=string_4, value=item_1_id_2)
string_5 = StringInput("Clash Name")
item_2_id_2 = CodeBlock(a=python_script) { a[6]; }
setParameterByName_5 = Element.SetParameterByName(element=byPoints, parameterName=string_5, value=item_2_id_2)
