# Dynamo graph V!.dyn (Dynamo 2.5.0.7460)
# packages: bimorphNodes 3.0.3

select_model_elements = DSModelElementsSelection()  # 10 picked in the model
select_model_elements_2 = DSModelElementsSelection()  # 382 picked in the model
intersectsElement = Revit.Element.IntersectsElement(elementSetA=select_model_elements, elementSetB=select_model_elements_2)
floor = CodeBlock(a=intersectsElement.intersectsWith) { a; }
void = CodeBlock(a=intersectsElement.Element) { a; }
python_script = Python(IN[0]=floor, IN[1]=void)
# ---------- python_script.python (16 lines) ----------
# Load the Python Standard and DesignScript Libraries
import sys
import clr
clr.AddReference('ProtoGeometry')
from Autodesk.DesignScript.Geometry import *

# The inputs to this node will be stored as a list in the IN variables.
floors=IN[0]
inters=IN[1]
final=[]

for ind, i in enumerate(floors):
	l=len(inters[ind])
	x=[i]*l
	final.append(x)
OUT=final
# ----------------------------------------
flatten = List.Flatten(list=python_script)
solids = Element.Solids(element=void)
byGeometry = BoundingBox.ByGeometry(geom=solids)
toCuboid = BoundingBox.ToCuboid(boundingBox=byGeometry)
name = Element.Name(element=void)
code_block = CodeBlock { "Rectangular"; }
contains = String.Contains(str=name, searchFor=code_block)
filterByBoolMask = List.FilterByBoolMask(list=toCuboid, mask=contains)
filterByBoolMask_2 = List.FilterByBoolMask(list=python_script, mask=contains)
byFace = FamilyInstance.ByFace()  # unwired: familyType, face, location, referenceDirection
code_block_2 = CodeBlock { "B6_Length"; "B6_Width"; "B6_Diameter"; }
getParameterValueByName = Element.GetParameterValueByName(element=void, parameterName=code_block_2.out0)
getParameterValueByName_2 = Element.GetParameterValueByName(element=void, parameterName=code_block_2.out1)
getParameterValueByName_3 = Element.GetParameterValueByName(element=void, parameterName=code_block_2.out2)
