# Dynamo graph V3.dyn (Dynamo 2.5.0.7460)
# packages: bimorphNodes 3.0.3, Rhythm 2020.1.22, Sastrugi 2.0.0, Chynamo 0.8.5, Orchid 203.3.0.7815, Clockwork for Dynamo 2.x 2.3.0, Modelical 2.2.19

select_model_elements = DSModelElementsSelection()  # 10 picked in the model
select_model_elements_2 = DSModelElementsSelection()  # 381 picked in the model
intersectsElement = Revit.Element.IntersectsElement(elementSetA=select_model_elements, elementSetB=select_model_elements_2)
floor = CodeBlock(a=intersectsElement.intersectsWith) { a; }
void = CodeBlock(a=intersectsElement.Element) { a; }
python_script = Python(IN[0]=floor, IN[1]=void)
# ---------- python_script.python (16 lines) ----------
# Load the Python Standard and DesignScript Libraries
import sys
import clr
clr.AddReference('ProtoGeometry')
from Autodesk.DesignScript.Geometry import *

# The inputs to this node will be stored as a list in the IN variables.
floors=IN[0]
inters=IN[1]
final=[]

for ind, i in enumerate(floors):
	l=len(inters[ind])
	x=[i]*l
	final.append(x)
OUT=final
# ----------------------------------------
flatten = List.Flatten(list=python_script)
ʳʰʸᵗʰᵐ_hostobject_topsurface = Rhythm.Revit.Elements.HostObject.TopSurface(hostObject=flatten)
flatten_2 = List.Flatten(list=ʳʰʸᵗʰᵐ_hostobject_topsurface)
surface_plane = Custom[❄_Surface Plane](InputSurfaces=ʳʰʸᵗʰᵐ_hostobject_topsurface)  # package Sastrugi; (Sastrugi_Geometry) This node will extract a plane that best fits a surface.
flatten_3 = List.Flatten(list=surface_plane)  # frozen
solids = Element.Solids(element=void)
flatten_4 = List.Flatten(list=solids)
python_script_2 = Python(IN[0]=surface_plane)
# ---------- python_script_2.python (17 lines) ----------
# Load the Python Standard and DesignScript Libraries
import sys
import clr
clr.AddReference('ProtoGeometry')
from Autodesk.DesignScript.Geometry import *

# The inputs to this node will be stored as a list in the IN variables.
surf=IN[0]
final=[]

for i in surf:
	x=i[0][0]
	if len(x)==1:
		final.append(x[0])
	else:
		final.append(x[0])
OUT=final
# ----------------------------------------
code_block = CodeBlock { -100; }
offset = Plane.Offset(plane=python_script_2, dist=code_block)
intersect = Geometry.Intersect(geometry=flatten_4, other=offset)
perimeterCurves = Surface.PerimeterCurves(surface=intersect@L2)
python_script_3 = Python(IN[0]=perimeterCurves)
# ---------- python_script_3.python (21 lines) ----------
# Load the Python Standard and DesignScript Libraries
import sys
import clr
clr.AddReference('ProtoGeometry')
from Autodesk.DesignScript.Geometry import *

# The inputs to this node will be stored as a list in the IN variables.
curves=IN[0]
final=[]
for i in curves:
	try:
		
		x=i[0]
		if len(x)==8:
			final.append(x[0:4])
		else:
			final.append(x[0])
	except:
		final.append(None)
		
OUT=final
# ----------------------------------------
byJoinedCurves = PolyCurve.ByJoinedCurves(curves=python_script_3)
openingByClosedPolyCurve = Custom[OpeningByClosedPolyCurve](Host=flatten, polycurve=byJoinedCurves)  # package Chynamo; Create openings on host floor from given internal closed polycurve
code_block_2 = CodeBlock(a=openingByClosedPolyCurve.Opening) { a; }
flatten_5 = List.Flatten(list=void)
cutGeometry = Custom[Element.CutGeometry]()  # package Clockwork for Dynamo 2.x; Adds a solid-solid cut for two model elements (if possible).; unwired: elementToBeCut, cuttingElement
python_script_4 = Python(IN[0]=flatten, IN[1]=python_script_3)
# ---------- python_script_4.python (18 lines) ----------
# Load the Python Standard and DesignScript Libraries
import sys
import clr
clr.AddReference('ProtoGeometry')
from Autodesk.DesignScript.Geometry import *

# The inputs to this node will be stored as a list in the IN variables.
floors=IN[0]
curves=IN[1]

final=[]
curvf=[]
for ind, i in enumerate(floors):
	curve=curves[ind]
	if type(curve)!=list:
		curvf.append(curve)
		final.append(i)		
OUT=final, curvf
# ----------------------------------------
code_block_3 = CodeBlock(a=python_script_4) { a[0]; a[1]; }
ZAxis = Vector.ZAxis()
reverse = Vector.Reverse(vector=ZAxis)
code_block_4 = CodeBlock { 150; }
extrudeAsSolid = Curve.ExtrudeAsSolid(curve=code_block_3.out1, direction=reverse, distance=code_block_4)
extrudeAsSolid_2 = Curve.ExtrudeAsSolid(curve=code_block_3.out1, direction=ZAxis, distance=code_block_4)
list_create = List.Create(item0=extrudeAsSolid, item1=extrudeAsSolid_2)
transpose = List.Transpose(lists=list_create)
byUnion = Solid.ByUnion(solids=transpose)
categories = Categories("OST_Mass")
materials = Material("Glass")
python_script_5 = Python(IN[0]=byUnion)
# ---------- python_script_5.python (8 lines) ----------
# Load the Python Standard and DesignScript Libraries
import sys
import clr
clr.AddReference('ProtoGeometry')
from Autodesk.DesignScript.Geometry import *

# The inputs to this node will be stored as a list in the IN variables.
OUT=["Solid"+str(i) for i in range(1,len(IN[0])+1)]
# ----------------------------------------
byGeometry = DirectShape.ByGeometry(geometry=byUnion, category=categories, material=materials, name=python_script_5)
selectInRevit = Custom[SelectInRevit](ElemsOrIDs=byGeometry)  # package Modelical; Select elements in Revit by Element or ID
levels = Custom[Levels](element=void)  # package Chynamo; Get the residing and above levels of given element, combined functions from Clockwork and ArchiLab
