# Dynamo graph V1.dyn (Dynamo 2.5.0.7460)
# packages: Genius Loci 2021.5.18, Data-Shapes 2021.2.94, designtech 1.0.8, Orchid 203.3.0.7815

element_types = ElementTypes("DimensionType")
all_elements_of_type = ElementsOfType(element_type=element_types)
code_block = CodeBlock(a=all_elements_of_type) { a[47]; }
dimension_byreferences = Custom[Dimension ByReferences](dimensionType=code_block, lacing=Longest)  # package Genius Loci; Creates a new linear dimension from at least two geometric references of an object.; unwired: line, references
name = Element.Name(element=all_elements_of_type)
dimensionWithReference = dtRevit.Annotation.DimensionWithReference(lacing=Longest)  # unwired: view, line, references
current = Document.Current()
activeView = Document.ActiveView(document=current)
categories = Categories("OST_PipeFitting")
element_types_2 = ElementTypes("RevitLinkInstance")
all_elements_of_type_2 = ElementsOfType(element_type=element_types_2)
code_block_2 = CodeBlock(a=all_elements_of_type_2) { a[11]; }
selectByCategoryInHostView = Custom[SelectByCategoryInHostView](view=activeView, category=categories, docOrRevitLinkInstance=code_block_2)  # package Genius Loci; Collects the elements of the given document by category and host view (3D view or Plan View). The transform CS is returned only with a LinkInstance input.
code_block_3 = CodeBlock(a=selectByCategoryInHostView.Elements) { a; }
getLocation = Element.GetLocation(element=code_block_3)
X = Point.X(point=getLocation)
Y = Point.Y(point=getLocation)
byCoordinates = Point.ByCoordinates(x=X, y=Y)
all_elements_in_view_s = Custom[All Elements In View(s)](Views=activeView)  # package Data-Shapes; Retrieves all visible element in a view or a set of views
string_from_object = FromObject(obj=all_elements_in_view_s)
code_block_4 = CodeBlock { "Grid"; }
code_block_5 = CodeBlock { true; }
contains = String.Contains(str=string_from_object, searchFor=code_block_4, ignoreCase=code_block_5)
filterByBoolMask = List.FilterByBoolMask(list=all_elements_in_view_s, mask=contains)
code_block_6 = CodeBlock(a=filterByBoolMask.in) { a; }
flatten = List.Flatten(list=code_block_6)
curve = Grid.Curve(grid=flatten)
code_block_7 = CodeBlock { 0; }
tangentAtParameter = Curve.TangentAtParameter(curve=curve, param=code_block_7)
XAxis = Vector.XAxis()
isParallel = Vector.IsParallel(vector=tangentAtParameter, other=XAxis)
filterByBoolMask_2 = List.FilterByBoolMask(list=curve, mask=isParallel)
horiz_curve = CodeBlock(hori=filterByBoolMask_2.in) { hori; }
closestPointTo = Geometry.ClosestPointTo(geometry=horiz_curve, other=getLocation, lacing=CrossProduct)
X_2 = Point.X(point=closestPointTo)
Y_2 = Point.Y(point=closestPointTo)
python_script = Python(IN[0]=X_2, IN[1]=X, IN[2]=Y_2, IN[3]=Y)
# ---------- python_script.python (31 lines) ----------
# Load the Python Standard and DesignScript Libraries
import sys
import clr
clr.AddReference('ProtoGeometry')
from Autodesk.DesignScript.Geometry import *

# The inputs to this node will be stored as a list in the IN variables.
x1=IN[0]
x2=IN[1]
y1=IN[2]
y2=IN[3]
final=[]
fin=[]
import math

for ind, i in enumerate(x1):
	y11=y1[ind]
	sub=[]
	sub_index=[]
	
	for ind1, j in enumerate(i):
		x21=x2[ind1]		
		y21=y2[ind1]	
	
		d=math.sqrt((x21-j)*(x21-j) + (y21- y11[ind1])*(y21- y11[ind1]))	
		sub.append(d)
	final.append(sub)



OUT=final
# ----------------------------------------
transpose = List.Transpose(lists=python_script)
python_script_2 = Python(IN[0]=transpose)
# ---------- python_script_2.python (15 lines) ----------
# Load the Python Standard and DesignScript Libraries
import sys
import clr
clr.AddReference('ProtoGeometry')
from Autodesk.DesignScript.Geometry import *

# The inputs to this node will be stored as a list in the IN variables.
d=IN[0]
final=[]
for i in d:
	Min=min(i)
	ind=i.index(Min)
	final.append(ind)
	
OUT=final
# ----------------------------------------
python_script_3 = Python(IN[0]=closestPointTo, IN[1]=python_script_2)
# ---------- python_script_3.python (26 lines) ----------
# Load the Python Standard and DesignScript Libraries
import sys
import clr
clr.AddReference('ProtoGeometry')
from Autodesk.DesignScript.Geometry import *

# The inputs to this node will be stored as a list in the IN variables.
index1=IN[1]
points=IN[0]
points0=points[0]
points1=points[1]	
points2=points[2]
points3=points[3]
final=[]
for ind, i in enumerate(index1):
	if i==0:
		final.append(points0[ind])	
	if i==1:
		final.append(points1[ind])
	if i==2:
		final.append(points2[ind])
	if i==3:
		final.append(points3[ind])
OUT=final		

	
# ----------------------------------------
byStartPointEndPoint = Line.ByStartPointEndPoint(startPoint=byCoordinates, endPoint=python_script_3)
XAxis_2 = Vector.XAxis()
code_block_8 = CodeBlock { 300; }
translate = Geometry.Translate(geometry=byStartPointEndPoint, direction=XAxis_2, distance=code_block_8)
vertical_curve = CodeBlock(vert=filterByBoolMask_2.out) { vert; }
closestPointTo_2 = Geometry.ClosestPointTo(geometry=vertical_curve, other=getLocation, lacing=CrossProduct)
X_3 = Point.X(point=closestPointTo_2)
Y_3 = Point.Y(point=closestPointTo_2)
python_script_4 = Python(IN[0]=X_3, IN[1]=X, IN[2]=Y_3, IN[3]=Y)  # same code as python_script
transpose_2 = List.Transpose(lists=python_script_4)
python_script_5 = Python(IN[0]=transpose_2)  # same code as python_script_2
python_script_6 = Python(IN[0]=closestPointTo_2, IN[1]=python_script_5)  # same code as python_script_3
byStartPointEndPoint_2 = Line.ByStartPointEndPoint(startPoint=byCoordinates, endPoint=python_script_6)
YAxis = Vector.YAxis()
translate_2 = Geometry.Translate(geometry=byStartPointEndPoint_2, direction=YAxis, distance=code_block_8)
join = List.Join(list0=translate, list1=translate_2)
code_block_9 = CodeBlock(a=join) { a[1..10]; }
familyinstance_references = Custom[FamilyInstance References](familyInstance=code_block_3)  # package Genius Loci; Returns all references and references names.
code_block_10 = CodeBlock()
# ---------- code_block_10.designscript (2 lines) ----------
["Center (Left/Right)",
"Center (Front/Back)"];
# ----------------------------------------
indexOf = List.IndexOf(list=familyinstance_references.ReferenceName@L2, element=code_block_10@L2, lacing=Longest)
getItemAtIndex = List.GetItemAtIndex(list=familyinstance_references.Reference@L2, index=indexOf@L2)
transpose_3 = List.Transpose(lists=getItemAtIndex)
code_block_11 = CodeBlock(l=transpose_3) { vert= l[0]; hori=l[1]; }
filterByBoolMask_3 = List.FilterByBoolMask(list=flatten, mask=isParallel)
code_block_12 = CodeBlock(hori=filterByBoolMask_3.in) { hori; }
element_reference = Custom[Element Reference](element=code_block_12)  # package Genius Loci; Gets the reference of a geometric object or a dimension or a reference plane.
python_script_7 = Python(IN[0]=element_reference, IN[1]=python_script_5)
# ---------- python_script_7.python (20 lines) ----------
# Load the Python Standard and DesignScript Libraries
import sys
import clr
clr.AddReference('ProtoGeometry')
from Autodesk.DesignScript.Geometry import *

# The inputs to this node will be stored as a list in the IN variables.
ref=IN[0]
indexes=IN[1]
final=[]

for ind, i in enumerate(indexes):
	
	final.append(ref[i])



OUT=final		

	
# ----------------------------------------
python_script_8 = Python(IN[0]=code_block_11.hori, IN[1]=python_script_7)
# ---------- python_script_8.python (14 lines) ----------
# Load the Python Standard and DesignScript Libraries
import sys
import clr
clr.AddReference('ProtoGeometry')
from Autodesk.DesignScript.Geometry import *

# The inputs to this node will be stored as a list in the IN variables.
ref1=IN[0]
ref2=IN[1]
final=[]
for ind, i in enumerate(ref1):
	ref2s=ref2[ind]
	final.append([i,ref2s])
OUT=final
# ----------------------------------------
code_block_13 = CodeBlock(vert=filterByBoolMask_3.out) { vert; }
element_reference_2 = Custom[Element Reference](element=code_block_13)
python_script_9 = Python(IN[0]=element_reference_2, IN[1]=python_script_5)  # same code as python_script_7
python_script_10 = Python(IN[0]=code_block_11.vert, IN[1]=python_script_9)  # same code as python_script_8
join_2 = List.Join(list0=python_script_8, list1=python_script_10)
code_block_14 = CodeBlock(a=join_2) { a[1..10]; }
byReference = Orchid.RevitFamily.Dimension.ByReference(view=activeView, line=code_block_9, reference=code_block_14, dimensionType=code_block)
