# Dynamo graph Unfolding Surfaces.dyn (Dynamo 2.5.0.7460)
# packages: Rhythm 2020.1.22, DynamoUnfold 1.0.1, Orchid 203.3.0.7815

select_model_elements = DSModelElementsSelection()  # 26 picked in the model

# group: For other filter
categories = Categories("OST_StructuralFraming")  # frozen
all_elements_of_category = ElementsOfCategory(Category=categories)
code_block = CodeBlock { "Comments"; }
ʳʰʸᵗʰᵐ_elements = Rhythm.Revit.Elements.Elements.GetParameterValueByNameTypeOrInstance(element=select_model_elements, parameterName=code_block)
code_block_2 = CodeBlock { "System H3"; }
python_script = Python(IN[0]=select_model_elements, IN[1]=ʳʰʸᵗʰᵐ_elements, IN[2]=code_block_2)
# ---------- python_script.python (16 lines) ----------
# Load the Python Standard and DesignScript Libraries
import sys
import clr
clr.AddReference('ProtoGeometry')
from Autodesk.DesignScript.Geometry import *

# The inputs to this node will be stored as a list in the IN variables.
elements=IN[0]
comments=IN[1]
helix=IN[2]
final=[]
for ind, i in enumerate(comments):
	if i==helix:
		final.append(elements[ind])
		
OUT=final
# ----------------------------------------

faces = Element.Faces(element=python_script)
area = Surface.Area(surface=faces)
python_script_2 = Python(IN[0]=faces, IN[1]=area)
# ---------- python_script_2.python (18 lines) ----------
# Load the Python Standard and DesignScript Libraries
import sys
import clr
clr.AddReference('ProtoGeometry')
from Autodesk.DesignScript.Geometry import *

# The inputs to this node will be stored as a list in the IN variables.
area=IN[1]
surface=IN[0]
areaf=[]
surfacef=[]
for ind, i in enumerate(area):
	surf=surface[ind]
	lst1,lst2=(list(t) for t in zip(*sorted(zip(i,surf))))
	areaf.append(lst1)
	surfacef.append(lst2)
	
OUT=surfacef, areaf
# ----------------------------------------
code_block_3 = CodeBlock(a=python_script_2) { a[0]; }
python_script_3 = Python(IN[0]=code_block_3)
# ---------- python_script_3.python (12 lines) ----------
# Load the Python Standard and DesignScript Libraries
import sys
import clr
clr.AddReference('ProtoGeometry')
from Autodesk.DesignScript.Geometry import *

def func1(A):
	return [A[-1]]
	
final=list(map(func1, IN[0]))

OUT=final
# ----------------------------------------
tesselateSurfaces = DynamoUnfold.Unfolding._TesselateSurfaces(surfaces=python_script_3)
unfoldListOfSurfaces = DynamoUnfold.Unfolding.UnfoldListOfSurfaces(surfaces=tesselateSurfaces)
python_script_4 = Python(IN[0]=unfoldListOfSurfaces)
# ---------- python_script_4.python (13 lines) ----------
# Load the Python Standard and DesignScript Libraries
import sys
import clr
clr.AddReference('ProtoGeometry')
from Autodesk.DesignScript.Geometry import *

# The inputs to this node will be stored as a list in the IN variables.
surfaces=IN[0]
final=[]
for i in surfaces:
	final.append(i[0])
	
OUT=final
# ----------------------------------------
byJoinedSurfaces = PolySurface.ByJoinedSurfaces(surfaces=python_script_4)
flatten = List.Flatten(list=byJoinedSurfaces)
code_block_4 = CodeBlock { 5; }
thicken = Surface.Thicken(surface=flatten, thickness=code_block_4)
categories_2 = Categories("OST_GenericModel")
materials = Material("Concrete")
python_script_5 = Python(IN[0]=unfoldListOfSurfaces)
# ---------- python_script_5.python (8 lines) ----------
# Load the Python Standard and DesignScript Libraries
import sys
import clr
clr.AddReference('ProtoGeometry')
from Autodesk.DesignScript.Geometry import *

# The inputs to this node will be stored as a list in the IN variables.
OUT=["Surface"+str(ind) for ind in range(1, len(IN[0])+1)]
# ----------------------------------------
byGeometry = DirectShape.ByGeometry(geometry=thicken, category=categories_2, material=materials, name=python_script_5)
code_block_5 = CodeBlock { "Comments"; }

# group: Area Veification
area_2 = Surface.Area(surface=unfoldListOfSurfaces)
python_script_6 = Python(IN[0]=area_2)
# ---------- python_script_6.python (15 lines) ----------
# Load the Python Standard and DesignScript Libraries
import sys
import clr
clr.AddReference('ProtoGeometry')
from Autodesk.DesignScript.Geometry import *

# The inputs to this node will be stored as a list in the IN variables.
area=IN[0]

areaf=[]

for i in area:
	s=sum(i[0])
	areaf.append(s)
OUT=areaf
# ----------------------------------------

python_script_7 = Python(IN[0]=python_script_6)
# ---------- python_script_7.python (8 lines) ----------
# Load the Python Standard and DesignScript Libraries
import sys
import clr
clr.AddReference('ProtoGeometry')
from Autodesk.DesignScript.Geometry import *

# The inputs to this node will be stored as a list in the IN variables.
OUT=[str(round(i,2)) for i in IN[0]]
# ----------------------------------------
ʳʰʸᵗʰᵐ_elements_2 = Rhythm.Revit.Elements.Elements.SetParameterByNameTypeOrInstance(element=byGeometry, parameterName=code_block_5, value=python_script_7)
code_block_6 = CodeBlock { "Mark"; }
flatten_2 = List.Flatten(list=python_script_3)
edges = Topology.Edges(topology=flatten_2)
curveGeometry = Edge.CurveGeometry(edge=edges)
length = Curve.Length(curve=curveGeometry)
python_script_8 = Python(IN[0]=length)
# ---------- python_script_8.python (22 lines) ----------
# Load the Python Standard and DesignScript Libraries
import sys
import clr
clr.AddReference('ProtoGeometry')
from Autodesk.DesignScript.Geometry import *

# The inputs to this node will be stored as a list in the IN variables.
final=[]
length=IN[0]
rounded=[]
for i in length:
	sub=[]	
	for j in i:
		x=round(j,2)
		sub.append(str(x))
	rounded.append(sub)

for i in rounded:
	x="+".join(i)
	final.append(x)
	
OUT=final
# ----------------------------------------
ʳʰʸᵗʰᵐ_elements_3 = Rhythm.Revit.Elements.Elements.SetParameterByNameTypeOrInstance(element=byGeometry, parameterName=code_block_6, value=python_script_8)
