# Dynamo graph V1.dyn (Dynamo 2.5.0.7460)
# packages: Rhythm 2020.1.22, Modelical 2.2.19, Orchid 203.3.0.7815, DynamoUnfold 1.0.1

categories = Categories("OST_StructuralFraming")
all_elements_of_category = ElementsOfCategory(Category=categories)
code_block = CodeBlock { "Comments"; }
ʳʰʸᵗʰᵐ_elements = Rhythm.Revit.Elements.Elements.GetParameterValueByNameTypeOrInstance(element=all_elements_of_category, parameterName=code_block)
code_block_2 = CodeBlock { "Helix Ramp Beams"; }
python_script = Python(IN[0]=all_elements_of_category, IN[1]=ʳʰʸᵗʰᵐ_elements, IN[2]=code_block_2)
# ---------- python_script.python (16 lines) ----------
# Load the Python Standard and DesignScript Libraries
import sys
import clr
clr.AddReference('ProtoGeometry')
from Autodesk.DesignScript.Geometry import *

# The inputs to this node will be stored as a list in the IN variables.
elements=IN[0]
comments=IN[1]
helix=IN[2]
final=[]
for ind, i in enumerate(comments):
	if i==helix:
		final.append(elements[ind])
		
OUT=final
# ----------------------------------------
selectInRevit = Custom[SelectInRevit](ElemsOrIDs=python_script)  # frozen; package Modelical; Select elements in Revit by Element or ID
faces = Element.Faces(element=python_script)
python_script_2 = Python(IN[0]=faces)
# ---------- python_script_2.python (13 lines) ----------
# Load the Python Standard and DesignScript Libraries
import sys
import clr
clr.AddReference('ProtoGeometry')
from Autodesk.DesignScript.Geometry import *

# The inputs to this node will be stored as a list in the IN variables.
surf=[i for i in IN[0] if len(i)==6]
index=[ind for ind, i in enumerate(IN[0]) if len(i)==6]
surf2=[i for i in IN[0] if len(i)>6]
index2=[ind for ind, i in enumerate(IN[0]) if len(i)>6]

OUT=index, surf, index2, surf2
# ----------------------------------------
code_block_3 = CodeBlock(a=python_script_2) { a[1]; }
area = Surface.Area(surface=code_block_3)
python_script_3 = Python(IN[0]=code_block_3, IN[1]=area)
# ---------- python_script_3.python (18 lines) ----------
# Load the Python Standard and DesignScript Libraries
import sys
import clr
clr.AddReference('ProtoGeometry')
from Autodesk.DesignScript.Geometry import *

# The inputs to this node will be stored as a list in the IN variables.
area=IN[1]
surface=IN[0]
areaf=[]
surfacef=[]
for ind, i in enumerate(area):
	surf=surface[ind]
	lst1,lst2=(list(t) for t in zip(*sorted(zip(i,surf))))
	areaf.append(lst1)
	surfacef.append(lst2)
	
OUT=surfacef, areaf
# ----------------------------------------
code_block_4 = CodeBlock(a=python_script_3) { a[1]; }
code_block_5 = CodeBlock(a=python_script_2) { a[0]; }
getItemAtIndex = List.GetItemAtIndex(list=python_script, index=code_block_5)
code_block_6 = CodeBlock(a=python_script_3) { a[0]; }

# group: Both the surface
python_script_4 = Python(IN[0]=code_block_6)  # frozen
# ---------- python_script_4.python (12 lines) ----------
# Load the Python Standard and DesignScript Libraries
import sys
import clr
clr.AddReference('ProtoGeometry')
from Autodesk.DesignScript.Geometry import *

def func1(A):
	return [A[4], A[5]]
	
final=list(map(func1, IN[0]))

OUT=final
# ----------------------------------------

code_block_7 = CodeBlock(a=python_script_2) { a[3]; }
code_block_8 = CodeBlock(a=python_script_2) { a[2]; }
getItemAtIndex_2 = List.GetItemAtIndex(list=faces, index=code_block_8)
code_block_9 = CodeBlock(a=python_script_2) { a[2]; }
getItemAtIndex_3 = List.GetItemAtIndex(list=python_script, index=code_block_9)
python_script_5 = Python(IN[0]=code_block_6)
# ---------- python_script_5.python (12 lines) ----------
# Load the Python Standard and DesignScript Libraries
import sys
import clr
clr.AddReference('ProtoGeometry')
from Autodesk.DesignScript.Geometry import *

def func1(A):
	return [A[5]]
	
final=list(map(func1, IN[0]))

OUT=final
# ----------------------------------------
flatten = List.Flatten(list=python_script_5)  # frozen
edges = Topology.Edges(topology=flatten)
curveGeometry = Edge.CurveGeometry(edge=edges)

# group: Curve and Tangent
python_script_6 = Python(IN[0]=curveGeometry)
# ---------- python_script_6.python (12 lines) ----------
# Load the Python Standard and DesignScript Libraries
import sys
import clr
clr.AddReference('ProtoGeometry')
from Autodesk.DesignScript.Geometry import *

def func1(A):
	return [A[1]]
	
final=list(map(func1, IN[0]))

OUT=final
# ----------------------------------------
flatten_2 = List.Flatten(list=python_script_6)
code_block_10 = CodeBlock { 0; }
tangentAtParameter = Curve.TangentAtParameter(curve=flatten_2, param=code_block_10)

startPoint = Curve.StartPoint(curve=flatten_2)
length = Curve.Length(curve=curveGeometry)
python_script_7 = Python(IN[0]=length)  # same code as python_script_6
flatten_3 = List.Flatten(list=python_script_7)
byStartPointDirectionLength = Line.ByStartPointDirectionLength(startPoint=startPoint, direction=tangentAtParameter, length=flatten_3)
endPoint = Curve.EndPoint(curve=byStartPointDirectionLength)
ZAxis = Vector.ZAxis()
python_script_8 = Python(IN[0]=length)
# ---------- python_script_8.python (12 lines) ----------
# Load the Python Standard and DesignScript Libraries
import sys
import clr
clr.AddReference('ProtoGeometry')
from Autodesk.DesignScript.Geometry import *

def func1(A):
	return [A[0]]
	
final=list(map(func1, IN[0]))

OUT=final
# ----------------------------------------
flatten_4 = List.Flatten(list=python_script_8)
byStartPointDirectionLength_2 = Line.ByStartPointDirectionLength(startPoint=endPoint, direction=ZAxis, length=flatten_4)
endPoint_2 = Curve.EndPoint(curve=byStartPointDirectionLength_2)
reverse = Vector.Reverse(vector=tangentAtParameter)
python_script_9 = Python(IN[0]=length)
# ---------- python_script_9.python (12 lines) ----------
# Load the Python Standard and DesignScript Libraries
import sys
import clr
clr.AddReference('ProtoGeometry')
from Autodesk.DesignScript.Geometry import *

def func1(A):
	return [A[3]]
	
final=list(map(func1, IN[0]))

OUT=final
# ----------------------------------------
flatten_5 = List.Flatten(list=python_script_9)
byStartPointDirectionLength_3 = Line.ByStartPointDirectionLength(startPoint=endPoint_2, direction=reverse, length=flatten_5)
endPoint_3 = Curve.EndPoint(curve=byStartPointDirectionLength_3)
reverse_2 = Vector.Reverse(vector=ZAxis)
python_script_10 = Python(IN[0]=length)
# ---------- python_script_10.python (12 lines) ----------
# Load the Python Standard and DesignScript Libraries
import sys
import clr
clr.AddReference('ProtoGeometry')
from Autodesk.DesignScript.Geometry import *

def func1(A):
	return [A[2]]
	
final=list(map(func1, IN[0]))

OUT=final
# ----------------------------------------
flatten_6 = List.Flatten(list=python_script_10)
byStartPointDirectionLength_4 = Line.ByStartPointDirectionLength(startPoint=endPoint_3, direction=reverse_2, length=flatten_6)
python_script_11 = Python(IN[0]=byStartPointDirectionLength, IN[1]=byStartPointDirectionLength_2, IN[2]=byStartPointDirectionLength_3, IN[3]=byStartPointDirectionLength_4)
# ---------- python_script_11.python (8 lines) ----------
# Load the Python Standard and DesignScript Libraries
import sys
import clr
clr.AddReference('ProtoGeometry')
from Autodesk.DesignScript.Geometry import *

# The inputs to this node will be stored as a list in the IN variables.
OUT=[[i, IN[1][ind], IN[2][ind], IN[3][ind]] for ind, i  in enumerate(IN[0])]
# ----------------------------------------
byJoinedCurves = PolyCurve.ByJoinedCurves(curves=python_script_11)

# group: Creat Surface
closeWithLine = PolyCurve.CloseWithLine(polyCurve=byJoinedCurves)
byPatch = Surface.ByPatch(closedCurve=closeWithLine)  # frozen
clean = Orchid.Common.List.Clean(list=byPatch)

isClosed = Curve.IsClosed(curve=byJoinedCurves)
filterByBoolMask = List.FilterByBoolMask(list=python_script_11, mask=isClosed)
code_block_11 = CodeBlock(a=filterByBoolMask.out) { a; }
byJoinedCurves_2 = PolyCurve.ByJoinedCurves(curves=code_block_11)
closeWithLine_2 = PolyCurve.CloseWithLine(polyCurve=byJoinedCurves_2)
unfoldListOfSurfaces = DynamoUnfold.Unfolding.UnfoldListOfSurfaces()  # frozen; unwired: surfaces
tesselateSurfaces = DynamoUnfold.Unfolding._TesselateSurfaces(surfaces=python_script_5)
unfoldListOfSurfaces_AndReturnTransforms = DynamoUnfold.Unfolding.UnfoldListOfSurfaces_AndReturnTransforms(surfaces=tesselateSurfaces)
map = List.Map(list=python_script_5, f_x=unfoldListOfSurfaces_AndReturnTransforms.surfaces)
perimeterCurves = Surface.PerimeterCurves(surface=map)
map_2 = List.Map(list=python_script_5, f_x=unfoldListOfSurfaces_AndReturnTransforms.unfoldingObject)
mergeUnfoldingObjects = DynamoUnfold.Unfolding.MergeUnfoldingObjects(unfoldings=map_2)
code_block_12 = CodeBlock { 0.5; }
generateUnfoldedLabels = DynamoUnfold.Unfolding.GenerateUnfoldedLabels(unfoldingObject=mergeUnfoldingObjects, labelScale=code_block_12)
