# Dynamo graph 3IM_DYN_PLACING GOLE DRAFT.dyn (Dynamo 2.5.0.7460)
# packages: bimorphNodes 3.0.3, Clockwork for Dynamo 2.x 2.3.0

# group: EXTRACT DAVANZALI
categories = Categories("OST_Floors")
all_elements_of_category = ElementsOfCategory(Category=categories)
string = StringInput("Type")
getParameterValueByName = Element.GetParameterValueByName(element=all_elements_of_category, parameterName=string)
string_from_object = FromObject(obj=getParameterValueByName)
string_2 = StringInput("WD-01")
contains = String.Contains(str=string_from_object, searchFor=string_2)
filterByBoolMask = List.FilterByBoolMask(list=all_elements_of_category, mask=contains)

# group: EXTRACT VERTEX FROM PARTS
geometry = Element.Geometry(element=filterByBoolMask.in)

vertices = Topology.Vertices(topology=geometry)
pointGeometry = Vertex.PointGeometry(vertex=vertices)
Z = Point.Z(point=pointGeometry)
python_script = Python(IN[0]=Z)
# ---------- python_script.python (18 lines) ----------
# Load the Python Standard and DesignScript Libraries
import sys
import clr
clr.AddReference('ProtoGeometry')
from Autodesk.DesignScript.Geometry import *

# The inputs to this node will be stored as a list in the IN variables.
final=[]
for i in IN[0]:
	Min=min(i[0])
	Min1=round(Min,4)
	sub=[]
	for ind1, j in enumerate(i[0]):
		j1=round(j,4)
		if j1==Min1:
			sub.append(ind1)
	final.append(sub)
OUT=final
# ----------------------------------------
getItemAtIndex = List.GetItemAtIndex(list=vertices@L2, index=python_script@L2)
python_script_2 = Python(IN[0]=getItemAtIndex)
# ---------- python_script_2.python (10 lines) ----------
# Load the Python Standard and DesignScript Libraries
import sys
import clr
clr.AddReference('ProtoGeometry')
from Autodesk.DesignScript.Geometry import *

# The inputs to this node will be stored as a list in the IN variables.
def func1(A):
	return [A[3]]
OUT=list(map(func1, IN[0]))
# ----------------------------------------
flatten = List.Flatten(list=python_script_2)
adjacentEdges = Vertex.AdjacentEdges(vertex=flatten)
curveGeometry = Edge.CurveGeometry(edge=adjacentEdges)
length = Curve.Length(curve=curveGeometry)

# group: Point of placement
python_script_3 = Python(IN[0]=length)
# ---------- python_script_3.python (15 lines) ----------
# Load the Python Standard and DesignScript Libraries
import sys
import clr
clr.AddReference('ProtoGeometry')
from Autodesk.DesignScript.Geometry import *

# The inputs to this node will be stored as a list in the IN variables.
len=IN[0]
final=[]
for i in len:
	Max=max(i)
	ind=i.index(Max)
	final.append(ind)
	
OUT=final
# ----------------------------------------
python_script_4 = Python(IN[0]=curveGeometry, IN[1]=python_script_3)
# ---------- python_script_4.python (15 lines) ----------
# Load the Python Standard and DesignScript Libraries
import sys
import clr
clr.AddReference('ProtoGeometry')
from Autodesk.DesignScript.Geometry import *

# The inputs to this node will be stored as a list in the IN variables.

curves=IN[0]
index=IN[1]
final=[]
for ind, i in enumerate(curves):
	final.append(i[index[ind]])
	
OUT=final
# ----------------------------------------
startPoint = Curve.StartPoint(curve=python_script_4)
flatten_2 = List.Flatten(list=startPoint)
X = Point.X(point=flatten_2)
endPoint = Curve.EndPoint(curve=python_script_4)
flatten_3 = List.Flatten(list=endPoint)
X_2 = Point.X(point=flatten_3)
Y = Point.Y(point=flatten_2)
Y_2 = Point.Y(point=flatten_3)
Z_2 = Point.Z(point=flatten_2)
Z_3 = Point.Z(point=flatten_3)
python_script_5 = Python(IN[0]=X, IN[1]=X_2, IN[2]=Y, IN[3]=Y_2, IN[4]=Z_2, IN[5]=Z_3)
# ---------- python_script_5.python (33 lines) ----------
# Load the Python Standard and DesignScript Libraries
import sys
import clr
clr.AddReference('ProtoGeometry')
from Autodesk.DesignScript.Geometry import *

# The inputs to this node will be stored as a list in the IN variables.
x1=IN[0]
x2=IN[1]
y1=IN[2]
y2=IN[3]
z1=IN[4]
z2=IN[5]
x=[]
y=[]
z=[]
for ind, i in enumerate(x1):
	
	x21=x2[ind]
	y11=y1[ind]
	y21=y2[ind]
	z11=z1[ind]
	z21=z2[ind]
	
	xn=(i+x21)/2
	yn=(y11+y21)/2
	zn=(z11+z21)/2

	x.append(xn)
	y.append(yn)
	z.append(zn)
OUT=x,y,z
	
# ----------------------------------------
code_block = CodeBlock(a=python_script_5) { a[0]; }
code_block_2 = CodeBlock(a=python_script_5) { a[1]; }
code_block_3 = CodeBlock(a=python_script_5) { a[2]; }
byCoordinates = Point.ByCoordinates(x=code_block, y=code_block_2, z=code_block_3)

length_2 = Curve.Length(curve=python_script_4)

# group: PLACING FAMILY ON POINT
family_types = FamilyTypes("3IM_FUR_Profilo Gola Davanzale:3IM_FUR_Profilo Gola Davanzale")
byPoint = FamilyInstance.ByPoint(familyType=family_types, point=byCoordinates)
string_3 = StringInput("Lunghezza Profilo Gola")
setParameterByName = Element.SetParameterByName(element=byPoint, parameterName=string_3, value=length_2)

solids = Revit.LinkElement.Solids(linkElement=setParameterByName)
byUnion = Solid.ByUnion(solids=solids)
code_block_4 = CodeBlock { 0; }
tangentAtParameter = Curve.TangentAtParameter(curve=python_script_4, param=code_block_4)

# group: Orientation of Placed Families
vertices_2 = Topology.Vertices(topology=byUnion)
pointGeometry_2 = Vertex.PointGeometry(vertex=vertices_2)
Z_4 = Point.Z(point=pointGeometry_2)
python_script_6 = Python(IN[0]=Z_4)
# ---------- python_script_6.python (18 lines) ----------
# Load the Python Standard and DesignScript Libraries
import sys
import clr
clr.AddReference('ProtoGeometry')
from Autodesk.DesignScript.Geometry import *

# The inputs to this node will be stored as a list in the IN variables.
final=[]
for i in IN[0]:
	Min=min(i)
	Min1=round(Min,4)
	sub=[]
	for ind1, j in enumerate(i):
		j1=round(j,4)
		if j1==Min1:
			sub.append(ind1)
	final.append(sub)
OUT=final
# ----------------------------------------
getItemAtIndex_2 = List.GetItemAtIndex(list=vertices_2@L2, index=python_script_6@L2)
python_script_7 = Python(IN[0]=getItemAtIndex_2)  # same code as python_script_2
flatten_4 = List.Flatten(list=python_script_7)
adjacentEdges_2 = Vertex.AdjacentEdges(vertex=flatten_4)
curveGeometry_2 = Edge.CurveGeometry(edge=adjacentEdges_2)
length_3 = Curve.Length(curve=curveGeometry_2)
python_script_8 = Python(IN[0]=length_3)  # same code as python_script_3
python_script_9 = Python(IN[0]=curveGeometry_2, IN[1]=python_script_8)  # same code as python_script_4
code_block_5 = CodeBlock { 0; }
tangentAtParameter_2 = Curve.TangentAtParameter(curve=python_script_9, param=code_block_5)
ZAxis = Vector.ZAxis()
angleAboutAxis = Vector.AngleAboutAxis(vector=tangentAtParameter_2, otherVector=tangentAtParameter, rotationAxis=ZAxis)

# group: Orienation Verification in Dynamo before element rotation
centroid = Solid.Centroid(solid=byUnion)  # frozen
ZAxis_2 = Vector.ZAxis()
rotate = Geometry.Rotate(geometry=solids, origin=centroid, axis=ZAxis_2, degrees=angleAboutAxis)  # frozen

startPoint_2 = Curve.StartPoint(curve=python_script_4)
code_block_6 = CodeBlock(a=angleAboutAxis) { -a; }
setRotation = FamilyInstance.SetRotation(familyInstance=setParameterByName, degree=code_block_6)

# group: To Confirm final Orienation
solids_2 = Element.Solids(element=setRotation)  # frozen

# group: EXTRACT Walls
categories_2 = Categories("OST_Walls")
all_elements_of_category_2 = ElementsOfCategory(Category=categories_2)
string_4 = StringInput("Type")
getParameterValueByName_2 = Element.GetParameterValueByName(element=all_elements_of_category_2, parameterName=string_4)
string_from_object_2 = FromObject(obj=getParameterValueByName_2)
string_5 = StringInput("L2-N_PAR_160mm")
contains_2 = String.Contains(str=string_from_object_2, searchFor=string_5)
filterByBoolMask_2 = List.FilterByBoolMask(list=all_elements_of_category_2, mask=contains_2)
code_block_7 = CodeBlock(a=filterByBoolMask_2.in) { a; }

# group: EXTRACT Walls
string_6 = StringInput("Type")
getParameterValueByName_3 = Element.GetParameterValueByName(element=all_elements_of_category_2, parameterName=string_6)
string_from_object_3 = FromObject(obj=getParameterValueByName_3)
string_7 = StringInput("L2-X_PAR_52mm")
contains_3 = String.Contains(str=string_from_object_3, searchFor=string_7)
filterByBoolMask_3 = List.FilterByBoolMask(list=all_elements_of_category_2, mask=contains_3)
code_block_8 = CodeBlock(a=filterByBoolMask_3.in) { a; }

list_create = List.Create(item0=code_block_7, item1=code_block_8)
flatten_5 = List.Flatten(list=list_create)
intersectsElement = Revit.Element.IntersectsElement(elementSetA=setRotation, elementSetB=flatten_5)
flatten_6 = List.Flatten(list=intersectsElement.Element)
flatten_7 = List.Flatten(list=intersectsElement.intersectsWith)
cutGeometry = Custom[Element.CutGeometry](elementToBeCut=flatten_6, cuttingElement=flatten_7)  # package Clockwork for Dynamo 2.x; Adds a solid-solid cut for two model elements (if possible).
