# Dynamo graph 1. Duplication of Sheets.dyn (Dynamo 2.5.0.7460)
# packages: Genius Loci 2021.5.18, spring nodes 204.1.0, archi-lab.net 2021.25.2721, designtech 1.0.8

# group: Input
file_path = Filename(".\Sheet1.xlsx")

# group: Excel Data
file_from_path = FileObject(path=file_path)
code_block = CodeBlock { "Foglio"; }
boolean = BoolSelector(true)
boolean_2 = BoolSelector(false)
importExcel = Data.ImportExcel(file=file_from_path, sheetName=code_block, readAsStrings=boolean, showExcel=boolean_2)  # frozen
restOfItems = List.RestOfItems(list=importExcel)
transpose = List.Transpose(lists=restOfItems)

# group: Sheet Name
code_block_2 = CodeBlock { 1; }
getItemAtIndex = List.GetItemAtIndex(list=transpose, index=code_block_2)

# group: Sheet Number
code_block_3 = CodeBlock { 0; }
getItemAtIndex_2 = List.GetItemAtIndex(list=transpose, index=code_block_3)

# group: Sheet type
family_types = FamilyTypes("_B6_ANO_Elevation Mark Pointer (Interior Round):1/2\" Circle - Demolition")

# group: Create Sheets
create_sheet = Custom[Create Sheet](SheetName=getItemAtIndex, SheetNumber=getItemAtIndex_2, TitleBlock=family_types)  # package Genius Loci; Creates new sheets.

# group: Sheets arrangement w.r.t viewport
list_create = List.Create(item0=create_sheet.Sheets, item1=create_sheet.Sheets, item2=create_sheet.Sheets)
flatten = List.Flatten(list=list_create)
python_script = Python(IN[0]=flatten, IN[1]=create_sheet.Sheets)
# ---------- python_script.python (53 lines) ----------
import clr #This is .NET's Common Language Runtime. It's an execution environment
#that is able to execute code from several different languages.
import sys #sys is a fundamental Python library - here, we're using it to load in
#the standard IronPython libraries
sys.path.append('C:\Program Files (x86)\IronPython 2.7\Lib') #Imports the
#standard IronPython libraries, which cover everything from servers and
#encryption through to regular expressions.
import System #The System namespace at the root of .NET
from System import Array #.NET class for handling array information
from System.Collections.Generic import * #Lets you handle generics. Revit's API
#sometimes wants hard-typed 'generic' lists, called ILists. If you don't need
#these you can delete this line.
clr.AddReference('ProtoGeometry')  #A Dynamo library for its proxy geometry
#classes. You'll only need this if you're interacting with geometry.
from Autodesk.DesignScript.Geometry import * #Loads everything in Dynamo's
#geometry library
clr.AddReference("RevitNodes") #Dynamo's nodes for Revit
import Revit #Loads in the Revit namespace in RevitNodes
clr.ImportExtensions(Revit.Elements) #More loading of Dynamo's Revit libraries
clr.ImportExtensions(Revit.GeometryConversion) #More loading of Dynamo's
#Revit libraries. You'll only need this if you're interacting with geometry.
clr.AddReference("RevitServices") #Dynamo's classes for handling Revit documents
import RevitServices 
from RevitServices.Persistence import DocumentManager #An internal Dynamo class
#that keeps track of the document that Dynamo is currently attached to
from RevitServices.Transactions import TransactionManager #A Dynamo class for
#opening and closing transactions to change the Revit document's database

clr.AddReference("RevitAPI") #Adding reference to Revit's API DLLs
clr.AddReference("RevitAPIUI") #Adding reference to Revit's API DLLs

import Autodesk #Loads the Autodesk namespace
from Autodesk.Revit.DB import * #Loading Revit's API classes
from Autodesk.Revit.UI import * #Loading Revit's API UI classes  

doc = DocumentManager.Instance.CurrentDBDocument #Finally, setting up handles to the active Revit document
uiapp = DocumentManager.Instance.CurrentUIApplication #Setting a handle to the active Revit UI document
app = uiapp.Application  #Setting a handle to the currently-open instance of the Revit application
uidoc = uiapp.ActiveUIDocument #Setting a handle to the currently-open instance of the Revit UI application

sheets = []
for i in IN[0]:
	sheets.append(UnwrapElement(i))

sheets1=[]
st=[UnwrapElement(i) for i in IN[1]]

for i in st:
	for j in sheets:
		if i==j:
			sheets1.append(j)
		
OUT= sheets1
# ----------------------------------------

categories = Categories("OST_Views")  # frozen

# group: Accessing Views
all_elements_of_category = ElementsOfCategory(Category=categories)
boolean_3 = BoolSelector(false)
clean = List.Clean(list=all_elements_of_category, preserveIndices=boolean_3)
code_block_4 = CodeBlock { "View Name"; }
getParameterValueByName = Element.GetParameterValueByName(element=clean, parameterName=code_block_4)

# group: View Name
code_block_5 = CodeBlock { 2; }
getItemAtIndex_3 = List.GetItemAtIndex(list=transpose, index=code_block_5)

# group: Assigning view names to Views in the view list
indexOf = List.IndexOf(list=getParameterValueByName, element=getItemAtIndex_3@L1)
getItemAtIndex_4 = List.GetItemAtIndex(list=clean, index=indexOf)

# group: Input- Coordinate points
x_y_z_coordinate_of_viewport_on = CodeBlock { x=150..450..150; y=150..450..150; z=0..0..#3; }  # "x,y,z coordinate of viewport on sheets"

# group: Coordinates of viewport
list_create_2 = List.Create(item0=x_y_z_coordinate_of_viewport_on.x, item1=x_y_z_coordinate_of_viewport_on.y, item2=x_y_z_coordinate_of_viewport_on.z)

# group: Creating viewport
viewport = Python(IN[0]=python_script, IN[1]=getItemAtIndex_4, IN[2]=list_create_2, IN[3]=getItemAtIndex, IN[4]=getItemAtIndex_2, IN[5]=getItemAtIndex_3)
# ---------- viewport.python (91 lines) ----------
import clr
clr.AddReference('ProtoGeometry')
from Autodesk.DesignScript.Geometry import *
# Import ToDSType(bool) extension method



##################################################
coor=IN[2]
x_c=coor[0]
y_c=coor[1]
z_c=coor[2]
pts=[]

for x,y,z in zip(x_c, y_c, z_c):
	pt=Point.ByCoordinates(int(x),int(y),int(z))
	pts.append(pt)


def flatten(l):
    flatList = []
    for elem in l:
        # if an element of a list is a list
        # iterate over this list and add elements to flatList 
        if type(elem) == list:
            for e in elem:
                flatList.append(e)
        else:
            flatList.append(elem)
    return flatList
    

###################################################
clr.AddReference("RevitNodes")
import Revit
clr.ImportExtensions(Revit.Elements)
# Import geometry conversion extension methods
clr.ImportExtensions(Revit.GeometryConversion)
# Import DocumentManager and TransactionManager
clr.AddReference("RevitServices")
import RevitServices
from RevitServices.Persistence import DocumentManager
from RevitServices.Transactions import TransactionManager
from System.Collections.Generic import *
# Import RevitAPI
clr.AddReference("RevitAPI")
import Autodesk
from Autodesk.Revit.DB import *

doc = DocumentManager.Instance.CurrentDBDocument
uiapp = DocumentManager.Instance.CurrentUIApplication
app = uiapp.Application
uidoc=DocumentManager.Instance.CurrentUIApplication.ActiveUIDocument


#######################################################


sheets = []
for i in IN[0]:
	sheets.append(UnwrapElement(i))
	
views=[]	
for i in IN[1]:
	views.append(UnwrapElement(i))
	
	
sheet_name_excel=IN[3]
sheet_num_excel= IN[4]
view_name_excel= IN[5]

final_points=[]

if len(view_name_excel)/3 ==3:

	for i in range(len(view_name_excel)/3):
		final_points.append(pts)

point_list=flatten(final_points)


view_ports = []
TransactionManager.Instance.EnsureInTransaction(doc)
for sheet, v,p in zip(sheets, views, point_list):
	viewport = Viewport.Create(doc, sheet.Id, v.Id, p.ToXyz())
	view_ports.append(viewport)

TransactionManager.Instance.TransactionTaskDone()

# Assign your output to the OUT variable.
OUT = view_ports
# ----------------------------------------

code_block_6 = CodeBlock { true; }
ꟿ_document_activeview = Custom[ꟿ Document.ActiveView](refresh=code_block_6)  # package spring nodes; Selects the current document's active view. Supports more view types than the built-in option. Will be depreciated once the bult in node works with all plan types.
views = Views("LEVEL 55 TOWER FOOTPRINT -GA PLAN VIEW")
createReferenceCallout = archilab.Revit.Views.Views.CreateReferenceCallout(lacing=Shortest)  # unwired: view, referenceView, extents
current = dtRevit.View.Current()
select_model_elements = DSModelElementsSelection()  # 21 picked in the model
elementType = Element.ElementType(element=select_model_elements)
python_script_2 = Python(IN[0]=elementType)
# ---------- python_script_2.python (9 lines) ----------
# Load the Python Standard and DesignScript Libraries
import sys
import clr
clr.AddReference('ProtoGeometry')
from Autodesk.DesignScript.Geometry import *

# The inputs to this node will be stored as a list in the IN variables.
call=IN[0]
OUT=[call[7]]*len(IN[0])
# ----------------------------------------
python_script_3 = Python(IN[0]=current, IN[1]=python_script_2)
# ---------- python_script_3.python (9 lines) ----------
# Load the Python Standard and DesignScript Libraries
import sys
import clr
clr.AddReference('ProtoGeometry')
from Autodesk.DesignScript.Geometry import *

# The inputs to this node will be stored as a list in the IN variables.
call=[IN[0]]
OUT=[[call[0]]*len(IN[1])]
# ----------------------------------------
flatten_2 = List.Flatten(list=python_script_3)
views_2 = Views("LEVEL 54 TOWER FOOTPRINT -GA PLAN VIEW")
python_script_4 = Python(IN[0]=views_2, IN[1]=python_script_2)  # same code as python_script_3
flatten_3 = List.Flatten(list=python_script_4)
code_block_7 = CodeBlock(a=current) { a; }
watch = Watch(code_block_7)
type = archilab.Revit.Elements.Elements.Type(element=code_block_7)
views_3 = Views("LEVEL 54 TOWER FOOTPRINT -GA PLAN VIEW")
python_script_5 = Python(IN[0]=select_model_elements, IN[1]=views_3)
# ---------- python_script_5.python (22 lines) ----------
import clr
clr.AddReference('RevitAPI')
from Autodesk.Revit.DB import *

clr.AddReference("RevitNodes")
import Revit
clr.ImportExtensions(Revit.GeometryConversion)

items = UnwrapElement(IN[0])
view = UnwrapElement(IN[1])
elementlist = list()
maxlist = list()
minlist = list()

for item in items:
	try:
		elementlist.append(item.BoundingBox[view])
		maxlist.append(item.BoundingBox[view].Max.ToPoint())
		minlist.append(item.BoundingBox[view].Min.ToPoint())
	except:
		donothing = 1
OUT = elementlist,maxlist,minlist
# ----------------------------------------
code_block_8 = CodeBlock(a=python_script_5) { a[2]; }

# group: Min- Pt1
X = Point.X(point=code_block_8)
Y = Point.Y(point=code_block_8)

levels = Levels("Level 55")
elevation = Level.Elevation(level=levels)
code_block_9 = CodeBlock(a=elevation) { a-6150; }
byCoordinates = Point.ByCoordinates(x=X, y=Y, z=code_block_9)
code_block_10 = CodeBlock(a=python_script_5) { a[1]; }

# group: Max- Pt2
X_2 = Point.X(point=code_block_10)
Y_2 = Point.Y(point=code_block_10)

# group: pt3
code_block_11 = CodeBlock(x=X_2) { x; }
code_block_12 = CodeBlock(y=Y) { y; }

byCoordinates_2 = Point.ByCoordinates(x=code_block_11, y=code_block_12, z=code_block_9)
byCoordinates_3 = Point.ByCoordinates(x=X_2, y=Y_2, z=code_block_9)

# group: pt4
code_block_13 = CodeBlock(x=X) { x; }
code_block_14 = CodeBlock(y=Y_2) { y; }

byCoordinates_4 = Point.ByCoordinates(x=code_block_13, y=code_block_14, z=code_block_9)
byCornerPoints = Rectangle.ByCornerPoints(p1=byCoordinates, p2=byCoordinates_2, p3=byCoordinates_3, p4=byCoordinates_4)
code_block_15 = CodeBlock(a=byCornerPoints) { a[0]; }
createCallout = archilab.Revit.Views.Views.CreateCallout(view=code_block_7, viewFamilyType=type, extents=code_block_15)
select_model_element = DSModelElementSelection()  # 1 picked in the model
geometry = Element.Geometry(element=select_model_element)
levels_2 = Levels("Level 55")
select_model_elements_2 = DSModelElementsSelection()  # 2 picked in the model
views_4 = Views("LEVEL 55 TOWER FOOTPRINT -GA PLAN VIEW")
python_script_6 = Python(IN[0]=select_model_elements_2, IN[1]=views_4)  # same code as python_script_5
code_block_16 = CodeBlock(a=python_script_6) { a[2]; }

# group: Min- Pt1
X_3 = Point.X(point=code_block_16)
Y_3 = Point.Y(point=code_block_16)

byCoordinates_5 = Point.ByCoordinates(x=X_3, y=Y_3)
code_block_17 = CodeBlock(a=python_script_6) { a[1]; }

# group: Max- Pt2
X_4 = Point.X(point=code_block_17)
Y_4 = Point.Y(point=code_block_17)

# group: pt3
code_block_18 = CodeBlock(x=X_4) { x; }
code_block_19 = CodeBlock(y=Y_3) { y; }

byCoordinates_6 = Point.ByCoordinates(x=code_block_18, y=code_block_19)
byCoordinates_7 = Point.ByCoordinates(x=X_4, y=Y_4)

# group: pt4
code_block_20 = CodeBlock(x=X_3) { x; }
code_block_21 = CodeBlock(y=Y_4) { y; }

byCoordinates_8 = Point.ByCoordinates(x=code_block_20, y=code_block_21)
byCornerPoints_2 = Rectangle.ByCornerPoints(p1=byCoordinates_5, p2=byCoordinates_6, p3=byCoordinates_7, p4=byCoordinates_8)
code_block_22 = CodeBlock(a=byCornerPoints_2) { a[0]; }
select_model_element_2 = DSModelElementSelection()  # 1 picked in the model
Z = Point.Z(point=code_block_17)
Z_2 = Point.Z(point=code_block_16)
