# Dynamo graph Room information parameters .dyn "room information parameters" (Dynamo 2.6.1.8786)
# packages: archi-lab.net 2021.25.2621, Clockwork for Dynamo 2.x 2.3.0, Rhythm 2021.4.2

categories = Categories("OST_Rooms")
all_elements_of_category = ElementsOfCategory(Category=categories)
boundaries = Custom[Room.Boundaries](room=all_elements_of_category)  # package archi-lab.net; This node returns all Room bounding curves and elements that generated them (walls, separation lines etc).
code_block = CodeBlock { "Mark"; }
code_block_2 = CodeBlock { "Type Mark"; }
ʳʰʸᵗʰᵐ_elements = Rhythm.Revit.Elements.Elements.GetParameterValueByNameTypeOrInstance(element=boundaries.element@L2, parameterName=code_block_2)
setParameterByName = Element.SetParameterByName(element=boundaries.element, parameterName=code_block, value=ʳʰʸᵗʰᵐ_elements)
getParameterValueByName = Element.GetParameterValueByName(element=setParameterByName, parameterName=code_block)
python_script = Python(IN[0]=getParameterValueByName)
# ---------- python_script.python (105 lines) ----------
import clr #This is .NET's Common Language Runtime. It's an execution environment
#that is able to execute code from several different languages.
import sys #sys is a fundamental Python library - here, we're using it to load in
#the standard IronPython libraries
sys.path.append('C:\Program Files (x86)\IronPython 2.7\Lib') #Imports the
#standard IronPython libraries, which cover everything from servers and
#encryption through to regular expressions.
import System #The System namespace at the root of .NET
from System import Array #.NET class for handling array information
from System.Collections.Generic import * #Lets you handle generics. Revit's API
#sometimes wants hard-typed 'generic' lists, called ILists. If you don't need
#these you can delete this line.
clr.AddReference('ProtoGeometry')  #A Dynamo library for its proxy geometry
#classes. You'll only need this if you're interacting with geometry.
from Autodesk.DesignScript.Geometry import * #Loads everything in Dynamo's
#geometry library
clr.AddReference("RevitNodes") #Dynamo's nodes for Revit
import Revit #Loads in the Revit namespace in RevitNodes
clr.ImportExtensions(Revit.Elements) #More loading of Dynamo's Revit libraries
clr.ImportExtensions(Revit.GeometryConversion) #More loading of Dynamo's
#Revit libraries. You'll only need this if you're interacting with geometry.
clr.AddReference("RevitServices") #Dynamo's classes for handling Revit documents
import RevitServices 
from RevitServices.Persistence import DocumentManager #An internal Dynamo class
#that keeps track of the document that Dynamo is currently attached to
from RevitServices.Transactions import TransactionManager #A Dynamo class for
#opening and closing transactions to change the Revit document's database

clr.AddReference("RevitAPI") #Adding reference to Revit's API DLLs
clr.AddReference("RevitAPIUI") #Adding reference to Revit's API DLLs

import Autodesk #Loads the Autodesk namespace
from Autodesk.Revit.DB import * #Loading Revit's API classes
from Autodesk.Revit.UI import * #Loading Revit's API UI classes  

doc = DocumentManager.Instance.CurrentDBDocument #Finally, setting up handles to the active Revit document
uiapp = DocumentManager.Instance.CurrentUIApplication #Setting a handle to the active Revit UI document
app = uiapp.Application  #Setting a handle to the currently-open instance of the Revit application
uidoc = uiapp.ActiveUIDocument #Setting a handle to the currently-open instance of the Revit UI application

############# Inputs

names=IN[0]

############ Separating Elements



coll_walls=FilteredElementCollector(doc).OfCategory(BuiltInCategory.OST_Walls).WhereElementIsNotElementType().ToElements()
wall_names=[]
roof_names=[]
floor_names=[]
ceiling_names=[]

for elem in coll_walls:
	DB=elem.GetParameters("Mark")
	for i in DB:
		wall_names.append(i.AsString())

coll_roofs=FilteredElementCollector(doc).OfCategory(BuiltInCategory.OST_Roofs).WhereElementIsNotElementType().ToElements()
for elem in coll_roofs:
	DB=elem.GetParameters("Mark")
	for i in DB:
		roof_names.append(i.AsString())


coll_floors=FilteredElementCollector(doc).OfCategory(BuiltInCategory.OST_Floors).WhereElementIsNotElementType().ToElements()
for elem in coll_floors:
	DB=elem.GetParameters("Mark")
	for i in DB:
		floor_names.append(i.AsString())


coll_ceilings=FilteredElementCollector(doc).OfCategory(BuiltInCategory.OST_Ceilings).WhereElementIsNotElementType().ToElements()
for elem in coll_ceilings:
	DB=elem.GetParameters("Mark")
	for i in DB:
		ceiling_names.append(i.AsString())


roofs1=[]
floors1=[]
ceilings1=[]
walls1=[]
for name in names:
	sub_w=[]
	sub_r=[]
	sub_c=[]
	sub_f=[]
	for sub in name:
		if sub in wall_names:
			sub_w.append(sub)
		elif sub in roof_names:
			sub_r.append(sub)			
		elif sub in ceiling_names:
			sub_c.append(sub)
		elif sub in floor_names:
			sub_f.append(sub)		
		
	walls1.append(set(sub_w))
	roofs1.append(set(sub_r))
	ceilings1.append(set(sub_c))
	floors1.append(set(sub_f))
		
OUT=floors1,  roofs1, ceilings1, walls1
# ----------------------------------------
floors = CodeBlock(a=python_script) { a[0]; }
roofs = CodeBlock(a=python_script) { a[1]; }
ceilings = CodeBlock(a=python_script) { a[2]; }
walls = CodeBlock(a=python_script) { a[3]; }
python_script_2 = Python(IN[0]=floors, IN[1]=roofs, IN[2]=ceilings, IN[3]=walls)
# ---------- python_script_2.python (87 lines) ----------
import clr #This is .NET's Common Language Runtime. It's an execution environment
#that is able to execute code from several different languages.
import sys #sys is a fundamental Python library - here, we're using it to load in
#the standard IronPython libraries
sys.path.append('C:\Program Files (x86)\IronPython 2.7\Lib') #Imports the
#standard IronPython libraries, which cover everything from servers and
#encryption through to regular expressions.
import System #The System namespace at the root of .NET
from System import Array #.NET class for handling array information
from System.Collections.Generic import * #Lets you handle generics. Revit's API
#sometimes wants hard-typed 'generic' lists, called ILists. If you don't need
#these you can delete this line.
clr.AddReference('ProtoGeometry')  #A Dynamo library for its proxy geometry
#classes. You'll only need this if you're interacting with geometry.
from Autodesk.DesignScript.Geometry import * #Loads everything in Dynamo's
#geometry library
clr.AddReference("RevitNodes") #Dynamo's nodes for Revit
import Revit #Loads in the Revit namespace in RevitNodes
clr.ImportExtensions(Revit.Elements) #More loading of Dynamo's Revit libraries
clr.ImportExtensions(Revit.GeometryConversion) #More loading of Dynamo's
#Revit libraries. You'll only need this if you're interacting with geometry.
clr.AddReference("RevitServices") #Dynamo's classes for handling Revit documents
import RevitServices 
from RevitServices.Persistence import DocumentManager #An internal Dynamo class
#that keeps track of the document that Dynamo is currently attached to
from RevitServices.Transactions import TransactionManager #A Dynamo class for
#opening and closing transactions to change the Revit document's database

clr.AddReference("RevitAPI") #Adding reference to Revit's API DLLs
clr.AddReference("RevitAPIUI") #Adding reference to Revit's API DLLs

import Autodesk #Loads the Autodesk namespace
from Autodesk.Revit.DB import * #Loading Revit's API classes
from Autodesk.Revit.UI import * #Loading Revit's API UI classes  

doc = DocumentManager.Instance.CurrentDBDocument #Finally, setting up handles to the active Revit document
uiapp = DocumentManager.Instance.CurrentUIApplication #Setting a handle to the active Revit UI document
app = uiapp.Application  #Setting a handle to the currently-open instance of the Revit application
uidoc = uiapp.ActiveUIDocument #Setting a handle to the currently-open instance of the Revit UI application


floor=IN[0]
roof=IN[1]
ceiling=IN[2]
wall=IN[3]

new_floor=[]
new_roof=[]
new_ceiling=[]
new_wall=[]

for name in floor:
	if name=='':
		new_floor.append(" ")
	elif isinstance(name, list):
		new_floor.append(' + '.join(name))
	else:
		new_floor.append(name)
for name in roof:
	if name=='':
		new_roof.append(" ")
	elif isinstance(name, list):
		new_roof.append(' + '.join(name))
	else:
		new_roof.append(name)	
	
for name in ceiling:
	if name=='':
		new_ceiling.append(" ")
	elif isinstance(name, list):
		new_ceiling.append(' + '.join(name))
	else:
		new_ceiling.append(name)

for name in wall:
	
	if isinstance(name, list):
		sub=[]
		for i in name:
			if i!= "NoneType":
				sub.append(i)
		new_wall.append(sub)				
	else:
		new_wall.append(name)	
		

OUT= new_floor, new_roof, new_ceiling, new_wall
# ----------------------------------------
roofs_2 = CodeBlock(a=python_script_2) { a[1]; }
name = Custom[Element.Name+](element=all_elements_of_category)  # package Clockwork for Dynamo 2.x; Gets an element's name. Unlike the OOTB node, this node should work for all Revit elements that have names and will also return the localized names of system parameters, parameter groups, display unit types, parameter types, unit symbol types and unit types.
code_block_3 = CodeBlock { "Ceiling Finish"; }
ceilings_2 = CodeBlock(a=python_script_2) { a[2]; }
setParameterByName_2 = Element.SetParameterByName(element=all_elements_of_category, parameterName=code_block_3, value=ceilings_2)
code_block_4 = CodeBlock { "Floor Finish"; }
floors_2 = CodeBlock(a=python_script_2) { a[0]; }
setParameterByName_3 = Element.SetParameterByName(element=all_elements_of_category, parameterName=code_block_4, value=floors_2)
code_block_5 = CodeBlock { "Wall Finish"; }
walls_2 = CodeBlock(a=python_script_2) { a[3]; }
ʳʰʸᵗʰᵐ_elements_2 = Rhythm.Revit.Elements.Elements.SetParameterByNameTypeOrInstance(element=boundaries.element, parameterName=code_block_5, value=walls_2)
