# Dynamo graph 1. Creating Shared Parameters with excel.dyn "Creating Shared Parameters with excel" (Dynamo 2.6.1.8786)
# packages: archi-lab.net 2021.25.2621, DYN_SharedParamTesting 1.0.0, Orchid 206.3.0.7800

integer_slider = IntegerSlider(1, range=0..100 step 1)
# note: Custom Node: archilab v.2021.25.2621
parameter_groups = ParameterGroupUi()  # nothing selected
file_path = Filename(".\SHARED_PARA.xlsx")
file_from_path = FileObject(path=file_path)
code_block = CodeBlock { "Foglio1"; }
boolean = BoolSelector(true)
boolean_2 = BoolSelector(false)
importExcel = Data.ImportExcel(file=file_from_path, sheetName=code_block, readAsStrings=boolean, showExcel=boolean_2)
restOfItems = List.RestOfItems(list=importExcel)
transpose = List.Transpose(lists=restOfItems)
code_block_2 = CodeBlock { 0; }
# note: Custom Node: Dyn_SharedParamTesting v.1.0.0
getItemAtIndex = List.GetItemAtIndex(list=transpose, index=code_block_2)
code_block_3 = CodeBlock { 1; }
getItemAtIndex_2 = List.GetItemAtIndex(list=transpose, index=code_block_3)
parameter_groups_2 = ParameterGroupUi("PG_TEXT")
list_create = List.Create(item0=parameter_groups_2)
string_from_object = FromObject(obj=list_create)
code_block_4 = CodeBlock { 2; }
getItemAtIndex_3 = List.GetItemAtIndex(list=transpose, index=code_block_4)
indexOf = List.IndexOf(list=string_from_object, element=getItemAtIndex_3)
getItemAtIndex_4 = List.GetItemAtIndex(list=list_create, index=indexOf)
code_block_5 = CodeBlock { 3; }
getItemAtIndex_5 = List.GetItemAtIndex(list=transpose, index=code_block_5)
code_block_6 = CodeBlock { "Y"; }
eq = getItemAtIndex_5 == code_block_6
addSharedParamsToFamily = RBG_VSNodes.Document.AddSharedParamsToFamily(SPParameterName=getItemAtIndex, SPGroupName=getItemAtIndex_2, BuiltInPG=getItemAtIndex_4, IsInstance=eq)
current = Document.Current()
file_path_2 = Filename(".\SHARED_PARA.xlsx")
file_from_path_2 = FileObject(path=file_path_2)
code_block_7 = CodeBlock { "Sheet1"; }
boolean_3 = BoolSelector(false)
importExcel_2 = Data.ImportExcel(file=file_from_path_2, sheetName=code_block_7, readAsStrings=boolean_3, showExcel=boolean_3)
code_block_8 = CodeBlock(data=importExcel_2)
# ---------- code_block_8.designscript (13 lines) ----------
// Process excel data

dropped=DSCore.List.DropItems(data,1);
data_t =DSCore.List.Transpose(dropped);

// Values for Sp node

sp_names=data_t[0];
sp_grps=data_t[1];
p_types=data_t[2];
p_BIPs=data_t[4];
p_inst=data_t[5]=="Y";
p_rept=data_t[6]=="No";
# ----------------------------------------
boolean_4 = BoolSelector(true)
boolean_5 = BoolSelector(false)
create = Orchid.RevitFamily.Parameter.Create(familyDocument=current, parameterName=code_block_8.sp_names, type=code_block_8.p_types, group=code_block_8.sp_grps, instance=boolean_4, reporting=boolean_5)
