# Dynamo graph 1. Loading Family with Parameter Change.dyn "Loading Family with Parameter Change" (Dynamo 2.6.1.8786)
# packages: Orchid 206.3.0.7800

categories = Categories("OST_GenericModel")
all_elements_of_category = ElementsOfCategory(Category=categories)
directory_path = Directory("C:\Users\130\Desktop\EWS-20 TYPE 05")  # graph input
string = StringInput("*.rfa")
contents = Orchid.Common.Directory.Contents(directory=directory_path, deepSearch=string)
string_from_object = FromObject(obj=contents)
python_script = Python(IN[0]=string_from_object)
# ---------- python_script.python (69 lines) ----------
import clr #This is .NET's Common Language Runtime. It's an execution environment
#that is able to execute code from several different languages.
import sys #sys is a fundamental Python library - here, we're using it to load in
#the standard IronPython libraries
sys.path.append('C:\Program Files (x86)\IronPython 2.7\Lib') #Imports the
#standard IronPython libraries, which cover everything from servers and
#encryption through to regular expressions.
import System #The System namespace at the root of .NET
from System import Array #.NET class for handling array information
from System.Collections.Generic import * #Lets you handle generics. Revit's API
#sometimes wants hard-typed 'generic' lists, called ILists. If you don't need
#these you can delete this line.
clr.AddReference('ProtoGeometry')  #A Dynamo library for its proxy geometry
#classes. You'll only need this if you're interacting with geometry.
from Autodesk.DesignScript.Geometry import * #Loads everything in Dynamo's
#geometry library
clr.AddReference("RevitNodes") #Dynamo's nodes for Revit
import Revit #Loads in the Revit namespace in RevitNodes
clr.ImportExtensions(Revit.Elements) #More loading of Dynamo's Revit libraries
clr.ImportExtensions(Revit.GeometryConversion) #More loading of Dynamo's
#Revit libraries. You'll only need this if you're interacting with geometry.
clr.AddReference("RevitServices") #Dynamo's classes for handling Revit documents
import RevitServices 
from RevitServices.Persistence import DocumentManager #An internal Dynamo class
#that keeps track of the document that Dynamo is currently attached to
from RevitServices.Transactions import TransactionManager #A Dynamo class for
#opening and closing transactions to change the Revit document's database

clr.AddReference("RevitAPI") #Adding reference to Revit's API DLLs
clr.AddReference("RevitAPIUI") #Adding reference to Revit's API DLLs

import Autodesk #Loads the Autodesk namespace
from Autodesk.Revit.DB import * #Loading Revit's API classes
from Autodesk.Revit.UI import * #Loading Revit's API UI classes  

doc = DocumentManager.Instance.CurrentDBDocument #Finally, setting up handles to the active Revit document
uiapp = DocumentManager.Instance.CurrentUIApplication #Setting a handle to the active Revit UI document
app = uiapp.Application  #Setting a handle to the currently-open instance of the Revit application
uidoc = uiapp.ActiveUIDocument #Setting a handle to the currently-open instance of the Revit UI application
import re
sub1="0001.rfa$"
sub2="0002.rfa$"
sub3="0003.rfa$"
sub4="0002.0001.rfa$"
sub5="0004.rfa$"
generic_path=IN[0]
for index, path in enumerate(generic_path):
	if re.findall(sub1,path):
		del generic_path[index]
for index, path in enumerate(generic_path):
	if re.findall(sub2,path):
		del generic_path[index]

for index, path in enumerate(generic_path):
	if re.findall(sub3,path):
		del generic_path[index]

for index, path in enumerate(generic_path):
	if re.findall(sub4,path):
		del generic_path[index]
		
for index, path in enumerate(generic_path):
	if re.findall(sub5,path):
		del generic_path[index]
	
generic_paths=set(generic_path)


OUT = generic_paths
# ----------------------------------------
python_script_2 = Python(IN[0]=all_elements_of_category, IN[1]=python_script)
# ---------- python_script_2.python (70 lines) ----------
import clr #This is .NET's Common Language Runtime. It's an execution environment
#that is able to execute code from several different languages.
import sys #sys is a fundamental Python library - here, we're using it to load in
#the standard IronPython libraries
sys.path.append('C:\Program Files (x86)\IronPython 2.7\Lib') #Imports the
#standard IronPython libraries, which cover everything from servers and
#encryption through to regular expressions.
import System #The System namespace at the root of .NET
from System import Array #.NET class for handling array information
from System.Collections.Generic import * #Lets you handle generics. Revit's API
#sometimes wants hard-typed 'generic' lists, called ILists. If you don't need
#these you can delete this line.
clr.AddReference('ProtoGeometry')  #A Dynamo library for its proxy geometry
#classes. You'll only need this if you're interacting with geometry.
from Autodesk.DesignScript.Geometry import * #Loads everything in Dynamo's
#geometry library
clr.AddReference("RevitNodes") #Dynamo's nodes for Revit
import Revit #Loads in the Revit namespace in RevitNodes
clr.ImportExtensions(Revit.Elements) #More loading of Dynamo's Revit libraries
clr.ImportExtensions(Revit.GeometryConversion) #More loading of Dynamo's
#Revit libraries. You'll only need this if you're interacting with geometry.
clr.AddReference("RevitServices") #Dynamo's classes for handling Revit documents
import RevitServices 
from RevitServices.Persistence import DocumentManager #An internal Dynamo class
#that keeps track of the document that Dynamo is currently attached to
from RevitServices.Transactions import TransactionManager #A Dynamo class for
#opening and closing transactions to change the Revit document's database

clr.AddReference("RevitAPI") #Adding reference to Revit's API DLLs
clr.AddReference("RevitAPIUI") #Adding reference to Revit's API DLLs

import Autodesk #Loads the Autodesk namespace
from Autodesk.Revit.DB import * #Loading Revit's API classes
from Autodesk.Revit.UI import * #Loading Revit's API UI classes  

doc = DocumentManager.Instance.CurrentDBDocument #Finally, setting up handles to the active Revit document
uiapp = DocumentManager.Instance.CurrentUIApplication #Setting a handle to the active Revit UI document
app = uiapp.Application  #Setting a handle to the currently-open instance of the Revit application
uidoc = uiapp.ActiveUIDocument #Setting a handle to the currently-open instance of the Revit UI application


import re

#############Code####################
TransactionManager.Instance.EnsureInTransaction(doc)

inp=IN[0]

generic_model=[]
for elem in inp:
	el=UnwrapElement(elem)
	generic_model.append(el)


names=[]
for elem in generic_model:
	name=elem.Name
	names.append(name)
	
paths=IN[1]

generic_path=[]
for path in paths:
	for name in names:
		if re.findall(name,path):
			generic_path.append(path)

generic_paths=set(generic_path)

OUT = generic_paths
# ----------------------------------------
python_script_3 = Python(IN[0]=python_script_2)
# ---------- python_script_3.python (34 lines) ----------
import clr
clr.AddReference('RevitAPI')
from Autodesk.Revit.DB import *

clr.AddReference("RevitServices")
import RevitServices
from RevitServices.Persistence import DocumentManager
from RevitServices.Transactions import TransactionManager
doc = DocumentManager.Instance.CurrentDBDocument

class FamilyOption(IFamilyLoadOptions) :
	def OnFamilyFound(self, familyInUse, overwriteParameterValues):
		overwriteParameterValues.Value = True
		return True

	def OnSharedFamilyFound(self, sharedFamily, familyInUse, source, overwriteParameterValues):
		overwriteParameterValues.Value = True
		return True

toList = lambda x : x if hasattr(x, '__iter__') else [x]
pathsFamily = toList(IN[0])

TransactionManager.Instance.EnsureInTransaction(doc)

loadedFam = []
opts = FamilyOption()
for path in pathsFamily :
	refFam = clr.Reference[Family]()
	doc.LoadFamily(path, opts, refFam)
	loadedFam.append(refFam.Value)

TransactionManager.Instance.TransactionTaskDone()

OUT = loadedFam
# ----------------------------------------
