# Dynamo graph 1. AZA_Create Assemblies.dyn (Dynamo 2.6.1.8786)
# packages: SteamNodes 1.2.3

# group: 0. creare assemblies from model from GLA, GLF, GES generic models families
categories = Categories("OST_GenericModel")
all_elements_of_category = ElementsOfCategory(Category=categories)
string_from_object = FromObject(obj=all_elements_of_category)
string = StringInput("GES")
contains = String.Contains(str=string_from_object, searchFor=string)
filterByBoolMask = List.FilterByBoolMask(list=all_elements_of_category, mask=contains)
string_from_object_2 = FromObject(obj=all_elements_of_category)
string_2 = StringInput("GLF")
contains_2 = String.Contains(str=string_from_object_2, searchFor=string_2)
filterByBoolMask_2 = List.FilterByBoolMask(list=all_elements_of_category, mask=contains_2)
string_from_object_3 = FromObject(obj=all_elements_of_category)
string_3 = StringInput("GLA")
contains_3 = String.Contains(str=string_from_object_3, searchFor=string_3)
filterByBoolMask_3 = List.FilterByBoolMask(list=all_elements_of_category, mask=contains_3)
list_create = List.Create(item0=filterByBoolMask.in, item1=filterByBoolMask_2.in, item2=filterByBoolMask_3.in)

flatten = List.Flatten(list=list_create)
createAssembly = Custom[Tool.CreateAssembly](List=flatten@L1)  # package SteamNodes; Create an Assembly for each element
name = Element.Name(element=flatten)
python_script = Python(IN[0]=createAssembly, IN[1]=name)
# ---------- python_script.python (55 lines) ----------
import clr #This is .NET's Common Language Runtime. It's an execution environment
#that is able to execute code from several different languages.
import sys #sys is a fundamental Python library - here, we're using it to load in
#the standard IronPython libraries
sys.path.append('C:\Program Files (x86)\IronPython 2.7\Lib') #Imports the
#standard IronPython libraries, which cover everything from servers and
#encryption through to regular expressions.
import System #The System namespace at the root of .NET
from System import Array #.NET class for handling array information
from System.Collections.Generic import * #Lets you handle generics. Revit's API
#sometimes wants hard-typed 'generic' lists, called ILists. If you don't need
#these you can delete this line.
clr.AddReference('ProtoGeometry')  #A Dynamo library for its proxy geometry
#classes. You'll only need this if you're interacting with geometry.
from Autodesk.DesignScript.Geometry import * #Loads everything in Dynamo's
#geometry library
clr.AddReference("RevitNodes") #Dynamo's nodes for Revit
import Revit #Loads in the Revit namespace in RevitNodes
clr.ImportExtensions(Revit.Elements) #More loading of Dynamo's Revit libraries
clr.ImportExtensions(Revit.GeometryConversion) #More loading of Dynamo's
#Revit libraries. You'll only need this if you're interacting with geometry.
clr.AddReference("RevitServices") #Dynamo's classes for handling Revit documents
import RevitServices 
from RevitServices.Persistence import DocumentManager #An internal Dynamo class
#that keeps track of the document that Dynamo is currently attached to
from RevitServices.Transactions import TransactionManager #A Dynamo class for
#opening and closing transactions to change the Revit document's database

clr.AddReference("RevitAPI") #Adding reference to Revit's API DLLs
clr.AddReference("RevitAPIUI") #Adding reference to Revit's API DLLs

import Autodesk #Loads the Autodesk namespace
from Autodesk.Revit.DB import * #Loading Revit's API classes
from Autodesk.Revit.UI import * #Loading Revit's API UI classes  

doc = DocumentManager.Instance.CurrentDBDocument #Finally, setting up handles to the active Revit document
uiapp = DocumentManager.Instance.CurrentUIApplication #Setting a handle to the active Revit UI document
app = uiapp.Application  #Setting a handle to the currently-open instance of the Revit application
uidoc = uiapp.ActiveUIDocument #Setting a handle to the currently-open instance of the Revit UI application
elt=[UnwrapElement(i) for i in IN[0]]
NamesList=IN[1]
i = 0
TransactionManager.Instance.EnsureInTransaction(doc)
names=[]
Assemb=[]

for i,n in zip(elt,NamesList):
	i.AssemblyTypeName = n
	Assemb.append(i)
for i in Assemb:
	names.append(i.AssemblyTypeName)
	
TransactionManager.Instance.TransactionTaskDone()

OUT= names
# ----------------------------------------
