# Dynamo graph 2. AZA_Rename Assembly.dyn (Dynamo 2.5.0.7460)

element_types = ElementTypes("AssemblyType")
all_elements_of_type = ElementsOfType(element_type=element_types)
name = Element.Name(element=all_elements_of_type)
file_path = Filename("..\..\..\..\..\Book1.xlsx")
file_from_path = FileObject(path=file_path)
code_block = CodeBlock { "Sheet1"; }
boolean = BoolSelector(true)
boolean_2 = BoolSelector(false)
importExcel = Data.ImportExcel(file=file_from_path, sheetName=code_block, readAsStrings=boolean, showExcel=boolean_2)
transpose = List.Transpose(lists=importExcel)
code_block_2 = CodeBlock(lst=transpose) { lst[1]; lst[0]; }
python_script = Python(IN[0]=all_elements_of_type, IN[1]=code_block_2.out0, IN[2]=code_block_2.out1)
# ---------- python_script.python (52 lines) ----------
import clr
clr.AddReference('RevitAPI')
from Autodesk.Revit.DB import *

clr.AddReference("RevitNodes")
import Revit
clr.ImportExtensions(Revit.Elements)

clr.AddReference("RevitServices")
import RevitServices
from RevitServices.Persistence import DocumentManager
from RevitServices.Transactions import TransactionManager

doc = DocumentManager.Instance.CurrentDBDocument

TransactionManager.Instance.EnsureInTransaction(doc)

items = UnwrapElement(IN[0])
generic_names1 = IN[1]
actual_names1= IN[2]

def reverse(lst):
	new_list=lst[::-1]
	return new_list

actual_names=reverse(actual_names1)
generic_names=reverse(generic_names1)


	
for item, generic, actual in zip(items, generic_names, actual_names):
	if item.GetType().ToString() == "Autodesk.Revit.DB.FamilyParameter":
		try:
			doc.FamilyManager.RenameParameter(item,actual)
		except: False
		
	elif item.GetType().ToString()=="Autodesk.Revit.DB.Workset":
		try:
			doc.GetWorksetTable.RenameParameter(item, actual)
		except: False
		
	else:
		try: 
			item.Name=actual
		except: False
		


TransactionManager.Instance.TransactionTaskDone()


OUT= items
# ----------------------------------------
name_2 = Element.Name(element=python_script)
