# Dynamo graph 3. AZA_Change Assembly Name without Naviswork_SetParameter.dyn "3. AZA_Change Assembly Name without Naviswork" (Dynamo 2.6.1.8786)
# packages: SteamNodes 1.2.3, Clockwork for Dynamo 2.x 2.3.0, MEPover 2020.6.2, Rhythm 2021.4.2

# group: 0. creare assemblies from model from GLA, GLF, GES generic models families
categories = Categories("OST_GenericModel")
all_elements_of_category = ElementsOfCategory(Category=categories)
string_from_object = FromObject(obj=all_elements_of_category)
string = StringInput("GES")
contains = String.Contains(str=string_from_object, searchFor=string)
filterByBoolMask = List.FilterByBoolMask(list=all_elements_of_category, mask=contains)
string_from_object_2 = FromObject(obj=all_elements_of_category)
string_2 = StringInput("GLF")
contains_2 = String.Contains(str=string_from_object_2, searchFor=string_2)
filterByBoolMask_2 = List.FilterByBoolMask(list=all_elements_of_category, mask=contains_2)
string_from_object_3 = FromObject(obj=all_elements_of_category)
string_3 = StringInput("GLA")
contains_3 = String.Contains(str=string_from_object_3, searchFor=string_3)
filterByBoolMask_3 = List.FilterByBoolMask(list=all_elements_of_category, mask=contains_3)
list_create = List.Create(item0=filterByBoolMask.in, item1=filterByBoolMask_2.in, item2=filterByBoolMask_3.in)

createAssembly = Custom[Tool.CreateAssembly](List=list_create@L1)  # frozen; package SteamNodes; Create an Assembly for each element
name = Custom[Element.Name+](element=list_create@L1)  # package Clockwork for Dynamo 2.x; Gets an element's name. Unlike the OOTB node, this node should work for all Revit elements that have names and will also return the localized names of system parameters, parameter groups, display unit types, parameter types, unit symbol types and unit types.
python_script = Python(IN[0]=createAssembly, IN[1]=name)  # frozen
# ---------- python_script.python (47 lines) ----------
import clr
clr.AddReference('ProtoGeometry')
from Autodesk.DesignScript.Geometry import *
# Import ToDSType(bool) extension method
clr.AddReference("RevitNodes")
import Revit
clr.ImportExtensions(Revit.Elements)
# Import geometry conversion extension methods
clr.ImportExtensions(Revit.GeometryConversion)
# Import DocumentManager and TransactionManager
clr.AddReference("RevitServices")
import RevitServices
from RevitServices.Persistence import DocumentManager
from RevitServices.Transactions import TransactionManager
from System.Collections.Generic import *
# Import RevitAPI
clr.AddReference("RevitAPI")
import Autodesk
from Autodesk.Revit.DB import *

doc = DocumentManager.Instance.CurrentDBDocument
uiapp = DocumentManager.Instance.CurrentUIApplication
app = uiapp.Application
uidoc=DocumentManager.Instance.CurrentUIApplication.ActiveUIDocument
#TransactionManager.ForceCloseTransaction()
elt = []
for i in IN[0]:
	elt.append(UnwrapElement(i))
NamesList=IN[1]
names=[]
# Start Transaction
TransactionManager.Instance.EnsureInTransaction(doc)

Assemb=[]
non=[]
for index, i in enumerate(elt):
	if i!= None:
		i.AssemblyTypeName = NamesList[index]
		Assemb.append(i)
	
for i in Assemb:
	names.append(i.AssemblyTypeName)
# End Transaction
TransactionManager.Instance.TransactionTaskDone()

OUT= elt
#Assign your output to the OUT variable.
# ----------------------------------------
element_types = ElementTypes("AssemblyInstance")
all_elements_of_type = ElementsOfType(element_type=element_types)
code_block = CodeBlock { "Description"; }
flatten = List.Flatten(list=list_create)
code_block_2 = CodeBlock { "AZA_Descrizione"; }
ʳʰʸᵗʰᵐ_elements = Rhythm.Revit.Elements.Elements.GetParameterValueByNameTypeOrInstance(element=flatten, parameterName=code_block_2)
setParameterSetValueString = Custom[SetParameterSetValueString](Elements=all_elements_of_type, ParameterName=code_block, Values=ʳʰʸᵗʰᵐ_elements)  # package MEPover; Sets the parameters by strings. Useful for setting numerical values that are affected by Revit's internal unit conversion. Does not work for parameters that are stored as elementId
getParameterValueByName = Element.GetParameterValueByName(element=setParameterSetValueString, parameterName=code_block)
