# Dynamo graph 4. AZA_Setmaterial.dyn "3. AZA_Change Assembly Name without Naviswork_SetParameter" (Dynamo 2.6.1.8786)
# packages: Rhythm 2021.4.2, Clockwork for Dynamo 2.x 2.3.0

element_types = ElementTypes("AssemblyInstance")
all_elements_of_type = ElementsOfType(element_type=element_types)
code_block = CodeBlock { "Manufacturer"; }

# group: 0. creare assemblies from model from GLA, GLF, GES generic models families
categories = Categories("OST_GenericModel")
all_elements_of_category = ElementsOfCategory(Category=categories)
string_from_object = FromObject(obj=all_elements_of_category)
string = StringInput("GES")
contains = String.Contains(str=string_from_object, searchFor=string)
filterByBoolMask = List.FilterByBoolMask(list=all_elements_of_category, mask=contains)
string_from_object_2 = FromObject(obj=all_elements_of_category)
string_2 = StringInput("GLF")
contains_2 = String.Contains(str=string_from_object_2, searchFor=string_2)
filterByBoolMask_2 = List.FilterByBoolMask(list=all_elements_of_category, mask=contains_2)
string_from_object_3 = FromObject(obj=all_elements_of_category)
string_3 = StringInput("GLA")
contains_3 = String.Contains(str=string_from_object_3, searchFor=string_3)
filterByBoolMask_3 = List.FilterByBoolMask(list=all_elements_of_category, mask=contains_3)
list_create = List.Create(item0=filterByBoolMask.in, item1=filterByBoolMask_2.in, item2=filterByBoolMask_3.in)

flatten = List.Flatten(list=list_create)
code_block_2 = CodeBlock { "AZA_Materiale"; }
ʳʰʸᵗʰᵐ_elements = Rhythm.Revit.Elements.Elements.GetParameterValueByNameTypeOrInstance(element=flatten, parameterName=code_block_2)
name = Custom[Element.Name+](element=ʳʰʸᵗʰᵐ_elements)  # package Clockwork for Dynamo 2.x; Gets an element's name. Unlike the OOTB node, this node should work for all Revit elements that have names and will also return the localized names of system parameters, parameter groups, display unit types, parameter types, unit symbol types and unit types.
ʳʰʸᵗʰᵐ_elements_2 = Rhythm.Revit.Elements.Elements.SetParameterByNameTypeOrInstance(element=all_elements_of_type, parameterName=code_block, value=name)
