# Dynamo graph 6. Renaming Assembly Using Schdule.dyn "Renaming Assembly Using Schdule" (Dynamo 2.5.0.7460)
# packages: archi-lab.net 2021.25.2721, Clockwork for Dynamo 2.x 2.3.0, bimorphNodes 3.0.3

categories = Categories("OST_Assemblies")
all_elements_of_category = ElementsOfCategory(Category=categories)
type = archilab.Revit.Elements.Elements.Type(element=all_elements_of_category)
name = Custom[Element.Name+](element=type)  # package Clockwork for Dynamo 2.x; Gets an element's name. Unlike the OOTB node, this node should work for all Revit elements that have names and will also return the localized names of system parameters, parameter groups, display unit types, parameter types, unit symbol types and unit types.
python_script = Python(IN[0]=type, IN[1]=name)
# ---------- python_script.python (21 lines) ----------
# Load the Python Standard and DesignScript Libraries
import sys
import clr
clr.AddReference('ProtoGeometry')
from Autodesk.DesignScript.Geometry import *

# The inputs to this node will be stored as a list in the IN variables.
names=IN[1]
type=IN[0]

names_n=[]
index=[]
types=[]

for ind, i in enumerate(names):
	
	if i not in names_n:
		index.append(ind)
		names_n.append(i)
		types.append(type[ind])
OUT=types
# ----------------------------------------
name_2 = Custom[Element.Name+](element=python_script)
categories_2 = Categories("OST_Schedules")
all_elements_of_category_2 = ElementsOfCategory(Category=categories_2)
name_3 = Custom[Element.Name+](element=all_elements_of_category_2)
code_block = CodeBlock { "Generic Model Schedule"; }
python_script_2 = Python(IN[0]=name_3, IN[1]=code_block)
# ---------- python_script_2.python (10 lines) ----------
# Load the Python Standard and DesignScript Libraries
import sys
import clr
clr.AddReference('ProtoGeometry')
from Autodesk.DesignScript.Geometry import *

schedules=IN[0]
gen_sc=IN[1]

OUT=schedules.index(gen_sc)
# ----------------------------------------
getItemAtIndex = List.GetItemAtIndex(list=all_elements_of_category_2, index=python_script_2)
getData = Revit.Schedule.GetData(scheduleView=getItemAtIndex)
transpose = List.Transpose(lists=getData)
generic_name = CodeBlock(a=transpose) { a[0]; }
existing_name = CodeBlock(a=transpose) { a[1]; }
python_script_3 = Python(IN[0]=generic_name, IN[1]=existing_name)
# ---------- python_script_3.python (19 lines) ----------
# Load the Python Standard and DesignScript Libraries
import sys
import clr
clr.AddReference('ProtoGeometry')
from Autodesk.DesignScript.Geometry import *

# The inputs to this node will be stored as a list in the IN variables.
existing=IN[1][2::]
generic=IN[0][2::]

new_generic=[]
new_exist=[]

for ind, i in enumerate(existing):
	if i!=None and i!=[] and i!="" and i not in new_exist:
		new_exist.append(i)
		new_generic.append(generic[ind])

OUT=new_generic, new_exist
# ----------------------------------------
code_block_2 = CodeBlock(a=python_script_3) { a[1]; }
code_block_3 = CodeBlock(a=python_script_3) { a[0]; }
python_script_4 = Python(IN[0]=python_script, IN[1]=code_block_3)
# ---------- python_script_4.python (40 lines) ----------
# Common Language Runtime module
import clr
clr.AddReference('RevitAPI')
clr.AddReference('RevitServices')

# Revit and Dynamo module
from Autodesk.Revit.DB import FilteredElementCollector, Family
from RevitServices.Persistence import DocumentManager
from RevitServices.Transactions import TransactionManager

doc = DocumentManager.Instance.CurrentDBDocument

# argument assigned the IN port
elements = [UnwrapElement(i) for i in IN[0]]
rename = IN[1]

# core data processing
type_name = []

for idx, element in enumerate(elements):
	try:
		if hasattr(element, "Name"):
			element.Name = rename[idx]
	except:
		pass
	try:
		if hasattr(IN[0][idx], "Name"):
			element.Name = rename[idx]
	except:
		pass
	try:
		if hasattr(IN[0][idx], "Name"):
			element.name = rename[idx]
	except:
		pass

TransactionManager.Instance.ForceCloseTransaction()

# return assigned the OUT port
OUT = type_name
# ----------------------------------------
