# Dynamo graph Creating Views.dyn (Dynamo 2.6.1.8786)
# packages: Rhythm 2021.4.2, Clockwork for Dynamo 2.x 2.3.0, archi-lab.net 2021.25.2621, Orchid 206.3.0.7800

# group: Excel Data
# note: The Excel Data has 6 columns
# 1.  Level Names (must be present in document)
# 2. ScopeBox Name (must be present in element)
# 3. FamilyType (FloorPlan)
# 4. ViewType Name (PLAN-GE etc)
# 5. View Name
# 6. ViewTemplate Name (must be present in document)
file_path = Filename(".\VIEW.xlsx")
file_from_path = FileObject(path=file_path)
code_block = CodeBlock { "Sheet1"; }
boolean = BoolSelector(true)
boolean_2 = BoolSelector(false)
importExcel = Data.ImportExcel(file=file_from_path, sheetName=code_block, readAsStrings=boolean, showExcel=boolean_2)
restOfItems = List.RestOfItems(list=importExcel)
transpose = List.Transpose(lists=restOfItems)

# group: Duplicating Floor Plans
viewFamilyTypes = ViewFamilyTypes()  # nothing selected
code_block_2 = CodeBlock(a=transpose) { "Family and Type"; a[3]; }
duplicate = ElementType.Duplicate(elementType=viewFamilyTypes, name=code_block_2.out1)

passthrough = Custom[Passthrough](passThrough=transpose, waitFor=duplicate)  # package Clockwork for Dynamo 2.x; Forces a sequential order of execution. The node wired into the output of the Passthrough node will be executed *after* the node wired into the waitFor input (e.g. important for some Revit operations). The value of the passThrough input will be passed on to the node wired into the output port of the Passthrough node.

# group: Creating Views, Assigining SB and Organising in groups
python_script = Python(IN[0]=passthrough)  # unwired: IN[1]
# ---------- python_script.python (98 lines) ----------
import clr #This is .NET's Common Language Runtime. It's an execution environment
#that is able to execute code from several different languages.
import sys #sys is a fundamental Python library - here, we're using it to load in
#the standard IronPython libraries
sys.path.append('C:\Program Files (x86)\IronPython 2.7\Lib') #Imports the
#standard IronPython libraries, which cover everything from servers and
#encryption through to regular expressions.
import System #The System namespace at the root of .NET
from System import Array #.NET class for handling array information
from System.Collections.Generic import * #Lets you handle generics. Revit's API
#sometimes wants hard-typed 'generic' lists, called ILists. If you don't need
#these you can delete this line.
clr.AddReference('ProtoGeometry')  #A Dynamo library for its proxy geometry
#classes. You'll only need this if you're interacting with geometry.
from Autodesk.DesignScript.Geometry import * #Loads everything in Dynamo's
#geometry library
clr.AddReference("RevitNodes") #Dynamo's nodes for Revit
import Revit #Loads in the Revit namespace in RevitNodes
clr.ImportExtensions(Revit.Elements) #More loading of Dynamo's Revit libraries
clr.ImportExtensions(Revit.GeometryConversion) #More loading of Dynamo's
#Revit libraries. You'll only need this if you're interacting with geometry.
clr.AddReference("RevitServices") #Dynamo's classes for handling Revit documents
import RevitServices 
from RevitServices.Persistence import DocumentManager #An internal Dynamo class
#that keeps track of the document that Dynamo is currently attached to
from RevitServices.Transactions import TransactionManager #A Dynamo class for
#opening and closing transactions to change the Revit document's database

clr.AddReference("RevitAPI") #Adding reference to Revit's API DLLs
clr.AddReference("RevitAPIUI") #Adding reference to Revit's API DLLs

import Autodesk #Loads the Autodesk namespace
from Autodesk.Revit.DB import * #Loading Revit's API classes
from Autodesk.Revit.UI import * #Loading Revit's API UI classes  

doc = DocumentManager.Instance.CurrentDBDocument #Finally, setting up handles to the active Revit document
uiapp = DocumentManager.Instance.CurrentUIApplication #Setting a handle to the active Revit UI document
app = uiapp.Application  #Setting a handle to the currently-open instance of the Revit application
uidoc = uiapp.ActiveUIDocument #Setting a handle to the currently-open instance of the Revit UI application


############################# INPUT

level=IN[0][0]
scope_box1=IN[0][1]
family_type=IN[0][2]
view_type=IN[0][3]
view_name=IN[0][4]


############################ View Creation
TransactionManager.Instance.EnsureInTransaction(doc)
coll=FilteredElementCollector(doc).OfClass(ViewFamilyType).ToElements()

level1=FilteredElementCollector(doc).OfClass(Level).ToElements()
scope_boxes= FilteredElementCollector(doc).OfCategory(BuiltInCategory.OST_VolumeOfInterest).ToElements()


viewTypeId1=[]
for name in view_type:
	
	for i in coll:
		nam=i.get_Parameter(BuiltInParameter.ALL_MODEL_TYPE_NAME).AsString()
		if nam==name:
			viewTypeId1.append(i.Id)
			
levelId=[]
for name in level:
	for j in level1:
		nam=j.Name
		id=j.Id
		if nam==name:
			levelId.append(id)

scope_box=[]
scope_box_id=[]
for name in scope_box1:
	for j in scope_boxes:
		nam=j.Name
		id=j.Id
		if nam==name:
			scope_box.append(j)
			scope_box_id.append(id)
views=[]

for index,name in enumerate(view_name):
	view=ViewPlan.Create(doc,viewTypeId1[index], levelId[index])
	view.Name=name
	view.CropBoxActive=False
	view.CropBoxVisible=False
	scope_box_param = view.get_Parameter(BuiltInParameter.VIEWER_VOLUME_OF_INTEREST_CROP)
	scope_box_param.Set(scope_box_id[index])
	views.append(view)	

TransactionManager.Instance.TransactionTaskDone()	


OUT= views, scope_box
# ----------------------------------------

all = Orchid.RevitProject.Views.ViewTemplate.All()
code_block_3 = CodeBlock(a=passthrough) { a[5]; }  # frozen

# group: Extracting Templates according to excel
python_script_2 = Python(IN[0]=all, IN[1]=code_block_3)
# ---------- python_script_2.python (54 lines) ----------
import clr #This is .NET's Common Language Runtime. It's an execution environment
#that is able to execute code from several different languages.
import sys #sys is a fundamental Python library - here, we're using it to load in
#the standard IronPython libraries
sys.path.append('C:\Program Files (x86)\IronPython 2.7\Lib') #Imports the
#standard IronPython libraries, which cover everything from servers and
#encryption through to regular expressions.
import System #The System namespace at the root of .NET
from System import Array #.NET class for handling array information
from System.Collections.Generic import * #Lets you handle generics. Revit's API
#sometimes wants hard-typed 'generic' lists, called ILists. If you don't need
#these you can delete this line.
clr.AddReference('ProtoGeometry')  #A Dynamo library for its proxy geometry
#classes. You'll only need this if you're interacting with geometry.
from Autodesk.DesignScript.Geometry import * #Loads everything in Dynamo's
#geometry library
clr.AddReference("RevitNodes") #Dynamo's nodes for Revit
import Revit #Loads in the Revit namespace in RevitNodes
clr.ImportExtensions(Revit.Elements) #More loading of Dynamo's Revit libraries
clr.ImportExtensions(Revit.GeometryConversion) #More loading of Dynamo's
#Revit libraries. You'll only need this if you're interacting with geometry.
clr.AddReference("RevitServices") #Dynamo's classes for handling Revit documents
import RevitServices 
from RevitServices.Persistence import DocumentManager #An internal Dynamo class
#that keeps track of the document that Dynamo is currently attached to
from RevitServices.Transactions import TransactionManager #A Dynamo class for
#opening and closing transactions to change the Revit document's database

clr.AddReference("RevitAPI") #Adding reference to Revit's API DLLs
clr.AddReference("RevitAPIUI") #Adding reference to Revit's API DLLs

import Autodesk #Loads the Autodesk namespace
from Autodesk.Revit.DB import * #Loading Revit's API classes
from Autodesk.Revit.UI import * #Loading Revit's API UI classes  

doc = DocumentManager.Instance.CurrentDBDocument #Finally, setting up handles to the active Revit document
uiapp = DocumentManager.Instance.CurrentUIApplication #Setting a handle to the active Revit UI document
app = uiapp.Application  #Setting a handle to the currently-open instance of the Revit application
uidoc = uiapp.ActiveUIDocument #Setting a handle to the currently-open instance of the Revit UI application


temp=[UnwrapElement(i) for i in IN[0]]
viewtemp_name=IN[1]
names=[]
temp_new=[]
for tem in temp:
	name=tem.Name
	
	if name in viewtemp_name:
		temp_new.append(tem)
	
	names.append(name)
	
OUT= names, temp_new
# ----------------------------------------

code_block_4 = CodeBlock(t=python_script_2) { t[1]; }

# group: Setting View Template
setViewTemplate = archilab.Revit.Views.Views.SetViewTemplate(view=python_script, viewTemplate=code_block_4)  # frozen
