# Dynamo graph 31. Fill Parameters by part data-3.dyn (Dynamo 2.5.1.7586)
# packages: Civil3DToolkit 1.1.17

# group: Current Document Name Description Data
current = Autodesk.AutoCAD.DynamoNodes.Document.Current()
pressurePipeNetworks = PressurePipeNetworks(document=current)
getPipesFittings = Autodesk.Civil.DynamoNodes.PressurePipeNetworks.PressurePipeNetwork.GetPipesFittings(pressurePipeNetwork=pressurePipeNetworks)
code_block = CodeBlock(a=getPipesFittings.Fittings) { a[0]; }
partDescription = Autodesk.Civil.DynamoNodes.PressurePipeNetworks.PressureFitting.PartDescription(pressureFitting=code_block)  # frozen

# group: Property Set and Property name
code_block_2 = CodeBlock { "aa"; "A1"; }

# group: Excel Data
file_path = Filename(".\Basic2.csv")  # frozen
file_from_path = FileObject(path=file_path)
code_block_3 = CodeBlock { "Basic2"; true; false; }
importExcel = Data.ImportExcel(file=file_from_path, sheetName=code_block_3.out0, readAsStrings=code_block_3.out1, showExcel=code_block_3.out2)

python_script = Python(IN[0]=importExcel)
# ---------- python_script.python (1 lines) ----------
OUT=len(IN[0])
# ----------------------------------------
code_block_4 = CodeBlock(a=importExcel, n=python_script) { a[2..(n-1)]; }

# group (continued): Excel Data
transpose = List.Transpose(lists=code_block_4)
code_block_5 = CodeBlock(a=transpose) { a[2]; a[1]; a[3]; }

# group: model name
python_script_2 = Python(IN[0]=partDescription, IN[1]=code_block_5.out0, IN[2]=code_block_5.out1, IN[3]=code_block_5.out2)
# ---------- python_script_2.python (47 lines) ----------
sub_lst=IN[0]
full_name=IN[1]
full_dia=IN[2]
model_name=IN[3]


full=[i+" "+full_dia[index] for index, i in enumerate(full_name)]

bad_char=["-","(", ")", ",", "_"]

# removing bad charac

new_name=[]

for j in sub_lst:
	for i in bad_char:
		j=j.replace(i,"")
	new_name.append(j)
	
new_sub=[]

for i in new_name:
	i=i.replace("10MPa", "10 MPa")
	i=i.lower()
	new_sub.append(i.split())
	

new_full=[]

for j in full:
	n=j.lower()
	new_full.append(n)
	
#new_full=set(new_full)

lst2=[]
model=[]

for index, i in enumerate(new_full):
	for j in new_sub:
		if all(x in i for x in j):
			#lst2.append(j)
			model.append(model_name[index])

#models=[v for i, v in enumerate(model) if i==0 or v!=model[i-1]]

OUT= model
# ----------------------------------------

# group: Setting Property Value
updateProperty = Autodesk.AutoCAD.DynamoNodes.Object.UpdateProperty(object=code_block, propertySetName=code_block_2.out0, propertyName=code_block_2.out1, propertyValue=python_script_2)

layers = Autodesk.AutoCAD.DynamoNodes.Document.Layers(document=current)
code_block_6 = CodeBlock(a=layers) { a[202]; }
layerByName = Autodesk.AutoCAD.DynamoNodes.Document.LayerByName(document=current, name=code_block_6)
modelSpace = Autodesk.AutoCAD.DynamoNodes.Document.ModelSpace(document=current)
all_objects_on_layer = AcObjectsOnLayer(layer=code_block_6, block=modelSpace)
objects_types = AcObjectTypes("Table")
all_objects_of_type = AcObjectsOfType(type=objects_types, block=modelSpace)
