# Dynamo graph 31. Fill Parameters by part data.dyn (Dynamo 2.5.1.7586)
# packages: Civil3DToolkit 1.1.17

# group: Current Document Name Description Data
current = Autodesk.AutoCAD.DynamoNodes.Document.Current()
pressurePipeNetworks = PressurePipeNetworks(document=current)
getPipesFittings = Autodesk.Civil.DynamoNodes.PressurePipeNetworks.PressurePipeNetwork.GetPipesFittings(pressurePipeNetwork=pressurePipeNetworks)
code_block = CodeBlock(a=getPipesFittings.Fittings) { a[1]; }
partDescription = Autodesk.Civil.DynamoNodes.PressurePipeNetworks.PressureFitting.PartDescription(pressureFitting=code_block)

# group: Property Set and Property name
code_block_2 = CodeBlock { "bb"; "A2"; }

# group: Excel Data
file_path = Filename(".\Basic1.xlsx")
file_from_path = FileObject(path=file_path)
code_block_3 = CodeBlock { "Basic"; true; false; }
importExcel = Data.ImportExcel(file=file_from_path, sheetName=code_block_3.out0, readAsStrings=code_block_3.out1, showExcel=code_block_3.out2)
restOfItems = List.RestOfItems(list=importExcel)
transpose = List.Transpose(lists=restOfItems)
code_block_4 = CodeBlock(a=transpose) { a[3]; a[1]; a[4]; }

# group: Analyzing names
python_script = Python(IN[0]=partDescription)
# ---------- python_script.python (20 lines) ----------
bad_char=['-', '(', ')', ',']

# removing bad characters

#new_name= "".join(i for i in IN[0] if not i in bad_char)
new_name=[]
for j in IN[0]:
	for i in bad_char:
		j=j.replace(i,'')

	j=j.replace(" ", "")
	new_name.append(j)

new_name=[i.lower() for i in new_name]





OUT=new_name, [len(i) for i in new_name]
# ----------------------------------------
python_script_2 = Python(IN[0]=code_block_4.out0, IN[1]=code_block_4.out1)
# ---------- python_script_2.python (25 lines) ----------
bad_char=['-', '(', ')', ',']

# removing bad characters

#new_name= "".join(i for i in IN[0] if not i in bad_char)
new_name=[]
for j in IN[0]:
	for i in bad_char:
		j=j.replace(i,'')

	j=j.replace(" ", "")
	new_name.append(j)
	
new_name=[i[:-33] for i in new_name]

new_name=[i.lower() for i in new_name]

dia=[i.lower() for i in IN[1]]

new_name1=[]
for index, item in enumerate(new_name):
	item1=item+dia[index]
	new_name1.append(item1)

OUT= new_name1, [len(i) for i in new_name1]
# ----------------------------------------

code_block_5 = CodeBlock(a=python_script) { a[0]; }
code_block_6 = CodeBlock(a=python_script_2) { a[0]; }

# group: Sorting Model name based on current document data
python_script_3 = Python(IN[0]=code_block_5, IN[1]=code_block_6, IN[2]=code_block_4.out2)
# ---------- python_script_3.python (13 lines) ----------
doc_f=IN[0]
excel_f=IN[1]
model_name=IN[2]

model_sorted=[]

for i in doc_f:
	if i in excel_f:
		ind=excel_f.index(i)
		model_sorted.append(model_name[ind])
		
		
OUT= model_sorted
# ----------------------------------------

# group: Setting Property Value
updateProperty = Autodesk.AutoCAD.DynamoNodes.Object.UpdateProperty(object=code_block, propertySetName=code_block_2.out0, propertyName=code_block_2.out1, propertyValue=python_script_3)
