# Dynamo graph Zoning and paarameters assignment.dyn (Dynamo 2.6.1.8786)
# packages: spring nodes 110.0.2, Genius Loci 2021.4.13

# group: Select Elements in zones. You can select multiple times and then run the script. But becareful, as too many elements(6000+)can crrash revit
select_model_elements = DSModelElementsSelection()  # 322 picked in the model
select_model_elements_2 = DSModelElementsSelection()  # 709 picked in the model
select_model_elements_3 = DSModelElementsSelection()  # 1083 picked in the model
select_model_elements_4 = DSModelElementsSelection()  # 1563 picked in the model
select_model_elements_5 = DSModelElementsSelection()  # 2057 picked in the model

list_create = List.Create(item0=select_model_elements)
flatten = List.Flatten(list=list_create)

# group: Select Zone Mass
select_model_element = DSModelElementSelection()  # 1 picked in the model

# group: Element Geometry
solids = Element.Solids(element=flatten)  # frozen
geometry = Element.Geometry(element=select_model_element)

# group: Cleaning lists (Null, empty and sublist(stairs))
python_script = Python(IN[0]=solids)
# ---------- python_script.python (45 lines) ----------
items = IN[0]
solid_list = list()
index=[]

def ClearList(primList):
    result = []
    index=[]
    for ind, sublist in enumerate(primList):
        if sublist is "":
            continue
        elif sublist is None:
            continue 
        elif isinstance(sublist, list):
        	if len(sublist)>1:
        		continue
        if isinstance(sublist, list):
             sublist = ClearList(sublist)
             if not sublist:
                 continue
        result.append(sublist)
        index.append(ind)
    return  index

def solid(primList):
    result = []
    index=[]
    for ind, sublist in enumerate(primList):
        if sublist is "":
            continue
        elif sublist is None:
            continue 
        elif isinstance(sublist, list):
        	if len(sublist)>1:
        		continue
        if isinstance(sublist, list):
             sublist = solid(sublist)
             if not sublist:
                 continue
        result.append(sublist)
        index.append(ind)
    return  result
   


OUT =ClearList(IN[0]), solid(IN[0])
# ----------------------------------------

# group: Index of solids wrt to elements
code_block = CodeBlock(a=python_script) { a[0]; }

flatten_2 = List.Flatten(list=geometry)

# group: Solids
code_block_2 = CodeBlock(a=python_script) { a[1]; }
flatten_3 = List.Flatten(list=code_block_2)

# group: Centroid of solids
centroid = Solid.Centroid(solid=flatten_3)

# group: Checking if solids intersect with Mass
python_script_2 = Python(IN[0]=flatten_2, IN[1]=centroid, IN[2]=code_block)
# ---------- python_script_2.python (31 lines) ----------
import sys
import clr
clr.AddReference('ProtoGeometry')
from Autodesk.DesignScript.Geometry import *

clr.AddReference('DSCoreNodes')
import DSCore
from DSCore import *

# The inputs to this node will be stored as a list in the IN variables.

zone = IN[0]
otherobjects = IN[1]
element_index=[2]

# Place your code below this line
#solid1 = Surface.Thicken(otherobjects1, 20)
	
for i in zone:
	index1=[]
	for ind, j in enumerate(otherobjects):
		bool1 = j.DoesIntersect(i)	
		bool2 = str(bool1)
		if bool2 == "True" :
			index1.append(ind)
len1=len(otherobjects) # 676
len2=len(index1) # 199


	
OUT =index1
# ----------------------------------------

# group: Getting indexes of intersecting elements
getItemAtIndex = List.GetItemAtIndex(list=code_block, index=python_script_2)

# group: Getting Intersecting elements
getItemAtIndex_2 = List.GetItemAtIndex(list=select_model_elements, index=getItemAtIndex@L2)

# group: Parameter name
code_block_3 = CodeBlock { "B6_1D_Zone"; }

# group: Zone Parameter to apply in elements
code_block_4 = CodeBlock { "B6_1D_Zone"; }

# group: Parameter Value of Selected Zone
getParameterValueByName = Element.GetParameterValueByName(element=select_model_element, parameterName=code_block_4)

# group: Setting Parameter
nullSetParameter = Custom[Springs.NullSetParameter](element=getItemAtIndex_2, parameter=code_block_3, value=getParameterValueByName)  # package spring nodes; Similar to the built-in function but with the ability to handle null values. Part of the SmartCopyMon workflow.

# group: Checking if parameter is applied?
getParameterValueByName_2 = Element.GetParameterValueByName(element=nullSetParameter, parameterName=code_block_3)

# group: For elements with multiple solids( Such as Stairs, or piling columns)
python_script_3 = Python(IN[0]=solids)
# ---------- python_script_3.python (36 lines) ----------
items = IN[0]
solid_list = list()
index=[]

def ClearList(primList):
    result = []
    index=[]
    for ind, sublist in enumerate(primList):
        if sublist is "":
            continue
        elif sublist is None:
            continue 
        elif isinstance(sublist, list):
        	if len(sublist)>1:
        		
        		index.append(ind)       
   
    return  index

def solid(primList):
    result = []
    index=[]
    for ind, sublist in enumerate(primList):
        if sublist is "":
            continue
        elif sublist is None:
            continue 
        elif isinstance(sublist, list):
        	if len(sublist)>1:
        		result.append(sublist)
      
    return  result
   


OUT =ClearList(IN[0]), solid(IN[0])
# ----------------------------------------
code_block_5 = CodeBlock(a=python_script_3) { a[0]; }
code_block_6 = CodeBlock(a=python_script_3) { a[1]; }
centroid_2 = Solid.Centroid(solid=code_block_6)
python_script_4 = Python(IN[0]=flatten_2, IN[1]=centroid_2, IN[2]=code_block_5)
# ---------- python_script_4.python (34 lines) ----------
import sys
import clr
clr.AddReference('ProtoGeometry')
from Autodesk.DesignScript.Geometry import *

clr.AddReference('DSCoreNodes')
import DSCore
from DSCore import *

# The inputs to this node will be stored as a list in the IN variables.

zone = IN[0]
otherobjects = IN[1]
element_index=[2]

# Place your code below this line
#solid1 = Surface.Thicken(otherobjects1, 20)
	
for i in zone:
	index1=[]
	for ind, j in enumerate(otherobjects):
		index2=[]
		for k in j:
			bool1 = k.DoesIntersect(i)	
			bool2 = str(bool1)
			if bool2 == "True" :
				index2.append(ind)
		index1.append(index2)
len1=len(otherobjects) # 676
len2=len(index1) # 199


	
OUT =index1
# ----------------------------------------
list_clean = Custom[List Clean](list=python_script_4)  # package Genius Loci; Removes all Null, Empty and Blank from a list or nested list of lists.
flatten_4 = List.Flatten(list=list_clean)
uniqueItems = List.UniqueItems(list=flatten_4)

# group: Getting indexes of intersecting elements
getItemAtIndex_3 = List.GetItemAtIndex(list=code_block_5, index=uniqueItems)

# group: Getting Intersecting elements
getItemAtIndex_4 = List.GetItemAtIndex(list=select_model_elements, index=getItemAtIndex_3@L2)

# group: Parameter name
code_block_7 = CodeBlock { "B6_1D_Zone"; }

# group: Setting Parameter
nullSetParameter_2 = Custom[Springs.NullSetParameter](element=getItemAtIndex_4, parameter=code_block_7, value=getParameterValueByName)

# group: Checking if parameter is applied?
getParameterValueByName_3 = Element.GetParameterValueByName(element=nullSetParameter_2, parameterName=code_block_7)

select_model_element_2 = DSModelElementSelection()  # 1 picked in the model
geometry_2 = Element.Geometry(element=flatten)
