# Dynamo graph 2. Creating Voids on Multiple walls at the same time.dyn "Try1" (Dynamo 2.6.1.8786)
# packages: spring nodes 110.0.2, Clockwork for Dynamo 2.x 2.3.0

# group: Walls selection
select_model_elements = DSModelElementsSelection()  # 8 picked in the model

faces = Element.Faces(element=select_model_elements)

# group: Getting the longest surface
python_script = Python(IN[0]=faces)
# ---------- python_script.python (19 lines) ----------
# Load the Python Standard and DesignScript Libraries
import sys
import clr
clr.AddReference('ProtoGeometry')
from Autodesk.DesignScript.Geometry import *

# The inputs to this node will be stored as a list in the IN variables.

surfaces=[]
others=[]
for i in IN[0]:
	for ind, j in enumerate(i):
		if ind==0:
			surfaces.append(j)
		else:
			others.append(j)
		

OUT = surfaces
# ----------------------------------------

# group: Model line selection
select_model_element = DSModelElementSelection()  # 1 picked in the model

geometry = Element.Geometry(element=select_model_element)

# group: Intersecting points and index of intersecting wall
python_script_2 = Python(IN[0]=python_script, IN[1]=geometry)
# ---------- python_script_2.python (23 lines) ----------
# Load the Python Standard and DesignScript Libraries
import sys
import clr
clr.AddReference('ProtoGeometry')
from Autodesk.DesignScript.Geometry import *

# The inputs to this node will be stored as a list in the IN variables.
surfaces=IN[0]
line=IN[1]
points=[]
index=[]
for ind, i in enumerate(surfaces):
	boo1=str(line[0].DoesIntersect(i))
	if boo1=="True":
		index.append(ind)	
		pt=line[0].Intersect(i)
		points.append(pt)


# Place your code below this line

# Assign your output to the OUT variable.
OUT = points, index
# ----------------------------------------

code_block = CodeBlock(a=python_script_2) { a[1]; }
getItemAtIndex = List.GetItemAtIndex(list=select_model_elements, index=code_block)
family_types = FamilyTypes("Rough Openings:Rough Openings")
code_block_2 = CodeBlock(a=python_script_2) { a[0]; }
flatten = List.Flatten(list=code_block_2)
byPoints = Custom[Springs.HostedInstance.ByPoints](host=getItemAtIndex, type=family_types, point=flatten)  # package spring nodes; Creates hosted family instances(doors/windows) at the specified points. You can feed either a single family type or a unique type for each instance.
cutGeometry = Custom[Element.CutGeometry](elementToBeCut=getItemAtIndex, cuttingElement=byPoints)  # package Clockwork for Dynamo 2.x; Adds a solid-solid cut for two model elements (if possible).
