# Dynamo graph 3. Creating Voids on Multiple walls at the same time - Copy.dyn "Creating Voids on Multiple walls at the same time - Copy" (Dynamo 2.6.1.8786)
# packages: Genius Loci 2021.4.13, Clockwork for Dynamo 2.x 2.3.0, spring nodes 110.0.2

code_block = CodeBlock { true; }

# group: Select windows
select_model_element = DSModelElementSelection()  # 1 picked in the model

geometry = Element.Geometry(element=select_model_element)
byGeometry = BoundingBox.ByGeometry(geom=geometry)
minPoint = BoundingBox.MinPoint(boundingBox=byGeometry)
X = Point.X(point=minPoint)
maxPoint = BoundingBox.MaxPoint(boundingBox=byGeometry)
X_2 = Point.X(point=maxPoint)
Y = Point.Y(point=minPoint)
Y_2 = Point.Y(point=maxPoint)
Z = Point.Z(point=minPoint)
Z_2 = Point.Z(point=maxPoint)
code_block_2 = CodeBlock(x1=X, x2=X_2, y1=Y, y2=Y_2, z1=Z, z2=Z_2) { xav=(x1+x2)/2; yav=(y1+y2)/2; zav=(z1+z2)/2; }
byCoordinates = Point.ByCoordinates(x=code_block_2.xav, y=code_block_2.yav, z=code_block_2.zav)
toCuboid = BoundingBox.ToCuboid(boundingBox=byGeometry)
ZAxis = Vector.ZAxis()
element_getrotation = Custom[Element GetRotation](element=select_model_element)  # package Genius Loci; Calculates the rotation angle between the given element and the X axis. Works for point/ line/ sketch based elements and link instances.
code_block_3 = CodeBlock(a=element_getrotation) { angle=a-180; }
rotate = Geometry.Rotate(geometry=toCuboid, origin=byCoordinates, axis=ZAxis, degrees=code_block_3)
width = Cuboid.Width(cuboid=rotate)
code_block_4 = CodeBlock(a=width) { b=a+10000; }
length = Cuboid.Length(cuboid=rotate)
height = Cuboid.Height(cuboid=rotate)
byLengths = Cuboid.ByLengths(origin=byCoordinates, width=code_block_4, length=length, height=height)
code_block_5 = CodeBlock(a=element_getrotation) { angle=(a-180)-90; }
rotate_2 = Geometry.Rotate(geometry=byLengths, origin=byCoordinates, axis=ZAxis, degrees=code_block_5)
width_2 = Cuboid.Width(cuboid=rotate_2)
height_2 = Cuboid.Height(cuboid=rotate_2)
select_model_elements = DSModelElementsSelection()  # 4 picked in the model
difference = Solid.Difference(solid=rotate_2, other=rotate)
file_path = Filename("..\..\..\..\..\..\..\ProgramData\Autodesk\RVT 2021\Family Templates\English\Metric Generic Model.rft")
code_block_6 = CodeBlock { "aa"; }
categories = Categories("OST_GenericModel")
boolean = BoolSelector(true)
byGeometry_2 = Custom[Springs.FamilyInstance.ByGeometry](geometry=difference, familyTemplatePath=file_path, familyName=code_block_6, category=categories, isVoid=boolean)  # package spring nodes; You must provide a valid family template path that will be used for all input geometry objects. The project units(and not the templates) will be used to determine the size of the output geometry. The provided category will be used only if the family template supports it. If not, the default template category will be used instead. Likewise, the family material(provided as a string) will be set only if a material with that name exists in the template. If not, the default material will be used instead ("By Category"). For void cuts, the material settings will be ignored. The Subcategory name is an optional input. If you'd like to skip assigning a Subcategory to any new instance, simply use null. The node expects a unique family name for each geometry object. The rest of the input lists will be processed as if the node lacing is set to longest.
cutGeometry = Custom[Element.CutGeometry](elementToBeCut=select_model_elements, cuttingElement=byGeometry_2.instance)  # package Clockwork for Dynamo 2.x; Adds a solid-solid cut for two model elements (if possible).
select_model_elements_2 = DSModelElementsSelection()  # 9 picked in the model
python_script = Python(IN[0]=difference)
# ---------- python_script.python (15 lines) ----------
# Load the Python Standard and DesignScript Libraries
import sys
import clr
clr.AddReference('ProtoGeometry')
from Autodesk.DesignScript.Geometry import *

# The inputs to this node will be stored as a list in the IN variables.
sol=IN[0]

l=len(sol)

names=['solid'+str(i) for i in range(l+1)]

# Assign your output to the OUT variable.
OUT = names
# ----------------------------------------
