# Dynamo graph 5.2 Final - Void Cut_with multiple windows with Linked Data .dyn "5.2 Final - Void Cut_with multiple windows with Linked Data" (Dynamo 2.5.0.7460)
# packages: bimorphNodes 3.0.3, archi-lab.net 2021.25.2721, Genius Loci 2021.5.18, Orchid 203.3.0.7815, Rhythm 2020.1.22, spring nodes 204.1.0, Clockwork for Dynamo 2.x 2.3.0, WombatDynamo 1.3.2

# group: Linked File Data
getDocuments = archilab.Revit.Selection.Select.GetDocuments()
categories = Categories("OST_Windows")
ofCategory = Revit.LinkElement.OfCategory(linkInstance=getDocuments.Link_Instance, Category=categories)

# group: To Control The Number of Linked Windows you want to Process in one time
code_block = CodeBlock(a=ofCategory) { a[7][0..2]; }
element = Revit.LinkElement.Element(linkElement=code_block)

# note: Custom Node: GeniusLoci v.2021.4.13
element_host = Custom[Element Host](element=element)  # package Genius Loci; Gets the host of the element. Unlike the OOTB node FamilyInstance.GetHost, it also works for elements hosted by a linked document, wall sweeps, foundations, railings and builing pads. Based on a Clockwork's node
code_block_2 = CodeBlock { "Width"; }
# note: Custom Node: Rhythm v.2021.4.2
ʳʰʸᵗʰᵐ_elements = Rhythm.Revit.Elements.Elements.GetParameterValueByNameTypeOrInstance(element=element_host, parameterName=code_block_2)

# group: Window Parameters
code_block_3 = CodeBlock { "Width"; }
code_block_4 = CodeBlock { "Height"; }

# group: All walls are required as there is no check with linked files
categories_2 = Categories("OST_Walls")  # frozen
all_elements_of_category = ElementsOfCategory(Category=categories_2)

id = Element.Id(element=all_elements_of_category)
id_2 = Element.Id(element=element_host)
python_script = Python(IN[0]=id, IN[1]=id_2)
# ---------- python_script.python (19 lines) ----------
# Load the Python Standard and DesignScript Libraries
import sys
import clr
clr.AddReference('ProtoGeometry')
from Autodesk.DesignScript.Geometry import *

# The inputs to this node will be stored as a list in the IN variables.
total=IN[0]
host=IN[1]

indexes=[]
for ind, i in enumerate(total):
	if i not in host:
		indexes.append(ind)

# Place your code below this line

# Assign your output to the OUT variable.
OUT = indexes
# ----------------------------------------
getItemAtIndex = List.GetItemAtIndex(list=all_elements_of_category, index=python_script)
string_from_object = FromObject(obj=getItemAtIndex)
python_script_2 = Python(IN[0]=string_from_object)
# ---------- python_script_2.python (16 lines) ----------
# Load the Python Standard and DesignScript Libraries
import sys
import clr
clr.AddReference('ProtoGeometry')
from Autodesk.DesignScript.Geometry import *

# The inputs to this node will be stored as a list in the IN variables.
type=IN[0]
index=[]
sub="Wall"


for ind, i in enumerate(type):
	if i==sub:
		index.append(ind)
OUT=index
# ----------------------------------------
getItemAtIndex_2 = List.GetItemAtIndex(list=getItemAtIndex, index=python_script_2)

# group: JUST TO GET THE SUFACES OF THE AREA
faces = Element.Faces(element=getItemAtIndex_2)

# group: Getting the longest surface
python_script_3 = Python(IN[0]=faces)
# ---------- python_script_3.python (23 lines) ----------
# Load the Python Standard and DesignScript Libraries
import sys
import clr
clr.AddReference('ProtoGeometry')
from Autodesk.DesignScript.Geometry import *

# The inputs to this node will be stored as a list in the IN variables.

surfaces=[]
others=[]
index=[]
for ind, i in enumerate(IN[0]):
	if i!=[] and i!=None and type(i)==list:
		for ind1, j in enumerate(i):
			if ind1==0:
				surfaces.append(j)
				index.append(ind)
			else:
				others.append(j)
	else:	
		surfaces.append('')	

OUT = surfaces
# ----------------------------------------

solids = Revit.LinkElement.Solids(linkElement=code_block)

# group: Windows centroids and solids
centroid = Solid.Centroid(solid=solids)
volume = Solid.Volume(solid=solids)

python_script_4 = Python(IN[0]=centroid, IN[1]=volume)
# ---------- python_script_4.python (24 lines) ----------
# Load the Python Standard and DesignScript Libraries
import sys
import clr
clr.AddReference('ProtoGeometry')
from Autodesk.DesignScript.Geometry import *

# The inputs to this node will be stored as a list in the IN variables.
cen=IN[0]
vol=IN[1]

cen1=[]
index1=[]
for ind, i in enumerate(vol):
	
	
	if i!=[] and i!=None and type(i)==list:	
		index1.append(ind)
		cen_list=cen[ind]		
		cen_val=max(i)
		ind_val=i.index(cen_val)
		cen1.append(cen_list[ind_val])
		#cen1.append(cen_ind)

OUT= cen1,index1
# ----------------------------------------
code_block_5 = CodeBlock(a=python_script_4) { a[0]; }
# note: Custom Node: Orchid v. 206.3.0.7800
clean = Orchid.Common.List.Clean(list=code_block_5)
flatten = List.Flatten(list=clean)
X = Point.X(point=flatten)
Y = Point.Y(point=flatten)
Z = Point.Z(point=flatten)
byCoordinates = Point.ByCoordinates(x=X, y=Y, z=Z)
code_block_6 = CodeBlock(a=python_script_4) { a[1]; }
getItemAtIndex_3 = List.GetItemAtIndex(list=element, index=code_block_6)
code_block_7 = CodeBlock { "AZA_Foro muratura interna Larghezza"; }
ʳʰʸᵗʰᵐ_elements_2 = Rhythm.Revit.Elements.Elements.GetParameterValueByNameTypeOrInstance(element=getItemAtIndex_3, parameterName=code_block_7)

# group: Should not match with width or height
code_block_8 = CodeBlock { 4000; }

code_block_9 = CodeBlock { "AZA_Foro muratura interna Altezza"; }
ʳʰʸᵗʰᵐ_elements_3 = Rhythm.Revit.Elements.Elements.GetParameterValueByNameTypeOrInstance(element=getItemAtIndex_3, parameterName=code_block_9)
byLengths = Cuboid.ByLengths(origin=byCoordinates, width=ʳʰʸᵗʰᵐ_elements_2, length=code_block_8, height=ʳʰʸᵗʰᵐ_elements_3)
ZAxis = Vector.ZAxis()
getItemAtIndex_4 = List.GetItemAtIndex(list=element, index=code_block_6)
element_getrotation = Custom[Element GetRotation](element=getItemAtIndex_4)  # package Genius Loci; Calculates the rotation angle between the given element and the X axis. Works for point/ line/ sketch based elements and link instances.
code_block_10 = CodeBlock(a=element_getrotation) { angle=a-180; }
rotate = Geometry.Rotate(geometry=byLengths, origin=byCoordinates, axis=ZAxis, degrees=code_block_10)
clean_2 = Orchid.Common.List.Clean(list=rotate)
edges = Topology.Edges(topology=clean_2)
curveGeometry = Edge.CurveGeometry(edge=edges)
length = Curve.Length(curve=curveGeometry)
startVertex = Edge.StartVertex(edge=edges)
pointGeometry = Vertex.PointGeometry(vertex=startVertex)
Z_2 = Point.Z(point=pointGeometry)

# group: To get the two base lines of the cuboid
python_script_5 = Python(IN[0]=length, IN[1]=code_block_8, IN[2]=Z_2, IN[3]=edges)
# ---------- python_script_5.python (41 lines) ----------
# Load the Python Standard and DesignScript Libraries
import sys
import clr
clr.AddReference('ProtoGeometry')
from Autodesk.DesignScript.Geometry import *

# The inputs to this node will be stored as a list in the IN variables.

edge_len=IN[0]
edge_len_constraint=IN[1]
point_z=IN[2]
edges=IN[3]

index=[]
pts_1=[]
for ind, i in enumerate(edge_len):
	index_sub=[]	
	pts=point_z[ind]
	if pts!=[] and pts!=None and type(pts)==list:
		pt_min=round(min(pts))
		pts_1.append(int(pt_min))
	points=[]
	if i!=None and type(i)==list:
		for ind1, j in enumerate(i):
			x=round(pts[ind1])		
			y=round(j)
			if y==edge_len_constraint:
				if x==pt_min:
					index_sub.append(ind1)
		index.append(index_sub)

edge=[]
for ind, i in enumerate(edges):
	x=index[ind]
	edge_sub=[]
	for  ind1, j in enumerate(i):
		if ind1 in x:
			edge_sub.append(j)
	edge.append(edge_sub)			
	
OUT=edge
# ----------------------------------------

startVertex_2 = Edge.StartVertex(edge=python_script_5)
pointGeometry_2 = Vertex.PointGeometry(vertex=startVertex_2)
X_2 = Point.X(point=pointGeometry_2)
endVertex = Edge.EndVertex(edge=python_script_5)
pointGeometry_3 = Vertex.PointGeometry(vertex=endVertex)
X_3 = Point.X(point=pointGeometry_3)
Y_2 = Point.Y(point=pointGeometry_2)

# group: Line 1 Start x
python_script_6 = Python(IN[0]=X_2)
# ---------- python_script_6.python (16 lines) ----------
# Load the Python Standard and DesignScript Libraries
import sys
import clr
clr.AddReference('ProtoGeometry')
from Autodesk.DesignScript.Geometry import *

# The inputs to this node will be stored as a list in the IN variables.
pnts=IN[0]

def loc(n):
	return n[0]


result=list(map(loc,pnts))

OUT = result
# ----------------------------------------
python_script_7 = Python(IN[0]=Y_2)  # same code as python_script_6

Y_3 = Point.Y(point=pointGeometry_3)

# group: Line 2 End
python_script_8 = Python(IN[0]=X_3)
# ---------- python_script_8.python (16 lines) ----------
# Load the Python Standard and DesignScript Libraries
import sys
import clr
clr.AddReference('ProtoGeometry')
from Autodesk.DesignScript.Geometry import *

# The inputs to this node will be stored as a list in the IN variables.
pnts=IN[0]

def loc(n):
	return n[1]


result=list(map(loc,pnts))

OUT = result
# ----------------------------------------
python_script_9 = Python(IN[0]=Y_3)  # same code as python_script_8

# group: x point- start
python_script_10 = Python(IN[0]=python_script_6, IN[1]=python_script_8)
# ---------- python_script_10.python (12 lines) ----------
# Load the Python Standard and DesignScript Libraries
import sys
import clr
clr.AddReference('ProtoGeometry')
from Autodesk.DesignScript.Geometry import *

# The inputs to this node will be stored as a list in the IN variables.
pt1=IN[0]
pt2=IN[1]

av= list(map(lambda x,y: (x+y)/2, pt1, pt2))
OUT=av
# ----------------------------------------

# group: y poiint start
python_script_11 = Python(IN[0]=python_script_7, IN[1]=python_script_9)  # same code as python_script_10

Z_3 = Point.Z(point=pointGeometry_2)

# group: Z Coordinate
python_script_12 = Python(IN[0]=Z_3)
# ---------- python_script_12.python (9 lines) ----------
# Load the Python Standard and DesignScript Libraries
import sys
import clr
clr.AddReference('ProtoGeometry')
from Autodesk.DesignScript.Geometry import *

pts=IN[0]

OUT=list(map(lambda x: x[0], pts))
# ----------------------------------------

byCoordinates_2 = Point.ByCoordinates(x=python_script_10, y=python_script_11, z=python_script_12)

# group: Line 2 Start
python_script_13 = Python(IN[0]=X_2)  # same code as python_script_8
python_script_14 = Python(IN[0]=Y_2)  # same code as python_script_8

# group: Line 1 end
python_script_15 = Python(IN[0]=X_3)  # same code as python_script_6
python_script_16 = Python(IN[0]=Y_3)  # same code as python_script_6

# group: x point end
python_script_17 = Python(IN[0]=python_script_13, IN[1]=python_script_15)  # same code as python_script_10

# group: y point end
python_script_18 = Python(IN[0]=python_script_14, IN[1]=python_script_16)  # same code as python_script_10

byCoordinates_3 = Point.ByCoordinates(x=python_script_17, y=python_script_18, z=python_script_12)

# group: LINE PASSING THROUGH THE MIDDLE OF WINDOW AT THE BASE
byStartPointEndPoint = Line.ByStartPointEndPoint(startPoint=byCoordinates_2, endPoint=byCoordinates_3)

# group: Intersection point
python_script_19 = Python(IN[0]=python_script_3, IN[1]=byStartPointEndPoint)
# ---------- python_script_19.python (29 lines) ----------
# Load the Python Standard and DesignScript Libraries
import sys
import clr
clr.AddReference('ProtoGeometry')
from Autodesk.DesignScript.Geometry import *

# The inputs to this node will be stored as a list in the IN variables.
surfaces=IN[0]
line=IN[1]
points=[]
index_l=[]
index_w=[]

for ind, i in enumerate(surfaces):
	index_w1=[]
	pts=[]
	index_l1=[]
	if i!='':
		for ind1, j in enumerate(line):
			if j!='':
				boo1=str(j.DoesIntersect(i))
				if boo1=="True":
					index_w.append(ind)	
					pt=j.Intersect(i)
					points.append(pt)
					index_l.append(ind1)
	
		
OUT = points, index_w, index_l
# ----------------------------------------

# group: Elements at intersection
code_block_11 = CodeBlock(a=python_script_19) { a[1]; }

getItemAtIndex_5 = List.GetItemAtIndex(list=getItemAtIndex_2, index=code_block_11)
flatten_2 = List.Flatten(list=getItemAtIndex_5)

# group: INPUT
family_types = FamilyTypes("3IM_DYN_void Cut:Rough Openings")

# group: Intersection Points
code_block_12 = CodeBlock(a=python_script_19) { a[0]; }

flatten_3 = List.Flatten(list=code_block_12)
# note: Custom Node: spring nodes v.110.0.2
byPoints = Custom[Springs.HostedInstance.ByPoints](host=flatten_2, type=family_types, point=flatten_3)  # package spring nodes; Creates hosted family instances(doors/windows) at the specified points. You can feed either a single family type or a unique type for each instance.

# group: Void Parameters
code_block_13 = CodeBlock { "Width"; }
code_block_14 = CodeBlock { "Height"; }

code_block_15 = CodeBlock(a=python_script_19) { a[2]; }
getItemAtIndex_6 = List.GetItemAtIndex(list=getItemAtIndex_4, index=code_block_15)
code_block_16 = CodeBlock { "AZA_Foro muratura interna Larghezza"; }
ʳʰʸᵗʰᵐ_elements_4 = Rhythm.Revit.Elements.Elements.GetParameterValueByNameTypeOrInstance(element=getItemAtIndex_6, parameterName=code_block_16)
ʳʰʸᵗʰᵐ_elements_5 = Rhythm.Revit.Elements.Elements.SetParameterByNameTypeOrInstance(element=byPoints, parameterName=code_block_13, value=ʳʰʸᵗʰᵐ_elements_4)
code_block_17 = CodeBlock { "AZA_Foro muratura interna Altezza"; }
ʳʰʸᵗʰᵐ_elements_6 = Rhythm.Revit.Elements.Elements.GetParameterValueByNameTypeOrInstance(element=getItemAtIndex_6, parameterName=code_block_17)
ʳʰʸᵗʰᵐ_elements_7 = Rhythm.Revit.Elements.Elements.SetParameterByNameTypeOrInstance(element=ʳʰʸᵗʰᵐ_elements_5, parameterName=code_block_14, value=ʳʰʸᵗʰᵐ_elements_6)
# note: Custom Node: Clockwork v.2.3.0
cutGeometry = Custom[Element.CutGeometry](elementToBeCut=flatten_2, cuttingElement=ʳʰʸᵗʰᵐ_elements_7)  # package Clockwork for Dynamo 2.x; Adds a solid-solid cut for two model elements (if possible).
level = Custom[Element.Level](element=flatten_2)  # package Clockwork for Dynamo 2.x; Gets an element's level
# note: Custom Node: WombatDynamo v.1.3.2
byPointHostTypeAndLevel = WombatDynamo.FamilyInstance.ByPointHostTypeAndLevel(location=flatten_3, host=flatten_2, familyType=family_types, level=level)  # frozen
