# Dynamo graph 1.0 Placing voids on the floors and creating Inclined Plane.dyn (Dynamo 2.6.1.8786)
# packages: archi-lab.net 2021.25.2621, spring nodes 110.0.2, Clockwork for Dynamo 2.x 2.3.0, Rhythm 2021.4.2

categories = Categories("OST_FloorTags")
all_elements_of_category = ElementsOfCategory(Category=categories)
tag_host_element = Custom[Tag Host Element](tag=all_elements_of_category)  # package archi-lab.net; This node will retrieve an element that is hosting a given tag.
family_types = FamilyTypes("Family1:Family1")
geometry = Element.Geometry(element=tag_host_element)
centroid = Solid.Centroid(solid=geometry)
X = Point.X(point=centroid)
flatten = List.Flatten(list=X)
Y = Point.Y(point=centroid)
flatten_2 = List.Flatten(list=Y)
Z = Point.Z(point=centroid)
code_block = CodeBlock { "Thickness"; }
getParameterValueByName = Element.GetParameterValueByName(element=tag_host_element, parameterName=code_block)
python_script = Python(IN[0]=Z, IN[1]=getParameterValueByName)
# ---------- python_script.python (8 lines) ----------
# Load the Python Standard and DesignScript Libraries
import sys
import clr
clr.AddReference('ProtoGeometry')
from Autodesk.DesignScript.Geometry import *

# The inputs to this node will be stored as a list in the IN variables.
OUT=[i[0]+IN[1][ind]/2 for ind, i in enumerate(IN[0])]
# ----------------------------------------
byCoordinates = Point.ByCoordinates(x=flatten, y=flatten_2, z=python_script)
byPoints = Custom[Springs.HostedInstance.ByPoints](host=tag_host_element, type=family_types, point=byCoordinates)  # package spring nodes; Creates hosted family instances(doors/windows) at the specified points. You can feed either a single family type or a unique type for each instance.
code_block_2 = CodeBlock { "Depth"; }
nullSetParameter = Custom[Springs.NullSetParameter](element=byPoints, parameter=code_block_2, value=getParameterValueByName)  # package spring nodes; Similar to the built-in function but with the ability to handle null values. Part of the SmartCopyMon workflow.
cutGeometry = Custom[Element.CutGeometry](elementToBeCut=tag_host_element, cuttingElement=nullSetParameter)  # package Clockwork for Dynamo 2.x; Adds a solid-solid cut for two model elements (if possible).
ʳʰʸᵗʰᵐ_elements = Rhythm.Revit.Elements.Elements.SetParameterByNameTypeOrInstance(element=byPoints, parameterName=code_block_2)  # unwired: value
