# Dynamo graph 3. Floor Layering.dyn (Dynamo 2.6.1.8786)
# packages: Rhythm 2021.4.2, Sastrugi 2.0.0, Orchid 206.3.0.7800

# group: All Inclined Floors
categories = Categories("OST_Floors")
all_elements_of_category = ElementsOfCategory(Category=categories)
code_block = CodeBlock { "Elevation at Top"; }
ʳʰʸᵗʰᵐ_elements = Rhythm.Revit.Elements.Elements.GetParameterValueByNameTypeOrInstance(element=all_elements_of_category, parameterName=code_block)
python_script = Python(IN[0]=all_elements_of_category, IN[1]=ʳʰʸᵗʰᵐ_elements)
# ---------- python_script.python (14 lines) ----------
# Load the Python Standard and DesignScript Libraries
import sys
import clr
clr.AddReference('ProtoGeometry')
from Autodesk.DesignScript.Geometry import *

# The inputs to this node will be stored as a list in the IN variables.
floors=IN[0]
elev=IN[1]
floorf=[]
for ind, i in enumerate(elev):
	if i!=None and i!=[] and type(i)!=int and type(i)!=float:
		floorf.append(ind)
OUT= floorf
# ----------------------------------------
getItemAtIndex = List.GetItemAtIndex(list=all_elements_of_category, index=python_script)

solids = Element.Solids(element=getItemAtIndex)
faces = Topology.Faces(topology=solids@L2)
surfaceGeometry = Face.SurfaceGeometry(face=faces@L2)
area = Surface.Area(surface=surfaceGeometry)
python_script_2 = Python(IN[0]=area)
# ---------- python_script_2.python (13 lines) ----------
# Load the Python Standard and DesignScript Libraries
import sys
import clr
clr.AddReference('ProtoGeometry')
from Autodesk.DesignScript.Geometry import *

# The inputs to this node will be stored as a list in the IN variables.
points=IN[0]

points=[sorted(i) for i in points]
points_sub=[i[(len(i)-2)::] for i in points]

OUT=points_sub
# ----------------------------------------
python_script_3 = Python(IN[0]=surfaceGeometry, IN[1]=area, IN[2]=python_script_2)
# ---------- python_script_3.python (27 lines) ----------
# Load the Python Standard and DesignScript Libraries
import sys
import clr
clr.AddReference('ProtoGeometry')
from Autodesk.DesignScript.Geometry import *

# The inputs to this node will be stored as a list in the IN variables.
surface=IN[0]
areas=IN[1]
bot_top_surf=IN[2]
surface_interest=[]


for ind, i in enumerate(surface):
	sub=[]
	area=areas[ind]
	for ind1, j in enumerate(area):
		if j in bot_top_surf[ind]:	
			sub.append(i[ind1])
	surface_interest.append(sub)
	
top=[]
bottom=[]
for i in surface_interest:
	top.append(i[1])
	bottom.append(i[0])
OUT=top, bottom
# ----------------------------------------
bottom = CodeBlock(a=python_script_3) { a[1]; }
surface_plane = Custom[❄_Surface Plane](InputSurfaces=bottom)  # package Sastrugi; (Sastrugi_Geometry) This node will extract a plane that best fits a surface.

# group: Select Floor if not all inclined floors are to be taken
select_model_elements = DSModelElementsSelection()  # nothing selected; frozen

flatten = List.Flatten(list=solids)
top = CodeBlock(a=python_script_3) { a[0]; }
surface_plane_2 = Custom[❄_Surface Plane](InputSurfaces=top)
flatten_2 = List.Flatten(list=surface_plane_2)
offset_from_base_incline = CodeBlock { [50,100,150,200,250]; }
python_script_4 = Python(IN[0]=flatten_2, IN[1]=offset_from_base_incline)
# ---------- python_script_4.python (50 lines) ----------
import clr #This is .NET's Common Language Runtime. It's an execution environment
#that is able to execute code from several different languages.
import sys #sys is a fundamental Python library - here, we're using it to load in
#the standard IronPython libraries
sys.path.append('C:\Program Files (x86)\IronPython 2.7\Lib') #Imports the
#standard IronPython libraries, which cover everything from servers and
#encryption through to regular expressions.
import System #The System namespace at the root of .NET
from System import Array #.NET class for handling array information
from System.Collections.Generic import * #Lets you handle generics. Revit's API
#sometimes wants hard-typed 'generic' lists, called ILists. If you don't need
#these you can delete this line.
clr.AddReference('ProtoGeometry')  #A Dynamo library for its proxy geometry
#classes. You'll only need this if you're interacting with geometry.
from Autodesk.DesignScript.Geometry import * #Loads everything in Dynamo's
#geometry library
clr.AddReference("RevitNodes") #Dynamo's nodes for Revit
import Revit #Loads in the Revit namespace in RevitNodes
clr.ImportExtensions(Revit.Elements) #More loading of Dynamo's Revit libraries
clr.ImportExtensions(Revit.GeometryConversion) #More loading of Dynamo's
#Revit libraries. You'll only need this if you're interacting with geometry.
clr.AddReference("RevitServices") #Dynamo's classes for handling Revit documents
import RevitServices 
from RevitServices.Persistence import DocumentManager #An internal Dynamo class
#that keeps track of the document that Dynamo is currently attached to
from RevitServices.Transactions import TransactionManager #A Dynamo class for
#opening and closing transactions to change the Revit document's database

clr.AddReference("RevitAPI") #Adding reference to Revit's API DLLs
clr.AddReference("RevitAPIUI") #Adding reference to Revit's API DLLs

import Autodesk #Loads the Autodesk namespace
from Autodesk.Revit.DB import * #Loading Revit's API classes
from Autodesk.Revit.UI import * #Loading Revit's API UI classes  

doc = DocumentManager.Instance.CurrentDBDocument #Finally, setting up handles to the active Revit document
uiapp = DocumentManager.Instance.CurrentUIApplication #Setting a handle to the active Revit UI document
app = uiapp.Application  #Setting a handle to the currently-open instance of the Revit application
uidoc = uiapp.ActiveUIDocument #Setting a handle to the currently-open instance of the Revit UI application

planes=IN[0]
offset=IN[1]
planes_offset=[]
for ind, i in enumerate(planes):
	sub=[]
	for j in range(len(offset)):
		new=i.Offset(offset[j])
		sub.append(new)
	planes_offset.append(sub)
OUT=planes_offset
# ----------------------------------------

# group: Splitting Elements
python_script_5 = Python(IN[0]=flatten, IN[1]=python_script_4)
# ---------- python_script_5.python (32 lines) ----------
import clr
import sys
clr.AddReference('ProtoGeometry')
from Autodesk.DesignScript.Geometry import *


solids1=IN[0]
planes1=IN[1]
solids=[]
for ind, solid in enumerate(solids1):
	solid_sub=[]
	planes=planes1[ind]
	for ind, i in enumerate(planes):
		sol1=Geometry.Split(solid, i)
		if len(sol1)==2 and ind<len(planes)-1:
			boo1=str(sol1[0].DoesIntersect(planes[ind+1]))
			if boo1=="True":
				solid=sol1[0]
				solid_sub.append(sol1[1])
			else:
				solid=sol1[1]
				solid_sub.append(sol1[0])
		else:
			solid_sub.append(solid)
		
	solids1=Geometry.Split(solid_sub[-1], planes[-1])
	if len(solids1)==2:
		solid_sub[-1]=solids1[0]
		solid_sub.append(solids1[1])
	solids.append(solid_sub)

OUT=solids
# ----------------------------------------

categories_2 = Categories("OST_Floors")
code_block_2 = CodeBlock { ["Oak Flooring","Asphalt, Bitumen", "Brick, Common", "Concrete", "Damp-proofing", "Glass"]; }
byName = Material.ByName(name=code_block_2)

# group: Generating names
python_script_6 = Python(IN[0]=python_script_5, IN[1]=code_block_2)
# ---------- python_script_6.python (52 lines) ----------
import clr #This is .NET's Common Language Runtime. It's an execution environment
#that is able to execute code from several different languages.
import sys #sys is a fundamental Python library - here, we're using it to load in
#the standard IronPython libraries
sys.path.append('C:\Program Files (x86)\IronPython 2.7\Lib') #Imports the
#standard IronPython libraries, which cover everything from servers and
#encryption through to regular expressions.
import System #The System namespace at the root of .NET
from System import Array #.NET class for handling array information
from System.Collections.Generic import * #Lets you handle generics. Revit's API
#sometimes wants hard-typed 'generic' lists, called ILists. If you don't need
#these you can delete this line.
clr.AddReference('ProtoGeometry')  #A Dynamo library for its proxy geometry
#classes. You'll only need this if you're interacting with geometry.
from Autodesk.DesignScript.Geometry import * #Loads everything in Dynamo's
#geometry library
clr.AddReference("RevitNodes") #Dynamo's nodes for Revit
import Revit #Loads in the Revit namespace in RevitNodes
clr.ImportExtensions(Revit.Elements) #More loading of Dynamo's Revit libraries
clr.ImportExtensions(Revit.GeometryConversion) #More loading of Dynamo's
#Revit libraries. You'll only need this if you're interacting with geometry.
clr.AddReference("RevitServices") #Dynamo's classes for handling Revit documents
import RevitServices 
from RevitServices.Persistence import DocumentManager #An internal Dynamo class
#that keeps track of the document that Dynamo is currently attached to
from RevitServices.Transactions import TransactionManager #A Dynamo class for
#opening and closing transactions to change the Revit document's database

clr.AddReference("RevitAPI") #Adding reference to Revit's API DLLs
clr.AddReference("RevitAPIUI") #Adding reference to Revit's API DLLs

import Autodesk #Loads the Autodesk namespace
from Autodesk.Revit.DB import * #Loading Revit's API classes
from Autodesk.Revit.UI import * #Loading Revit's API UI classes  

doc = DocumentManager.Instance.CurrentDBDocument #Finally, setting up handles to the active Revit document
uiapp = DocumentManager.Instance.CurrentUIApplication #Setting a handle to the active Revit UI document
app = uiapp.Application  #Setting a handle to the currently-open instance of the Revit application
uidoc = uiapp.ActiveUIDocument #Setting a handle to the currently-open instance of the Revit UI application

inp=[UnwrapElement(i) for i in IN[0]]


size=len(inp)

name_general=IN[1]
new=[]
for i in inp:
	new.append(name_general)
	

OUT=new
# ----------------------------------------

byGeometry = DirectShape.ByGeometry(geometry=python_script_5, category=categories_2, material=byName@L2, name=python_script_6)
code_block_3 = CodeBlock { "Mark"; }

# group: Setting "Mark" parameter with names of solids
ʳʰʸᵗʰᵐ_elements_2 = Rhythm.Revit.Elements.Elements.SetParameterByNameTypeOrInstance(element=byGeometry, parameterName=code_block_3, value=python_script_6)

materials = Material("Glass")
volume = Solid.Volume(solid=python_script_5)
