# Dynamo graph 5. Floor Layering using compound structures.dyn (Dynamo 2.5.0.7460)
# packages: Rhythm 2020.1.22, Sastrugi 2.0.0, Clockwork for Dynamo 2.x 2.3.0, Modelical 2.2.19

# group: All Inclined Floors
categories = Categories("OST_Floors")
all_elements_of_category = ElementsOfCategory(Category=categories)
code_block = CodeBlock { "Elevation at Top"; }
# note: The Script needs to be run "twice".
# 1. Select Model Elements in the first Node and again make the same selection in "Delete Element Group".
# 2. Step2- Freeze The "Delete Element Group" and run the script.
# 3. Step3- Freeze the first select model
# element after runing the script once and unfreeze the "delete element group" and run the script.
ʳʰʸᵗʰᵐ_elements = Rhythm.Revit.Elements.Elements.GetParameterValueByNameTypeOrInstance(element=all_elements_of_category, parameterName=code_block)
python_script = Python(IN[0]=all_elements_of_category, IN[1]=ʳʰʸᵗʰᵐ_elements)
# ---------- python_script.python (14 lines) ----------
# Load the Python Standard and DesignScript Libraries
import sys
import clr
clr.AddReference('ProtoGeometry')
from Autodesk.DesignScript.Geometry import *

# The inputs to this node will be stored as a list in the IN variables.
floors=IN[0]
elev=IN[1]
floorf=[]
for ind, i in enumerate(elev):
	if i!=None and i!=[] and type(i)!=int and type(i)!=float:
		floorf.append(ind)
OUT= floorf
# ----------------------------------------
getItemAtIndex = List.GetItemAtIndex(list=all_elements_of_category, index=python_script)

# group: Select Floor if not all inclined floors are to be taken
# note: First "Select model Elements" node.
select_model_elements = DSModelElementsSelection()  # 2 picked in the model; frozen

elementType = Element.ElementType(element=select_model_elements)
compoundStructureLayers = Custom[FamilyType.CompoundStructureLayers](elementType=elementType)  # package Clockwork for Dynamo 2.x; Retrieves the compound layers of any layered family type (wall types, roof types, floor types etc.)
finish_type = CodeBlock(purpose=compoundStructureLayers.functions) { purpose; }
solids = Element.Solids(element=select_model_elements)
faces = Topology.Faces(topology=solids@L2)
surfaceGeometry = Face.SurfaceGeometry(face=faces@L2)
area = Surface.Area(surface=surfaceGeometry)
python_script_2 = Python(IN[0]=area)
# ---------- python_script_2.python (13 lines) ----------
# Load the Python Standard and DesignScript Libraries
import sys
import clr
clr.AddReference('ProtoGeometry')
from Autodesk.DesignScript.Geometry import *

# The inputs to this node will be stored as a list in the IN variables.
points=IN[0]

points=[sorted(i) for i in points]
points_sub=[i[(len(i)-2)::] for i in points]

OUT=points_sub
# ----------------------------------------
python_script_3 = Python(IN[0]=surfaceGeometry, IN[1]=area, IN[2]=python_script_2)
# ---------- python_script_3.python (27 lines) ----------
# Load the Python Standard and DesignScript Libraries
import sys
import clr
clr.AddReference('ProtoGeometry')
from Autodesk.DesignScript.Geometry import *

# The inputs to this node will be stored as a list in the IN variables.
surface=IN[0]
areas=IN[1]
bot_top_surf=IN[2]
surface_interest=[]


for ind, i in enumerate(surface):
	sub=[]
	area=areas[ind]
	for ind1, j in enumerate(area):
		if j in bot_top_surf[ind]:	
			sub.append(i[ind1])
	surface_interest.append(sub)
	
top=[]
bottom=[]
for i in surface_interest:
	top.append(i[1])
	bottom.append(i[0])
OUT=top, bottom
# ----------------------------------------
top = CodeBlock(a=python_script_3) { a[0]; }
surface_plane = Custom[❄_Surface Plane](InputSurfaces=top)  # package Sastrugi; (Sastrugi_Geometry) This node will extract a plane that best fits a surface.
flatten = List.Flatten(list=surface_plane)
thickness = CodeBlock(Thickness=compoundStructureLayers.widths) { Thickness; }
viariability_of_thickness = CodeBlock(Vaiable_Thi=compoundStructureLayers.isVariable) { Vaiable_Thi; }
bottom = CodeBlock(a=python_script_3) { a[1]; }
surface_plane_2 = Custom[❄_Surface Plane](InputSurfaces=bottom)
flatten_2 = List.Flatten(list=surface_plane_2)
flatten_3 = List.Flatten(list=solids)
python_script_4 = Python(IN[0]=flatten, IN[1]=thickness, IN[2]=viariability_of_thickness, IN[3]=flatten_2, IN[4]=flatten_3)
# ---------- python_script_4.python (166 lines) ----------
import clr #This is .NET's Common Language Runtime. It's an execution environment
#that is able to execute code from several different languages.
import sys #sys is a fundamental Python library - here, we're using it to load in
#the standard IronPython libraries
sys.path.append('C:\Program Files (x86)\IronPython 2.7\Lib') #Imports the
#standard IronPython libraries, which cover everything from servers and
#encryption through to regular expressions.
import System #The System namespace at the root of .NET
from System import Array #.NET class for handling array information
from System.Collections.Generic import * #Lets you handle generics. Revit's API
#sometimes wants hard-typed 'generic' lists, called ILists. If you don't need
#these you can delete this line.
clr.AddReference('ProtoGeometry')  #A Dynamo library for its proxy geometry
#classes. You'll only need this if you're interacting with geometry.
from Autodesk.DesignScript.Geometry import * #Loads everything in Dynamo's
#geometry library
clr.AddReference("RevitNodes") #Dynamo's nodes for Revit
import Revit #Loads in the Revit namespace in RevitNodes
clr.ImportExtensions(Revit.Elements) #More loading of Dynamo's Revit libraries
clr.ImportExtensions(Revit.GeometryConversion) #More loading of Dynamo's
#Revit libraries. You'll only need this if you're interacting with geometry.
clr.AddReference("RevitServices") #Dynamo's classes for handling Revit documents
import RevitServices 
from RevitServices.Persistence import DocumentManager #An internal Dynamo class
#that keeps track of the document that Dynamo is currently attached to
from RevitServices.Transactions import TransactionManager #A Dynamo class for
#opening and closing transactions to change the Revit document's database

clr.AddReference("RevitAPI") #Adding reference to Revit's API DLLs
clr.AddReference("RevitAPIUI") #Adding reference to Revit's API DLLs

import Autodesk #Loads the Autodesk namespace
from Autodesk.Revit.DB import * #Loading Revit's API classes
from Autodesk.Revit.UI import * #Loading Revit's API UI classes  

doc = DocumentManager.Instance.CurrentDBDocument #Finally, setting up handles to the active Revit document
uiapp = DocumentManager.Instance.CurrentUIApplication #Setting a handle to the active Revit UI document
app = uiapp.Application  #Setting a handle to the currently-open instance of the Revit application
uidoc = uiapp.ActiveUIDocument #Setting a handle to the currently-open instance of the Revit UI application

planes=IN[0]
thickness_layer=IN[1]
variability=IN[2]
base_plane=IN[3]
solids=IN[4]

offset=[]

for ind, i in enumerate(thickness_layer):
	sub=[]
	k=0
	for ind1, j in enumerate(i):
		if ind1<len(i)-1:
			k=k+j
			sub.append(k)
	offset.append(sub)

offset_r=[]

for ind, i in enumerate(thickness_layer):
	sub=[]
	i_r=i[::-1]
	k=0
	for ind1, j in enumerate(i_r):
		if ind1<len(i_r)-1:
			k=k+j
			sub.append(k)
	offset_r.append(sub)




boo2=[]
planes_offset=[]
for ind, i in enumerate(planes):
	offset_sub=offset[ind]
	variability_sub=variability[ind]
	true_index=variability_sub.index(True)
#	base_plane_sub=base_plane[ind]
	sub=[]
	for j in range(true_index):
		new=i.Offset(offset_sub[j])
		boo1=str(solids[ind].DoesIntersect(new))
		if boo1=="True":
			sub.append(new)
	if sub!=[]:
		planes_offset.append(sub)
	#boo2.append(boo1)

planes_offset1=[]
for ind, i in enumerate(base_plane):
	offset_sub=offset_r[ind]
	variability_sub=variability[ind]
	variability_sub=variability_sub[::-1]
	true_index=variability_sub.index(True)
#	base_plane_sub=base_plane[ind]
	sub=[]
	
	for j in range(true_index):
		new=i.Offset(offset_sub[j])
		boo1=str(solids[ind].DoesIntersect(new))
		if boo1=="True":
			sub.append(new)
	if sub!=[]:	
		planes_offset1.append(sub)

############################ Reverse Offset


boo2=[]
planes_offset_r=[]
for ind, i in enumerate(planes):
	offset_sub=offset[ind]
	variability_sub=variability[ind]
	true_index=variability_sub.index(True)
#	base_plane_sub=base_plane[ind]
	sub=[]

	
	for j in range(true_index):
		new=i.Offset(-1*offset_sub[j])
		boo1=str(solids[ind].DoesIntersect(new))
		if boo1=="True":
			sub.append(new)
	if sub!=[]:	
		planes_offset.append(sub)
	#boo2.append(boo1)

planes_offset1_r=[]
for ind, i in enumerate(base_plane):
	offset_sub=offset_r[ind]
	variability_sub=variability[ind]
	variability_sub=variability_sub[::-1]
	true_index=variability_sub.index(True)
#	base_plane_sub=base_plane[ind]
	sub=[]

	
	for j in range(true_index):
		new=i.Offset(-1*offset_sub[j])
		boo1=str(solids[ind].DoesIntersect(new))
		if boo1=="True":
			sub.append(new)
	if sub!=[]:	
		planes_offset1.append(sub)



#########################################

planef=[]
for ind, i in enumerate(planes_offset):
	sub=i+planes_offset1[-ind]
	planef.append(sub)


#########################################





OUT=planef

	
#OUT= offset_r
# ----------------------------------------
code_block_2 = CodeBlock { 10000; }
byWidthLength = Rectangle.ByWidthLength(plane=python_script_4, width=code_block_2, length=code_block_2)

# group: Splitting Elements
python_script_5 = Python(IN[0]=flatten_3, IN[1]=python_script_4)
# ---------- python_script_5.python (47 lines) ----------
import clr
import sys
clr.AddReference('ProtoGeometry')
from Autodesk.DesignScript.Geometry import *


solids1=IN[0]
planes1=IN[1]
solids=[]
for ind, solid in enumerate(solids1):
	solid_sub=[]
	planes=planes1[ind]
	sol1=Geometry.Split(solid, planes[0])
	if len(sol1)==2:
		for ind, i in enumerate(planes):
			sol1=Geometry.Split(solid, i)
			if len(sol1)==2 and ind<len(planes)-1:
				boo1=str(sol1[0].DoesIntersect(planes[ind+1]))
				if boo1=="True":
					solid=sol1[0]
					solid_sub.append(sol1[1])
				else:
					solid=sol1[1]
					solid_sub.append(sol1[0])
			else:
				solid_sub.append(solid)
	elif len(sol1)==1:
		for ind, i in enumerate(planes[1::]):
			sol1=Geometry.Split(solid, planes[ind])
			if len(sol1)==2 and ind<len(planes)-1:
				boo1=str(sol1[0].DoesIntersect(planes[ind+1]))
				if boo1=="True":
					solid=sol1[0]
					solid_sub.append(sol1[1])
				else:
					solid=sol1[1]
					solid_sub.append(sol1[0])
			else:
				solid_sub.append(solid)
				
	solids1=Geometry.Split(solid_sub[-1], planes[-1])
	if len(solids1)==2:
		solid_sub[-1]=solids1[0]
		solid_sub.append(solids1[1])
	solids.append(solid_sub)

OUT=solids
# ----------------------------------------

categories_2 = Categories("OST_Floors")
materials = CodeBlock(material=compoundStructureLayers.materials) { material; }

# group: Change Material Parameter
code_block_3 = CodeBlock { "Description"; }

ʳʰʸᵗʰᵐ_elements_2 = Rhythm.Revit.Elements.Elements.GetParameterValueByNameTypeOrInstance(element=materials, parameterName=code_block_3)
code_block_4 = CodeBlock { "3IM_ARC_FLS"; }

# group: Generating names
python_script_6 = Python(IN[0]=ʳʰʸᵗʰᵐ_elements_2, IN[1]=thickness, IN[2]=code_block_4)
# ---------- python_script_6.python (56 lines) ----------
import clr #This is .NET's Common Language Runtime. It's an execution environment
#that is able to execute code from several different languages.
import sys #sys is a fundamental Python library - here, we're using it to load in
#the standard IronPython libraries
sys.path.append('C:\Program Files (x86)\IronPython 2.7\Lib') #Imports the
#standard IronPython libraries, which cover everything from servers and
#encryption through to regular expressions.
import System #The System namespace at the root of .NET
from System import Array #.NET class for handling array information
from System.Collections.Generic import * #Lets you handle generics. Revit's API
#sometimes wants hard-typed 'generic' lists, called ILists. If you don't need
#these you can delete this line.
clr.AddReference('ProtoGeometry')  #A Dynamo library for its proxy geometry
#classes. You'll only need this if you're interacting with geometry.
from Autodesk.DesignScript.Geometry import * #Loads everything in Dynamo's
#geometry library
clr.AddReference("RevitNodes") #Dynamo's nodes for Revit
import Revit #Loads in the Revit namespace in RevitNodes
clr.ImportExtensions(Revit.Elements) #More loading of Dynamo's Revit libraries
clr.ImportExtensions(Revit.GeometryConversion) #More loading of Dynamo's
#Revit libraries. You'll only need this if you're interacting with geometry.
clr.AddReference("RevitServices") #Dynamo's classes for handling Revit documents
import RevitServices 
from RevitServices.Persistence import DocumentManager #An internal Dynamo class
#that keeps track of the document that Dynamo is currently attached to
from RevitServices.Transactions import TransactionManager #A Dynamo class for
#opening and closing transactions to change the Revit document's database

clr.AddReference("RevitAPI") #Adding reference to Revit's API DLLs
clr.AddReference("RevitAPIUI") #Adding reference to Revit's API DLLs

import Autodesk #Loads the Autodesk namespace
from Autodesk.Revit.DB import * #Loading Revit's API classes
from Autodesk.Revit.UI import * #Loading Revit's API UI classes  

doc = DocumentManager.Instance.CurrentDBDocument #Finally, setting up handles to the active Revit document
uiapp = DocumentManager.Instance.CurrentUIApplication #Setting a handle to the active Revit UI document
app = uiapp.Application  #Setting a handle to the currently-open instance of the Revit application
uidoc = uiapp.ActiveUIDocument #Setting a handle to the currently-open instance of the Revit UI application

keynote=IN[0]
thickness=IN[1]
prefix=IN[2]
suffix='mm'

new=[]

for ind, i in enumerate(thickness):
	keynote_sub=keynote[ind]
	sub=[]
	for ind1, j in enumerate(i):
		name=prefix+'_'+keynote_sub[ind1]+"_"+ str(j)+'_'+suffix
		sub.append(name)
	new.append(sub)		

OUT=new
# ----------------------------------------

byGeometry = DirectShape.ByGeometry(geometry=python_script_5, category=categories_2, material=materials, name=python_script_6)
code_block_5 = CodeBlock { "Mark"; }

# group: Setting "Mark" parameter with names of solids
ʳʰʸᵗʰᵐ_elements_3 = Rhythm.Revit.Elements.Elements.SetParameterByNameTypeOrInstance(element=byGeometry, parameterName=code_block_5, value=python_script_6)

code_block_6 = CodeBlock { "Comments"; }
volume = Solid.Volume(solid=python_script_5)
string_from_object = FromObject(obj=volume)
ʳʰʸᵗʰᵐ_elements_4 = Rhythm.Revit.Elements.Elements.SetParameterByNameTypeOrInstance(element=ʳʰʸᵗʰᵐ_elements_3, parameterName=code_block_6, value=string_from_object)

# group: Duplicate this for different parameters of the new floors
code_block_7 = CodeBlock { "Mark"; }
ʳʰʸᵗʰᵐ_elements_5 = Rhythm.Revit.Elements.Elements.SetParameterByNameTypeOrInstance(element=byGeometry, parameterName=code_block_7, value=python_script_6)  # frozen

# group: To Delete old Elements
select_model_elements_2 = DSModelElementsSelection()  # 2 picked in the model
deleteElements = Custom[DeleteElements](elemOrId=select_model_elements_2)  # package Modelical; Delete Revit elements by element or by ID
# note: "Delete Element Group"
categories_3 = Categories("OST_Floors")
all_elements_of_category_2 = ElementsOfCategory(Category=categories_3)
code_block_8 = CodeBlock { "Elevation at Top"; }
ʳʰʸᵗʰᵐ_elements_6 = Rhythm.Revit.Elements.Elements.GetParameterValueByNameTypeOrInstance(element=all_elements_of_category_2, parameterName=code_block_8)
python_script_7 = Python(IN[0]=all_elements_of_category_2, IN[1]=ʳʰʸᵗʰᵐ_elements_6)  # same code as python_script
getItemAtIndex_2 = List.GetItemAtIndex(list=all_elements_of_category_2, index=python_script_7)
