# Dynamo graph Automatic Insertion of Views in Existing Sheets based on Sheet Number.dyn (Dynamo 2.5.0.7460)
# packages: Rhythm 2020.1.22

categories = Categories("OST_Sheets")
all_elements_of_category = ElementsOfCategory(Category=categories)
sheetNumber = Sheet.SheetNumber(sheet=all_elements_of_category)
categories_2 = Categories("OST_Views")
all_elements_of_category_2 = ElementsOfCategory(Category=categories_2)
code_block = CodeBlock { "Sheet Name"; }
ʳʰʸᵗʰᵐ_elements = Rhythm.Revit.Elements.Elements.GetParameterValueByNameTypeOrInstance(element=all_elements_of_category_2, parameterName=code_block)
python_script = Python(IN[0]=ʳʰʸᵗʰᵐ_elements)
# ---------- python_script.python (15 lines) ----------
# Load the Python Standard and DesignScript Libraries
import sys
import clr
clr.AddReference('ProtoGeometry')
from Autodesk.DesignScript.Geometry import *

# The inputs to this node will be stored as a list in the IN variables.
sheets=IN[0]

index=[]

for ind, i in enumerate(sheets):
	if i!=None and i=="":
		index.append(ind)
OUT=index
# ----------------------------------------
getItemAtIndex = List.GetItemAtIndex(list=all_elements_of_category_2, index=python_script)
name = Element.Name(element=getItemAtIndex)
python_script_2 = Python(IN[0]=name)
# ---------- python_script_2.python (14 lines) ----------
# Load the Python Standard and DesignScript Libraries
import sys
import clr
clr.AddReference('ProtoGeometry')
from Autodesk.DesignScript.Geometry import *

# The inputs to this node will be stored as a list in the IN variables.
index=[]
names=[]
for ind, i in enumerate(IN[0]):	
	if type(i)==str and i!=None:
		names.append(i)
		index.append(ind)
OUT= names, index
# ----------------------------------------
code_block_2 = CodeBlock(a=python_script_2) { a[1]; }
getItemAtIndex_2 = List.GetItemAtIndex(list=getItemAtIndex, index=code_block_2)
code_block_3 = CodeBlock(a=python_script_2) { a[0]; }

# group: Creating viewport
viewport = Python(IN[0]=sheetNumber, IN[1]=all_elements_of_category, IN[2]=getItemAtIndex_2, IN[3]=code_block_3)
# ---------- viewport.python (65 lines) ----------
import clr
clr.AddReference('ProtoGeometry')
from Autodesk.DesignScript.Geometry import *
# Import ToDSType(bool) extension method

pt=Point.ByCoordinates(0,0,0)



###################################################
clr.AddReference("RevitNodes")
import Revit
clr.ImportExtensions(Revit.Elements)
# Import geometry conversion extension methods
clr.ImportExtensions(Revit.GeometryConversion)
# Import DocumentManager and TransactionManager
clr.AddReference("RevitServices")
import RevitServices
from RevitServices.Persistence import DocumentManager
from RevitServices.Transactions import TransactionManager
from System.Collections.Generic import *
# Import RevitAPI
clr.AddReference("RevitAPI")
import Autodesk
from Autodesk.Revit.DB import *

doc = DocumentManager.Instance.CurrentDBDocument
uiapp = DocumentManager.Instance.CurrentUIApplication
app = uiapp.Application
uidoc=DocumentManager.Instance.CurrentUIApplication.ActiveUIDocument


#######################################################

##################################################


sheets_num=IN[0]
sheets=[UnwrapElement(i) for i in IN[1]]

view_name=IN[3]	
views=[UnwrapElement(i) for i in IN[2]]	

view_ports = []

TransactionManager.Instance.EnsureInTransaction(doc)
for ind, s in enumerate(sheets_num):
	try:
		s_string=[string for string in view_name if s in string]
		
		sub=[]	
		if s_string!=[]:
			for i in s_string:
				ind1=view_name.index(i)
				view_sub=views[ind1]
				viewport = Viewport.Create(doc, sheets[ind].Id, view_sub.Id, pt.ToXyz())
				sub.append(viewport)
		view_ports.append(sub)
	except:
		pass
TransactionManager.Instance.TransactionTaskDone()

# Assign your output to the OUT variable.
#OUT = view_ports
OUT= view_ports
# ----------------------------------------
