# Dynamo graph Massive Duplication of Sheets.dyn "Sheet Duplication" (Dynamo 2.5.0.7460)
# packages: Clockwork for Dynamo 2.x 2.3.0, Data-Shapes 2021.2.94, archi-lab.net 2021.25.2721

code_block = CodeBlock { "Views To Duplicate"; }
categories = Categories("OST_Views")
all_elements_of_category = ElementsOfCategory(Category=categories)
name = Custom[Element.Name+](element=all_elements_of_category)  # package Clockwork for Dynamo 2.x; Gets an element's name. Unlike the OOTB node, this node should work for all Revit elements that have names and will also return the localized names of system parameters, parameter groups, display unit types, parameter types, unit symbol types and unit types.

# group: Removing Null and empty values from list
python_script = Python(IN[0]=name)
# ---------- python_script.python (15 lines) ----------
# Load the Python Standard and DesignScript Libraries
import sys
import clr
clr.AddReference('ProtoGeometry')
from Autodesk.DesignScript.Geometry import *

# The inputs to this node will be stored as a list in the IN variables.
index=[]
names=[]

for ind, i in enumerate(IN[0]):
	if i!=None and i!=[] and i!="" and i not in names:
		names.append(i)
		index.append(ind)
OUT= index, names
# ----------------------------------------
code_block_2 = CodeBlock(a=python_script) { a[1]; }
code_block_3 = CodeBlock(a=python_script) { a[0]; }

getItemAtIndex = List.GetItemAtIndex(list=all_elements_of_category, index=code_block_3)
code_block_4 = CodeBlock { 200; false; }

# group: UI for Selection
code_block_5 = CodeBlock { "Views to Duplicate"; }
code_block_6 = CodeBlock { true; "Run"; "Cancel"; 400; }
listview_data = Custom[Listview Data](InputName=code_block, Keys=code_block_2, Values=getItemAtIndex, Height_optionnal=code_block_4.out0, ShowId_optionnal=code_block_4.out1)  # package Data-Shapes; Create data for ListView input in UI.MultiInputForm ++ . Check out www.data-shapes.net for more infos.
ui_multipleinputform = Custom[UI.MultipleInputForm ++](Description_optional=code_block_5, ButtonText_optional=code_block_6.out1, Inputs=listview_data, Toggle=code_block_6.out0, CancelButtonText_optional=code_block_6.out2, Width_optional=code_block_6.out3)  # package Data-Shapes; Create a form with multiple inputs. see www.data-shapes.net for tutorials and infos!

code_block_7 = CodeBlock(a=ui_multipleinputform.User_Inputs) { a[0]; }

# group: Names for Duplication
name_2 = Element.Name(element=ui_multipleinputform.User_Inputs)
python_for_suffix = Python(IN[0]=ui_multipleinputform.User_Inputs, IN[1]=name_2)
# ---------- python_for_suffix.python (16 lines) ----------
# Load the Python Standard and DesignScript Libraries
import sys
import clr
clr.AddReference('ProtoGeometry')
from Autodesk.DesignScript.Geometry import *

# The inputs to this node will be stored as a list in the IN variables.
views=IN[0][0]
names=IN[1][0]
names_dup=[]
for ind, i  in enumerate(views):
	if i!=None:
		name=names[ind]
		name= str(name)+"_DUP"
		names_dup.append(name)
OUT=names_dup
# ----------------------------------------

# group: Duplicate options
duplicate_options = DuplicateOptionsUi("Duplicate")

duplicate = archilab.Revit.Views.Views.Duplicate(view=code_block_7, name=python_for_suffix, options=duplicate_options)
