# Dynamo graph 1. Volume Assignment.dyn (Dynamo 2.5.0.7460)
# packages: Rhythm 2020.1.22, Orchid 203.3.0.7815, Clockwork for Dynamo 2.x 2.3.0, Genius Loci 2021.5.18

select_model_elements = DSModelElementsSelection()  # 131 picked in the model
categories = Categories("OST_Rooms")
all_elements_of_category = ElementsOfCategory(Category=categories)
solids = Element.Solids(element=all_elements_of_category)
python_script = Python(IN[0]=solids)
# ---------- python_script.python (20 lines) ----------
# Load the Python Standard and DesignScript Libraries
import sys
import clr
clr.AddReference('ProtoGeometry')
from Autodesk.DesignScript.Geometry import *

# The inputs to this node will be stored as a list in the IN variables.
elem=IN[0]
solids=[]
solid_index=[]
no_solid=[]
for ind, i in enumerate(elem):
	if i!=None and i!=[]:
		solids.append(i)
		solid_index.append(ind)
		
	else:
		no_solid.append(ind)

OUT=solids, solid_index, no_solid
# ----------------------------------------

# group: Elements converted to Solids
code_block = CodeBlock(a=python_script) { a[1]; }
getItemAtIndex = List.GetItemAtIndex(list=all_elements_of_category, index=code_block)

# group: Parameter to fill
code_block_2 = CodeBlock { "Comments"; }

code_block_3 = CodeBlock(a=python_script) { a[0]; }
volume = Solid.Volume(solid=code_block_3)
python_script_2 = Python(IN[0]=volume)
# ---------- python_script_2.python (20 lines) ----------
# Load the Python Standard and DesignScript Libraries
import sys
import clr
clr.AddReference('ProtoGeometry')
from Autodesk.DesignScript.Geometry import *

# The inputs to this node will be stored as a list in the IN variables.
elem=IN[0]
volumes=[]
vol_index=[]
no_vol=[]
for ind, i in enumerate(elem):
	if i!=None and i!=[]:
		volumes.append(i)
		vol_index.append(ind)
		
	else:
		no_vol.append(ind)

OUT=volumes, vol_index, no_vol
# ----------------------------------------
code_block_4 = CodeBlock(a=python_script_2) { a[0]; }
code_block_5 = CodeBlock(a=code_block_4) { a/1000000000; }
string_from_object = FromObject(obj=code_block_5)
ʳʰʸᵗʰᵐ_elements = Rhythm.Revit.Elements.Elements.SetParameterByNameTypeOrInstance(element=getItemAtIndex, parameterName=code_block_2, value=string_from_object)

# group: Elements not converted to Solids
code_block_6 = CodeBlock(a=python_script) { a[2]; }
getItemAtIndex_2 = List.GetItemAtIndex(list=all_elements_of_category, index=code_block_6)

# group: Solids with Negative Volume
code_block_7 = CodeBlock(a=python_script_2) { a[2]; }
getItemAtIndex_3 = List.GetItemAtIndex(list=code_block_3, index=code_block_7)

categories_2 = Categories()  # nothing selected
materials = Material()  # nothing selected
python_script_3 = Python(IN[0]=code_block_7)
# ---------- python_script_3.python (11 lines) ----------
# Load the Python Standard and DesignScript Libraries
import sys
import clr
clr.AddReference('ProtoGeometry')
from Autodesk.DesignScript.Geometry import *

# The inputs to this node will be stored as a list in the IN variables.
size=len(IN[0])
names=[]
for i in range(size):
	names.append("Solid "+i)
# ----------------------------------------
byGeometry = DirectShape.ByGeometry(geometry=getItemAtIndex_3, category=categories_2, material=materials, name=python_script_3)

# group: Elements with Negative Volume
code_block_8 = CodeBlock(a=python_script_2) { a[2]; }
getItemAtIndex_4 = List.GetItemAtIndex(list=getItemAtIndex, index=code_block_8)

code_block_9 = CodeBlock { "Mark"; }
solids_2 = Element.Solids(element=byGeometry)
volume_2 = Solid.Volume(solid=solids_2)
ʳʰʸᵗʰᵐ_elements_2 = Rhythm.Revit.Elements.Elements.SetParameterByNameTypeOrInstance(element=getItemAtIndex_4, parameterName=code_block_9, value=volume_2)
passthrough = Custom[Passthrough](passThrough=byGeometry, waitFor=ʳʰʸᵗʰᵐ_elements_2)  # package Clockwork for Dynamo 2.x; Forces a sequential order of execution. The node wired into the output of the Passthrough node will be executed *after* the node wired into the waitFor input (e.g. important for some Revit operations). The value of the passThrough input will be passed on to the node wired into the output port of the Passthrough node.
current = Document.Current()
delete_elements = Custom[Delete Elements](element=passthrough, document=current)  # frozen; package Genius Loci; Delete the input list of elements from the given Revit document. The node returns the number of successfully deleted elements and their Ids as a string. Based on a Springs node
