# Dynamo graph 2. Create New material.dyn "Create New material" (Dynamo 2.6.1.8786)
# packages: BumbleBee 2021.25.3, archi-lab.net 2021.25.2621

code_block = CodeBlock { "ALL_MODEL_MANUFACTURER"; "ALL_MODEL_MODEL"; "ALL_MODEL_URL"; "KEYNOTE_PARAM"; }
file_path = Filename("C:\Users\USER\SQOneDrive\OneDrive - 3-im SRL\Desktop\mat.xlsx")
boolean = BoolSelector(true)
code_block_2 = CodeBlock { "FamilyData"; true; "A2"; "P6"; }
read_excel = Custom[Read Excel](filePath=file_path, runIt=boolean, sheetName=code_block_2.out0, byColumn=code_block_2.out1, origin=code_block_2.out2, extent=code_block_2.out3)  # package BumbleBee; This node will read an excel file. You can read an entore sheet contents, read from specific origin cell, read only specific range, or do all of the former for multiple sheets at the same time.
code_block_3 = CodeBlock(IN=read_excel)
# ---------- code_block_3.designscript (13 lines) ----------
names= IN[0];
manufacturer= IN[1];
model=IN[2];
url=IN[3];
keynote=IN[4];
materialClass=IN[5];
surfacePattern=IN[6];
cutPattern=IN[7];
color=[IN[8],IN[9],IN[10]];
glossiness=IN[11];
reflectivity=IN[12];
transparency=IN[13];
highlights=IN[14];
# ----------------------------------------
create = archilab.Revit.Elements.Materials.Create(name=code_block_3.names)
code_block_4 = CodeBlock { true; }
useRenderAppearanceForShading = archilab.Revit.Elements.Materials.UseRenderAppearanceForShading(material=create, check=code_block_4)
createViaDuplicate = archilab.Revit.Elements.AppearanceAssets.CreateViaDuplicate(name=code_block_3.names)
code_block_5 = CodeBlock { 0; 1; 2; }
getItemAtIndex = List.GetItemAtIndex(list=code_block_3.color, index=code_block_5.out0)
getItemAtIndex_2 = List.GetItemAtIndex(list=code_block_3.color, index=code_block_5.out1)
getItemAtIndex_3 = List.GetItemAtIndex(list=code_block_3.color, index=code_block_5.out2)
byARGB = Color.ByARGB(r=getItemAtIndex, g=getItemAtIndex_2, b=getItemAtIndex_3)
code_block_6 = CodeBlock { 50; 0; }
isNull = Object.IsNull()  # unwired: obj
replaceByCondition = Replace(item=code_block_3.reflectivity, replaceWith=code_block_6.out1, condition=isNull)
code_block_7 = CodeBlock { "Metallic"; }
equals = List.Equals(objectA=code_block_3.highlights, objectB=code_block_7)
setGenericProperties = archilab.Revit.Elements.AppearanceAssets.SetGenericProperties(appearanceAsset=createViaDuplicate, color=byARGB, glossiness=replaceByCondition, metallic=equals)
replaceByCondition_2 = Replace(item=code_block_3.glossiness, replaceWith=code_block_6.out0, condition=isNull)
setReflectivityProperties = archilab.Revit.Elements.AppearanceAssets.SetReflectivityProperties(appearanceAsset=setGenericProperties, directReflectivity=replaceByCondition, obliqueReflectivity=replaceByCondition_2)
replaceByCondition_3 = Replace(item=code_block_3.transparency, replaceWith=code_block_6.out1, condition=isNull)
setTransparencyProperties = archilab.Revit.Elements.AppearanceAssets.SetTransparencyProperties(appearanceAsset=setReflectivityProperties, amount=replaceByCondition_3)
setAppearanceAsset = archilab.Revit.Elements.Materials.SetAppearanceAsset(material=useRenderAppearanceForShading, appearanceAsset=setTransparencyProperties)
set_builtin_parameter = Custom[Set BuiltIn Parameter](parameterName=code_block.out0, elements=setAppearanceAsset, parameterValues=code_block_3.manufacturer)  # package archi-lab.net; This node will take an input of a built in parameter name and set that parameter to given value for given elements.
set_builtin_parameter_2 = Custom[Set BuiltIn Parameter](parameterName=code_block.out3, elements=setAppearanceAsset, parameterValues=code_block_3.keynote)
set_builtin_parameter_3 = Custom[Set BuiltIn Parameter](parameterName=code_block.out2, elements=setAppearanceAsset, parameterValues=code_block_3.url)
set_builtin_parameter_4 = Custom[Set BuiltIn Parameter](parameterName=code_block.out1, elements=setAppearanceAsset, parameterValues=code_block_3.model)
code_block_8 = CodeBlock { "<none>"; }
isNull_2 = Object.IsNull()  # unwired: obj
replaceByCondition_4 = Replace(item=code_block_3.surfacePattern, replaceWith=code_block_8, condition=isNull_2)
exists = archilab.Revit.Elements.FillPatterns.Exists(name=replaceByCondition_4)
filterByBoolMask = List.FilterByBoolMask(list=setAppearanceAsset, mask=exists)
filterByBoolMask_2 = List.FilterByBoolMask(list=code_block_3.surfacePattern, mask=exists)
getByName = archilab.Revit.Elements.FillPatterns.GetByName(name=filterByBoolMask_2.in)
setSurfacePattern = archilab.Revit.Elements.Materials.SetSurfacePattern(material=filterByBoolMask.in, foregroundPattern=getByName)
setMaterialClass = archilab.Revit.Elements.Materials.SetMaterialClass(material=setAppearanceAsset, materialClass=code_block_3.materialClass)
code_block_9 = CodeBlock { "<none>"; }
isNull_3 = Object.IsNull()  # unwired: obj
replaceByCondition_5 = Replace(item=code_block_3.cutPattern, replaceWith=code_block_9, condition=isNull_3)
exists_2 = archilab.Revit.Elements.FillPatterns.Exists(name=replaceByCondition_5)
filterByBoolMask_3 = List.FilterByBoolMask(list=setAppearanceAsset, mask=exists_2)
filterByBoolMask_4 = List.FilterByBoolMask(list=code_block_3.surfacePattern, mask=exists_2)
getByName_2 = archilab.Revit.Elements.FillPatterns.GetByName(name=filterByBoolMask_4.in)
setCutPattern = archilab.Revit.Elements.Materials.SetCutPattern(material=filterByBoolMask_3.in, backgroundPattern=getByName_2)
