# Dynamo graph 3. Checking Duplicates in Material List.dyn "extracting original material" (Dynamo 2.6.1.8786)

# group: Sorting elements based on their names
categories = Categories("OST_Materials")
all_elements_of_category = ElementsOfCategory(Category=categories)
name = Element.Name(element=all_elements_of_category)
python_script = Python(IN[0]=name, IN[1]=all_elements_of_category)
# ---------- python_script.python (112 lines) ----------
import clr #This is .NET's Common Language Runtime. It's an execution environment
#that is able to execute code from several different languages.
import sys #sys is a fundamental Python library - here, we're using it to load in
#the standard IronPython libraries
sys.path.append('C:\Program Files (x86)\IronPython 2.7\Lib') #Imports the
#standard IronPython libraries, which cover everything from servers and
#encryption through to regular expressions.
import System #The System namespace at the root of .NET
from System import Array #.NET class for handling array information
from System.Collections.Generic import * #Lets you handle generics. Revit's API
#sometimes wants hard-typed 'generic' lists, called ILists. If you don't need
#these you can delete this line.
clr.AddReference('ProtoGeometry')  #A Dynamo library for its proxy geometry
#classes. You'll only need this if you're interacting with geometry.
from Autodesk.DesignScript.Geometry import * #Loads everything in Dynamo's
#geometry library
clr.AddReference("RevitNodes") #Dynamo's nodes for Revit
import Revit #Loads in the Revit namespace in RevitNodes
clr.ImportExtensions(Revit.Elements) #More loading of Dynamo's Revit libraries
clr.ImportExtensions(Revit.GeometryConversion) #More loading of Dynamo's
#Revit libraries. You'll only need this if you're interacting with geometry.
clr.AddReference("RevitServices") #Dynamo's classes for handling Revit documents
import RevitServices 
from RevitServices.Persistence import DocumentManager #An internal Dynamo class
#that keeps track of the document that Dynamo is currently attached to
from RevitServices.Transactions import TransactionManager #A Dynamo class for
#opening and closing transactions to change the Revit document's database

clr.AddReference("RevitAPI") #Adding reference to Revit's API DLLs
clr.AddReference("RevitAPIUI") #Adding reference to Revit's API DLLs

import Autodesk #Loads the Autodesk namespace
from Autodesk.Revit.DB import * #Loading Revit's API classes
from Autodesk.Revit.UI import * #Loading Revit's API UI classes  

doc = DocumentManager.Instance.CurrentDBDocument #Finally, setting up handles to the active Revit document
uiapp = DocumentManager.Instance.CurrentUIApplication #Setting a handle to the active Revit UI document
app = uiapp.Application  #Setting a handle to the currently-open instance of the Revit application
uidoc = uiapp.ActiveUIDocument #Setting a handle to the currently-open instance of the Revit UI application

#######OK NOW YOU CAN CODE########
import re

material_name=IN[0]
wrapped_material_elements=IN[1]

materials_original=[]
materials_copy=[]
material_elements=[]
for material in wrapped_material_elements:
	mat=UnwrapElement(material)
	material_elements.append(mat)
	

for name in material_name:
	name1=name.lower()
	if name1.find("copy")!=-1:
		materials_copy.append(name)
	elif name1.find("(1)")!=-1:
		materials_copy.append(name)
	elif name1.find("(2)")!=-1:
		materials_copy.append(name)
	elif name1.find("(3)")!=-1:
		materials_copy.append(name)
	elif name1.find("(4)")!=-1:
		materials_copy.append(name)
	elif name1.find("(5)")!=-1:
		materials_copy.append(name)
	elif name1.find("(6)")!=-1:
		materials_copy.append(name)
	elif name1.find("(7)")!=-1:
		materials_copy.append(name)
	elif name1.find("(8)")!=-1:
		materials_copy.append(name)
	elif name1.find("(9)")!=-1:
		materials_copy.append(name)
	else:
		materials_original.append(name)

materials_orig_name=[]

for i in materials_original:
	for j in materials_copy:
		if j.find(i)!=-1:
			materials_orig_name.append(i)

materials_orig_elem=[]
for elem in material_elements:
	elm=elem.Name
	if elm in materials_orig_name:
		materials_orig_elem.append(elem)
# original content


# duplicate content

materials_duplicate_name=[]
materials_duplicate_elements=[]
for element in material_elements:
	elm=element.Name	
	if elm in materials_copy:
		materials_duplicate_elements.append(element)
		materials_duplicate_name.append(elm)
TransactionManager.Instance.EnsureInTransaction(doc)

#for e in materials_duplicate_elements:
#	doc.Delete(e.Id)

TransactionManager.Instance.TransactionTaskDone()


OUT=materials_orig_name, materials_duplicate_name, materials_orig_elem, materials_duplicate_elements
# ----------------------------------------

code_block = CodeBlock(mat=python_script)
# ---------- code_block.designscript (4 lines) ----------
material_original_name=mat[0];
material_duplicate_name=mat[1];
material_original_elem=mat[2];
material_duplicate_elem=mat[3];
# ----------------------------------------

# group: Sorting elements based on their property
python_script_2 = Python(IN[0]=code_block.material_original_name, IN[1]=code_block.material_duplicate_name, IN[2]=code_block.material_original_elem, IN[3]=code_block.material_duplicate_elem)
# ---------- python_script_2.python (157 lines) ----------
import clr #This is .NET's Common Language Runtime. It's an execution environment
#that is able to execute code from several different languages.
import sys #sys is a fundamental Python library - here, we're using it to load in
#the standard IronPython libraries
sys.path.append('C:\Program Files (x86)\IronPython 2.7\Lib') #Imports the
#standard IronPython libraries, which cover everything from servers and
#encryption through to regular expressions.
import System #The System namespace at the root of .NET
from System import Array #.NET class for handling array information
from System.Collections.Generic import * #Lets you handle generics. Revit's API
#sometimes wants hard-typed 'generic' lists, called ILists. If you don't need
#these you can delete this line.
clr.AddReference('ProtoGeometry')  #A Dynamo library for its proxy geometry
#classes. You'll only need this if you're interacting with geometry.
from Autodesk.DesignScript.Geometry import * #Loads everything in Dynamo's
#geometry library
clr.AddReference("RevitNodes") #Dynamo's nodes for Revit
import Revit #Loads in the Revit namespace in RevitNodes
clr.ImportExtensions(Revit.Elements) #More loading of Dynamo's Revit libraries
clr.ImportExtensions(Revit.GeometryConversion) #More loading of Dynamo's
#Revit libraries. You'll only need this if you're interacting with geometry.
clr.AddReference("RevitServices") #Dynamo's classes for handling Revit documents
import RevitServices 
from RevitServices.Persistence import DocumentManager #An internal Dynamo class
#that keeps track of the document that Dynamo is currently attached to
from RevitServices.Transactions import TransactionManager #A Dynamo class for
#opening and closing transactions to change the Revit document's database

clr.AddReference("RevitAPI") #Adding reference to Revit's API DLLs
clr.AddReference("RevitAPIUI") #Adding reference to Revit's API DLLs

import Autodesk #Loads the Autodesk namespace
from Autodesk.Revit.DB import * #Loading Revit's API classes
from Autodesk.Revit.UI import * #Loading Revit's API UI classes


clr.AddReference('DSCoreNodes')
import DSCore
from DSCore import Color

doc = DocumentManager.Instance.CurrentDBDocument #Finally, setting up handles to the active Revit document
uiapp = DocumentManager.Instance.CurrentUIApplication #Setting a handle to the active Revit UI document
app = uiapp.Application  #Setting a handle to the currently-open instance of the Revit application
uidoc = uiapp.ActiveUIDocument #Setting a handle to the currently-open instance of the Revit UI application

#######OK NOW YOU CAN CODE########


material_original_elem=IN[2]
material_duplicate_elem=IN[3]

TransactionManager.Instance.EnsureInTransaction(doc)
duplicates=[]
new_type=[]

materials_orig=[]
materials_dup=[]

for material in material_original_elem:
	materials_orig.append(UnwrapElement(material))

for material in material_duplicate_elem:
	materials_dup.append(UnwrapElement(material))
	
colornameo,sforpatternlisto,sbacpatternlisto,cforpatternlisto,cbacpatternlisto,transparencylisto,rgbListo,rgbSurforListo,rgbSurbacListo,rgbCutforListo,rgbCutbacListo=[],[],[],[],[],[],[],[],[],[],[]
colornamed,sforpatternlistd,sbacpatternlistd,cforpatternlistd,cbacpatternlistd,transparencylistd,rgbListd,rgbSurforListd,rgbSurbacListd,rgbCutforListd,rgbCutbacListd=[],[],[],[],[],[],[],[],[],[],[]


mato=[]

for mateo in materials_orig:
	namo=mateo.Name
	for mated in materials_dup:
		namd=mated.Name
		if namd.find(namo)!=-1: 
			mato.append(mateo)
		
for materialo, materiald in zip(mato, materials_dup) :
	colornameo.append(materialo.Name)
	colornamed.append(materiald.Name)
	
	if materialo.Color.IsValid:
		color=materialo.Color
		rgbo = DSCore.Color.ByARGB(255, color.Red, color.Green, color.Blue)
	else:
		rgbo = None
	rgbListo.append(rgbo)	
	if materiald.Color.IsValid:
		color=materiald.Color
		rgbd = DSCore.Color.ByARGB(255, color.Red, color.Green, color.Blue)
	else:
		rgbd = None
	
	
	rgbListd.append(rgbd)
	
	transparencylisto.append(materialo.Transparency)
	transparencylistd.append(materiald.Transparency)	
	

################Originals##########################


	sforpatternlisto.append(doc.GetElement(materialo.SurfaceForegroundPatternId))
	surcoloro = materialo.SurfaceForegroundPatternColor
	rgbSfo = DSCore.Color.ByARGB(255, surcoloro.Red, surcoloro.Green, surcoloro.Blue)
	rgbSurforListo.Add(rgbSfo)

	sbacpatternlisto.append(doc.GetElement(materialo.SurfaceBackgroundPatternId))
	surbaccoloro=materialo.SurfaceBackgroundPatternColor
	rgbSbo = DSCore.Color.ByARGB(255, surbaccoloro.Red, surbaccoloro.Green, surbaccoloro.Blue)
	rgbSurbacListo.Add(rgbSbo)	

	cforpatternlisto.append(doc.GetElement(materialo.CutForegroundPatternId))
	cutcoloro=materialo.CutForegroundPatternColor
	rgbCfo = DSCore.Color.ByARGB(255, cutcoloro.Red, cutcoloro.Green, cutcoloro.Blue)
	rgbCutforListo.Add(rgbCfo)

	cbacpatternlisto.append(doc.GetElement(materialo.CutBackgroundPatternId))
	cutbaccoloro = materialo.CutBackgroundPatternColor
	rgbCbo = DSCore.Color.ByARGB(255, cutbaccoloro.Red, cutbaccoloro.Green, cutbaccoloro.Blue)
	rgbCutbacListo.Add(rgbCbo)
	
	########Duplicates#####################
	
	
	sforpatternlistd.append(doc.GetElement(materiald.SurfaceForegroundPatternId))
	surcolord = materiald.SurfaceForegroundPatternColor
	rgbSfd = DSCore.Color.ByARGB(255, surcolord.Red, surcolord.Green, surcolord.Blue)
	rgbSurforListd.Add(rgbSfd)

	sbacpatternlistd.append(doc.GetElement(materiald.SurfaceBackgroundPatternId))
	surbaccolord=materiald.SurfaceBackgroundPatternColor
	rgbSbd = DSCore.Color.ByARGB(255, surbaccolord.Red, surbaccolord.Green, surbaccolord.Blue)
	rgbSurbacListd.Add(rgbSbd)	

	cforpatternlistd.append(doc.GetElement(materiald.CutForegroundPatternId))
	cutcolord=materiald.CutForegroundPatternColor
	rgbCfd = DSCore.Color.ByARGB(255, cutcolord.Red, cutcolord.Green, cutcolord.Blue)
	rgbCutforListd.Add(rgbCfd)

	cbacpatternlistd.append(doc.GetElement(materiald.CutBackgroundPatternId))
	cutbaccolord = materiald.CutBackgroundPatternColor
	rgbCbd = DSCore.Color.ByARGB(255, cutbaccolord.Red, cutbaccolord.Green, cutbaccolord.Blue)
	rgbCutbacListd.Add(rgbCbd)
	

	if  rgbListo==rgbListd and sforpatternlisto==sforpatternlistd and rgbSurforListo==rgbSurforListd and sbackpatternlisto==sbackpatternlistd and rgbSurbacListo==rgbSurbacListd and cforpatternlisto==cforpatternlistd and rgbCutforListo==rgbCutforListd and cbacpatternlisto==cbacpatternlistd and rgbCutbacListo==rgbCutbacListd and transparencylisto==transaparencylist:
		duplicates.append(materiald)
	else:
		new_type.append(materiald)

for e in duplicates:
	doc.Delete(e.Id)


OUT = duplicates, new_type,sforpatternlisto, sforpatternlistd,sbacpatternlisto,sbacpatternlistd, cforpatternlisto,cforpatternlistd, cbacpatternlisto, cbacpatternlistd, transparencylisto, transparencylistd, rgbListo, rgbListd, rgbSurforListo, rgbSurforListd, rgbSurbacListo, rgbSurbacListd, rgbCutforListo,rgbCutforListd, rgbCutbacListo, rgbCutbacListd
# ----------------------------------------

watch = Watch(python_script_2)
