# Dynamo graph 1. Importing ViewTemplates without loosing filter data.dyn "21-5-2021 Importing ViewTemplates without loosing filter data" (Dynamo 2.6.1.8786)
# packages: Clockwork for Dynamo 2.x 2.3.0, Orchid 206.3.0.7800, Data-Shapes 2021.2.94, Rhythm 2021.4.2, archi-lab.net 2021.25.2621

# group: File with template to import
file_path = Filename("..\..\223_C_B2_ARC_INT.rvt")

ʳʰʸᵗʰᵐ_applications = Rhythm.Revit.Application.Applications.OpenDocumentFile(filePath=file_path)
code_block = CodeBlock(SourceDocument=ʳʰʸᵗʰᵐ_applications) { SourceDocument; }
code_block_2 = CodeBlock { "Copy Selected View Templates"; }

# group: Filter and Sort View Templates
element_types = ElementTypes("View")

# group: Suffix for current Filters
suffix_for_old_filters = StringInput("_old")

# group: Changing Template Filter
code_block_3 = CodeBlock { "Changing Filter Name"; }
code_block_4 = CodeBlock { "Run"; "true"; "Cancel"; 400; }
code_block_5 = CodeBlock { "Select Filter"; }
boolean = BoolSelector(false)
all = Orchid.RevitProject.Filters.ParameterFilter.All(condense=boolean)
name = Custom[Element.Name+](element=all)  # package Clockwork for Dynamo 2.x; Gets an element's name. Unlike the OOTB node, this node should work for all Revit elements that have names and will also return the localized names of system parameters, parameter groups, display unit types, parameter types, unit symbol types and unit types.
listview_data = Custom[Listview Data](InputName=code_block_5, Keys=name, Values=all)  # package Data-Shapes; Create data for ListView input in UI.MultiInputForm ++ . Check out www.data-shapes.net for more infos.
multipleinputform = Custom[MultipleInputForm ++](Description_optional=code_block_3, ButtonText_optional=code_block_4.out0, Inputs=listview_data, Toggle=code_block_4.out1, CancelButtonText_optional=code_block_4.out2, Width_optional=code_block_4.out3)  # package Data-Shapes; Create a form with multiple inputs. see www.data-shapes.net for tutorials and infos!
code_block_6 = CodeBlock(a=multipleinputform.User_Inputs) { a[0]; }
python_script = Python(IN[0]=code_block_6, IN[1]=suffix_for_old_filters)
# ---------- python_script.python (112 lines) ----------
import clr #This is .NET's Common Language Runtime. It's an execution environment
#that is able to execute code from several different languages.
import sys #sys is a fundamental Python library - here, we're using it to load in
#the standard IronPython libraries
sys.path.append('C:\Program Files (x86)\IronPython 2.7\Lib') #Imports the
#standard IronPython libraries, which cover everything from servers and
#encryption through to regular expressions.
import System #The System namespace at the root of .NET
from System import Array #.NET class for handling array information
from System.Collections.Generic import * #Lets you handle generics. Revit's API
#sometimes wants hard-typed 'generic' lists, called ILists. If you don't need
#these you can delete this line.
clr.AddReference('ProtoGeometry')  #A Dynamo library for its proxy geometry
#classes. You'll only need this if you're interacting with geometry.
from Autodesk.DesignScript.Geometry import * #Loads everything in Dynamo's
#geometry library
clr.AddReference("RevitNodes") #Dynamo's nodes for Revit
import Revit #Loads in the Revit namespace in RevitNodes
clr.ImportExtensions(Revit.Elements) #More loading of Dynamo's Revit libraries
clr.ImportExtensions(Revit.GeometryConversion) #More loading of Dynamo's
#Revit libraries. You'll only need this if you're interacting with geometry.
clr.AddReference("RevitServices") #Dynamo's classes for handling Revit documents
import RevitServices 
from RevitServices.Persistence import DocumentManager #An internal Dynamo class
#that keeps track of the document that Dynamo is currently attached to
from RevitServices.Transactions import TransactionManager #A Dynamo class for
#opening and closing transactions to change the Revit document's database

clr.AddReference("RevitAPI") #Adding reference to Revit's API DLLs
clr.AddReference("RevitAPIUI") #Adding reference to Revit's API DLLs

import Autodesk #Loads the Autodesk namespace
from Autodesk.Revit.DB import * #Loading Revit's API classes
from Autodesk.Revit.UI import * #Loading Revit's API UI classes  

doc = DocumentManager.Instance.CurrentDBDocument #Finally, setting up handles to the active Revit document
uiapp = DocumentManager.Instance.CurrentUIApplication #Setting a handle to the active Revit UI document
app = uiapp.Application  #Setting a handle to the currently-open instance of the Revit application
uidoc = uiapp.ActiveUIDocument #Setting a handle to the currently-open instance of the Revit UI application


############ Getting Filter Name definition


def GetName(item):
	unwrapped=UnwrapElement(item)
	if unwrapped.GetType().ToString() in ("Autodesk.Revit.DB.ParameterFilterElement"): 
		return unwrapped.Name
 
	
def SetElementName(item, name):
	if item.GetType().ToString() == "Autodesk.Revit.DB.FamilyParameter":
		try: 
			doc.FamilyManager.RenameParameter(item, name)
			return True
		except: return False
	elif item.GetType().ToString() =="Autodesk.Revit.DB.Workset":
		try: 
			doc.GetWorksetTable().RenameWorkset(doc, item.Id, name)
			return True
		except: return False
	elif item.GetType().ToString() == "Archilab.Grimshaw.Elements.Workset":
		try: 
			doc.GetWorksetTable().RenameWorkset(doc, WorksetId(item.Id), name)
			return True
		except: return False
	else:
		try: 
			item.Name = name
			return True
		except: return False
		
############# Inputs


current_temp= [UnwrapElement(i) for i in IN[0]]
suffix=IN[1]
############# Main Code


current_temp_new=[]
current_name=[]
new_name=[]


############## Getting names + adding "_new" suffix


for curr in current_temp:
	c_name=GetName(curr)
	current_name.append(c_name+suffix)
	
	
############### Setting new name


TransactionManager.Instance.EnsureInTransaction(doc)
if isinstance(current_temp, list):
	if isinstance(current_name, list): 
		new_name=[SetElementName(x, y) for x, y in zip(current_temp, current_name)]
	else: 
		new_name=[SetElementName(x, current_name) for x in current_temp]
else:
	if isinstance(current_name, list):
		new_name=SetElementName(current_temp, current_name)
	else: 
		new_name=SetElementName(current_temp, current_name)
TransactionManager.Instance.TransactionTaskDone()


OUT = current_name, new_name, current_temp
	
# ----------------------------------------

passthrough = Custom[Passthrough](passThrough=element_types, waitFor=python_script)  # package Clockwork for Dynamo 2.x; Forces a sequential order of execution. The node wired into the output of the Passthrough node will be executed *after* the node wired into the waitFor input (e.g. important for some Revit operations). The value of the passThrough input will be passed on to the node wired into the output port of the Passthrough node.

# group (continued): Filter and Sort View Templates
ʳʰʸᵗʰᵐ_collector = Rhythm.Revit.Selection.Collector.ElementsOfTypeInDocument(document=ʳʰʸᵗʰᵐ_applications, elementType=passthrough)
isViewTemplate = Custom[View.IsViewTemplate+](view=ʳʰʸᵗʰᵐ_collector)  # package Clockwork for Dynamo 2.x; Checks if a given view is a view template. Unlike the OOTB node it works for all view types.
filterByBoolMask = List.FilterByBoolMask(list=ʳʰʸᵗʰᵐ_collector, mask=isViewTemplate)
name_2 = Custom[Element.Name+](element=filterByBoolMask.in)
sortByKey = List.SortByKey(list=filterByBoolMask.in, keys=name_2)

listview_data_2 = Custom[Listview Data](Keys=sortByKey.sorted_keys, Values=sortByKey.sorted_list)
boolean_2 = BoolSelector(true)
multipleinputform_2 = Custom[MultipleInputForm ++](ButtonText_optional=code_block_2, Inputs=listview_data_2, Toggle=boolean_2)
code_block_7 = CodeBlock { 0; }
getItemAtIndex = List.GetItemAtIndex(list=multipleinputform_2.User_Inputs, index=code_block_7)
ʳʰʸᵗʰᵐ_documents = Rhythm.Revit.Application.Documents.CopyElementsFromDocument(sourceDocument=code_block, elements=getItemAtIndex)
passthrough_2 = Custom[Passthrough](passThrough=code_block, waitFor=ʳʰʸᵗʰᵐ_documents)
code_block_8 = CodeBlock { false; }
ʳʰʸᵗʰᵐ_applications_2 = Rhythm.Revit.Application.Applications.CloseDocument(document=passthrough_2, save=code_block_8)
duplicate = archilab.Revit.Views.ViewTemplates.Duplicate(viewTemplate=getItemAtIndex)  # unwired: name
