# Dynamo graph 2. Deleting View Template Filters.dyn "21-5-2021 Deleting View Template Filters" (Dynamo 2.6.1.8786)
# packages: Clockwork for Dynamo 2.x 2.3.0, Orchid 206.3.0.7800, Data-Shapes 2021.2.94, Modelical 2.2.19

# group: Delete Template Filter
code_block = CodeBlock { "Delete Filter Name"; }
code_block_2 = CodeBlock { "Run"; "true"; "Cancel"; 400; }
code_block_3 = CodeBlock { "Select Filter"; }
boolean = BoolSelector(false)
all = Orchid.RevitProject.Filters.ParameterFilter.All(condense=boolean)
name = Custom[Element.Name+](element=all)  # package Clockwork for Dynamo 2.x; Gets an element's name. Unlike the OOTB node, this node should work for all Revit elements that have names and will also return the localized names of system parameters, parameter groups, display unit types, parameter types, unit symbol types and unit types.
listview_data = Custom[Listview Data](InputName=code_block_3, Keys=name, Values=all)  # package Data-Shapes; Create data for ListView input in UI.MultiInputForm ++ . Check out www.data-shapes.net for more infos.
multipleinputform = Custom[MultipleInputForm ++](Description_optional=code_block, ButtonText_optional=code_block_2.out0, Inputs=listview_data, Toggle=code_block_2.out1, CancelButtonText_optional=code_block_2.out2, Width_optional=code_block_2.out3)  # package Data-Shapes; Create a form with multiple inputs. see www.data-shapes.net for tutorials and infos!
code_block_4 = CodeBlock(a=multipleinputform.User_Inputs) { a[0]; }
deleteElements = Custom[DeleteElements](elemOrId=code_block_4)  # package Modelical; Delete Revit elements by element or by ID
