# Dynamo graph Rounding.dyn (Dynamo 2.5.0.7460)

code_block = CodeBlock { [1.11,2.11,3.5,4,5,7.9]; }
rounds_them_off = Python(IN[0]=code_block)
# ---------- rounds_them_off.python (10 lines) ----------
# Load the Python Standard and DesignScript Libraries
import sys
import clr
clr.AddReference('ProtoGeometry')
from Autodesk.DesignScript.Geometry import *

# The inputs to this node will be stored as a list in the IN variables.
numbers=list(map(round,IN[0]))

OUT=numbers
# ----------------------------------------
code_block_2 = CodeBlock { [1.11,2.11,3.5,4,5,7.9]; }
takes_the_integer = Python(IN[0]=code_block_2)
# ---------- takes_the_integer.python (10 lines) ----------
# Load the Python Standard and DesignScript Libraries
import sys
import clr
clr.AddReference('ProtoGeometry')
from Autodesk.DesignScript.Geometry import *

# The inputs to this node will be stored as a list in the IN variables.
numbers=list(map(int,IN[0]))

OUT=numbers
# ----------------------------------------
