# Dynamo graph Spliting Decimals.dyn (Dynamo 2.5.0.7460)

code_block = CodeBlock { ["1.000000","2.2222222", "3.3333333", "4.444444"]; }
python_script = Python(IN[0]=code_block)
# ---------- python_script.python (15 lines) ----------
# Load the Python Standard and DesignScript Libraries
import sys
import clr
clr.AddReference('ProtoGeometry')
from Autodesk.DesignScript.Geometry import *

# The inputs to this node will be stored as a list in the IN variables.
strings=IN[0]

final=[]

for i in strings:
	x=i.split(".")[0]
	final.append(x)
OUT=final
# ----------------------------------------
